# Grasshopper definition 20220111_print_execute.ghx (Grasshopper 1.0.7)
# plug-ins: Pufferfish

panel = Panel("70*150*100 = L*W*H")
# Proposed solution to intact:
# - reduce the last distance to the poop and
# the previous contour.
# l
panel_2 = Panel("C:\Users\ahmed\OneDrive - Politecnico di Milano\ETH Zurich\MAS Dfab\T2_Rammed Earth\T2_Rammed_Earth_G3\Ahmed\designbozza2.py")
# Fixed directions that are hardcoded in the
# code and the geometry are directly adjusted
#  based on them
# (even if x_dir and y_dir are changed)
panel_3 = Panel("5 layers")
crv = Curve(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)
read_file = ReadFile(File=panel_2, PerLineParse=False)
x_div = Slider(7, range=1..20)
x_div_2 = Slider(3.75, range=0..20)
graph = GraphMapper(x0=0, x1=1, y0=0, y1=1, Cx=0.5909423828, Cy=0.159721911, container_name="Conic")
pt = Point(Point(166.2884953, 146.5080274, 0))
pt_2 = Point(Point(307.3804476, 148.6418372, 0))
X = UnitX(Factor=1)
crv_2 = Curve(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)
Y = UnitY(Factor=1)
ghpython_script = GhPythonScript(
    Code=read_file,
    Curve=crv_2,
    X_dir=X,
    Y_dir=Y,
    Ref_point_st=pt,
    Ref_point_end=pt_2,
    X_spacing=x_div,
    Threshold_dist=x_div_2,
    Type1Dist=Slider(16, range=15..28),
    Perp_dist_thresh=Slider(4, range=3..7),
    Thresh_case1_end=Slider(4, range=0..10),
    Thresh_case2_end=Slider(10, range=0..15),
    Step_y_expand=Slider(1, range=0..5))  # -> Out, Contour_pts, Main_paths, Up_factors, Sec_paths, Crv_pt_st, EndSideContourPairs, StSideContourPairs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
knob = ControlKnob(Decimals=0, Limit=True, Maximum=10, Minimum=0, Range=10, Value=0)
knob_2 = ControlKnob(Decimals=0, Limit=True, Maximum=50, Minimum=0, Range=10, Value=0)
number_slider = Slider(0, range=0..4)
data = Data(ghpython_script.Contour_pts)
data_2 = Data(ghpython_script.EndSideContourPairs)
data_3 = Data(ghpython_script.StSideContourPairs)
data_4 = Data(ghpython_script.Contour_pts_st)
data_5 = Data(ghpython_script.All_points)
python = GhPythonScript(x=ghpython_script.All_points)  # -> out, a
# ---------- python: Python ----------
a = x
# ---------- end python ----------
panel_4 = Panel(ghpython_script.Out)
knob_3 = ControlKnob(Decimals=0, Limit=True, Maximum=10, Minimum=0, Range=10, Value=5)
item = ListItem(List=data_3, Index=knob, Wrap=True)
branch = TreeBranch(Tree=simplify(ghpython_script.All_fab_points), Path="{0}", MaintainPaths=False)
python_2 = GhPythonScript(x=python.a)  # -> out, simplify(a); same code as python
item_2 = ListItem(List=data_4, Index=knob, Wrap=True)
panel_5 = Panel("""{0}
{1}""")
panel_6 = Panel("""{2}
{3}""")
panel_7 = Panel("""{4}
{5}""")
panel_8 = Panel("""{6}
{7}""")
panel_9 = Panel("""{8}
{9}""")
panel_10 = Panel("""{12}
{13}""")
panel_11 = Panel("""{10}
{11}""")
item_3 = ListItem(List=branch, Index=knob_2, Wrap=True)
pt_3 = Point(<point referenced from the Rhino model>)
geo = Geometry(<brep referenced from the Rhino model>)
panel_12 = Panel(branch)
path_mapper = PathMapper(python_2.a, source="{A;B}", target="{A}")
p_n_c = PickNChoose(
    Pattern=knob_3,
    Stream0=graft(panel_5),
    Stream1=graft(panel_6),
    Stream2=graft(panel_7),
    Stream3=graft(panel_8),
    Stream4=graft(panel_9),
    Stream5=graft(panel_11),
    Stream6=graft(panel_10))
move2pt = MoveToPoint(Geometry=geo, PointA=pt_3, PointB=item_3)  # -> Moved, Vector, Transform
data_6 = Data(path_mapper)
panel_13 = Panel("""0
1""")
branch_2 = TreeBranch(MaintainPaths=True)
move2pt_2 = MoveToPoint(Geometry=geo, PointA=pt_3, PointB=path_mapper)  # -> Moved, Vector, Transform
combine = CombineData()  # -> Result, Index
merge = Merge()
branch_3 = TreeBranch(Tree=path_mapper, Path=p_n_c, MaintainPaths=True)
panel_14 = Panel(python_2.a)
dispatch = Dispatch(List=panel_13, DispatchPattern=path_mapper)  # -> ListA, ListB
number_slider_2 = Slider(50, range=40..2000)
number_slider_3 = Slider(7.5, range=0..100)
number_slider_4 = Slider(3.5, range=0..100)

# ----
# Load classes from src
button = Button()
add_paths_from_local_dir = GhPythonScript(reload=button)  # -> dire
# ---------- add_paths_from_local_dir: Python ----------
import os
import sys

#get current file path
path = ghenv.Component.OnPingDocument().FilePath
#get parent directory of the parent directory
parentdir = os.path.dirname(os.path.dirname(path))
#go to root folder
root = os.path.dirname(parentdir)
#get src folder which contains classes
dire = os.path.join(root,'src')

print dire
#add path to sys
sys.path.append(dire)

ghenv.Component.Message = "paths added"

from compas_rhino import unload_modules

if reload:
    unload_modules("design")
    unload_modules("planning")
    
    unload_modules("ur_fabrication")
    
    ghenv.Component.Message = "paths updated"
# ---------- end add_paths_from_local_dir ----------
panel_15 = Panel(add_paths_from_local_dir)

crv_3 = Curve(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)
generate_design_from_crv = GhPythonScript(
    input_crv=crv_3,
    h_spacing=number_slider_3,
    v_spacing=number_slider_4,
    height=number_slider_2,
    prototype_name="straightWall",
    extra_text="Demo")  # -> points, global_design; inputs input_crv: Curve
# ---------- generate_design_from_crv: Python ----------
from design import GlobalDesign
from ghpythonlib.treehelpers import list_to_tree as _tree


prototype_identifier = prototype_name + "_" +  extra_text

global_design= GlobalDesign.design_from_curve(input_crv, h_spacing, height, v_spacing, prototype_identifier)

#generate uid
global_design.generate_uid_for_all_parts()
points = global_design.visualize()

#Convert to tree to visualize
points = _tree(points)
# ---------- end generate_design_from_crv ----------
crv_4 = Curve([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])
generate_design_from_crv_2 = GhPythonScript(
    input_crv=crv_3,
    h_spacing=number_slider_3,
    v_spacing=number_slider_4,
    height=number_slider_2,
    prototype_name="straightWall",
    extra_text="Demo")  # -> points, global_design; inputs input_crv: Curve; same code as generate_design_from_crv
plan_sequence = GhPythonScript(design=generate_design_from_crv.global_design, toolpath_volume=Slider(900, range=0..1000), n=Slider(0, range=0..15))  # -> sequencer, points, tool_curve, data; inputs toolpath_volume: Int32, n: Int32
# ---------- plan_sequence: Python ----------
from planning import ConstructionSequencer


sequencer = ConstructionSequencer(design, toolpath_volume)
sequencer.generate_toolpaths_continuous()

toolpath = sequencer.toolpaths[n]
toolpath.add_safety_points(setup = "UR")


points, tool_curve = toolpath.visualize_pts()
data = [toolpath.export_toolpath_to_UR(wait_time = 1.2)]
# ---------- end plan_sequence ----------
parse_data = GhPythonScript(data=plan_sequence.data)  # -> planes, toggles, wait_times
# ---------- parse_data: Python ----------
planes = data['planes']
toggles = data['toggles']
wait_times = data['wait times']
# ---------- end parse_data ----------
send_to_robot = GhPythonScript(
    planes=flatten(parse_data.planes),
    toggles=flatten(parse_data.toggles),
    waits=flatten(parse_data.wait_times),
    lift_height=Slider(18, range=0..100),
    send=Button())  # -> ur10, robot_planes, script; inputs planes: list of Plane, toggles: list of Boolean, waits: list
# ---------- send_to_robot: Python ----------
import os
import sys
import Rhino.Geometry as rg

from math import radians

from ur_fabrication import UR

ur10 = UR(planes,toggles,waits, ip = "192.168.10.20")

ur10.tcp(-86.62,-28.48,147.92,0.0,180.0, 0.0)

origin = rg.Point3d(-293.81, -673.70, 11.50) #Origin
xaxis = rg.Point3d(247.93, -677.69, 10.70) #XAxis Point
yaxis = rg.Point3d(62.22, -430.51, 7.78) #Point on +XY Plane
ur10.set_base_plane(origin, xaxis, yaxis)

ur10.prepare_script(lift_height = lift_height + 1.5)

robot_planes = ur10.robot_frames
script = ur10.script
if send:
   ur10.trigger()
# ---------- end send_to_robot ----------
panel_16 = Panel(send_to_robot.script)
