# Grasshopper definition 20230126_Grasshopper_file.gh (Grasshopper 1.0.7)
# plug-ins: Pufferfish

number_slider = Slider(15, range=0..100)
# Line Grid
panel = Panel("70*150*100 = L*W*H")
pt = ConstructPoint(XCoordinate=0, YCoordinate=0, ZCoordinate=0)
number_slider_2 = Slider(7, range=0..100)

shit = Geometry(<brep referenced from the Rhino model>)
shit_cp = Point(<point referenced from the Rhino model>)

Y = UnitY(Factor=1)
division = Division(A=number_slider, B=2)
panel_2 = Panel("5 layers")
move = Move(Motion=Vector(0, 0, 10))  # -> Geometry, Transform
series = Series(Start=0, Step=number_slider_2, Count=Slider(9, range=1..20))
line = LineSDL(Start=pt, Direction=Y, Length=Slider(41, range=10..100))
X = UnitX(Factor=series)
move_2 = Move(Geometry=line, Motion=X)  # -> Geometry, Transform
curvepoint = PointOnCurve(move_2.Geometry, parameter=0.5)
item = ListItem(List=curvepoint, Index=0, Wrap=True)
vec2pt = Vector2Pt(PointA=item, PointB=Point(0, 0, 0), Unitize=False)  # -> Vector, Length
# type1
move_3 = Move(Geometry=move_2.Geometry, Motion=vec2pt.Vector)  # -> Geometry, Transform
number_slider_3 = Slider(4, range=0..10)
addition = Addition(A=number_slider_3, B=Slider(1, range=0..1))
expression = Expression(x=number_slider_2, Expression="-x/2")
split = SplitList(List=move_3.Geometry, Index=number_slider_3)  # -> ListA, ListB

subtraction = Subtraction(A=number_slider_3, B=1)
range = Range(Domain=Domain(0, 1), Steps=subtraction)
graph = GraphMapper(range, x0=0, x1=1, y0=0.5, y1=1, Cx=0.2780204415, Cy=0.4379223585, container_name="Conic")
eval = EvaluateCurve(Curve=reparameterize(reverse(split.ListA)), Parameter=graph)  # -> Point, Tangent, Angle
move2pt = MoveToPoint(Geometry=shit, PointA=shit_cp, PointB=eval.Point)  # -> Moved, Vector, Transform
mirror = Mirror(Geometry=move2pt.Moved, Plane=PlaneYZ(0, 0, 0))  # -> Geometry, Transform
cull_i = CullIndex(List=mirror.Geometry, Indices=-1, Wrap=True)
merge = Merge(Data1=move2pt.Moved, Data2=reverse(cull_i))  # -> flatten(Result)
xz = XZPlane(Origin=Point(0, 0, 0))
mirror_2 = Mirror(Geometry=merge, Plane=xz)  # -> Geometry, Transform
cull_i_2 = CullIndex(List=mirror_2.Geometry, Indices=[-1, 0], Wrap=True)

split_2 = SplitList(List=move_3.Geometry, Index=addition)  # -> ListA, ListB
X_2 = UnitX(Factor=expression)
move_4 = Move(Geometry=split_2.ListA, Motion=X_2)  # -> Geometry, Transform
cull_i_3 = CullIndex(List=move_4.Geometry, Indices=0, Wrap=True)
dom = ConstructDomain(DomainStart=Slider(18, range=0..100), DomainEnd=Slider(23, range=0..150))
split_3 = SplitList(List=reverse(cull_i_3), Index=Slider(2, range=0..10))  # -> ListA, ListB
lng = ListLength(List=split_3.ListB)
subtraction_2 = Subtraction(A=lng, B=1)
range_2 = Range(Domain=Domain(0, 1), Steps=subtraction_2)
graph_2 = GraphMapper(range_2, x0=0, x1=1, y0=0, y1=1, Cx=0.2727298439, Cy=0.5630311966, container_name="Conic")
remap = RemapNumbers(Value=graph_2, Source=Domain(0, 1), Target=dom)  # -> Mapped, Clipped
curvepoint_2 = PointOnCurve(split_3.ListB, parameter=0.5)
Y_2 = UnitY(Factor=remap.Mapped)
item_2 = ListItem(List=split_3.ListA, Index=0, Wrap=True)  # -> Item, Item1
curvepoint_3 = PointOnCurve(item_2.Item1, parameter=0.5)
curvepoint_4 = PointOnCurve(item_2.Item, parameter=0.5)
move_5 = Move(Geometry=curvepoint_2, Motion=Y_2)  # -> Geometry, Transform
Y_3 = UnitY(Factor=number_slider)
move_6 = Move(Geometry=curvepoint_3, Motion=Y_3)  # -> Geometry, Transform
move2pt_2 = MoveToPoint(Geometry=shit, PointA=shit_cp, PointB=curvepoint_3)  # -> Moved, Vector, Transform
move2pt_3 = MoveToPoint(Geometry=shit, PointA=shit_cp, PointB=move_5.Geometry)  # -> Moved, Vector, Transform
move2pt_4 = MoveToPoint(Geometry=shit, PointA=shit_cp, PointB=move_6.Geometry)  # -> Moved, Vector, Transform
move2pt_5 = MoveToPoint(Geometry=shit, PointA=shit_cp, PointB=curvepoint_4)  # -> Moved, Vector, Transform
merge_2 = Merge(Data1=move2pt_4.Moved, Data2=move2pt_3.Moved)  # -> flatten(Result)
mirror_3 = Mirror(Geometry=merge_2, Plane=xz)  # -> Geometry, Transform
merge_3 = Merge(Data1=merge, Data2=cull_i_2)  # -> simplify(flatten(Result))
merge_4 = Merge(Data1=move2pt_5.Moved, Data2=merge_2, Data3=mirror_3.Geometry, Data4=move2pt_2.Moved)  # -> flatten(Result)
number_slider_4 = Slider(5, range=0..100)
mirror_4 = Mirror(Geometry=merge_4, Plane=PlaneYZ(0, 0, 0))  # -> Geometry, Transform
series_2 = Series(Start=0, Step=number_slider_4, Count=Slider(2, range=1..20))
merge_5 = Merge(Data1=merge_4, Data2=mirror_4.Geometry)  # -> simplify(flatten(Result))
Z = UnitZ(Factor=number_slider_4)
move_7 = Move(Geometry=merge_3, Motion=Z)  # -> Geometry, Transform
