# Grasshopper definition 20230205_design_by_material_v2.gh (Grasshopper 1.0.7)
# plug-ins: Pufferfish

layer_height = Slider(5, range=0..10)
height_column = Slider(1.8, range=1..2)

height_column_2 = Slider(0.25, range=0.2..2)
span_left_side = Slider(0.17, range=0..2)
span_right_side = Slider(1.03, range=1..2)
# Fixed directions that are hardcoded in the
# code and the geometry are directly adjusted
#  based on them
# (even if x_dir and y_dir are changed)
panel = Panel("C:\Users\ahmed\OneDrive - Politecnico di Milano\ETH Zurich\MAS Dfab\T2_Rammed Earth\T2_Rammed_Earth_G3\Ahmed\designbozza3.py")
Y = UnitY(Factor=1)
X = UnitX(Factor=1)
crv = Curve(<curve referenced from the Rhino model>)
x_div = Slider(7, range=1..20)
x_div_2 = Slider(3.75, range=0..20)
number_slider = Slider(16, range=15..28)
layer_height_2 = Slider(8, range=0..10)
layer_height_3 = Slider(5, range=0..10)
layer_height_4 = Slider(8, range=0..10)
crv_2 = Curve(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)
crv_3 = Curve(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)
length = Slider(7, range=0..10)
pt = Point(Point(166.2884953, 146.5080274, 0))
pt_2 = Point(Point(307.3804476, 148.6418372, 0))
read_file = ReadFile(File=panel, PerLineParse=False)
data = Data([1, 2, 3, 4, 5, 6, 7, 8, 9, 10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])
points = Data(Tree({0;0}: [Point(242.9583429, 172.7020066, 0), Point(235.9583429, 174.0064636, 0), Point(228.9583429, 174.6929276, 0), Point(221.9583429, 173.467636, 0), Point(214.9583429, 169.467636, 0), Point(207.9583429, 165.867636, 0)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], {0;1}: [Point(239.4583429, 173.7020066, -5), Point(232.4583429, 175.0064636, -5), Point(225.4583429, 175.6929276, -5), Point(218.4583429, 174.467636, -5), Point(211.4583429, 170.467636, -5), Point(204.4583429, 166.867636, -5)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], {0;2}: [Point(242.9583429, 173.7020066, -10), Point(235.9583429, 173.7020066, -10), Point(228.9583429, 175.0064636, -10), Point(221.9583429, 175.6929276, -10), Point(214.9583429, 174.467636, -10), Point(207.9583429, 170.467636, -10)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], {0;3}: [Point(239.4583429, 174.7020066, -15), Point(232.4583429, 174.7020066, -15), Point(225.4583429, 176.0064636, -15), Point(218.4583429, 176.6929276, -15), Point(211.4583429, 175.467636, -15), Point(204.4583429, 171.467636, -15)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], {0;4}: [Point(242.9583429, 175.513482, -20), Point(235.9583429, 175.513482, -20), Point(228.9583429, 175.513482, -20), Point(221.9583429, 176.817939, -20), Point(214.9583429, 177.504403, -20), Point(207.9583429, 176.2791114, -20)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], {0;5}: [Point(239.4583429, 175.513482, -25), Point(232.4583429, 175.513482, -25), Point(225.4583429, 175.513482, -25), Point(218.4583429, 176.817939, -25), Point(211.4583429, 177.504403, -25), Point(204.4583429, 176.2791114, -25)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]))
division = Division(A=height_column, B=100)
Z = UnitZ(Factor=division)
python = GhPythonScript(name="dict2_key1")  # -> out, sticky_dicts
# ---------- python: Python ----------
import scriptcontext as sc

# define the number of sticky dictionaries to create
num_dictionaries = 5

# define the number of keys in each sticky dictionary
num_keys = 3

sticky_dicts = []

for i in range(num_dictionaries):
    for j in range(num_keys):
        sc.sticky["n_{0},pos_{1}".format(i,j)] = 0
        sticky_dicts.append(sc.sticky["n_{0},pos_{1}".format(i,j)])
    print(0)
        

# create a list of lists of sticky dictionaries
#sticky_dicts = [sc.sticky["n_{0},pos_{1}"].format(i,j)  for i in range(num_dictionaries) for j in range(num_keys)]

# initialize all values in the sticky dictionaries to zero
#for i in range(num_dictionaries):
#    for j in range(num_keys):
#        sticky_dicts[i][j]['value'] = 0

# define a function to update the sticky variable based on user input
def update_sticky(name, value):
    for i in range(num_dictionaries):
        for j in range(num_keys):
            if name == "n_{0},pos_{1}".format(i, j):
                sticky_dicts["n_{0},pos_{1}".format(i, j)] += value

# example usage
update_sticky("n_{0},pos_{1}".format(1, 2), 3)
# ---------- end python ----------

# ---- group: Left Cantilever
span_left_side_2 = Slider(1.44, range=1..2)
multiplication = Multiplication(A=height_column, B="100")
division_2 = Division(A=multiplication, B=layer_height)
range = Range(Domain=Domain(0, 1), Steps=division_2)
domain = Domain(span_left_side_2)

# ---- group: Right Cantilever
span_right_side_2 = Slider(1.03, range=1..2)
multiplication_2 = Multiplication(A=height_column, B="100")
division_3 = Division(A=multiplication_2, B=layer_height)
range_2 = Range(Domain=Domain(0, 1), Steps=division_3)
graph = GraphMapper(range_2, x0=0, x1=1, y0=0, y1=1, Cx=0.7991268039, Cy=0.2119224072, container_name="Conic")
domain_2 = Domain(span_left_side_2)
remap = RemapNumbers(Value=graph, Source=Domain(0, 1), Target=domain_2)  # -> Mapped, Clipped

# ----
graph_2 = GraphMapper(reverse(range), x0=0, x1=1, y0=1, y1=0, Cx=0.9172042012, Cy=0.3464022279, container_name="Conic")

# ---- group: Left Cantilever (continued)
graph_3 = GraphMapper(graph_2, x0=0, x1=1, y0=0, y1=1, Cx=0.8066081405, Cy=0.1631289124, container_name="Conic")
remap_2 = RemapNumbers(Value=graph_3, Source=Domain(0, 1), Target=domain)  # -> Mapped, Clipped

# ----
panel_2 = Panel(remap_2.Mapped)
ghpython_script = GhPythonScript(
    Code=read_file,
    Curve=crv,
    X_dir=X,
    Y_dir=Y,
    Ref_point_st=pt,
    Ref_point_end=pt_2,
    X_spacing=x_div,
    Threshold_dist=x_div_2,
    Type1Dist=Slider(20.43, range=15..28),
    Perp_dist_thresh=Slider(6, range=3..7),
    Thresh_case1_end=Slider(3, range=0..10),
    Thresh_case2_end=Slider(6, range=0..15),
    Reduction=Slider(0.5, range=0..1),
    Upper_limit_y_move=Slider(4, range=0..5),
    Lower_limit_y_move=Slider(0.5, range=0..5),
    Average_step_y=Slider(1, range=0..5),
    Length=length,
    Layer_height=layer_height_3,
    Max_consec_t1=layer_height_4,
    Max_consec_t2=layer_height_2,
    Height=height_column,
    GM_values_L=remap_2.Mapped,
    GM_values_R=remap.Mapped,
    Slider=Slider(20, range=0..50))  # -> Out, Contour_pts, Main_paths, Contour_pts_end, Contour_pts_st, Crv_pt_st, EndSideContourPairs, StSideContourPairs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
data_2 = Data([ghpython_script.Contour_pts_end, ghpython_script.Contour_pts_st])
data_3 = Data(ghpython_script.Inc3)
data_4 = Data(ghpython_script.StSideContourPairs)
data_5 = Data(ghpython_script.EndSideContourPairs)
points2 = Data(ghpython_script.All_fab_points)
panel_3 = Panel(ghpython_script.Incremental_list2)
panel_4 = Panel(data_3)
python_2 = GhPythonScript(x=ghpython_script.All_fab_points)  # -> out, a
# ---------- python_2: Python ----------
a = x
# ---------- end python_2 ----------
panel_5 = Panel(ghpython_script.Out)

# ---- group: output points
move = Move(Geometry=python_2.a, Motion=Z)  # -> Geometry, Transform

# ---- group: Visualize Bullets!!
move2pt = MoveToPoint(PointB=flatten(move.Geometry))  # -> graft(Moved), Vector, Transform; disabled
