# Grasshopper definition Column_20230111.ghx (Grasshopper 1.0.7)

unit_length = Slider(15, range=0..100)
unit_length_2 = Slider(15, range=0..100)
number_slider = Slider(0.1, range=0.1..0.2)
number_slider_2 = Slider(0.1, range=0.1..0.2)
dom = ConstructDomain(DomainStart=0, DomainEnd=1)
brep = Brep(<brep referenced from the Rhino model>)
dom_2 = ConstructDomain(DomainStart=0, DomainEnd=1)
brep_2 = Brep(<brep referenced from the Rhino model>)

# ----
# Single Unit
brep_3 = Brep(<brep referenced from the Rhino model>)

# ----
# Single Unit
brep_4 = Brep(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)
python = GhPythonScript(
    column=brep,
    Layer_height=Slider(6.25, range=0..10),
    Unit_width=Slider(7, range=0..10),
    Unit_length=unit_length,
    Unit_Interval=dom,
    SeamRotate=Slider(0.02, range=0.01..0.1))  # -> out, Contour_StartPt, Contour_EndPt, Contour_bbxs, Contours, StartPts, Pt_tree; inputs column: Brep
# ---------- python: Python ----------
import Rhino.Geometry as rg
import rhinoscriptsyntax as rs
from ghpythonlib import treehelpers as th

Unit_length = Unit_length*2

column_bbx = column.GetBoundingBox(True)
print type(column_bbx)
Contour_StartPt = rg.BoundingBox.PointAt(column_bbx, 0,0,0)
Contour_EndPt = rg.BoundingBox.PointAt(column_bbx, 0,0,1)
Contours = rg.Brep.CreateContourCurves(column, Contour_StartPt, Contour_EndPt, Layer_height)


StartPts = []
Pt_tree = []
Contour_bbxs = []
for i,Contour in enumerate(Contours):
    Contour_bbx = Contour.GetBoundingBox(True)
    L = Contour_bbx.GetEdges()[0]
    W = Contour_bbx.GetEdges()[1]
    Length = L.Length
    print Length
    Width = W.Length
    print Width
#    scale_L = 
    Contour.Domain = rg.Interval(0,1)
    Start_t = i*SeamRotate
    Start_pt = rg.Curve.ChangeClosedCurveSeam(Contour,Start_t)
    StartPt = rg.Curve.PointAt(Contour, Start_t)
    DivideNum = int(rg.Curve.GetLength(Contour)/Unit_width)
    StartPts.append(StartPt)
    Contour_bbxs.append(Contour_bbx)
    Shots = []
    for j in range(DivideNum):
        Shot = rg.Curve.PointAt(Contour, Start_t+j/DivideNum)
        Shots.append(Shot)
    Pt_tree.append(Shots)

Pt_tree = th.list_to_tree(Pt_tree)
# ---------- end python ----------
python_2 = GhPythonScript(
    column=brep_2,
    Layer_height=Slider(6.25, range=0..10),
    Unit_width=Slider(7, range=0..10),
    Unit_length=unit_length_2,
    Unit_Interval=dom_2,
    SeamRotate=Slider(0.02, range=0.01..0.1))  # -> out, Contour_bbxs, Contours, StartPts, Pt_tree; inputs column: Brep
# ---------- python_2: Python ----------
import Rhino.Geometry as rg
import rhinoscriptsyntax as rs
from ghpythonlib import treehelpers as th

Unit_length = Unit_length*2

column_bbx = column.GetBoundingBox(True)
print type(column_bbx)
Contour_StartPt = rg.BoundingBox.PointAt(column_bbx, 0,0,0)
Contour_EndPt = rg.BoundingBox.PointAt(column_bbx, 0,0,1)
Contours = rg.Brep.CreateContourCurves(column, Contour_StartPt, Contour_EndPt, Layer_height)


StartPts = []
Pt_tree = []
Contour_bbxs = []
for i,Contour in enumerate(Contours):
    Contour_bbx = Contour.GetBoundingBox(True)
    Contour.Domain = rg.Interval(0,1)
    Start_t = i*SeamRotate
    Start_pt = rg.Curve.ChangeClosedCurveSeam(Contour,Start_t)
    StartPt = rg.Curve.PointAt(Contour, Start_t)
    DivideNum = int(rg.Curve.GetLength(Contour)/Unit_width)
    StartPts.append(StartPt)
    Contour_bbxs.append(Contour_bbx)
    Shots = []
    for j in range(DivideNum):
        Shot = rg.Curve.PointAt(Contour, Start_t+j/DivideNum)
        Shots.append(Shot)
    Pt_tree.append(Shots)

Pt_tree = th.list_to_tree(Pt_tree)
# ---------- end python_2 ----------
volume = Volume(Geometry=brep_4)  # -> Volume, Centroid
rot3d = Rotate3D(Geometry=brep_4, Angle=1.570796327, Center=volume.Centroid, Axis=Vector(0, 0, 1))  # -> Geometry, Transform
move = Move(Geometry=brep_3, Motion=python.Pt_tree)  # -> Geometry, Transform
flatten = FlattenTree(Tree=python.Pt_tree, Path="{0}")
move_2 = Move(Geometry=rot3d.Geometry, Motion=python_2.Pt_tree)  # -> Geometry, Transform
flatten_2 = FlattenTree(Tree=python_2.Pt_tree, Path="{0}")
pt = Point(python.Contour_StartPt)
pt_2 = Point(python.Contour_EndPt)
crv = Curve(python.Contours)
pt_3 = Point(python.Pt_tree)
brep_5 = Brep(python_2.Contour_bbxs)
crv_2 = Curve(python_2.Contours)
pt_4 = Point(python_2.Pt_tree)
brep_6 = Brep(python.Contour_bbxs)
sph = Sphere(Base=python.StartPts, Radius=2)
sph_2 = Sphere(Base=python_2.StartPts, Radius=2)
preview = CustomPreview(Geometry=move.Geometry, Material=ColourSwatch(SwatchColor=RGB(186, 166, 132)))
preview_2 = CustomPreview(Geometry=move_2.Geometry, Material=ColourSwatch(SwatchColor=RGBA(186, 166, 132, 110)))
viewer = ParamViewer(python.Pt_tree)
viewer_2 = ParamViewer(python_2.Pt_tree)
