# Grasshopper definition Pattern Grid_Rotation and Closeup.gh (Grasshopper 1.0.7)
# plug-ins: Wallacei

genes = GenePool(
    Decimals=2,
    Maximum=1.05,
    Minimum=0.95,
    Value=[1.02, 1, 1, 0.98, 1.04, 1.02, 1.04, 1.04, 0.98, 0.95, 0.95, 1.05, 1, 1.04, 1.04, 0.97, 1, 0.96, 0.96, 1.01, 0.98, 1.05, 1.01])
genes_2 = GenePool(
    Decimals=2,
    Maximum=1.05,
    Minimum=0.95,
    Value=[0.96, 1.05, 0.98, 0.98, 0.95, 0.99, 0.97, 0.99, 0.99, 0.99, 1.01, 1.02, 0.98, 1.05, 1.02, 1.01, 1, 0.95, 1.02, 1.03, 0.99, 0.96, 0.96])
number_slider = Slider(70, range=0..100)
number_slider_2 = Slider(150, range=0..1000)
brep = Brep(<brep referenced from the Rhino model>)

# ----
# Single Unit
brep_2 = Brep(<brep referenced from the Rhino model>)

python = GhPythonScript(
    column=brep,
    layer_height=Slider(62.5, range=0..100),
    unit_width=number_slider,
    unit_length=number_slider_2,
    seam_shift=Slider(0.04, range=0.01..0.1),
    x_list=genes_2,
    y_list=genes,
    overlap=Slider(10, range=0..20))  # -> out, contours, start_pts, pt_tree, gap_pts, gap_values, last_pts; inputs column: Brep, x_list: list, y_list: list
# ---------- python: Python ----------
import Rhino.Geometry as rg
import rhinoscriptsyntax as rs
import math as m
import System, clr
from System import Array
from ghpythonlib import treehelpers as th

def curve_to_points(curve, division, index):
    if curve.IsClosed:
        curve.Domain = rg.Interval(0,1)
        start_t = rg.Curve.ChangeClosedCurveSeam(curve, index*seam_shift)
        start_pt = rg.Curve.PointAt(curve, start_t)
        pts_t = rg.Curve.DivideByCount(curve,division, True)
        pts = []
        for i in range(len(pts_t)):
            pt = curve.PointAt(pts_t[i])
            pts.append(pt)
    else:
        pts = rg.Curve.DivideByCount(curve,division, False)
        pts = []
        for i in range(len(pts_t)):
            pt = curve.PointAt(pts_t[i])
            pts.append(pt)
    return pts

def find_nextpoint(index,points,curve,radius1,radius2,overlap):
    curve.Domain = rg.Interval(0,1)
    start_pt = rg.Curve.PointAt(curve,0)
    start_pl = rg.Plane(points[-1], rg.Vector3d(0,0,1))
    detect = rg.NurbsCurve.CreateFromEllipse(rg.Ellipse(start_pl,radius1-overlap, radius2-overlap))
    pt1= rg.Intersect.Intersection.CurveCurve(curve, detect,0,0)[0].PointA
    pt2= rg.Intersect.Intersection.CurveCurve(curve, detect,0,0)[1].PointA
    points = []
    if index==0:
        points.append(pt1)
    else:
        points.append(pt2)
    return points

def curve_rescale(index, curve ,x_list, y_list):
    properties = rg.AreaMassProperties.Compute(curve)
    center_pt = properties.Centroid
    scale = rg.Transform.Scale(rg.Plane(center_pt,rg.Vector3d(0,0,1)),x_list[index],y_list[index],1)
    curve.Transform(scale)
    return curve

column_bbx = column.GetBoundingBox(True)
up_edge = column.Edges[1]
dn_edge = column.Edges[2]
contour_startpt = rg.BoundingBox.PointAt(column_bbx, 0,0,0)
contour_endpt = rg.BoundingBox.PointAt(column_bbx, 0,0,1)
contours = rg.Brep.CreateContourCurves(column, contour_startpt, contour_endpt, layer_height)
r1= unit_width
r2= unit_length

pt_tree =[]
start_pts= []
last_pts=[]
gap_pts = []
gap_values = []
for j, contour in enumerate(contours):
    contour = curve_rescale(j,contour,x_list,y_list)
    contour.Domain = rg.Interval(0,1)
    start_t = j*seam_shift
    start_pt = rg.Curve.PointAt(contour, start_t)
    seam = rg.Curve.ChangeClosedCurveSeam(contour, start_t)
    start_pts.append(start_pt)
    i=0
    pts =[]
    pts.append(start_pt)
    while i<30:
        points = find_nextpoint(i,pts,contour,r1,r2,overlap)
        detect_pt= points[-1]
        start_pl = rg.Plane(start_pt, rg.Vector3d(0,0,1))
        detect_pl = rg.Plane(detect_pt, rg.Vector3d(0,0,1))
        detect = rg.NurbsCurve.CreateFromEllipse(rg.Ellipse(detect_pl,r1/2-overlap, r2/2-overlap))
        start = rg.NurbsCurve.CreateFromEllipse(rg.Ellipse(start_pl,r1/2-overlap, r2/2-overlap))
        ccx_event= len(rg.Intersect.Intersection.CurveCurve(start, detect,0,0))
        if i<2:
            pts.append(points[-1])
            i+=1
        elif i>2 and ccx_event>1:
            break
        else:
            pts.append(points[-1])
            i+=1
        last_pl =rg.Plane(pts[-1], rg.Vector3d(0,0,1))
        last_ellipse=rg.NurbsCurve.CreateFromEllipse(rg.Ellipse(last_pl,r1,r2))
        gap_pt=rg.Intersect.Intersection.CurveCurve(contour, last_ellipse,0,0)[1].PointA
        gap = rg.Point3d.DistanceTo(start_pt,gap_pt)
    pt_tree.append(pts)
    last_pts.append(pts[-1])
    gap_values.append(gap)
    gap_pts.append(gap_pt)

pt_tree = th.list_to_tree(pt_tree)
# ---------- end python ----------
crv = Curve(<curve referenced from the Rhino model>)
pt = Point([<point referenced from the Rhino model> x15])
number_slider_3 = Slider(219, range=0..1000)

sph = Sphere(Base=python.gap_pts, Radius=Slider(10, range=0..10))
preview = CustomPreview(Geometry=sph, Material=ColourSwatch(SwatchColor=RGB(255, 0, 0)))

sph_2 = Sphere(Base=python.last_pts, Radius=Slider(10, range=0..10))
preview_2 = CustomPreview(Geometry=sph_2, Material=ColourSwatch(SwatchColor=RGB(21, 255, 0)))

sph_3 = Sphere(Base=python.start_pts, Radius=Slider(10, range=0..10))
preview_3 = CustomPreview(Geometry=sph_3, Material=ColourSwatch(SwatchColor=RGB(0, 72, 255)))

volume = Volume(Geometry=brep_2)  # -> Volume, Centroid
python_2 = GhPythonScript(points=pt, Curve=crv, Radius=number_slider_3)  # -> out, output; inputs points: list of Point3d
# ---------- python_2: Python ----------
import rhinoscriptsyntax as rs
import ghpythonlib.components as lib
import random
import Rhino





def GenePool(list_len, Max_Value):
    motherList=[]
    for i in range(list_len):
        motherList.append(random.uniform(0,Max_Value))
    return motherList
mypool = GenePool(250,1)
def solution_Creator(solution_Count, Genepools):
    return(random.sample(Genepools, solution_Count))


def population(Population_count):
    population=[]
    for i in range(Population_count):
        population.append(solution_Creator(2,mypool))
    return population
# use this function if you wanna use the ghpythonlib library
def Function(First_Geo, Second_Geo, solutions):
    First_Geo= rs.coercebrep(First_Geo)
    interval_u= Rhino.Geometry.Interval(0.0, 1)
    interval_v= Rhino.Geometry.Interval(0.0, 1)
    
    First_Geo.Faces[0].SetDomain(0, interval_u)
    First_Geo.Faces[0].SetDomain(1, interval_v)
    
    circle_pt= rs.EvaluateSurface(First_Geo, solutions[0], solutions[1])
    circle= rs.AddCircle(circle_pt, Radius)
    point_List = Second_Geo
    return lib.PointInCurve(rs.coerce3dpointlist(point_List), rs.coercecurve(circle))[0]

def fitness(population,First_Geo,Second_Geo):
    fitness_values=[]
    for solution in population:
        test=sum(Function(First_Geo,Second_Geo,solution))
        fitness_values.append(test)
    return fitness_values

def Crossover(population):
    gene_one=[]
    gene_two=[]
    def divide_chunks(Listt, n):
    #looping till length Listt
        for i in range(0, len(Listt), n):
            yield Listt[i:i + n]
    if len(population)%2!=0 :
        del population[-1]
    else:
        population
    child_one=[]
    for choromosome in population:
        gene_one.append(choromosome[0])
        gene_two.append(choromosome[1])
    #child_one= list(divide_chucks(zip(gene_one, reserversed(gene_two)),1))
    #child_one= list(divide_chucks(zip(gene_one, reserversed(gene_one)),1))
    child_whole = list([i,j] for i,j in zip (gene_one, reversed(gene_two)))
    
    return child_whole

def select(pop_list,value_list, sorted_values):
    best_individuals=[]
    if len(value_list)>1:
        best_values=sorted_values[int(len(value_list)/2):]
        print best_values
        for item in best_values:
            best_individuals.append(pop_list[value_list.index(item)])
        return best_individuals
    else:
        return pop_list

def recursive(parents, best_fitness,sort):
    genes=[]
    genes.append(list(parents))
    print genes
    if len(select(parents, best_fitness, sort))<2:
        return select(parents,best_fitness,sort)
    else:
        child = select(parents, best_fitness, sort)
        new_gene = Crossover(child)
        new_gene_fitness = fitness(new_gene,mysurfe,points)
        sort_list= fitness(new_gene,mysurfe,points)
        sort_list.sort()
        return recursive(new_gene,new_gene_fitness,sort_list)

mysurfe = rs.AddPlanarSrf(Curve)

def main():
    parents=population(180)
    best_fitness = fitness(parents,mysurfe,points)
    sort = fitness(parents,mysurfe,points)
    sort.sort()
    return recursive(parents,best_fitness,sort)

output = main()[0]
# ---------- end python_2 ----------
rot3d = Rotate3D(Geometry=brep_2, Angle=1.570796327, Center=volume.Centroid, Axis=Vector(0, 0, 1))  # -> Geometry, Transform
item = ListItem(List=python_2.output, Index=0, Wrap=True)  # -> Item, Item1
pt_2 = Point(python.pt_tree)

move = Move(Geometry=brep_2, Motion=python.pt_tree)  # -> Geometry, Transform
preview_4 = CustomPreview(Geometry=move.Geometry, Material=ColourSwatch(SwatchColor=RGB(186, 166, 132)))

pt_3 = ConstructPoint(XCoordinate=item.Item, YCoordinate=item.Item1, ZCoordinate=0)
ellipse = Ellipse(Plane=python.last_pts, Radius1=number_slider, Radius2=number_slider_2)  # -> Ellipse, Focus1, Focus2
move_2 = Move(Geometry=brep_2, Motion=python.pt_tree)  # -> Geometry, Transform
evalsrf = EvaluateSurface(Surface=reparameterize(crv), Point=pt_3)  # -> Point, Normal, UDirection, VDirection, Frame
preview_5 = CustomPreview(Geometry=ellipse.Ellipse, Material=ColourSwatch(SwatchColor=RGB(255, 0, 0)))

item_2 = ListItem(List=python.contours, Index=Slider(0, range=0..100), Wrap=True)

preview_6 = CustomPreview(Geometry=move_2.Geometry, Material=ColourSwatch(SwatchColor=RGB(186, 166, 132)))
cir = Circle(Plane=evalsrf.Point, Radius=number_slider_3)
wallacei_x = WallaceiX(
    Genes=[genes_2, genes],
    Objectives=python.gap_values,
    Phenotype=pt_2,
    allFitness="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",
    allFrontIdx="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",
    allGenomes="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",
    curFrontIdx="29|0;29|1;29|2;29|3;29|4;29|5;29|6;29|7;29|8;29|9;29|10;29|11;29|12;29|13;29|14",
    curFrontIdxSave="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",
    popGen="15,30",
    total="85625",
    wlcDone=True)  # -> WallaceiGenomes, FitnessValues, Data, WPhenotypes

number_slider_4 = Slider(1.028, range=0.95..1.05)
number_slider_5 = Slider(0.987, range=0.95..1.05)
area = Area(Geometry=item_2)  # -> Area, Centroid
scale_nu = ScaleNU(Geometry=item_2, Plane=area.Centroid, ScaleX=number_slider_5, ScaleY=number_slider_4, ScaleZ=Slider(1, range=0..1))  # -> Geometry, Transform

pdecoder = DecodePhenotype(WallaceiPhenotype=wallacei_x.WPhenotypes)  # -> GeometriesList, MeshesList, NumbersList, TextList
pt_4 = Point(pdecoder.GeometriesList)
move_3 = Move(Geometry=brep_2, Motion=pt_4)  # -> Geometry, Transform

number_slider_6 = Slider(13, range=0..100)
python_3 = GhPythonScript(contour=scale_nu.Geometry, r1=number_slider, r2=number_slider_2, overlap=number_slider_6)  # -> out, contour, pts; inputs contour: Curve
# ---------- python_3: Python ----------
import rhinoscriptsyntax as rs
import Rhino.Geometry as rg

def find_nextpoint(index,points,curve,radius1,radius2,overlap):
    curve.Domain = rg.Interval(0,1)
    start_pt = rg.Curve.PointAt(curve,0)
    start_pl = rg.Plane(points[-1], rg.Vector3d(0,0,1))
    detect = rg.NurbsCurve.CreateFromEllipse(rg.Ellipse(start_pl,radius1-overlap, radius2-overlap))
    pt1= rg.Intersect.Intersection.CurveCurve(curve, detect,0,0)[0].PointA
    pt2= rg.Intersect.Intersection.CurveCurve(curve, detect,0,0)[1].PointA
    points = []
    if index==0:
        points.append(pt1)
    else:
        points.append(pt2)
    return points

contour.Domain = rg.Interval(0,1)
p1 = rg.Curve.PointAt(contour,0)
t=0
i=0
pts =[]
t_values = []
t_values.append(t)
pts.append(p1)

while i<30:
    points = find_nextpoint(i,pts,contour,r1,r2,overlap)
    detect_pt= points[-1]
    start_pl = rg.Plane(p1, rg.Vector3d(0,0,1))
    detect_pl = rg.Plane(detect_pt, rg.Vector3d(0,0,1))
    detect = rg.NurbsCurve.CreateFromEllipse(rg.Ellipse(detect_pl,r1/2-overlap, r2/2-overlap))
    start = rg.NurbsCurve.CreateFromEllipse(rg.Ellipse(start_pl,r1/2-overlap, r2/2-overlap))
    ccx_event= len(rg.Intersect.Intersection.CurveCurve(start, detect,0,0))
    print (ccx_event)
    if i<2:
        pts.append(points[-1])
        i+=1
    elif i>2 and ccx_event>1:
        break
    else:
        pts.append(points[-1])
        i+=1
# ---------- end python_3 ----------
ellipse_2 = Ellipse(Plane=python_3.pts, Radius1=35, Radius2=75)  # -> Ellipse, Focus1, Focus2

preview_7 = CustomPreview(Geometry=move_3.Geometry, Material=ColourSwatch(SwatchColor=RGB(186, 166, 132)))
python_4 = GhPythonScript(contour=scale_nu.Geometry, r1=number_slider, r2=number_slider_2)  # -> out, contour, pts, t_values, t_remap, pts_remap; inputs contour: Curve
# ---------- python_4: Python ----------
import rhinoscriptsyntax as rs
import Rhino.Geometry as rg

def find_nextpoint(index,points,curve,radius1,radius2):
    curve.Domain = rg.Interval(0,1)
    start_pt = rg.Curve.PointAt(curve,0)
    start_pl = rg.Plane(points[-1], rg.Vector3d(0,0,1))
    detect = rg.NurbsCurve.CreateFromEllipse(rg.Ellipse(start_pl,radius1, radius2))
    pt1= rg.Intersect.Intersection.CurveCurve(curve, detect,0,0)[0].PointA
    pt2= rg.Intersect.Intersection.CurveCurve(curve, detect,0,0)[1].PointA
    points = []
    if index==0:
        points.append(pt1)
    else:
        points.append(pt2)
    return points

contour.Domain = rg.Interval(0,1)
p1 = rg.Curve.PointAt(contour,0)
t=0
i=0
pts =[]
t_values = []
t_values.append(t)
pts.append(p1)

while i<30:
    points = find_nextpoint(i,pts,contour,r1,r2)
    detect_pt= points[-1]
    start_pl = rg.Plane(p1, rg.Vector3d(0,0,1))
    detect_pl = rg.Plane(detect_pt, rg.Vector3d(0,0,1))
    detect = rg.NurbsCurve.CreateFromEllipse(rg.Ellipse(detect_pl,r1/2, r2/2))
    start = rg.NurbsCurve.CreateFromEllipse(rg.Ellipse(start_pl,r1/2, r2/2))
    ccx_event= len(rg.Intersect.Intersection.CurveCurve(start, detect,0,0))
    print (ccx_event)
    if i<2:
        pts.append(points[-1])
        i+=1
    elif i>2 and ccx_event>1:
        break
    else:
        pts.append(points[-1])
        i+=1
    t = rg.Curve.ClosestPoint(contour, points[-1], 0)[1]
    t_values.append(t)

#pts_remap = []
#t_remap = []
#for i,t in enumerate(t_values):
#    gap = (1-max(t_values))/13
#    t= t+gap*i
#    t_remap.append(t)
#    pt = rg.Curve.PointAt(contour,t)
#    pts_remap.append(pt)
# ---------- end python_4 ----------

crv_2 = Curve(scale_nu.Geometry)
number_slider_7 = Slider(10, range=0..100)
eval = EvaluateCurve(Curve=reparameterize(scale_nu.Geometry), Parameter=Slider(0, range=0..1))  # -> Point, Tangent, Angle
subtraction = Subtraction(A=Slider(75, range=0..100), B=number_slider_7)
subtraction_2 = Subtraction(A=Slider(35, range=0..100), B=number_slider_7)
ellipse_3 = Ellipse(Plane=eval.Point, Radius1=35, Radius2=75)  # -> Ellipse, Focus1, Focus2
multiplication = Multiplication(A=subtraction_2, B=2)
multiplication_2 = Multiplication(A=subtraction, B=2)
ellipse_4 = Ellipse(Plane=eval.Point, Radius1=multiplication, Radius2=multiplication_2)  # -> Ellipse, Focus1, Focus2
ccx = CurveCurve(CurveA=ellipse_4.Ellipse, CurveB=scale_nu.Geometry)  # -> Points, ParamsA, ParamsB
item_3 = ListItem(List=ccx.Points, Index=0, Wrap=True)
ellipse_5 = Ellipse(Plane=item_3, Radius1=35, Radius2=75)  # -> Ellipse, Focus1, Focus2

move_4 = Move(Geometry=brep_2, Motion=python_4.pts)  # -> Geometry, Transform
preview_8 = CustomPreview(Geometry=move_4.Geometry, Material=ColourSwatch(SwatchColor=RGB(186, 166, 132)))

ellipse_6 = Ellipse(Plane=python_4.pts, Radius1=35, Radius2=75)  # -> Ellipse, Focus1, Focus2
item_4 = ListItem(List=python_3.pts, Index="0", Wrap=True)

subtraction_3 = Subtraction(A=Slider(35, range=0..100), B=number_slider_6)
subtraction_4 = Subtraction(A=Slider(75, range=0..100), B=number_slider_6)
ellipse_7 = Ellipse(Plane=item_4, Radius1=subtraction_3, Radius2=subtraction_4)  # -> Ellipse, Focus1, Focus2

item_5 = ListItem(List=python_3.pts, Index="-1", Wrap=True)

subtraction_5 = Subtraction(A=Slider(35, range=0..100), B=number_slider_6)
subtraction_6 = Subtraction(A=Slider(75, range=0..100), B=number_slider_6)
ellipse_8 = Ellipse(Plane=python_3.pts, Radius1=subtraction_5, Radius2=subtraction_6)  # -> Ellipse, Focus1, Focus2

item_6 = ListItem(List=python_4.pts, Index="-1", Wrap=True)
item_7 = ListItem(List=python_4.pts, Index="0", Wrap=True)
ellipse_9 = Ellipse(Plane=item_5, Radius1=35, Radius2=75)  # -> Ellipse, Focus1, Focus2

subtraction_7 = Subtraction(A=Slider(75, range=0..100), B=number_slider_7)
subtraction_8 = Subtraction(A=Slider(35, range=0..100), B=number_slider_7)
ellipse_10 = Ellipse(Plane=eval.Point, Radius1=subtraction_8, Radius2=subtraction_7)  # -> Ellipse, Focus1, Focus2

subtraction_9 = Subtraction(A=Slider(75, range=0..100), B=number_slider_7)
subtraction_10 = Subtraction(A=Slider(35, range=0..100), B=number_slider_7)
ellipse_11 = Ellipse(Plane=item_3, Radius1=subtraction_10, Radius2=subtraction_9)  # -> Ellipse, Focus1, Focus2

ellipse_12 = Ellipse(Plane=item_6, Radius1=number_slider, Radius2=number_slider_2)  # -> Ellipse, Focus1, Focus2
ellipse_13 = Ellipse(Plane=item_7, Radius1=35, Radius2=75)  # -> Ellipse, Focus1, Focus2
ccx_2 = CurveCurve(CurveA=ellipse_9.Ellipse, CurveB=scale_nu.Geometry)  # -> Points, ParamsA, ParamsB
ellipse_14 = Ellipse(Plane=item_6, Radius1=35, Radius2=75)  # -> Ellipse, Focus1, Focus2
ccx_3 = CurveCurve(CurveA=ellipse_12.Ellipse, CurveB=scale_nu.Geometry)  # -> Points, ParamsA, ParamsB
item_8 = ListItem(List=ccx_2.Points, Index=Slider(1, range=0..1), Wrap=True)
ccx_4 = CurveCurve(CurveA=ellipse_7.Ellipse, CurveB=scale_nu.Geometry)  # -> Points, ParamsA, ParamsB
item_9 = ListItem(List=ccx_3.Points, Index=Slider(1, range=0..1), Wrap=True)
item_10 = ListItem(List=ccx_4.Points, Index=Slider(0, range=0..1), Wrap=True)
dist = Distance(PointA=item_9, PointB=item_7)
dist_2 = Distance(PointA=item_8, PointB=item_10)
galapagos = Galapagos(fitness=dist, gene=[number_slider_5, number_slider_4])
galapagos_2 = Galapagos(fitness=dist_2, gene=[number_slider_5, number_slider_4])
