# Grasshopper definition Pattern Grid.gh (Grasshopper 1.0.7)

brep = Brep(<brep referenced from the Rhino model>)
number_slider = Slider(70, range=0..100)
number_slider_2 = Slider(150, range=0..1000)
number_slider_3 = Slider(2, range=0..10)
# Single Unit
brep_2 = Brep(<brep referenced from the Rhino model>)
python = GhPythonScript(
    column=brep,
    layer_height=Slider(62.5, range=0..100),
    unit_width=number_slider,
    unit_length=number_slider_2,
    seam_shift=Slider(0.1, range=0.01..0.1),
    gap_factor=Slider(0.2, range=0..1))  # -> out, up_edge, dn_edge, contours, start_pts, pts, pt_tree; inputs column: Brep
# ---------- python: Python ----------
import Rhino.Geometry as rg
import rhinoscriptsyntax as rs
import math as m
import System, clr
from System import Array
from ghpythonlib import treehelpers as th

def curve_to_points(curve, division, index):
    if curve.IsClosed:
        curve.Domain = rg.Interval(0,1)
        start_t = rg.Curve.ChangeClosedCurveSeam(curve, index*seam_shift)
        start_pt = rg.Curve.PointAt(curve, start_t)
        pts_t = rg.Curve.DivideByCount(curve,division, True)
        pts = []
        for i in range(len(pts_t)):
            pt = curve.PointAt(pts_t[i])
            pts.append(pt)
    else:
        pts = rg.Curve.DivideByCount(curve,division, False)
        pts = []
        for i in range(len(pts_t)):
            pt = curve.PointAt(pts_t[i])
            pts.append(pt)
    return pts, start_pt

column_bbx = column.GetBoundingBox(True)
up_edge = column.Edges[1]
dn_edge = column.Edges[2]


contour_startpt = rg.BoundingBox.PointAt(column_bbx, 0,0,0)
contour_endpt = rg.BoundingBox.PointAt(column_bbx, 0,0,1)
contours = rg.Brep.CreateContourCurves(column, contour_startpt, contour_endpt, layer_height)


lengths = []
for i,contour in enumerate(contours):
    length = contour.GetLength()
    lengths.append(length)

division = 0
start_pts = []
pt_tree = []
for i,(length, contour) in enumerate(zip(lengths,contours)):
    divisions = []
    if i ==0:
        first_division = int(lengths[0]/unit_width)
        division = first_division
        pts,start_pt = curve_to_points(contours[0],division, i)
        pt_tree.append(pts)
        start_pts.append(start_pt)
    else:
        difference = lengths[i]-lengths[i-1]
        if abs(difference) <gap_factor*unit_width:
            division = division
        elif difference > gap_factor*unit_width:
            division= division-m.ceil(difference/unit_width)
        elif difference< -(gap_factor*unit_width):
            division= division+m.ceil(difference/unit_width)
        pts,start_pt = curve_to_points(contour,division,i)
        start_pts.append(start_pt)
        pt_tree.append(pts)

pt_tree = th.list_to_tree(pt_tree)
# ---------- end python ----------
crv = Curve(python.dn_edge)
volume = Volume(Geometry=brep_2)  # -> Volume, Centroid
division = Division(A=number_slider_2, B=number_slider_3)
division_2 = Division(A=number_slider, B=number_slider_3)
item = ListItem(List=python.start_pts, Index=0, Wrap=True)
rot3d = Rotate3D(Geometry=brep_2, Angle=1.570796327, Center=volume.Centroid, Axis=Vector(0, 0, 1))  # -> Geometry, Transform
flip = FlipMatrix(Data=python.pt_tree)
move = Move(Geometry=brep_2, Motion=python.pt_tree)  # -> Geometry, Transform
lng = ListLength(List=flip)
pt = Point(python.start_pts)

ellipse = Ellipse(Plane=item, Radius1=number_slider, Radius2=number_slider_2)  # -> Ellipse, Focus1, Focus2
ellipse_2 = Ellipse(Plane=item, Radius1=division_2, Radius2=division)  # -> Ellipse, Focus1, Focus2
ccx = CurveCurve(CurveA=crv, CurveB=ellipse.Ellipse)  # -> Points, ParamsA, ParamsB
item_2 = ListItem(List=ccx.Points, Index=Slider(0, range=0..100), Wrap=True)

dom = ConstructDomain(DomainStart=0, DomainEnd=lng)
item_3 = ListItem(List=python.contours, Index=Slider(0, range=0..100), Wrap=True)
preview = CustomPreview(Geometry=move.Geometry, Material=ColourSwatch(SwatchColor=RGB(186, 166, 132)))
item_4 = ListItem(List=flip, Index=Slider(0, range=0..100), Wrap=dom)

number_slider_4 = Slider(0.963, range=0.95..1.05)
number_slider_5 = Slider(0.98, range=0.95..1.05)
area = Area(Geometry=item_3)  # -> Area, Centroid
scale_nu = ScaleNU(Geometry=item_3, Plane=area.Centroid, ScaleX=number_slider_5, ScaleY=number_slider_4, ScaleZ=Slider(1, range=0..1))  # -> Geometry, Transform

number_slider_6 = Slider(0.963, range=0.95..1.05)
number_slider_7 = Slider(0.98, range=0.95..1.05)
python_2 = GhPythonScript(contours=python.contours, r1=number_slider, r2=number_slider_2)  # -> out, contour, pt_tree; inputs contours: list of Curve
# ---------- python_2: Python ----------
import rhinoscriptsyntax as rs
import Rhino.Geometry as rg
from ghpythonlib import treehelpers as th

def find_nextpoint(index,points,curve,radius1,radius2):
    curve.Domain = rg.Interval(0,1)
    start_pt = rg.Curve.PointAt(curve,0)
    distance = rg.Point3d.DistanceTo(start_pt,points[-1])
    start_pl = rg.Plane(points[-1], rg.Vector3d(0,0,1))
    detect = rg.NurbsCurve.CreateFromEllipse(rg.Ellipse(start_pl,radius1, radius2))
    pt1= rg.Intersect.Intersection.CurveCurve(curve, detect,0,0)[0].PointA
    pt2= rg.Intersect.Intersection.CurveCurve(curve, detect,0,0)[1].PointA
    points = []
    if index==0:
        points.append(pt1)
    else:
        points.append(pt2)
    return points

pt_tree = []
for i, contour in enumerate(contours):
    contour.Domain = rg.Interval(0,1)
    p1 = rg.Curve.PointAt(contour,0)
    i=0
    pts =[]
    t_values = []
    pts.append(p1)
    while i<30:
        points = find_nextpoint(i,pts,contour,r1,r2)
        if i<2:
            pts.append(points[-1])
            i+=1
        elif i>2 and t_values[-1] > 1-t_values[1]:
            break
        else:
            pts.append(points[-1])
            i+=1
        t = rg.Curve.ClosestPoint(contour, points[-1], 0)[1]
        t_values.append(t)
    pt_tree.append(pts)

pt_tree = th.list_to_tree(pt_tree)
# ---------- end python_2 ----------
flip_2 = FlipMatrix(Data=python_2.pt_tree)
lng_2 = ListLength(List=flip_2)
area_2 = Area(Geometry=item_3)  # -> Area, Centroid
python_3 = GhPythonScript(contour=item_3, r1=number_slider, r2=number_slider_2)  # -> out, contour, pts; inputs contour: Curve
# ---------- python_3: Python ----------
import rhinoscriptsyntax as rs
import Rhino.Geometry as rg

def find_nextpoint(index,points,curve,radius1,radius2):
    curve.Domain = rg.Interval(0,1)
    start_pt = rg.Curve.PointAt(curve,0)
    distance = rg.Point3d.DistanceTo(start_pt,points[-1])
    start_pl = rg.Plane(points[-1], rg.Vector3d(0,0,1))
    detect = rg.NurbsCurve.CreateFromEllipse(rg.Ellipse(start_pl,radius1, radius2))
    pt1= rg.Intersect.Intersection.CurveCurve(curve, detect,0,0)[0].PointA
    pt2= rg.Intersect.Intersection.CurveCurve(curve, detect,0,0)[1].PointA
    points = []
    if index==0:
        points.append(pt1)
    else:
        points.append(pt2)
    return points

contour.Domain = rg.Interval(0,1)
p1 = rg.Curve.PointAt(contour,0)
#ellipse = rg.NurbsCurve.CreateFromEllipse(rg.Ellipse(start_pl, r1/2, r2/2))

i=0
pts =[]
t_values = []
pts.append(p1)


while i<30:
    points = find_nextpoint(i,pts,contour,r1,r2)
    if i<2:
        pts.append(points[-1])
        i+=1
    elif i>2 and t_values[-1] > 1-t_values[1]:
        break
    else:
        pts.append(points[-1])
        i+=1
    t = rg.Curve.ClosestPoint(contour, points[-1], 0)[1]
    t_values.append(t)


print t_values
# ---------- end python_3 ----------
python_4 = GhPythonScript(contour=item_3, r1=number_slider, r2=number_slider_2)  # -> out, contour, pts, t_values, t_remap, pts_remap; inputs contour: Curve
# ---------- python_4: Python ----------
import rhinoscriptsyntax as rs
import Rhino.Geometry as rg

def find_nextpoint(index,points,curve,radius1,radius2):
    curve.Domain = rg.Interval(0,1)
    start_pt = rg.Curve.PointAt(curve,0)
    distance = rg.Point3d.DistanceTo(start_pt,points[-1])
    start_pl = rg.Plane(points[-1], rg.Vector3d(0,0,1))
    detect = rg.NurbsCurve.CreateFromEllipse(rg.Ellipse(start_pl,radius1, radius2))
    pt1= rg.Intersect.Intersection.CurveCurve(curve, detect,0,0)[0].PointA
    pt2= rg.Intersect.Intersection.CurveCurve(curve, detect,0,0)[1].PointA
    points = []
    if index==0:
        points.append(pt1)
    else:
        points.append(pt2)
    return points

contour.Domain = rg.Interval(0,1)
p1 = rg.Curve.PointAt(contour,0)
t=0
i=0
pts =[]
t_values = []
t_values.append(t)
pts.append(p1)


while i<30:
    points = find_nextpoint(i,pts,contour,r1,r2)
    if i<2:
        pts.append(points[-1])
        i+=1
    elif i>2 and t_values[-1] > 1-t_values[2]:
        break
    else:
        pts.append(points[-1])
        i+=1
    t = rg.Curve.ClosestPoint(contour, points[-1], 0)[1]
    t_values.append(t)
print max(t_values)
pts_remap = []
t_remap = []
for i,t in enumerate(t_values):
    gap = (1-max(t_values))/13
    t= t+gap*i
    t_remap.append(t)
    pt = rg.Curve.PointAt(contour,t)
    pts_remap.append(pt)
# ---------- end python_4 ----------

move_2 = Move(Geometry=brep_2, Motion=item_4)  # -> Geometry, Transform
preview_2 = CustomPreview(Geometry=move_2.Geometry, Material=ColourSwatch(SwatchColor=RGB(186, 166, 132)))

dom_2 = ConstructDomain(DomainStart=0, DomainEnd=lng_2)

ellipse_3 = Ellipse(Plane=item_2, Radius1=number_slider, Radius2=number_slider_2)  # -> Ellipse, Focus1, Focus2
ellipse_4 = Ellipse(Plane=item_2, Radius1=division_2, Radius2=division)  # -> Ellipse, Focus1, Focus2
ccx_2 = CurveCurve(CurveA=ellipse_3.Ellipse, CurveB=crv)  # -> Points, ParamsA, ParamsB
item_5 = ListItem(List=ccx_2.Points, Index=Slider(1, range=0..1), Wrap=True)

scale_nu_2 = ScaleNU(Geometry=item_3, Plane=area_2.Centroid, ScaleX=number_slider_7, ScaleY=number_slider_6, ScaleZ=Slider(1, range=0..1))  # -> Geometry, Transform
item_6 = ListItem(List=flip_2, Index=Slider(0, range=0..100), Wrap=dom_2)

python_5 = GhPythonScript(contour=scale_nu.Geometry, r1=number_slider, r2=number_slider_2)  # -> out, contour, pts, t_values; inputs contour: Curve
# ---------- python_5: Python ----------
import rhinoscriptsyntax as rs
import Rhino.Geometry as rg

def find_nextpoint(index,points,curve,radius1,radius2):
    curve.Domain = rg.Interval(0,1)
    start_pt = rg.Curve.PointAt(curve,0)
    distance = rg.Point3d.DistanceTo(start_pt,points[-1])
    start_pl = rg.Plane(points[-1], rg.Vector3d(0,0,1))
    detect = rg.NurbsCurve.CreateFromEllipse(rg.Ellipse(start_pl,radius1, radius2))
    pt1= rg.Intersect.Intersection.CurveCurve(curve, detect,0,0)[0].PointA
    pt2= rg.Intersect.Intersection.CurveCurve(curve, detect,0,0)[1].PointA
    points = []
    if index==0:
        points.append(pt1)
    else:
        points.append(pt2)
    return points

contour.Domain = rg.Interval(0,1)
p1 = rg.Curve.PointAt(contour,0)
t=0
i=0
pts =[]
t_values = []
t_values.append(t)
pts.append(p1)


while i<30:
    points = find_nextpoint(i,pts,contour,r1,r2)
    if i<2:
        pts.append(points[-1])
        i+=1
    elif i>2 and t_values[-1] > 1-t_values[2]:
        break
    else:
        pts.append(points[-1])
        i+=1
    t = rg.Curve.ClosestPoint(contour, points[-1], 0)[1]
    t_values.append(t)
    
    

#print max(t_values)
#pts_remap = []
#t_remap = []
#for i,t in enumerate(t_values):
#    gap = (1-max(t_values))/13
#    t= t+gap*i
#    t_remap.append(t)
#    pt = rg.Curve.PointAt(contour,t)
#    pts_remap.append(pt)
# ---------- end python_5 ----------
pt_2 = Point(python_5.pts)
item_7 = ListItem(List=python_5.pts, Index="0", Wrap=True)
item_8 = ListItem(List=python_5.pts, Index="-1", Wrap=True)
ellipse_5 = Ellipse(Plane=item_8, Radius1=number_slider, Radius2=number_slider_2)  # -> Ellipse, Focus1, Focus2
ellipse_6 = Ellipse(Plane=item_7, Radius1=division_2, Radius2=division)  # -> Ellipse, Focus1, Focus2
ellipse_7 = Ellipse(Plane=python_5.pts, Radius1=division_2, Radius2=division)  # -> Ellipse, Focus1, Focus2
ccx_3 = CurveCurve(CurveA=ellipse_5.Ellipse, CurveB=scale_nu.Geometry)  # -> Points, ParamsA, ParamsB
item_9 = ListItem(List=ccx_3.Points, Index=Slider(1, range=0..1), Wrap=True)
dist = Distance(PointA=item_9, PointB=item_7)
galapagos = Galapagos(fitness=dist, gene=[number_slider_5, number_slider_4])

pt_3 = Point(python_4.pts_remap)
python_6 = GhPythonScript(
    contours=python.contours,
    r1=number_slider,
    r2=number_slider_2,
    x=Slider(0.98, range=0.95..1.05),
    y=Slider(0.963, range=0.95..1.05))  # -> out, contour, pts, t_values, pt_tree; inputs contours: list of Curve
# ---------- python_6: Python ----------
import rhinoscriptsyntax as rs
import Rhino.Geometry as rg
from ghpythonlib import treehelpers as th

def find_nextpoint(point,curve,radius1,radius2):
    curve.Domain = rg.Interval(0,1)
    start_pt = rg.Curve.PointAt(curve,0)
    distance = rg.Point3d.DistanceTo(start_pt,points[-1])
    start_pl = rg.Plane(points[-1], rg.Vector3d(0,0,1))
    detect = rg.NurbsCurve.CreateFromEllipse(rg.Ellipse(start_pl,radius1, radius2))
    properties = rg.AreaMassProperties.Compute(contour)
    center_pl = rg.Plane(properties.Centroid,rg.Vector3d(0,0,1))
    scale = rg.Transform.Scale(center_pl, x, y,1)
    pt1= rg.Intersect.Intersection.CurveCurve(curve, detect,0,0)[0].PointA
    pt2= rg.Intersect.Intersection.CurveCurve(curve, detect,0,0)[1].PointA
    points = []
    if index==0:
        points.append(pt1)
    else:
        points.append(pt2)
    return points

def find_gap(point_last, point_first,curve,radius1,radius2):
    last_pl=rg.Plane(point_last, rg.Vector3d(0,0,1))
    detect = rg.NurbsCurve.CreateFromEllipse(rg.Ellipse(last_pl,radius1, radius2))
    intersect= rg.Intersect.Intersection.CurveCurve(curve, detect,0,0)[0].PointA
    gap = rg.Point3d.DistanceTo(intersect,point_first)
    return gap


pt_tree = []
for j, contour in enumerate(contours):
    contour.Domain = rg.Interval(0,1)
    p1 = rg.Curve.PointAt(contour,0)

    contour.Transform(scale)
    t=0
    i=0
    pts =[]
    t_values = []
    t_values.append(t)
    pts.append(p1)
    while i<30:
        points = find_nextpoint(i,pts,contour,r1,r2)
        if i<2:
            pts.append(points[-1])
            i+=1
        elif i>2 and t_values[-1] > 1-t_values[2]:
            break
        else:
            pts.append(points[-1])
            i+=1
        t = rg.Curve.ClosestPoint(contour, points[-1], 0)[1]
        t_values.append(t)
    gap = find_gap(pts[-1],pts[0],contour,r1,r2)
    pt_tree.append(pts)

pt_tree = th.list_to_tree(pt_tree)
# ---------- end python_6 ----------
pt_4 = Point(python_4.pts)
ellipse_8 = Ellipse(Plane=item_6, Radius1=division_2, Radius2=division)  # -> Ellipse, Focus1, Focus2

move_3 = Move(Geometry=brep_2, Motion=python_2.pt_tree)  # -> Geometry, Transform
preview_3 = CustomPreview(Geometry=move_3.Geometry, Material=ColourSwatch(SwatchColor=RGB(186, 166, 132)))

ellipse_9 = Ellipse(Plane=pt_3, Radius1=division_2, Radius2=division)  # -> Ellipse, Focus1, Focus2
panel = Panel(python_4.t_values)
bbox = BoundingBox(Content=ellipse_9.Ellipse, Plane=PlaneXY(0, 0, 0))  # -> Box, Box_2
pt_5 = Point(python_6.pts)

ellipse_10 = Ellipse(Plane=item_5, Radius1=division_2, Radius2=division)  # -> Ellipse, Focus1, Focus2
ellipse_11 = Ellipse(Plane=item_5, Radius1=number_slider, Radius2=number_slider_2)  # -> Ellipse, Focus1, Focus2
ccx_4 = CurveCurve(CurveA=ellipse_11.Ellipse, CurveB=crv)  # -> Points, ParamsA, ParamsB
item_10 = ListItem(List=ccx_4.Points, Index=Slider(1, range=0..1), Wrap=True)

item_11 = ListItem(List=python_6.pts, Index="0", Wrap=True)
item_12 = ListItem(List=python_6.pts, Index="-1", Wrap=True)
ellipse_12 = Ellipse(Plane=python_6.pt_tree, Radius1=division_2, Radius2=division)  # -> Ellipse, Focus1, Focus2
panel_2 = Panel(python.pts)
ellipse_13 = Ellipse(Plane=item_12, Radius1=number_slider, Radius2=number_slider_2)  # -> Ellipse, Focus1, Focus2
ellipse_14 = Ellipse(Plane=item_11, Radius1=division_2, Radius2=division)  # -> Ellipse, Focus1, Focus2
ccx_5 = CurveCurve(CurveA=ellipse_13.Ellipse, CurveB=scale_nu_2.Geometry)  # -> Points, ParamsA, ParamsB
item_13 = ListItem(List=ccx_5.Points, Index=Slider(1, range=0..1), Wrap=True)

ellipse_15 = Ellipse(Plane=item_10, Radius1=division_2, Radius2=division)  # -> Ellipse, Focus1, Focus2
ellipse_16 = Ellipse(Plane=item_10, Radius1=number_slider, Radius2=number_slider_2)  # -> Ellipse, Focus1, Focus2
ccx_6 = CurveCurve(CurveA=ellipse_16.Ellipse, CurveB=crv)  # -> Points, ParamsA, ParamsB
item_14 = ListItem(List=ccx_6.Points, Index=Slider(1, range=0..1), Wrap=True)

dist_2 = Distance(PointA=item_13, PointB=item_11)
galapagos_2 = Galapagos(fitness=dist_2, gene=[number_slider_6, number_slider_7])

ellipse_17 = Ellipse(Plane=item_14, Radius1=division_2, Radius2=division)  # -> Ellipse, Focus1, Focus2
ellipse_18 = Ellipse(Plane=item_14, Radius1=number_slider, Radius2=number_slider_2)  # -> Ellipse, Focus1, Focus2
ccx_7 = CurveCurve(CurveA=ellipse_18.Ellipse, CurveB=crv)  # -> Points, ParamsA, ParamsB
item_15 = ListItem(List=ccx_7.Points, Index=Slider(1, range=0..1), Wrap=True)
