# Grasshopper definition Pattern Grid_Optimization.gh (Grasshopper 1.0.7)
# plug-ins: Wallacei

genes = GenePool(
    Decimals=2,
    Maximum=1.05,
    Minimum=0.95,
    Value=[0.98, 1.02, 1.04, 1.02, 1.04, 1.01, 0.97, 0.95, 0.96, 1.04, 0.97, 0.95, 0.96, 0.96, 1, 1.02, 1.04, 1.03, 1.01, 1, 0.96, 0.96, 0.95])
genes_2 = GenePool(
    Decimals=2,
    Maximum=1,
    Minimum=0.9,
    Value=[0.94, 0.91, 0.97, 0.98, 0.91, 0.91, 0.95, 0.93, 0.96, 0.99, 0.95, 0.95, 0.97, 0.92, 0.94, 0.93, 0.92, 0.93, 0.92, 0.99, 0.94, 0.92, 0.96])
number_slider = Slider(70, range=0..100)
number_slider_2 = Slider(150, range=0..1000)
brep = Brep(<brep referenced from the Rhino model>)

# ----
# Single Unit
brep_2 = Brep(<brep referenced from the Rhino model>)

python = GhPythonScript(
    column=brep,
    layer_height=Slider(62.5, range=0..100),
    unit_width=number_slider,
    unit_length=number_slider_2,
    seam_shift=Slider(0.04, range=0.01..0.1),
    x_list=genes_2,
    y_list=genes)  # -> out, contours, start_pts, pt_tree, gap_pts, gap_values, last_pts; inputs column: Brep, x_list: list, y_list: list
# ---------- python: Python ----------
import Rhino.Geometry as rg
import rhinoscriptsyntax as rs
import math as m
import System, clr
from System import Array
from ghpythonlib import treehelpers as th

def curve_to_points(curve, division, index):
    if curve.IsClosed:
        curve.Domain = rg.Interval(0,1)
        start_t = rg.Curve.ChangeClosedCurveSeam(curve, index*seam_shift)
        start_pt = rg.Curve.PointAt(curve, start_t)
        pts_t = rg.Curve.DivideByCount(curve,division, True)
        pts = []
        for i in range(len(pts_t)):
            pt = curve.PointAt(pts_t[i])
            pts.append(pt)
    else:
        pts = rg.Curve.DivideByCount(curve,division, False)
        pts = []
        for i in range(len(pts_t)):
            pt = curve.PointAt(pts_t[i])
            pts.append(pt)
    return pts

def find_nextpoint(index,points,curve,radius1,radius2):
    curve.Domain = rg.Interval(0,1)
    start_pt = rg.Curve.PointAt(curve,0)
    start_pl = rg.Plane(points[-1], rg.Vector3d(0,0,1))
    detect = rg.NurbsCurve.CreateFromEllipse(rg.Ellipse(start_pl,radius1, radius2))
    pt1= rg.Intersect.Intersection.CurveCurve(curve, detect,0,0)[0].PointA
    pt2= rg.Intersect.Intersection.CurveCurve(curve, detect,0,0)[1].PointA
    points = []
    if index==0:
        points.append(pt1)
    else:
        points.append(pt2)
    return points

def curve_rescale(index, curve ,x_list, y_list):
    properties = rg.AreaMassProperties.Compute(curve)
    center_pt = properties.Centroid
    scale = rg.Transform.Scale(rg.Plane(center_pt,rg.Vector3d(0,0,1)),x_list[index],y_list[index],1)
    curve.Transform(scale)
    return curve

column_bbx = column.GetBoundingBox(True)
up_edge = column.Edges[1]
dn_edge = column.Edges[2]
contour_startpt = rg.BoundingBox.PointAt(column_bbx, 0,0,0)
contour_endpt = rg.BoundingBox.PointAt(column_bbx, 0,0,1)
contours = rg.Brep.CreateContourCurves(column, contour_startpt, contour_endpt, layer_height)
r1= unit_width
r2= unit_length

pt_tree =[]
start_pts= []
last_pts=[]
gap_pts = []
gap_values = []
for j, contour in enumerate(contours):
    contour = curve_rescale(j,contour,x_list,y_list)
    contour.Domain = rg.Interval(0,1)
    start_t = j*seam_shift
    start_pt = rg.Curve.PointAt(contour, start_t)
    seam = rg.Curve.ChangeClosedCurveSeam(contour, start_t)
    start_pts.append(start_pt)
    i=0
    pts =[]
    pts.append(start_pt)
    while i<30:
        points = find_nextpoint(i,pts,contour,r1,r2)
        detect_pt= points[-1]
        start_pl = rg.Plane(start_pt, rg.Vector3d(0,0,1))
        detect_pl = rg.Plane(detect_pt, rg.Vector3d(0,0,1))
        detect = rg.NurbsCurve.CreateFromEllipse(rg.Ellipse(detect_pl,r1/2, r2/2))
        start = rg.NurbsCurve.CreateFromEllipse(rg.Ellipse(start_pl,r1/2, r2/2))
        ccx_event= len(rg.Intersect.Intersection.CurveCurve(start, detect,0,0))
        if i<2:
            pts.append(points[-1])
            i+=1
        elif i>2 and ccx_event>1:
            break
        else:
            pts.append(points[-1])
            i+=1
        last_pl =rg.Plane(pts[-1], rg.Vector3d(0,0,1))
        last_ellipse=rg.NurbsCurve.CreateFromEllipse(rg.Ellipse(last_pl,r1/2,r2/2))
        gap_pt=rg.Intersect.Intersection.CurveCurve(contour, last_ellipse,0,0)[1].PointA
        gap = rg.Point3d.DistanceTo(start_pt,gap_pt)
    pt_tree.append(pts)
    last_pts.append(pts[-1])
    gap_values.append(gap)
    gap_pts.append(gap_pt)

pt_tree = th.list_to_tree(pt_tree)
# ---------- end python ----------

sph = Sphere(Base=python.start_pts, Radius=Slider(10, range=0..10))
preview = CustomPreview(Geometry=sph, Material=ColourSwatch(SwatchColor=RGB(0, 72, 255)))

sph_2 = Sphere(Base=python.gap_pts, Radius=Slider(10, range=0..10))
preview_2 = CustomPreview(Geometry=sph_2, Material=ColourSwatch(SwatchColor=RGB(255, 0, 0)))

volume = Volume(Geometry=brep_2)  # -> Volume, Centroid

sph_3 = Sphere(Base=python.last_pts, Radius=Slider(10, range=0..10))
preview_3 = CustomPreview(Geometry=sph_3, Material=ColourSwatch(SwatchColor=RGB(21, 255, 0)))

rot3d = Rotate3D(Geometry=brep_2, Angle=1.570796327, Center=volume.Centroid, Axis=Vector(0, 0, 1))  # -> Geometry, Transform
pt = Point(python.pt_tree)

move = Move(Geometry=brep_2, Motion=python.pt_tree)  # -> Geometry, Transform
preview_4 = CustomPreview(Geometry=move.Geometry, Material=ColourSwatch(SwatchColor=RGB(186, 166, 132)))

move_2 = Move(Geometry=brep_2, Motion=python.pt_tree)  # -> Geometry, Transform
preview_5 = CustomPreview(Geometry=move_2.Geometry, Material=ColourSwatch(SwatchColor=RGB(186, 166, 132)))
wallacei_x = WallaceiX(
    Objectives=python.gap_values,
    Phenotype=pt,
    allFitness="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",
    allFrontIdx="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",
    allGenomes="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",
    curFrontIdx="29|0;29|1;29|2;29|3;29|4;29|5;29|6;29|7;29|8;29|9;29|10;29|11;29|12;29|13;29|14",
    curFrontIdxSave="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",
    popGen="15,30",
    total="100172",
    wlcDone=True)  # -> WallaceiGenomes, FitnessValues, Data, WPhenotypes; disabled
pdecoder = DecodePhenotype(WallaceiPhenotype=wallacei_x.WPhenotypes)  # -> GeometriesList, MeshesList, NumbersList, TextList
item = ListItem(List=python.contours, Index=Slider(0, range=0..100), Wrap=True)

number_slider_3 = Slider(0.95, range=0.95..1.05)
number_slider_4 = Slider(0.95, range=0.95..1.05)
area = Area(Geometry=item)  # -> Area, Centroid
scale_nu = ScaleNU(Geometry=item, Plane=area.Centroid, ScaleX=number_slider_4, ScaleY=number_slider_3, ScaleZ=Slider(1, range=0..1))  # -> Geometry, Transform

python_2 = GhPythonScript(contour=item, r1=number_slider, r2=number_slider_2)  # -> out, contour, pts, t_values, t_remap, pts_remap; inputs contour: Curve
# ---------- python_2: Python ----------
import rhinoscriptsyntax as rs
import Rhino.Geometry as rg

def find_nextpoint(index,points,curve,radius1,radius2):
    curve.Domain = rg.Interval(0,1)
    start_pt = rg.Curve.PointAt(curve,0)
    start_pl = rg.Plane(points[-1], rg.Vector3d(0,0,1))
    detect = rg.NurbsCurve.CreateFromEllipse(rg.Ellipse(start_pl,radius1, radius2))
    pt1= rg.Intersect.Intersection.CurveCurve(curve, detect,0,0)[0].PointA
    pt2= rg.Intersect.Intersection.CurveCurve(curve, detect,0,0)[1].PointA
    points = []
    if index==0:
        points.append(pt1)
    else:
        points.append(pt2)
    return points

contour.Domain = rg.Interval(0,1)
p1 = rg.Curve.PointAt(contour,0)
t=0
i=0
pts =[]
t_values = []
t_values.append(t)
pts.append(p1)

while i<30:
    points = find_nextpoint(i,pts,contour,r1,r2)
    detect_pt= points[-1]
    start_pl = rg.Plane(p1, rg.Vector3d(0,0,1))
    detect_pl = rg.Plane(detect_pt, rg.Vector3d(0,0,1))
    detect = rg.NurbsCurve.CreateFromEllipse(rg.Ellipse(detect_pl,r1/2, r2/2))
    start = rg.NurbsCurve.CreateFromEllipse(rg.Ellipse(start_pl,r1/2, r2/2))
    ccx_event= len(rg.Intersect.Intersection.CurveCurve(start, detect,0,0))
    print (ccx_event)
    if i<2:
        pts.append(points[-1])
        i+=1
    elif i>2 and ccx_event>1:
        break
    else:
        pts.append(points[-1])
        i+=1
    t = rg.Curve.ClosestPoint(contour, points[-1], 0)[1]
    t_values.append(t)

#pts_remap = []
#t_remap = []
#for i,t in enumerate(t_values):
#    gap = (1-max(t_values))/13
#    t= t+gap*i
#    t_remap.append(t)
#    pt = rg.Curve.PointAt(contour,t)
#    pts_remap.append(pt)
# ---------- end python_2 ----------
pt_2 = Point(pdecoder.GeometriesList)
move_3 = Move(Geometry=brep_2, Motion=pt_2)  # -> Geometry, Transform
preview_6 = CustomPreview(Geometry=move_3.Geometry, Material=ColourSwatch(SwatchColor=RGB(186, 166, 132)))

move_4 = Move(Geometry=brep_2, Motion=python_2.pts)  # -> Geometry, Transform
preview_7 = CustomPreview(Geometry=move_4.Geometry, Material=ColourSwatch(SwatchColor=RGB(186, 166, 132)))

python_3 = GhPythonScript(contour=scale_nu.Geometry, r1=number_slider, r2=number_slider_2, x=Slider(20, range=0..20))  # -> out, contour, pts, t_values; inputs contour: Curve
# ---------- python_3: Python ----------
import rhinoscriptsyntax as rs
import Rhino.Geometry as rg

def find_nextpoint(index,points,curve,radius1,radius2):
    curve.Domain = rg.Interval(0,1)
    start_pt = rg.Curve.PointAt(curve,0)
    distance = rg.Point3d.DistanceTo(start_pt,points[-1])
    start_pl = rg.Plane(points[-1], rg.Vector3d(0,0,1))
    detect = rg.NurbsCurve.CreateFromEllipse(rg.Ellipse(start_pl,radius1, radius2))
    pt1= rg.Intersect.Intersection.CurveCurve(curve, detect,0,0)[0].PointA
    pt2= rg.Intersect.Intersection.CurveCurve(curve, detect,0,0)[1].PointA
    points = []
    if index==0:
        points.append(pt1)
    else:
        points.append(pt2)
    return points

contour.Domain = rg.Interval(0,1)
p1 = rg.Curve.PointAt(contour,0)
t=0
i=0
pts =[]
t_values = []
t_values.append(t)
pts.append(p1)


while i<x:
    points = find_nextpoint(i,pts,contour,r1,r2)
    if i<2:
        pts.append(points[-1])
        i+=1
    elif i>2 and t_values[-1] > 1-t_values[2]:
        break
    else:
        pts.append(points[-1])
        i+=1
    t = rg.Curve.ClosestPoint(contour, points[-1], 0)[1]
    t_values.append(t)


#print max(t_values)
#pts_remap = []
#t_remap = []
#for i,t in enumerate(t_values):
#    gap = (1-max(t_values))/13
#    t= t+gap*i
#    t_remap.append(t)
#    pt = rg.Curve.PointAt(contour,t)
#    pts_remap.append(pt)
# ---------- end python_3 ----------
ellipse = Ellipse(Plane=python_3.pts, Radius1=35, Radius2=75)  # -> Ellipse, Focus1, Focus2
pt_3 = Point(python_2.pts)
item_2 = ListItem(List=python_2.pts, Index="0", Wrap=True)
item_3 = ListItem(List=python_2.pts, Index="-1", Wrap=True)
ellipse_2 = Ellipse(Plane=python.last_pts, Radius1=number_slider, Radius2=number_slider_2)  # -> Ellipse, Focus1, Focus2
galapagos = Galapagos(fitness=dist, gene=[number_slider_4, number_slider_3])

ellipse_3 = Ellipse(Plane=item_3, Radius1=35, Radius2=75)  # -> Ellipse, Focus1, Focus2
ellipse_4 = Ellipse(Plane=item_3, Radius1=number_slider, Radius2=number_slider_2)  # -> Ellipse, Focus1, Focus2

ccx = CurveCurve(CurveA=ellipse_4.Ellipse, CurveB=scale_nu.Geometry)  # -> Points, ParamsA, ParamsB
item_4 = ListItem(List=ccx.Points, Index=Slider(1, range=0..1), Wrap=True)
dist = Distance(PointA=item_4, PointB=item_2)

preview_8 = CustomPreview(Geometry=ellipse_2.Ellipse, Material=ColourSwatch(SwatchColor=RGB(0, 0, 0)))
