# Grasshopper definition Pattern Grid_first.gh (Grasshopper 1.0.7)

brep = Brep(<brep referenced from the Rhino model>)
# StraightColumn
dom = ConstructDomain(DomainStart=0, DomainEnd=1)
# Single Unit
brep_2 = Brep(<brep referenced from the Rhino model>)
python = GhPythonScript(
    column=brep,
    Layer_height=Slider(25, range=0..100),
    Unit_width=Slider(70, range=0..100),
    Unit_length=Slider(150, range=0..1000),
    Unit_Interval=dom,
    SeamRotate=Slider(0.08, range=0.01..0.1))  # -> out, Contour_bbxs, Contours, StartPts, Pt_tree; inputs column: Brep
# ---------- python: Python ----------
import Rhino.Geometry as rg
import rhinoscriptsyntax as rs
from ghpythonlib import treehelpers as th

column_bbx = column.GetBoundingBox(True)
Contour_StartPt = rg.BoundingBox.PointAt(column_bbx, 0,0,0)
Contour_EndPt = rg.BoundingBox.PointAt(column_bbx, 0,0,1)
Contours = rg.Brep.CreateContourCurves(column, Contour_StartPt, Contour_EndPt, Layer_height)


StartPts = []
Pt_tree = []

for i,Contour in enumerate(Contours):
    Contour.Domain = rg.Interval(0,1)
    Start_t = i*SeamRotate
    Start_pt = rg.Curve.ChangeClosedCurveSeam(Contour,Start_t)
    StartPt = rg.Curve.PointAt(Contour, Start_t)
    DivideNum = int(rg.Curve.GetLength(Contour)/Unit_width)
    StartPts.append(StartPt)
    Shots = []
    for j in range(DivideNum):
        Shot = rg.Curve.PointAt(Contour, Start_t+float(j/DivideNum))
        if i == 0:
                    print (j/DivideNum)
        Shots.append(Shot)
    Pt_tree.append(Shots)

Pt_tree = th.list_to_tree(Pt_tree)
# ---------- end python ----------
volume = Volume(Geometry=brep_2)  # -> Volume, Centroid
rot3d = Rotate3D(Geometry=brep_2, Angle=1.570796327, Center=volume.Centroid, Axis=Vector(0, 0, 1))  # -> Geometry, Transform
scale = Scale(Geometry=brep_2, Center=volume.Centroid, Factor=Slider(1.2, range=0..10))  # -> Geometry, Transform
pt = Point(python.Pt_tree)
move = Move(Geometry=rot3d.Geometry, Motion=python.Pt_tree)  # -> Geometry, Transform
flatten = FlattenTree(Tree=python.Pt_tree, Path="{0}")
brep_3 = Brep(python.Contour_bbxs)
crv = Curve(python.Contours)
move_2 = Move(Geometry=scale.Geometry, Motion=python.StartPts)  # -> Geometry, Transform
preview = CustomPreview(Geometry=move.Geometry, Material=ColourSwatch(SwatchColor=RGB(158, 149, 125)))
viewer = ParamViewer(python.Pt_tree)
preview_2 = CustomPreview(Geometry=move_2.Geometry, Material=ColourSwatch(SwatchColor=RGB(92, 92, 92)))
unit_length = Slider(15, range=0..100)
number_slider = Slider(70, range=0..100)
# 20230113
number_slider_2 = Slider(150, range=0..1000)
dom_2 = ConstructDomain(DomainStart=0, DomainEnd=1)
number_slider_3 = Slider(0.2, range=0.1..0.5)
number_slider_4 = Slider(0.1, range=0.1..0.2)
number_slider_5 = Slider(0.2, range=0.1..0.5)
dom_3 = ConstructDomain(DomainStart=0, DomainEnd=1)
brep_4 = Brep(<brep referenced from the Rhino model>)
brep_5 = Brep(<brep referenced from the Rhino model>)

# ----
# Single Unit
brep_6 = Brep(<brep referenced from the Rhino model>)

# ----
# First Attempt
number_slider_6 = Slider(150, range=0..1000)
brep_7 = Brep(<brep referenced from the Rhino model>)
dom_4 = ConstructDomain(DomainStart=0, DomainEnd=1)
python_2 = GhPythonScript(
    column=brep_7,
    Layer_height=Slider(25, range=0..100),
    Unit_width=Slider(70, range=0..100),
    Unit_length=number_slider_6,
    Unit_Interval=dom_4,
    SeamRotate=Slider(0.04, range=0.01..0.1))  # -> out, Contour_bbxs, Contours, StartPts, Pt_tree; inputs column: Brep; same code as python
volume_2 = Volume(Geometry=brep_6)  # -> Volume, Centroid
rot3d_2 = Rotate3D(Geometry=brep_6, Angle=1.570796327, Center=volume_2.Centroid, Axis=Vector(0, 0, 1))  # -> Geometry, Transform
scale_2 = Scale(Geometry=brep_6, Center=volume_2.Centroid, Factor=Slider(1.2, range=0..10))  # -> Geometry, Transform
pt_2 = Point(python_2.Pt_tree)
move_3 = Move(Geometry=rot3d_2.Geometry, Motion=python_2.Pt_tree)  # -> Geometry, Transform
flatten_2 = FlattenTree(Tree=python_2.Pt_tree, Path="{0}")
brep_8 = Brep(python_2.Contour_bbxs)
crv_2 = Curve(python_2.Contours)
move_4 = Move(Geometry=scale_2.Geometry, Motion=python_2.StartPts)  # -> Geometry, Transform
preview_3 = CustomPreview(Geometry=move_3.Geometry, Material=ColourSwatch(SwatchColor=RGB(158, 149, 125)))
viewer_2 = ParamViewer(python_2.Pt_tree)
preview_4 = CustomPreview(Geometry=move_4.Geometry, Material=ColourSwatch(SwatchColor=RGB(92, 92, 92)))

number_slider_7 = Slider(0.4, range=0..1)
brep_9 = Brep(<brep referenced from the Rhino model>)
brep_10 = Brep(<brep referenced from the Rhino model>)
# Single Unit
brep_11 = Brep(<brep referenced from the Rhino model>)

# ----
# Single Unit
brep_12 = Brep(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)

# ----
# Single Unit
brep_13 = Brep(<brep referenced from the Rhino model>)
python_3 = GhPythonScript(
    column=brep_4,
    Layer_height=Slider(6.25, range=0..10),
    Unit_width=Slider(7, range=0..10),
    Unit_length=unit_length,
    Unit_Interval=dom_3,
    SeamRotate=Slider(0.02, range=0.01..0.1))  # -> out, Contour_StartPt, Contour_EndPt, Contour_bbxs, Contours, Centerlines, StartPts, Pt_tree; inputs column: Brep
# ---------- python_3: Python ----------
import Rhino.Geometry as rg
import rhinoscriptsyntax as rs
import copy
from ghpythonlib import treehelpers as th

Unit_length = Unit_length*2

column_bbx = column.GetBoundingBox(True)
print type(column_bbx)
Contour_StartPt = rg.BoundingBox.PointAt(column_bbx, 0,0,0)
Contour_EndPt = rg.BoundingBox.PointAt(column_bbx, 0,0,1)
Contours = rg.Brep.CreateContourCurves(column, Contour_StartPt, Contour_EndPt, Layer_height)


StartPts = []
Pt_tree = []
Contour_bbxs = []
Centerlines = []
for i,Contour in enumerate(Contours):
    Contour_bbx = Contour.GetBoundingBox(True)
    L = Contour_bbx.GetEdges()[0]
    W = Contour_bbx.GetEdges()[1]
    Length = L.Length
    Width = W.Length
    factor_L = (Length-Unit_length)/Length
    factor_W = (Width-Unit_width)/Width
    Scale = rg.Transform.Scale(rg.Plane(Contour_bbx.Center, rg.Vector3d(0,0,1)), factor_W, factor_L, 0)
    Centerline = copy.copy(Contour)
    Centerline.Transform(Scale)
    Centerlines.append(Centerline)
    Centerline.Domain = rg.Interval(0,1)
    Start_t = i*SeamRotate
    Start_pt = rg.Curve.ChangeClosedCurveSeam(Centerline,Start_t)
    StartPt = rg.Curve.PointAt(Centerline, Start_t)
    DivideNum = int(rg.Curve.GetLength(Contour)/Unit_width)
    StartPts.append(StartPt)
    Contour_bbxs.append(Contour_bbx)
    Shots = []
    for j in range(DivideNum):
        Shot = rg.Curve.PointAt(Contour, Start_t+j/DivideNum)
        Shots.append(Shot)
    Pt_tree.append(Shots)

Pt_tree = th.list_to_tree(Pt_tree)
# ---------- end python_3 ----------
# Single Unit
brep_14 = Brep(<brep referenced from the Rhino model>)
volume_3 = Volume(Geometry=brep_11)  # -> Volume, Centroid
python_4 = GhPythonScript(
    column=brep_5,
    layer_height=Slider(62.5, range=0..100),
    unit_width=number_slider,
    unit_length=number_slider_2,
    unit_interval=dom_2,
    seam_rotate=Slider(0.03, range=0.01..0.1))  # -> out, up_edge, dn_edge, column_tween, contour_bbxs, contours, startPts, pt_tree; inputs column: Brep
# ---------- python_4: Python ----------
import Rhino.Geometry as rg
import rhinoscriptsyntax as rs
from ghpythonlib import treehelpers as th

column_bbx = column.GetBoundingBox(True)
up_edge = column.Edges[1]
dn_edge = column.Edges[2]


contour_startpt = rg.BoundingBox.PointAt(column_bbx, 0,0,0)
contour_endpt = rg.BoundingBox.PointAt(column_bbx, 0,0,1)
contours = rg.Brep.CreateContourCurves(column, contour_startpt, contour_endpt, layer_height)


startPts = []
pt_tree = []

for i,contour in enumerate(contours):
    contour.Domain = rg.Interval(0,1)
    start_t = i*seam_rotate
    start_pt = rg.Curve.ChangeClosedCurveSeam(contour,start_t)
    startPt = rg.Curve.PointAt(contour, start_t)
    divideNum = int(rg.Curve.GetLength(contour)/unit_width)
    startPts.append(startPt)
    shots = []
    for j in range(divideNum):
        shot = rg.Curve.PointAt(contour, start_t+float(j/divideNum))
        shots.append(shot)
    pt_tree.append(shots)


pt_tree = th.list_to_tree(pt_tree)
# ---------- end python_4 ----------
python_5 = GhPythonScript(
    column=brep_9,
    layer_height=Slider(62.5, range=0..100),
    unit_width=Slider(70, range=0..100),
    unit_length=Slider(150, range=0..1000),
    seam_shift=Slider(0.01, range=0.01..0.1))  # -> out, up_edge, dn_edge, contours, start_edge, pts, pt_tree; inputs column: Brep
# ---------- python_5: Python ----------
import Rhino.Geometry as rg
import rhinoscriptsyntax as rs
import math as m
from ghpythonlib import treehelpers as th

column_bbx = column.GetBoundingBox(True)
up_edge = column.Edges[1]
dn_edge = column.Edges[2]


contour_startpt = rg.BoundingBox.PointAt(column_bbx, 0,0,0)
contour_endpt = rg.BoundingBox.PointAt(column_bbx, 0,0,1)
contours = rg.Brep.CreateContourCurves(column, contour_startpt, contour_endpt, layer_height)

start_edge = contours[0]

lengths = []
for i,contour in enumerate(contours):
    length = contour.GetLength()
    lengths.append(length)


pt_tree = []
division = 0
for i,(length, contour) in enumerate(zip(lengths,contours)):
    divisions = []
    pts = []
    start_pts = []
    if i ==0:
        first_division = int(lengths[0]/unit_width)
        divisions.append(division)
        division = first_division
        for j in range(int(division)):
            contours[0].Domain= rg.Interval(0,1)
            start_t = j*seam_shift
#            seam = rg.Curve.ChangeClosedCurveSeam(contours[0],start_t)
#            start_pt = rg.Curve.PointAt(contours[0],start_t)
            pt = rg.Curve.PointAt(contours[0], float(j/division))
            pts.append(pt)
#            start_pts.append(start_pt)
    else:
        difference = abs(lengths[i]-lengths[i-1])
        if difference <0.4*unit_width:
            division = division
#            pass
        else:
            division= division-m.ceil(difference/unit_width)
        for j in range(int(division)):
            contours[i].Domain= rg.Interval(0,1)
            start_t = j*seam_shift
#            seam = rg.Curve.ChangeClosedCurveSeam(contours[i],start_t)
#            start_pt = rg.Curve.PointAt(contours[i],start_t)
            pt = rg.Curve.PointAt(contours[i], start_t+float(j/division))
            pts.append(pt)
#            start_pts.append(start_pt)
    pt_tree.append(pts)

pt_tree = th.list_to_tree(pt_tree)
# ---------- end python_5 ----------
volume_4 = Volume(Geometry=brep_13)  # -> Volume, Centroid
python_6 = GhPythonScript(
    column=brep_10,
    layer_height=Slider(62.5, range=0..100),
    unit_width=Slider(70, range=0..100),
    unit_length=Slider(150, range=0..1000),
    seam_shift=Slider(0.01, range=0.01..0.1))  # -> out, up_edge, dn_edge, contours, start_edge, pts, pt_tree; inputs column: Brep
# ---------- python_6: Python ----------
import Rhino.Geometry as rg
import rhinoscriptsyntax as rs
import math as m
import System, clr
from ghpythonlib import treehelpers as th

column_bbx = column.GetBoundingBox(True)
up_edge = column.Edges[1]
dn_edge = column.Edges[2]


contour_startpt = rg.BoundingBox.PointAt(column_bbx, 0,0,0)
contour_endpt = rg.BoundingBox.PointAt(column_bbx, 0,0,1)
contours = rg.Brep.CreateContourCurves(column, contour_startpt, contour_endpt, layer_height)

start_edge = contours[0]

lengths = []
for i,contour in enumerate(contours):
    length = contour.GetLength()
    lengths.append(length)



division = 0
for i,(length, contour) in enumerate(zip(lengths,contours)):
    divisions = []
    pts= clr.StrongBox[System.Array[rg.Point3d]]()
    pt_tree = []
    if i ==0:
        first_division = int(lengths[0]/unit_width)
        divisions.append(division)
        division = first_division
        pts = rg.Curve.DivideByCount(contours[0],division, False, pts)
        pt_tree.append(pts)
    else:
        difference = abs(lengths[i]-lengths[i-1])
        if difference <0.4*unit_width:
            division = division
#            pass
        else:
            division= division-m.ceil(difference/unit_width)
            pts = rg.Curve.DivideByCount(contours[i],division, False, pts)
            pt_tree.append(pts)

pt_tree = th.list_to_tree(pt_tree)
# ---------- end python_6 ----------
volume_5 = Volume(Geometry=brep_14)  # -> Volume, Centroid
rot3d_3 = Rotate3D(Geometry=brep_11, Angle=1.570796327, Center=volume_3.Centroid, Axis=Vector(0, 0, 1))  # -> Geometry, Transform
rot3d_4 = Rotate3D(Geometry=brep_13, Angle=1.570796327, Center=volume_4.Centroid, Axis=Vector(0, 0, 1))  # -> Geometry, Transform
flatten_3 = FlattenTree(Tree=python_3.Pt_tree, Path="{0}")
rot3d_5 = Rotate3D(Geometry=brep_14, Angle=1.570796327, Center=volume_5.Centroid, Axis=Vector(0, 0, 1))  # -> Geometry, Transform
move_5 = Move(Geometry=brep_12, Motion=python_3.StartPts)  # -> Geometry, Transform
pt_3 = Point(python_3.Pt_tree)
crv_3 = Curve(python_3.Centerlines)
pt_4 = Point(python_3.Contour_StartPt)
pt_5 = Point(python_3.Contour_EndPt)
crv_4 = Curve(python_3.Contours)
brep_15 = Brep(python_3.Contour_bbxs)
pt_6 = Point(python_5.pt_tree)
python_7 = GhPythonScript(x=python_5.pt_tree)  # -> out, a
# ---------- python_7: Python ----------
__author__ = "jiang"
__version__ = "2023.01.15"

import rhinoscriptsyntax as rs
x = a
# ---------- end python_7 ----------
crv_5 = Curve(python_4.up_edge)
crv_6 = Curve(python_4.dn_edge)
crv_7 = Curve(python_4.column_tween)
brep_16 = Brep(python_4.contour_bbxs)
crv_8 = Curve(python_4.contours)
pt_7 = Point(python_4.pt_tree)
move_6 = Move(Geometry=rot3d_3.Geometry, Motion=python_4.pt_tree)  # -> Geometry, Transform
sph = Sphere(Base=python_3.StartPts, Radius=2)
move_7 = Move(Geometry=brep_13, Motion=python_5.pt_tree)  # -> Geometry, Transform
python_8 = GhPythonScript(x=python_6.pts)  # -> out, a; same code as python_7
pt_8 = Point(python_8.a)
move_8 = Move(Geometry=brep_14, Motion=python_6.pt_tree)  # -> Geometry, Transform
preview_5 = CustomPreview(Geometry=move_5.Geometry, Material=ColourSwatch(SwatchColor=RGB(186, 166, 132)))
preview_6 = CustomPreview(Geometry=move_6.Geometry, Material=ColourSwatch(SwatchColor=RGB(186, 166, 132)))
preview_7 = CustomPreview(Geometry=move_7.Geometry, Material=ColourSwatch(SwatchColor=RGB(186, 166, 132)))
preview_8 = CustomPreview(Geometry=move_8.Geometry, Material=ColourSwatch(SwatchColor=RGB(186, 166, 132)))
viewer_3 = ParamViewer(python_3.Pt_tree)
python_9 = GhPythonScript(unit_width=number_slider, up_edge=crv_5, dn_edge=crv_6, t=Slider(0, range=0..1), shift=Slider(0.041, range=0..1))  # -> out, up_pts, dn_pts; inputs up_edge: Curve, dn_edge: Curve
# ---------- python_9: Python ----------
import rhinoscriptsyntax as rs
import Rhino.Geometry as rg

up_edge.Domain = rg.Interval(0,1)
dn_edge.Domain = rg.Interval(0,1)
up_length = up_edge.GetLength()
dn_length = dn_edge.GetLength()
up_division = int(up_length/unit_width)
dn_division = int(dn_length/unit_width)
print dn_division

up_pts = []
for i in range(up_division):
    pt = rg.Curve.PointAt(up_edge, i/up_division)
    up_pts.append(pt)

dn_pts = []
for i in range(dn_division):
    pt = rg.Curve.PointAt(dn_edge, i/dn_division)
    dn_pts.append(pt)
# ---------- end python_9 ----------
pt_9 = Point(python_9.up_pts)

# ----
# Load classes from src
button = Button()
add_paths_from_local_dir = GhPythonScript(reload=button)  # -> dire
# ---------- add_paths_from_local_dir: Python ----------
import os
import sys

#get current file path
path = ghenv.Component.OnPingDocument().FilePath
#get parent directory of the parent directory
parentdir = os.path.dirname(os.path.dirname(path))
#go to root folder
root = os.path.dirname(parentdir)
#get src folder which contains classes
dire = os.path.join(root,'src')

print dire
#add path to sys
sys.path.append(dire)

ghenv.Component.Message = "paths added"

from compas_rhino import unload_modules

if reload:
    unload_modules("design")
    unload_modules("planning")
    
    unload_modules("ur_fabrication")
    
    ghenv.Component.Message = "paths updated"
# ---------- end add_paths_from_local_dir ----------
panel = Panel(add_paths_from_local_dir)

crv_9 = Curve(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)

# ----
# Single Unit
# First Attempt
number_slider_8 = Slider(150, range=0..1000)
brep_17 = Brep(<brep referenced from the Rhino model>)
dom_5 = ConstructDomain(DomainStart=0, DomainEnd=1)
brep_18 = Brep(<brep referenced from the Rhino model>)
python_10 = GhPythonScript(
    column=brep_17,
    Layer_height=Slider(25, range=0..100),
    Unit_width=Slider(70, range=0..100),
    Unit_length=number_slider_8,
    Unit_Interval=dom_5,
    SeamRotate=Slider(0.03, range=0.01..0.1))  # -> out, Contour_bbxs, Contours, StartPts, Pt_tree; inputs column: Brep; same code as python
volume_6 = Volume(Geometry=brep_18)  # -> Volume, Centroid
rot3d_6 = Rotate3D(Geometry=brep_18, Angle=1.570796327, Center=volume_6.Centroid, Axis=Vector(0, 0, 1))  # -> Geometry, Transform
scale_3 = Scale(Geometry=brep_18, Center=volume_6.Centroid, Factor=Slider(1.2, range=0..10))  # -> Geometry, Transform
pt_10 = Point(python_10.Pt_tree)
move_9 = Move(Geometry=rot3d_6.Geometry, Motion=python_10.Pt_tree)  # -> Geometry, Transform
flatten_4 = FlattenTree(Tree=python_10.Pt_tree, Path="{0}")
brep_19 = Brep(python_10.Contour_bbxs)
crv_10 = Curve(python_10.Contours)
move_10 = Move(Geometry=scale_3.Geometry, Motion=python_10.StartPts)  # -> Geometry, Transform
preview_9 = CustomPreview(Geometry=move_9.Geometry, Material=ColourSwatch(SwatchColor=RGB(158, 149, 125)))
viewer_4 = ParamViewer(python_10.Pt_tree)
preview_10 = CustomPreview(Geometry=move_10.Geometry, Material=ColourSwatch(SwatchColor=RGB(92, 92, 92)))

generate_design_from_crv = GhPythonScript(
    input_crv=crv_9,
    h_spacing=Slider(7.5, range=0..100),
    v_spacing=Slider(5, range=0..100),
    height=Slider(150, range=40..2000),
    prototype_name="straightWall",
    extra_text="Demo")  # -> points, global_design; inputs input_crv: Curve
# ---------- generate_design_from_crv: Python ----------
from design import GlobalDesign
from ghpythonlib.treehelpers import list_to_tree as _tree


prototype_identifier = prototype_name + "_" +  extra_text

global_design= GlobalDesign.design_from_curve(input_crv, h_spacing, height, v_spacing, prototype_identifier)

#generate uid
global_design.generate_uid_for_all_parts()
points = global_design.visualize()

#Convert to tree to visualize
points = _tree(points)
# ---------- end generate_design_from_crv ----------

# ----
# Single Unit
# First Attempt
number_slider_9 = Slider(150, range=0..1000)
brep_20 = Brep(<brep referenced from the Rhino model>)
dom_6 = ConstructDomain(DomainStart=0, DomainEnd=1)
brep_21 = Brep(<brep referenced from the Rhino model>)
python_11 = GhPythonScript(
    column=brep_20,
    Layer_height=Slider(25, range=0..100),
    Unit_width=Slider(70, range=0..100),
    Unit_length=number_slider_9,
    Unit_Interval=dom_6,
    SeamRotate=Slider(0.03, range=0.01..0.1))  # -> out, Contour_bbxs, Contours, StartPts, Pt_tree; inputs column: Brep; same code as python
volume_7 = Volume(Geometry=brep_21)  # -> Volume, Centroid
rot3d_7 = Rotate3D(Geometry=brep_21, Angle=1.570796327, Center=volume_7.Centroid, Axis=Vector(0, 0, 1))  # -> Geometry, Transform
scale_4 = Scale(Geometry=brep_21, Center=volume_7.Centroid, Factor=Slider(1.2, range=0..10))  # -> Geometry, Transform
pt_11 = Point(python_11.Pt_tree)
move_11 = Move(Geometry=rot3d_7.Geometry, Motion=python_11.Pt_tree)  # -> Geometry, Transform
flatten_5 = FlattenTree(Tree=python_11.Pt_tree, Path="{0}")
brep_22 = Brep(python_11.Contour_bbxs)
crv_11 = Curve(python_11.Contours)
move_12 = Move(Geometry=scale_4.Geometry, Motion=python_11.StartPts)  # -> Geometry, Transform
preview_11 = CustomPreview(Geometry=move_11.Geometry, Material=ColourSwatch(SwatchColor=RGB(158, 149, 125)))
viewer_5 = ParamViewer(python_11.Pt_tree)
preview_12 = CustomPreview(Geometry=move_12.Geometry, Material=ColourSwatch(SwatchColor=RGB(92, 92, 92)))

panel_2 = Panel(generate_design_from_crv.global_design)
number_slider_10 = Slider(20, range=0..100)
crv_12 = Curve(<curve referenced from the Rhino model>)
crv_13 = Curve(<curve referenced from the Rhino model>)
divide = DivideCurve(Curve=crv_13, Count=number_slider_10, Kinks=False)  # -> Points, Tangents, Parameters
divide_2 = DivideCurve(Curve=crv_12, Count=number_slider_10, Kinks=False)  # -> Points, Tangents, Parameters
plan_sequence = GhPythonScript(design=generate_design_from_crv.global_design, toolpath_volume=Slider(900, range=0..1000), n=Slider(0, range=0..15))  # -> sequencer, points, tool_curve, data; inputs toolpath_volume: Int32, n: Int32
# ---------- plan_sequence: Python ----------
from planning import ConstructionSequencer


sequencer = ConstructionSequencer(design, toolpath_volume)
sequencer.generate_toolpaths_continuous()

toolpath = sequencer.toolpaths[n]
toolpath.add_safety_points(setup = "UR")


points, tool_curve = toolpath.visualize_pts()
data = [toolpath.export_toolpath_to_UR()]
# ---------- end plan_sequence ----------
xy = XYPlane(Origin=Point(0, 0, 0))
metaball = MetaBall(Points=divide_2.Points, Plane=xy, Point=divide.Points)
parse_data = GhPythonScript(data=plan_sequence.data)  # -> planes, toggles, wait_times
# ---------- parse_data: Python ----------
planes = data['planes']
toggles = data['toggles']
wait_times = data['wait times']
# ---------- end parse_data ----------
pln = Plane(parse_data.planes)
panel_3 = Panel(parse_data.toggles)
