# Grasshopper definition print_execute_CJ.ghx (Grasshopper 1.0.7)
# plug-ins: Pufferfish

# ----
# Single Unit
# StraightColumn
number_slider = Slider(15, range=0..1000)
brep = Brep(<brep referenced from the Rhino model>)
brep_2 = Brep(<brep referenced from the Rhino model>)
dom = ConstructDomain(DomainStart=0, DomainEnd=1)
number_slider_2 = Slider(1.2, range=0..10)
number_slider_3 = Slider(0.1, range=0..0.1)
python = GhPythonScript(
    column=brep_2,
    Layer_height=Slider(5, range=0..100),
    Unit_width=Slider(7, range=0..100),
    Unit_length=number_slider,
    Unit_Interval=dom,
    SeamRotate=Slider(0.08, range=0.01..0.1))  # -> out, Contour_bbxs, Contours, StartPts, Pt_tree; inputs column: Brep
# ---------- python: Python ----------
import Rhino.Geometry as rg
import rhinoscriptsyntax as rs
from ghpythonlib import treehelpers as th

column_bbx = column.GetBoundingBox(True)
Contour_StartPt = rg.BoundingBox.PointAt(column_bbx, 0,0,0)
Contour_EndPt = rg.BoundingBox.PointAt(column_bbx, 0,0,1)
Contours = rg.Brep.CreateContourCurves(column, Contour_StartPt, Contour_EndPt, Layer_height)


StartPts = []
Pt_tree = []

for i,Contour in enumerate(Contours):
    Contour.Domain = rg.Interval(0,1)
    Start_t = i*SeamRotate
    Start_pt = rg.Curve.ChangeClosedCurveSeam(Contour,Start_t)
    StartPt = rg.Curve.PointAt(Contour, Start_t)
    DivideNum = int(rg.Curve.GetLength(Contour)/Unit_width)
    StartPts.append(StartPt)
    Shots = []
    for j in range(DivideNum):
        Shot = rg.Curve.PointAt(Contour, Start_t+float(j/DivideNum))
        if i == 0:
                    print (j/DivideNum)
        Shots.append(Shot)
    Pt_tree.append(Shots)

Pt_tree = th.list_to_tree(Pt_tree)
# ---------- end python ----------
volume = Volume(Geometry=brep)  # -> Volume, Centroid
scale = Scale(Geometry=brep, Center=volume.Centroid, Factor=Slider(1, range=0..1))  # -> Geometry, Transform
rot3d = Rotate3D(Geometry=scale.Geometry, Angle=1.570796327, Center=volume.Centroid, Axis=Vector(0, 0, 1))  # -> Geometry, Transform
brep_3 = Brep(python.Contour_bbxs)
pt = Point(python.Pt_tree)
flatten = FlattenTree(Tree=python.Pt_tree, Path="{0}")
crv = Curve(python.Contours)
move = Move(Geometry=rot3d.Geometry, Motion=python.Pt_tree)  # -> simplify(Geometry), Transform
move_2 = Move(Geometry=scale.Geometry, Motion=python.StartPts)  # -> Geometry, Transform
preview = CustomPreview(Geometry=move.Geometry, Material=ColourSwatch(SwatchColor=RGB(158, 149, 125)))
viewer = ParamViewer(python.Pt_tree)
preview_2 = CustomPreview(Geometry=move_2.Geometry, Material=ColourSwatch(SwatchColor=RGB(92, 92, 92)))

point = Point(Tree({0}: [Point(211.6479998, -177.8772965, 0), Point(207.7858583, -169.3251374, 0), Point(201.2543217, -164.8989725, 0), Point(194.1975039, -162.6690078, 0), Point(187.0779998, -161.9872965, 0), Point(179.9584957, -162.6690078, 0)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], {1}: [Point(211.6479998, -177.8772965, 9), Point(207.7858583, -169.3251374, 9), Point(201.2543217, -164.8989725, 9), Point(194.1975039, -162.6690078, 9), Point(187.0779998, -161.9872965, 9), Point(179.9584957, -162.6690078, 9)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], {2}: [Point(211.6479998, -177.8772965, 18), Point(207.7858583, -169.3251374, 18), Point(201.2543217, -164.8989725, 18), Point(194.1975039, -162.6690078, 18), Point(187.0779998, -161.9872965, 18), Point(179.9584957, -162.6690078, 18)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], {3}: [Point(211.6479998, -177.8772965, 27), Point(207.7858583, -169.3251374, 27), Point(201.2543217, -164.8989725, 27), Point(194.1975039, -162.6690078, 27), Point(187.0779998, -161.9872965, 27), Point(179.9584957, -162.6690078, 27)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], {4}: [Point(211.6479998, -177.8772965, 36), Point(207.7858583, -169.3251374, 36), Point(201.2543217, -164.8989725, 36), Point(194.1975039, -162.6690078, 36), Point(187.0779998, -161.9872965, 36), Point(179.9584957, -162.6690078, 36)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], {5}: [Point(211.6479998, -177.8772965, 45), Point(207.7858583, -169.3251374, 45), Point(201.2543217, -164.8989725, 45), Point(194.1975039, -162.6690078, 45), Point(187.0779998, -161.9872965, 45), Point(179.9584957, -162.6690078, 45)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]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))
bounding_box = BoundingBox(Content=point, Plane=PlaneXY(0, 0, 0), UnionBox=True)  # -> Box, Box_2
tree_item = TreeItem(Tree=bounding_box.Box, Path=Slider(0, range=0..100), Index=0, Wrap=True)
deconstruct_brep = DeconstructBrep(Brep=tree_item)  # -> Faces, Edges, Vertices
list_item = ListItem(List=deconstruct_brep.Faces, Index=Slider(4, range=0..5), Wrap=True)
area = Area(Geometry=list_item)  # -> Area, Centroid
rotate = Rotate(Geometry=point, Angle=degrees(Slider(90, range=0..100)), Plane=area.Centroid)  # -> Geometry, Transform
Z = UnitZ(Factor=Slider(-15, range=-20..0))
point_2 = Point(Point(85.77465848, 75.07152375, 0))
move_3 = Move(Geometry=point_2, Motion=Z)  # -> Geometry, Transform
move_to_point = MoveToPoint(Geometry=simplify(rotate.Geometry), PointA=area.Centroid, PointB=move_3.Geometry)  # -> simplify(Moved), Vector, Transform
pline = PolyLine(Vertices=flatten(pt), Closed=False)
item = ListItem(List=flatten(pt), Index=Slider(6, range=0..10), Wrap=True)
crv_2 = Curve(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)
number_slider_4 = Slider(3.41, range=0..100)
crv_3 = Curve(<curve referenced from the Rhino model>)
crv_4 = Curve(<curve referenced from the Rhino model>)

# ----
# Load classes from src
button = Button()
add_paths_from_local_dir = GhPythonScript(reload=button)  # -> dire
# ---------- add_paths_from_local_dir: Python ----------
import os
import sys

#get current file path
path = ghenv.Component.OnPingDocument().FilePath
#get parent directory of the parent directory
parentdir = os.path.dirname(os.path.dirname(path))
#go to root folder
root = os.path.dirname(parentdir)
#get src folder which contains classes
dire = os.path.join(root,'src')

print dire
#add path to sys
sys.path.append(dire)

ghenv.Component.Message = "paths added"

from compas_rhino import unload_modules

if reload:
    unload_modules("design")
    unload_modules("planning")
    
    unload_modules("ur_fabrication")
    
    ghenv.Component.Message = "paths updated"
# ---------- end add_paths_from_local_dir ----------
panel = Panel(add_paths_from_local_dir)

crv_5 = Curve(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)
len = Length(Curve=crv_3)
python_2 = GhPythonScript(
    input_crv=crv_2,
    rotation=Slider(1, range=0..10),
    offset_factor=Slider(0.95, range=0.9..1),
    h_spacing=Slider(7.5, range=0..100),
    v_spacing=Slider(5, range=0..100),
    height=Slider(150, range=40..2000),
    prototype_name="straightWall",
    extra_text="Demo")  # -> out, design_crvs, design, prototype_identifier; inputs input_crv: Curve, rotation: Int32
# ---------- python_2: Python ----------
import rhinoscriptsyntax as rs
import Rhino.Geometry as rg
import math as m
import copy
from design import GlobalDesign
from ghpythonlib.treehelpers import list_to_tree as _tree

prototype_identifier = prototype_name + "_" +  extra_text
piviot_pt = rg.Curve.PointAt(input_crv,rg.Curve.GetLength(input_crv)/2)

layer_num =int(height/h_spacing)
design_crvs = []
for i in range(layer_num):
    rotate = rg.Transform.Rotation(m.radians(rotation*i), piviot_pt)
    offset = rg.Transform.Scale(rg.Plane(piviot_pt, rg.Vector3d(0,0,1)),offset_factor**i, offset_factor**i, 0)
    move = rg.Transform.Translation(rg.Vector3d(0,0,h_spacing*i))
    design_crv = copy.copy(input_crv)
    design_crv.Transform(rotate)
    design_crv.Transform(offset)
    design_crv.Transform(move)
    design_crvs.append(design_crv)
# ---------- end python_2 ----------
generate_design_from_crv = GhPythonScript(
    input_crv=crv_5,
    h_spacing=Slider(7.5, range=0..100),
    v_spacing=Slider(5, range=0..100),
    height=Slider(150, range=40..2000),
    prototype_name="straightWall",
    extra_text="Demo")  # -> points, global_design; inputs input_crv: Curve
# ---------- generate_design_from_crv: Python ----------
from design import GlobalDesign
from ghpythonlib.treehelpers import list_to_tree as _tree


prototype_identifier = prototype_name + "_" +  extra_text

global_design= GlobalDesign.design_from_curve(input_crv, h_spacing, height, v_spacing, prototype_identifier)

#generate uid
global_design.generate_uid_for_all_parts()
points = global_design.visualize()

#Convert to tree to visualize
points = _tree(points)
# ---------- end generate_design_from_crv ----------
division = Division(A=len, B=Slider(58, range=0..100))
python_3 = GhPythonScript(
    input_crv=crv_4,
    rotation=Slider(0, range=0..1),
    offset_factor=Slider(0.96, range=0.9..1),
    h_spacing=number_slider_4,
    v_spacing=Slider(4, range=0..100),
    height=Slider(40, range=40..2000))  # -> out, design_crvs, design; inputs input_crv: Curve, rotation: Int32
# ---------- python_3: Python ----------
import rhinoscriptsyntax as rs
import Rhino.Geometry as rg
import math as m
import copy
from design import *
from ghpythonlib.treehelpers import list_to_tree as _tree

piviot_pt = rg.Curve.PointAt(input_crv,rg.Curve.GetLength(input_crv)/2)

layer_num =int(height/v_spacing)
design_crvs = []
for i in range(layer_num):
    rotate = rg.Transform.Rotation(m.radians(rotation*i), piviot_pt)
    offset = rg.Transform.Scale(rg.Plane(piviot_pt, rg.Vector3d(0,0,1)),offset_factor**i, offset_factor**i, 0)
    move = rg.Transform.Translation(rg.Vector3d(0,0,v_spacing*i))
    design_crv = copy.copy(input_crv)
    design_crv.Transform(rotate)
    design_crv.Transform(offset)
    design_crv.Transform(move)
    design_crvs.append(design_crv)
# ---------- end python_3 ----------
dom_2 = ConstructDomain(DomainStart=Slider(1, range=0..10), DomainEnd=Slider(5.4, range=0..10))
int = Integer(division)
divdist = DivideDistance(Curve=crv_3, Distance=Slider(20, range=0..100))  # -> flatten(Points), Tangents, Parameters
multiplication = Multiplication(A=int, B=2)
divide = DivideCurve(Curve=crv_3, Count=multiplication, Kinks=False)  # -> Points, Tangents, Parameters
random = Random(Range=dom_2, Number=int, Seed=2)
crv_6 = Curve(python_3.design_crvs)
crv_7 = Curve(python_2.design_crvs)
panel_2 = Panel(python_2.prototype_identifier)
python_4 = GhPythonScript(pts=divdist.Points)  # -> out, a, b; inputs pts: list of Point3d
# ---------- python_4: Python ----------
__author__ = "jiang"
__version__ = "2023.01.09"

import rhinoscriptsyntax as rs
a = []
b = []
for i in range(len(pts)):
    if i%2==0:
        a.append(pts[i])
    else:
        b.append(pts[i])
# ---------- end python_4 ----------
dispatch = Dispatch(List=divide.Points, DispatchPattern=[True, False])  # -> ListA, ListB
panel_3 = Panel(generate_design_from_crv.global_design)
pt_2 = Point(python_4.a)
multiplication_2 = Multiplication(A=number_slider_4, B=Slider(2.1, range=0..10))
loft = Loft(Curves=crv_6, Options={Adjust=False, Closed=False, LoftEnds=0, LoftSimp=0, LoftType=0, Rebuild=10, Refit=0.01})
len_2 = Length(Curve=crv_6)
multiplication_3 = Multiplication(A=random, B=Slider(29, range=0..1000))
item_2 = ListItem(List=divdist.Points, Index=Slider(5, range=1..40), Wrap=True)
division_2 = Division(A=len_2, B=multiplication_2)
cat = Catenary(PointA=dispatch.ListA, PointB=dispatch.ListB, Length=multiplication_3, Gravity=Vector(0, 0, -1))
int_2 = Integer(division_2)
divide_2 = DivideCurve(Curve=crv_6, Count=int_2, Kinks=False)  # -> Points, Tangents, Parameters
python_5 = GhPythonScript(Pt_tree=pt)  # -> out, Pt_tree; inputs Pt_tree: tree of Point3d
# ---------- python_5: Python ----------
import rhinoscriptsyntax as rs
import Rhino as rg
import ghpythonlib.treehelpers as th


Pt_tree = th.tree_to_list(Pt_tree)

for i, list in enumerate(Pt_tree[0]):
    if i%2==0:
        listReverse = Pt_tree[0][i].reverse()
    Pt_tree[0][i]=listReverse

Pt_tree = th.list_to_tree(Pt_tree)
# ---------- end python_5 ----------
plan_sequence = GhPythonScript(design=generate_design_from_crv.global_design, toolpath_volume=Slider(900, range=0..1000), n=Slider(0, range=0..15))  # -> sequencer, points, tool_curve, data; inputs toolpath_volume: Int32, n: Int32
# ---------- plan_sequence: Python ----------
from planning import ConstructionSequencer


sequencer = ConstructionSequencer(design, toolpath_volume)
sequencer.generate_toolpaths_continuous()

toolpath = sequencer.toolpaths[n]
toolpath.add_safety_points(setup = "UR")


points, tool_curve = toolpath.visualize_pts()
data = [toolpath.export_toolpath_to_UR()]
# ---------- end plan_sequence ----------
viewer_2 = ParamViewer(pt)
pt_3 = Point(python_5.Pt_tree)
pt_4 = Point(simplify(pt))
viewer_3 = ParamViewer(python_5.Pt_tree)
parse_data = GhPythonScript(data=plan_sequence.data)  # -> planes, toggles, wait_times
# ---------- parse_data: Python ----------
planes = data['planes']
toggles = data['toggles']
wait_times = data['wait times']
# ---------- end parse_data ----------
panel_4 = Panel(pt)
pln = Plane(parse_data.planes)
item_3 = ListItem(List=flatten(pt), Index=0, Wrap=True)  # -> Item1, Item
Z_2 = UnitZ(Factor=Slider(100, range=0..100))
move_4 = Move(Geometry=item_3.Item1, Motion=Z_2)  # -> Geometry, Transform
panel_5 = Panel(parse_data.toggles)
flatten_2 = FlattenTree(Tree=pt, Path="{0}")
ins = InsertItems(List=flatten_2, Item=move_4.Geometry, Indices=Slider(0, range=0..100), Wrap=True)
lng = ListLength(List=ins)
subtraction = Subtraction(A=lng, B=Slider(2, range=0..10))
repeat = RepeatData(Data=Slider(1, range=0..1), Length=subtraction)
pt_5 = Point(ins)
repeat_2 = RepeatData(Data=Slider(0.7, range=0..1), Length=lng)
ins_2 = InsertItems(List=repeat, Item=Slider(0, range=0..100), Indices=[Slider(0, range=0..100), Slider(-1, range=-1..0)], Wrap=True)
xy = XYPlane(Origin=pt_5)
send_to_robot = GhPythonScript(planes=flatten(xy), toggles=flatten(ins_2), waits=flatten(repeat_2), send=Button(), lift_height=Slider(10, range=0..10))  # -> ur10, robot_planes, script; inputs planes: list of Plane, toggles: list of Boolean, waits: list
# ---------- send_to_robot: Python ----------
import os
import sys
import Rhino.Geometry as rg

from math import radians

from ur_fabrication import UR

ur10 = UR(planes,toggles,waits, ip = "192.168.10.20")

ur10.tcp(-86.62,-28.48,147.92,0.0,180.0, 0.0)

origin = rg.Point3d(-293.81, -673.70, 11.50) #Origin
xaxis = rg.Point3d(247.93, -677.69, 10.70) #XAxis Point
yaxis = rg.Point3d(62.22, -430.51, 7.78) #Point on +XY Plane
ur10.set_base_plane(origin, xaxis, yaxis)

ur10.prepare_script(lift_height = lift_height + 1.5)

robot_planes = ur10.robot_frames
script = ur10.script
if send:
   ur10.trigger()
# ---------- end send_to_robot ----------
panel_6 = Panel(send_to_robot.script)
pline_2 = PolyLine(Vertices=pt_5, Closed=False)
