# Grasshopper definition 20230117 column path 4 git.gh (Grasshopper 1.0.7)
# plug-ins: treesloth01

crv = Curve([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])
crv_2 = Curve([<curve referenced from the Rhino model> x3])
crv_3 = Curve([<curve referenced from the Rhino model> x3])
loft = Loft(Curves=crv_3, Options={Adjust=True, Closed=False, LoftEnds=0, LoftSimp=0, LoftType=0, Rebuild=10, Refit=0.01})
loft_2 = Loft(Curves=crv_2, Options={Adjust=True, Closed=False, LoftEnds=0, LoftSimp=0, LoftType=0, Rebuild=10, Refit=0.01})
loft_3 = Loft(Curves=crv, Options={Adjust=True, Closed=False, LoftEnds=0, LoftSimp=0, LoftType=0, Rebuild=10, Refit=0.01})
# Distance between each bullet
# Layer Height
number_slider = Slider(2, range=0..10)
number_slider_2 = Slider(5, range=0..100)
number_slider_3 = Slider(7, range=0..10)
# Distance between each bullet
# Layer Height
number_slider_4 = Slider(2, range=0..10)
number_slider_5 = Slider(5, range=0..100)
number_slider_6 = Slider(7, range=0..10)
division = Division(A=number_slider_2, B=number_slider)
# IMPUT with 2 ellipses loft together
number_slider_7 = Slider(161, range=0..1000)
division_2 = Division(A=number_slider_5, B=number_slider_4)
multiplication = Multiplication(A=division, B=Slider(50, range=0..100))
number_slider_8 = Slider(300, range=0..1000)
multiplication_2 = Multiplication(A=division_2, B=Slider(50, range=0..100))
unit_z = UnitZ(Factor=multiplication)

# ----
# IMPUT with surface
# IMPUT SURFACE
geometry = Geometry(<brep referenced from the Rhino model>)
bounding_box = BoundingBox(Content=geometry, Plane=PlaneXY(0, 0, 0))  # -> Box, Box_2
deconstruct_brep = DeconstructBrep(Brep=bounding_box.Box)  # -> Faces, Edges, Vertices
list_item = ListItem(List=deconstruct_brep.Faces, Index=Slider(4, range=0..10), Wrap=True)
area = Area(Geometry=list_item)  # -> Area, Centroid

negative = Negative(Value=number_slider_7)
unit_z_2 = UnitZ(Factor=multiplication_2)
number_slider_9 = Slider(-140, range=-150..0)
number_slider_10 = Slider(140, range=0..1000)
point = Point(Point(187.0779998, -177.8772965, 0))
negative_2 = Negative(Value=number_slider_8)
number_slider_11 = Slider(-140, range=-150..0)
number_slider_12 = Slider(140, range=0..1000)
construct_domain = ConstructDomain(DomainStart=negative, DomainEnd=number_slider_7)
xy_plane = XYPlane(Origin=point)
move = Move(Geometry=xy_plane, Motion=unit_z)  # -> Geometry, Transform
construct_domain_2 = ConstructDomain(DomainStart=negative, DomainEnd=number_slider_7)
multiplication_3 = Multiplication(A=number_slider_3, B=Slider(1, range=0..11))
multiplication_4 = Multiplication(A=number_slider_3, B=Slider(6, range=0..11))
xz_plane = XZPlane(Origin=point)
construct_domain_3 = ConstructDomain(DomainStart=negative_2, DomainEnd=number_slider_8)
xy_plane_2 = XYPlane(Origin=area.Centroid)
move_2 = Move(Geometry=xy_plane_2, Motion=unit_z_2)  # -> Geometry, Transform
construct_domain_4 = ConstructDomain(DomainStart=negative_2, DomainEnd=number_slider_8)
multiplication_5 = Multiplication(A=number_slider_6, B=Slider(1, range=0..11))
multiplication_6 = Multiplication(A=number_slider_6, B=Slider(6, range=0..11))
construct_domain_5 = ConstructDomain(DomainStart=number_slider_9, DomainEnd=number_slider_10)
xz_plane_2 = XZPlane(Origin=area.Centroid)
construct_domain_6 = ConstructDomain(DomainStart=number_slider_9, DomainEnd=number_slider_10)
ellipse = Ellipse(Plane=move.Geometry, Radius1=multiplication_3, Radius2=Slider(11, range=0..55))  # -> Ellipse, Focus1, Focus2
ellipse_2 = Ellipse(Plane=xy_plane, Radius1=multiplication_4, Radius2=Slider(26.12, range=0..55))  # -> Ellipse, Focus1, Focus2
rectangle = Rectangle(Plane=xz_plane, XSize=construct_domain, YSize=construct_domain_2, Radius=0)  # -> Rectangle, Length
construct_domain_7 = ConstructDomain(DomainStart=number_slider_11, DomainEnd=number_slider_12)
construct_domain_8 = ConstructDomain(DomainStart=number_slider_11, DomainEnd=number_slider_12)
ellipse_3 = Ellipse(Plane=move_2.Geometry, Radius1=multiplication_5, Radius2=Slider(11, range=0..55))  # -> Ellipse, Focus1, Focus2
ellipse_4 = Ellipse(Plane=xy_plane_2, Radius1=multiplication_6, Radius2=Slider(26.12, range=0..55))  # -> Ellipse, Focus1, Focus2
rectangle_2 = Rectangle(Plane=xz_plane_2, XSize=construct_domain_3, YSize=construct_domain_4, Radius=0)  # -> Rectangle, Length
# IMPUT with 2 ellipses
merge = Merge(Data1=ellipse_2.Ellipse, Data2=ellipse.Ellipse)
rectangle_3 = Rectangle(Plane=xy_plane, XSize=construct_domain_5, YSize=construct_domain_6, Radius=0)  # -> Rectangle, Length
number_slider_13 = Slider(2.5, range=0..10)
boundary_surfaces = BoundarySurfaces(Edges=rectangle.Rectangle)
merge_2 = Merge(Data1=ellipse_4.Ellipse, Data2=ellipse_3.Ellipse)
rectangle_4 = Rectangle(Plane=xy_plane_2, XSize=construct_domain_7, YSize=construct_domain_8, Radius=0)  # -> Rectangle, Length
loft_4 = Loft(Curves=merge, Options={Adjust=False, Closed=False, LoftEnds=0, LoftSimp=0, LoftType=0, Rebuild=10, Refit=0.01})
boundary_surfaces_2 = BoundarySurfaces(Edges=rectangle_2.Rectangle)
division_3 = Division(A=number_slider_2, B=Slider(2, range=0..10))
explode = Explode(Curve=rectangle_3.Rectangle, Recursive=True)  # -> Segments, Vertices
division_4 = Division(A=number_slider_5, B=Slider(2, range=0..10))
contour = Contour(Shape=loft_4, Point=point, Direction=Vector(0, 0, 1), Distance=division_3)
brep_curve = BrepCurve(Brep=boundary_surfaces, Curve=contour)  # -> Curves, simplify(Points)
explode_2 = Explode(Curve=rectangle_4.Rectangle, Recursive=True)  # -> Segments, Vertices
contour_2 = Contour(Shape=geometry, Point=area.Centroid, Direction=Vector(0, 0, 1), Distance=division_4)
brep_curve_2 = BrepCurve(Brep=boundary_surfaces_2, Curve=contour_2)  # -> Curves, simplify(Points)
number_slider_14 = Slider(7, range=0..10)
list_item_2 = ListItem(List=explode.Segments, Index=0, Wrap=True)
list_item_3 = ListItem(List=explode.Segments, Index=Slider(2, range=0..10), Wrap=True)
boundary_surfaces_3 = BoundarySurfaces(Edges=contour)  # -> simplify(Surfaces)
number_slider_15 = Slider(7, range=0..10)
list_item_4 = ListItem(List=explode_2.Segments, Index=0, Wrap=True)
list_item_5 = ListItem(List=explode_2.Segments, Index=Slider(2, range=0..10), Wrap=True)
boundary_surfaces_4 = BoundarySurfaces(Edges=contour_2)  # -> simplify(Surfaces)
dispatch = Dispatch(List=flatten(boundary_surfaces_3), DispatchPattern=[True, False])  # -> ListA, ListB
divide_length = DivideLength(Curve=list_item_3, Length=number_slider_14)  # -> reverse(Points), Tangents, Parameters
divide_length_2 = DivideLength(Curve=list_item_2, Length=number_slider_14)  # -> Points, Tangents, Parameters
division_5 = Division(A=number_slider_14, B=Slider(2, range=0..10))
dispatch_2 = Dispatch(List=flatten(boundary_surfaces_4), DispatchPattern=[True, False])  # -> ListA, ListB
tree_item = TreeItem(Tree=boundary_surfaces_3, Path=Slider(0, range=0..100), Index=0, Wrap=True)
divide_length_3 = DivideLength(Curve=list_item_5, Length=number_slider_15)  # -> reverse(Points), Tangents, Parameters
divide_length_4 = DivideLength(Curve=list_item_4, Length=number_slider_15)  # -> Points, Tangents, Parameters
division_6 = Division(A=number_slider_15, B=Slider(2, range=0..10))
tree_item_2 = TreeItem(Tree=boundary_surfaces_4, Path=Slider(0, range=0..100), Index=0, Wrap=True)
unit_x = UnitX(Factor=division_5)

geometry_2 = Geometry(dispatch.ListA)
geometry_3 = Geometry(dispatch.ListB)

list_length = ListLength(List=geometry_3)
list_length_2 = ListLength(List=geometry_2)
series = Series(Start=division_3, Step=number_slider_2, Count=list_length)
series_2 = Series(Start=0, Step=number_slider_2, Count=list_length_2)
unit_z_3 = UnitZ(Factor=series)
unit_z_4 = UnitZ(Factor=series_2)
line = Line(StartPoint=divide_length_2.Points, EndPoint=divide_length.Points)
unit_x_2 = UnitX(Factor=division_6)

geometry_4 = Geometry(dispatch_2.ListA)
geometry_5 = Geometry(dispatch_2.ListB)

list_length_3 = ListLength(List=geometry_5)
list_length_4 = ListLength(List=geometry_4)
series_3 = Series(Start=division_4, Step=number_slider_5, Count=list_length_3)
series_4 = Series(Start=0, Step=number_slider_5, Count=list_length_4)
unit_z_5 = UnitZ(Factor=series_3)
unit_z_6 = UnitZ(Factor=series_4)
line_2 = Line(StartPoint=divide_length_4.Points, EndPoint=divide_length_3.Points)
curve = Curve(line)
move_3 = Move(Geometry=curve, Motion=simplify(graft(unit_z_4)))  # -> simplify(Geometry), Transform
move_4 = Move(Geometry=curve, Motion=unit_x)  # -> Geometry, Transform
brep_curve_3 = BrepCurve(Brep=tree_item, Curve=curve)  # -> simplify(Curves), Points
unit_z_7 = UnitZ(Factor=division_3)
curve_2 = Curve(line_2)
move_5 = Move(Geometry=curve_2, Motion=simplify(graft(unit_z_6)))  # -> simplify(Geometry), Transform
move_6 = Move(Geometry=curve_2, Motion=unit_x_2)  # -> Geometry, Transform
brep_curve_4 = BrepCurve(Brep=tree_item_2, Curve=curve_2)  # -> simplify(Curves), Points
unit_z_8 = UnitZ(Factor=division_4)
curve_3 = Curve(move_4.Geometry)
move_7 = Move(Geometry=curve_3, Motion=simplify(graft(unit_z_3)))  # -> simplify(Geometry), Transform
clean_tree = CleanTree(RemoveNulls=True, RemoveInvalid=True, RemoveEmpty=Toggle(True), Tree=brep_curve_3.Points)
clean_tree_2 = CleanTree(RemoveNulls=True, RemoveInvalid=True, RemoveEmpty=Toggle(True), Tree=brep_curve_3.Curves)
move_8 = Move(Geometry=curve_3, Motion=unit_z_7)  # -> Geometry, Transform
brep_curve_5 = BrepCurve(Brep=graft(geometry_3), Curve=move_7.Geometry)  # -> simplify(Curves), simplify(Points)
curve_4 = Curve(move_6.Geometry)
move_9 = Move(Geometry=curve_4, Motion=simplify(graft(unit_z_5)))  # -> simplify(Geometry), Transform
brep_curve_6 = BrepCurve(Brep=graft(geometry_2), Curve=move_3.Geometry)  # -> simplify(Curves), simplify(Points)
list_item_6 = ListItem(List=geometry_3, Index=0, Wrap=True)
clean_tree_3 = CleanTree(RemoveNulls=True, RemoveInvalid=True, RemoveEmpty=Toggle(True), Tree=brep_curve_4.Points)
clean_tree_4 = CleanTree(RemoveNulls=True, RemoveInvalid=True, RemoveEmpty=Toggle(True), Tree=brep_curve_4.Curves)
move_10 = Move(Geometry=curve_4, Motion=unit_z_8)  # -> Geometry, Transform
brep_curve_7 = BrepCurve(Brep=graft(geometry_5), Curve=move_9.Geometry)  # -> simplify(Curves), simplify(Points)
brep_curve_8 = BrepCurve(Brep=graft(geometry_4), Curve=move_5.Geometry)  # -> simplify(Curves), simplify(Points)
list_item_7 = ListItem(List=geometry_5, Index=0, Wrap=True)
clean_tree_5 = CleanTree(RemoveNulls=True, RemoveInvalid=True, RemoveEmpty=Toggle(True), Tree=brep_curve_5.Curves)  # -> simplify(Tree)
brep_curve_9 = BrepCurve(Brep=list_item_6, Curve=move_8.Geometry)  # -> simplify(Curves), Points
clean_tree_6 = CleanTree(RemoveNulls=True, RemoveInvalid=True, RemoveEmpty=Toggle(True), Tree=brep_curve_6.Curves)  # -> simplify(Tree)
clean_tree_7 = CleanTree(RemoveNulls=True, RemoveInvalid=True, RemoveEmpty=Toggle(True), Tree=brep_curve_7.Curves)  # -> simplify(Tree)
brep_curve_10 = BrepCurve(Brep=list_item_7, Curve=move_10.Geometry)  # -> simplify(Curves), Points
clean_tree_8 = CleanTree(RemoveNulls=True, RemoveInvalid=True, RemoveEmpty=Toggle(True), Tree=brep_curve_8.Curves)  # -> simplify(Tree)
flatten_tree = FlattenTree(Tree=clean_tree, Path="{0}")  # -> simplify(graft(Tree))
flatten_tree_2 = FlattenTree(Tree=clean_tree_2, Path="{0}")  # -> simplify(graft(Tree))
null_item = NullItem(Item=brep_curve_6.Points)  # -> NullFlags, InvalidFlags, Description
clean_tree_9 = CleanTree(RemoveNulls=True, RemoveInvalid=True, RemoveEmpty=Toggle(True), Tree=brep_curve_9.Curves)
trim_tree = TrimTree(Tree=clean_tree_5, Depth=1)
trim_tree_2 = TrimTree(Tree=clean_tree_6, Depth=1)
flatten_tree_3 = FlattenTree(Tree=clean_tree_3, Path="{0}")  # -> simplify(graft(Tree))
flatten_tree_4 = FlattenTree(Tree=clean_tree_4, Path="{0}")  # -> simplify(graft(Tree))
null_item_2 = NullItem(Item=brep_curve_8.Points)  # -> NullFlags, InvalidFlags, Description
clean_tree_10 = CleanTree(RemoveNulls=True, RemoveInvalid=True, RemoveEmpty=Toggle(True), Tree=brep_curve_10.Curves)
trim_tree_3 = TrimTree(Tree=clean_tree_7, Depth=1)
end_points = EndPoints(Curve=flatten_tree_2)  # -> Start, End
trim_tree_4 = TrimTree(Tree=clean_tree_8, Depth=1)
null_item_3 = NullItem(Item=brep_curve_5.Points)  # -> NullFlags, InvalidFlags, Description
flatten_tree_5 = FlattenTree(Tree=clean_tree_9, Path="{0}")  # -> simplify(graft(Tree))
explode_3 = Explode(Curve=trim_tree, Recursive=True)  # -> Segments, Vertices
tree_item_3 = TreeItem(Tree=flatten_tree, Path=Slider(0, range=0..100), Index=0, Wrap=True)
tree_item_4 = TreeItem(Tree=flatten_tree, Path=Slider(1, range=0..100), Index=0, Wrap=True)
dispatch_3 = Dispatch(List=brep_curve_6.Points, DispatchPattern=invert(null_item.InvalidFlags))  # -> ListA, ListB
explode_4 = Explode(Curve=trim_tree_2, Recursive=True)  # -> Segments, Vertices
end_points_2 = EndPoints(Curve=flatten_tree_4)  # -> Start, End
tree_statistics = TreeStatistics(Tree=trim_tree)  # -> Paths, Length, Count
null_item_4 = NullItem(Item=brep_curve_7.Points)  # -> NullFlags, InvalidFlags, Description
tree_statistics_2 = TreeStatistics(Tree=trim_tree_2)  # -> Paths, Length, Count
flatten_tree_6 = FlattenTree(Tree=clean_tree_10, Path="{0}")  # -> simplify(graft(Tree))
explode_5 = Explode(Curve=trim_tree_3, Recursive=True)  # -> Segments, Vertices
tree_item_5 = TreeItem(Tree=flatten_tree_3, Path=Slider(0, range=0..100), Index=0, Wrap=True)
tree_item_6 = TreeItem(Tree=flatten_tree_3, Path=Slider(1, range=0..100), Index=0, Wrap=True)
dispatch_4 = Dispatch(List=brep_curve_8.Points, DispatchPattern=invert(null_item_2.InvalidFlags))  # -> ListA, ListB
explode_6 = Explode(Curve=trim_tree_4, Recursive=True)  # -> Segments, Vertices
tree_statistics_3 = TreeStatistics(Tree=trim_tree_3)  # -> Paths, Length, Count
explode_7 = Explode(Curve=flatten_tree_5, Recursive=True)  # -> Segments, Vertices
tree_statistics_4 = TreeStatistics(Tree=trim_tree_4)  # -> Paths, Length, Count
dispatch_5 = Dispatch(List=brep_curve_5.Points, DispatchPattern=invert(null_item_3.InvalidFlags))  # -> ListA, ListB
merge_3 = Merge(Data1=graft(tree_item_3), Data2=end_points.End, Data3=graft(tree_item_4), Data4=end_points.Start)
explode_8 = Explode(Curve=flatten_tree_6, Recursive=True)  # -> Segments, Vertices
clean_tree_11 = CleanTree(RemoveNulls=True, RemoveInvalid=True, RemoveEmpty=Toggle(True), Tree=dispatch_3.ListA)
flatten_tree_7 = FlattenTree(Tree=explode_3.Vertices, Path="{0}")
entwine = Entwine(Branch00=tree_item_3, Branch01=end_points.End, Branch02=tree_item_4, Branch03=end_points.Start, FlattenInputs=True)  # -> simplify(Result)
flatten_tree_8 = FlattenTree(Tree=explode_4.Vertices, Path="{0}")
dispatch_6 = Dispatch(List=brep_curve_7.Points, DispatchPattern=invert(null_item_4.InvalidFlags))  # -> ListA, ListB
merge_4 = Merge(Data1=graft(tree_item_5), Data2=end_points_2.End, Data3=graft(tree_item_6), Data4=end_points_2.Start)
multiplication_7 = Multiplication(A=tree_statistics.Length, B=Slider(2, range=0..10))
clean_tree_12 = CleanTree(RemoveNulls=True, RemoveInvalid=True, RemoveEmpty=Toggle(True), Tree=dispatch_4.ListA)
flatten_tree_9 = FlattenTree(Tree=explode_5.Vertices, Path="{0}")
entwine_2 = Entwine(Branch00=tree_item_5, Branch01=end_points_2.End, Branch02=tree_item_6, Branch03=end_points_2.Start, FlattenInputs=True)  # -> simplify(Result)
multiplication_8 = Multiplication(A=tree_statistics_2.Length, B=Slider(2, range=0..10))
flatten_tree_10 = FlattenTree(Tree=explode_6.Vertices, Path="{0}")
clean_tree_13 = CleanTree(RemoveNulls=True, RemoveInvalid=True, RemoveEmpty=Toggle(True), Tree=dispatch_5.ListA)
flatten_tree_11 = FlattenTree(Tree=entwine, Path="{0}")
partition_list = PartitionList(List=flatten_tree_7, Size=multiplication_7)  # -> simplify(Chunks)
multiplication_9 = Multiplication(A=tree_statistics_3.Length, B=Slider(2, range=0..10))
shift_paths = ShiftPaths(Data=clean_tree_11, Offset=-1)
partition_list_2 = PartitionList(List=flatten_tree_8, Size=multiplication_8)  # -> simplify(Chunks)
multiplication_10 = Multiplication(A=tree_statistics_4.Length, B=Slider(2, range=0..10))
clean_tree_14 = CleanTree(RemoveNulls=True, RemoveInvalid=True, RemoveEmpty=Toggle(True), Tree=dispatch_6.ListA)
flatten_tree_12 = FlattenTree(Tree=entwine_2, Path="{0}")
partition_list_3 = PartitionList(List=flatten_tree_9, Size=multiplication_9)  # -> simplify(Chunks)
merge_5 = Merge(Data1=flatten_tree_11, Data2=flatten(explode_7.Vertices))
shift_paths_2 = ShiftPaths(Data=clean_tree_12, Offset=-1)
partition_list_4 = PartitionList(List=flatten_tree_10, Size=multiplication_10)  # -> simplify(Chunks)
graft_tree = GraftTree(Tree=flatten_tree_11, IncludeEmptyLists=True, IncludeNullItems=True)
merge_6 = Merge(Data1=partition_list_2, Data2=shift_paths)
shift_paths_3 = ShiftPaths(Data=clean_tree_13, Offset=-1)
merge_7 = Merge(Data1=partition_list, Data2=shift_paths_3)
merge_8 = Merge(Data1=flatten_tree_12, Data2=flatten(explode_8.Vertices))
graft_tree_2 = GraftTree(Tree=flatten_tree_12, IncludeEmptyLists=True, IncludeNullItems=True)
param_viewer = ParamViewer(partition_list_2)
merge_9 = Merge(Data1=partition_list_4, Data2=shift_paths_2)
shift_paths_4 = ShiftPaths(Data=clean_tree_14, Offset=-1)
merge_10 = Merge(Data1=partition_list_3, Data2=shift_paths_4)
point_2 = Point(merge_7)
point_3 = Point(merge_6)
param_viewer_2 = ParamViewer(point_3)
param_viewer_3 = ParamViewer(partition_list_4)
point_4 = Point(merge_10)
point_5 = Point(merge_9)
param_viewer_4 = ParamViewer(point_5)
param_viewer_5 = ParamViewer(point_2)
merge_11 = Merge(Data1=point_3, Data2=point_2, Data3=brep_curve.Points)
param_viewer_6 = ParamViewer(point_4)
polyline = PolyLine(Vertices=flatten(point_2), Closed=False)
# CT Line
curve_5 = Curve(simplify(contour))
merge_12 = Merge(Data1=point_5, Data2=point_4, Data3=brep_curve_2.Points)
polyline_2 = PolyLine(Vertices=flatten(point_4), Closed=False)
# CT Line
curve_6 = Curve(simplify(contour_2))
geometry_6 = Geometry(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)
explode_9 = Explode(Curve=polyline, Recursive=True)  # -> Segments, Vertices
tree_statistics_5 = TreeStatistics(Tree=curve_5)  # -> Paths, Length, Count
area_2 = Area(Geometry=geometry_6)  # -> Area, Centroid
area_3 = Area(Geometry=geometry_6)  # -> Area, Centroid
area_4 = Area(Geometry=geometry_6)  # -> Area, Centroid
explode_10 = Explode(Curve=polyline_2, Recursive=True)  # -> Segments, Vertices
geometry_7 = Geometry(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)
tree_statistics_6 = TreeStatistics(Tree=curve_6)  # -> Paths, Length, Count
area_5 = Area(Geometry=geometry_7)  # -> Area, Centroid
area_6 = Area(Geometry=geometry_7)  # -> Area, Centroid
dispatch_7 = Dispatch(List=tree_statistics_5.Paths, DispatchPattern=[True, False])  # -> ListA, ListB
area_7 = Area(Geometry=geometry_7)  # -> Area, Centroid
dispatch_8 = Dispatch(List=tree_statistics_6.Paths, DispatchPattern=[True, False])  # -> ListA, ListB
orient = Orient(Geometry=geometry_6, Source=area_2.Centroid, Target=point_2)  # -> Geometry, Transform
orient_2 = Orient(Geometry=geometry_6, Source=area_3.Centroid, Target=brep_curve.Points)  # -> Geometry, Transform
orient_3 = Orient(Geometry=geometry_6, Source=area_4.Centroid, Target=point_3)  # -> Geometry, Transform
split_tree = SplitTree(Data=curve_5, Masks=flatten(dispatch_7.ListA))  # -> Positive, Negative
orient_4 = Orient(Geometry=geometry_7, Source=area_5.Centroid, Target=point_4)  # -> Geometry, Transform
orient_5 = Orient(Geometry=geometry_7, Source=area_6.Centroid, Target=brep_curve_2.Points)  # -> Geometry, Transform
orient_6 = Orient(Geometry=geometry_7, Source=area_7.Centroid, Target=point_5)  # -> Geometry, Transform
split_tree_2 = SplitTree(Data=curve_6, Masks=flatten(dispatch_8.ListA))  # -> Positive, Negative
geometry_8 = Geometry(orient.Geometry)
geometry_9 = Geometry(orient_2.Geometry)
geometry_10 = Geometry(orient_3.Geometry)
tree_statistics_7 = TreeStatistics(Tree=geometry_9)  # -> Paths, Length, Count
curve_7 = Curve(split_tree.Positive)
curve_8 = Curve(split_tree.Negative)
geometry_11 = Geometry(orient_4.Geometry)
geometry_12 = Geometry(orient_5.Geometry)
geometry_13 = Geometry(orient_6.Geometry)
tree_statistics_8 = TreeStatistics(Tree=geometry_12)  # -> Paths, Length, Count
curve_9 = Curve(split_tree_2.Positive)
curve_10 = Curve(split_tree_2.Negative)
sort_along_curve = SortAlongCurve(Points=point_3, Curve=curve_7)  # -> Points, Indices
sort_along_curve_2 = SortAlongCurve(Points=point_2, Curve=curve_8)  # -> Points, Indices
dispatch_9 = Dispatch(List=tree_statistics_7.Paths, DispatchPattern=[True, False])  # -> ListA, ListB
sort_along_curve_3 = SortAlongCurve(Points=point_5, Curve=curve_9)  # -> Points, Indices
sort_along_curve_4 = SortAlongCurve(Points=point_4, Curve=curve_10)  # -> Points, Indices
dispatch_10 = Dispatch(List=tree_statistics_8.Paths, DispatchPattern=[True, False])  # -> ListA, ListB
custom_preview = CustomPreview(Geometry=geometry_9, Material=ColourSwatch(SwatchColor=RGBA(89, 252, 135, 197)))  # disabled
point_6 = Point(simplify(sort_along_curve.Points))
point_7 = Point(simplify(sort_along_curve_2.Points))
split_tree_3 = SplitTree(Data=geometry_9, Masks=flatten(dispatch_9.ListA))  # -> Positive, Negative
point_8 = Point(simplify(sort_along_curve_3.Points))
point_9 = Point(simplify(sort_along_curve_4.Points))
split_tree_4 = SplitTree(Data=geometry_12, Masks=flatten(dispatch_10.ListA))  # -> Positive, Negative
shift_list = ShiftList(List=point_6, Shift=1, Wrap=True)
shift_list_2 = ShiftList(List=point_7, Shift=1, Wrap=True)
point_10 = Point(brep_curve.Points)
shift_list_3 = ShiftList(List=point_8, Shift=1, Wrap=True)
shift_list_4 = ShiftList(List=point_9, Shift=1, Wrap=True)
tree_statistics_9 = TreeStatistics(Tree=point_10)  # -> Paths, Length, Count
point_11 = Point(brep_curve_2.Points)

# ----
# Distances to add green bullets
number_slider_16 = Slider(23, range=0..100)

tree_statistics_10 = TreeStatistics(Tree=point_11)  # -> Paths, Length, Count
distance = Distance(PointA=point_6, PointB=shift_list)
distance_2 = Distance(PointA=point_7, PointB=shift_list_2)
dispatch_11 = Dispatch(List=tree_statistics_9.Paths, DispatchPattern=[True, False])  # -> ListA, ListB

# ----
# Distances to add green bullets
number_slider_17 = Slider(22.2, range=0..100)

param_viewer_7 = ParamViewer(point_7)
param_viewer_8 = ParamViewer(point_6)
distance_3 = Distance(PointA=point_8, PointB=shift_list_3)
distance_4 = Distance(PointA=point_9, PointB=shift_list_4)
dispatch_12 = Dispatch(List=tree_statistics_10.Paths, DispatchPattern=[True, False])  # -> ListA, ListB
param_viewer_9 = ParamViewer(point_9)
param_viewer_10 = ParamViewer(point_8)
larger_than = LargerThan(FirstNumber=distance, SecondNumber=Slider(23, range=0..100))  # -> LargerThan, OrEqualTo
larger_than_2 = LargerThan(FirstNumber=distance_2, SecondNumber=number_slider_16)  # -> LargerThan, OrEqualTo
split_tree_5 = SplitTree(Data=point_10, Masks=flatten(dispatch_11.ListA))  # -> Positive, Negative
larger_than_3 = LargerThan(FirstNumber=distance_3, SecondNumber=Slider(22.2, range=0..100))  # -> LargerThan, OrEqualTo
larger_than_4 = LargerThan(FirstNumber=distance_4, SecondNumber=number_slider_17)  # -> LargerThan, OrEqualTo
split_tree_6 = SplitTree(Data=point_11, Masks=flatten(dispatch_12.ListA))  # -> Positive, Negative
panel = Panel(distance_2)
dispatch_13 = Dispatch(List=point_6, DispatchPattern=simplify(larger_than.LargerThan))  # -> ListA, ListB
dispatch_14 = Dispatch(List=split_tree_3.Positive, DispatchPattern=dispatch_13.ListA)  # -> ListA, ListB
geometry_14 = Geometry(dispatch_14.ListA)
dispatch_15 = Dispatch(List=point_7, DispatchPattern=simplify(larger_than_2.LargerThan))  # -> ListA, ListB
dispatch_16 = Dispatch(List=split_tree_3.Negative, DispatchPattern=dispatch_15.ListA)  # -> ListA, ListB
geometry_15 = Geometry(dispatch_16.ListA)
panel_2 = Panel(distance_4)
dispatch_17 = Dispatch(List=point_8, DispatchPattern=simplify(larger_than_3.LargerThan))  # -> ListA, ListB
dispatch_18 = Dispatch(List=split_tree_4.Positive, DispatchPattern=dispatch_17.ListA)  # -> ListA, ListB
geometry_16 = Geometry(dispatch_18.ListA)
dispatch_19 = Dispatch(List=point_9, DispatchPattern=simplify(larger_than_4.LargerThan))  # -> ListA, ListB
dispatch_20 = Dispatch(List=split_tree_4.Negative, DispatchPattern=dispatch_19.ListA)  # -> ListA, ListB
geometry_17 = Geometry(dispatch_20.ListA)
dispatch_21 = Dispatch(List=split_tree_5.Positive, DispatchPattern=dispatch_13.ListA)  # -> ListA, ListB
dispatch_22 = Dispatch(List=split_tree_5.Negative, DispatchPattern=dispatch_15.ListA)  # -> ListA, ListB
dispatch_23 = Dispatch(List=split_tree_6.Positive, DispatchPattern=dispatch_17.ListA)  # -> ListA, ListB
dispatch_24 = Dispatch(List=split_tree_6.Negative, DispatchPattern=dispatch_19.ListA)  # -> ListA, ListB
point_12 = Point(dispatch_21.ListA)
point_13 = Point(dispatch_22.ListA)
point_14 = Point(dispatch_23.ListA)
point_15 = Point(dispatch_24.ListA)
clean_tree_15 = CleanTree(RemoveNulls=True, RemoveInvalid=True, RemoveEmpty=Toggle(True), Tree=point_12)
clean_tree_16 = CleanTree(RemoveNulls=True, RemoveInvalid=True, RemoveEmpty=Toggle(True), Tree=point_13)
panel_3 = Panel(distance)
clean_tree_17 = CleanTree(RemoveNulls=True, RemoveInvalid=True, RemoveEmpty=Toggle(True), Tree=point_14)
clean_tree_18 = CleanTree(RemoveNulls=True, RemoveInvalid=True, RemoveEmpty=Toggle(True), Tree=point_15)
panel_4 = Panel(distance_3)
point_16 = Point(clean_tree_16)
point_17 = Point(clean_tree_15)
point_18 = Point(point_7)
point_19 = Point(point_6)
point_20 = Point(clean_tree_18)
point_21 = Point(clean_tree_17)
param_viewer_11 = ParamViewer(point_17)
point_22 = Point(point_9)
point_23 = Point(point_8)
param_viewer_12 = ParamViewer(point_21)
merge_13 = Merge(Data1=point_18, Data2=point_16)
merge_14 = Merge(Data1=point_19, Data2=point_17)
merge_15 = Merge(Data1=point_22, Data2=point_20)
merge_16 = Merge(Data1=point_23, Data2=point_21)
param_viewer_13 = ParamViewer(merge_14)
param_viewer_14 = ParamViewer(merge_16)
sort_along_curve_5 = SortAlongCurve(Points=merge_13, Curve=curve_8)  # -> simplify(Points), Indices
sort_along_curve_6 = SortAlongCurve(Points=merge_14, Curve=curve_7)  # -> simplify(Points), Indices
sort_along_curve_7 = SortAlongCurve(Points=merge_15, Curve=curve_10)  # -> simplify(Points), Indices
sort_along_curve_8 = SortAlongCurve(Points=merge_16, Curve=curve_9)  # -> simplify(Points), Indices
polyline_3 = PolyLine(Vertices=flatten(sort_along_curve_6.Points), Closed=False)
polyline_4 = PolyLine(Vertices=flatten(sort_along_curve_5.Points), Closed=False)

custom_preview_2 = CustomPreview(Geometry=geometry_10, Material=ColourSwatch(SwatchColor=RGBA(240, 63, 129, 197)))
custom_preview_3 = CustomPreview(Geometry=geometry_8, Material=ColourSwatch(SwatchColor=RGBA(65, 230, 231, 197)))
custom_preview_4 = CustomPreview(Geometry=geometry_14, Material=ColourSwatch(SwatchColor=RGBA(89, 252, 135, 197)))
custom_preview_5 = CustomPreview(Geometry=geometry_15, Material=ColourSwatch(SwatchColor=RGBA(89, 252, 135, 197)))

polyline_5 = PolyLine(Vertices=flatten(sort_along_curve_8.Points), Closed=False)
polyline_6 = PolyLine(Vertices=flatten(sort_along_curve_7.Points), Closed=False)
# Final Pts
merge_17 = Merge(Data1=sort_along_curve_6.Points, Data2=sort_along_curve_5.Points)
geometry_18 = Geometry(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)
# Final Pts
merge_18 = Merge(Data1=sort_along_curve_8.Points, Data2=sort_along_curve_7.Points)
area_8 = Area(Geometry=geometry_18)  # -> Area, Centroid
geometry_19 = Geometry(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)

custom_preview_6 = CustomPreview(Geometry=geometry_13, Material=ColourSwatch(SwatchColor=RGBA(240, 63, 129, 197)))
custom_preview_7 = CustomPreview(Geometry=geometry_11, Material=ColourSwatch(SwatchColor=RGBA(65, 230, 231, 197)))
custom_preview_8 = CustomPreview(Geometry=geometry_16, Material=ColourSwatch(SwatchColor=RGBA(89, 252, 135, 197)))
custom_preview_9 = CustomPreview(Geometry=geometry_17, Material=ColourSwatch(SwatchColor=RGBA(89, 252, 135, 197)))

polyline_7 = PolyLine(Vertices=flatten(merge_17), Closed=False)
list_item_8 = ListItem(List=flatten(merge_17), Index=Slider(0, range=0..343), Wrap=True)
area_9 = Area(Geometry=geometry_19)  # -> Area, Centroid
polyline_8 = PolyLine(Vertices=flatten(merge_18), Closed=False)
list_item_9 = ListItem(List=flatten(merge_18), Index=Slider(0, range=0..343), Wrap=True)
number_slider_18 = Slider(0, range=0..79)
orient_7 = Orient(Geometry=geometry_18, Source=area_8.Centroid, Target=merge_17)  # -> Geometry, Transform
orient_8 = Orient(Geometry=geometry_19, Source=area_9.Centroid, Target=merge_18)  # -> Geometry, Transform
geometry_20 = Geometry(orient_7.Geometry)
addition = Addition(A=number_slider_18, B=Slider(1, range=0..79))
geometry_21 = Geometry(orient_8.Geometry)
tree_statistics_11 = TreeStatistics(Tree=geometry_21)  # -> Paths, Length, Count
list_item_10 = ListItem(List=tree_statistics_11.Paths, Index=number_slider_18, Wrap=True)
list_item_11 = ListItem(List=tree_statistics_11.Paths, Index=addition, Wrap=True)
merge_19 = Merge(Data1=list_item_10, Data2=list_item_11)
split_tree_7 = SplitTree(Data=geometry_21, Masks=flatten(merge_19))  # -> Positive, Negative
custom_preview_10 = CustomPreview(Geometry=geometry_20, Material=ColourSwatch(SwatchColor=RGBA(185, 219, 129, 197)))  # disabled
custom_preview_11 = CustomPreview(Geometry=split_tree_7.Positive, Material=ColourSwatch(SwatchColor=RGBA(229, 184, 117, 197)))  # disabled
