# Grasshopper definition 20230118 fixing column 4 git.gh (Grasshopper 1.0.7)
# plug-ins: treesloth01, Kangaroo2 Components

# Distance between each bullet
# Layer Height
number_slider = Slider(2, range=0..10)
number_slider_2 = Slider(9, range=0..100)
number_slider_3 = Slider(7, range=0..10)
division = Division(A=number_slider_2, B=number_slider)
# IMPUT with 2 ellipses loft together
number_slider_4 = Slider(161, range=0..1000)
multiplication = Multiplication(A=division, B=Slider(11, range=0..100))
unit_z = UnitZ(Factor=multiplication)
negative = Negative(Value=number_slider_4)
number_slider_5 = Slider(-140, range=-150..0)
number_slider_6 = Slider(140, range=0..1000)
point = Point(Point(187.0779998, -177.8772965, 0))
construct_domain = ConstructDomain(DomainStart=negative, DomainEnd=number_slider_4)
xy_plane = XYPlane(Origin=point)
move = Move(Geometry=xy_plane, Motion=unit_z)  # -> Geometry, Transform
construct_domain_2 = ConstructDomain(DomainStart=negative, DomainEnd=number_slider_4)
multiplication_2 = Multiplication(A=number_slider_3, B=Slider(4, range=0..11))
multiplication_3 = Multiplication(A=number_slider_3, B=Slider(5, range=0..11))
xz_plane = XZPlane(Origin=point)
construct_domain_3 = ConstructDomain(DomainStart=number_slider_5, DomainEnd=number_slider_6)
construct_domain_4 = ConstructDomain(DomainStart=number_slider_5, DomainEnd=number_slider_6)
ellipse = Ellipse(Plane=move.Geometry, Radius1=multiplication_2, Radius2=Slider(11, range=0..55))  # -> Ellipse, Focus1, Focus2
ellipse_2 = Ellipse(Plane=xy_plane, Radius1=multiplication_3, Radius2=Slider(26.12, range=0..55))  # -> Ellipse, Focus1, Focus2
rectangle = Rectangle(Plane=xz_plane, XSize=construct_domain, YSize=construct_domain_2, Radius=0)  # -> Rectangle, Length
# IMPUT with 2 ellipses
merge = Merge(Data1=ellipse_2.Ellipse, Data2=ellipse.Ellipse)
rectangle_2 = Rectangle(Plane=xy_plane, XSize=construct_domain_3, YSize=construct_domain_4, Radius=0)  # -> Rectangle, Length
number_slider_7 = Slider(2.5, range=0..10)
boundary_surfaces = BoundarySurfaces(Edges=rectangle.Rectangle)
loft = Loft(Curves=merge, Options={Adjust=False, Closed=False, LoftEnds=0, LoftSimp=0, LoftType=0, Rebuild=10, Refit=0.01})
division_2 = Division(A=number_slider_2, B=Slider(2, range=0..10))
explode = Explode(Curve=rectangle_2.Rectangle, Recursive=True)  # -> Segments, Vertices
contour = Contour(Shape=loft, Point=point, Direction=Vector(0, 0, 1), Distance=division_2)
brep_curve = BrepCurve(Brep=boundary_surfaces, Curve=contour)  # -> Curves, simplify(Points)
number_slider_8 = Slider(7, range=0..10)
list_item = ListItem(List=explode.Segments, Index=0, Wrap=True)
list_item_2 = ListItem(List=explode.Segments, Index=Slider(2, range=0..10), Wrap=True)
boundary_surfaces_2 = BoundarySurfaces(Edges=contour)  # -> simplify(Surfaces)
dispatch = Dispatch(List=flatten(boundary_surfaces_2), DispatchPattern=[True, False])  # -> ListA, ListB
divide_length = DivideLength(Curve=list_item_2, Length=number_slider_8)  # -> reverse(Points), Tangents, Parameters
divide_length_2 = DivideLength(Curve=list_item, Length=number_slider_8)  # -> Points, Tangents, Parameters
division_3 = Division(A=number_slider_8, B=Slider(2, range=0..10))
tree_item = TreeItem(Tree=boundary_surfaces_2, Path=Slider(0, range=0..100), Index=0, Wrap=True)
unit_x = UnitX(Factor=division_3)

geometry = Geometry(dispatch.ListA)
geometry_2 = Geometry(dispatch.ListB)

list_length = ListLength(List=geometry_2)
list_length_2 = ListLength(List=geometry)
series = Series(Start=division_2, Step=number_slider_2, Count=list_length)
series_2 = Series(Start=0, Step=number_slider_2, Count=list_length_2)
unit_z_2 = UnitZ(Factor=series)
unit_z_3 = UnitZ(Factor=series_2)
line = Line(StartPoint=divide_length_2.Points, EndPoint=divide_length.Points)
curve = Curve(line)
move_2 = Move(Geometry=curve, Motion=simplify(graft(unit_z_3)))  # -> simplify(Geometry), Transform
move_3 = Move(Geometry=curve, Motion=unit_x)  # -> Geometry, Transform
brep_curve_2 = BrepCurve(Brep=tree_item, Curve=curve)  # -> simplify(Curves), Points
unit_z_4 = UnitZ(Factor=division_2)
curve_2 = Curve(move_3.Geometry)
move_4 = Move(Geometry=curve_2, Motion=simplify(graft(unit_z_2)))  # -> simplify(Geometry), Transform
clean_tree = CleanTree(RemoveNulls=True, RemoveInvalid=True, RemoveEmpty=Toggle(True), Tree=brep_curve_2.Points)
clean_tree_2 = CleanTree(RemoveNulls=True, RemoveInvalid=True, RemoveEmpty=Toggle(True), Tree=brep_curve_2.Curves)
move_5 = Move(Geometry=curve_2, Motion=unit_z_4)  # -> Geometry, Transform
brep_curve_3 = BrepCurve(Brep=graft(geometry_2), Curve=move_4.Geometry)  # -> simplify(Curves), simplify(Points)
brep_curve_4 = BrepCurve(Brep=graft(geometry), Curve=move_2.Geometry)  # -> simplify(Curves), simplify(Points)
list_item_3 = ListItem(List=geometry_2, Index=0, Wrap=True)
clean_tree_3 = CleanTree(RemoveNulls=True, RemoveInvalid=True, RemoveEmpty=Toggle(True), Tree=brep_curve_3.Curves)  # -> simplify(Tree)
brep_curve_5 = BrepCurve(Brep=list_item_3, Curve=move_5.Geometry)  # -> simplify(Curves), Points
clean_tree_4 = CleanTree(RemoveNulls=True, RemoveInvalid=True, RemoveEmpty=Toggle(True), Tree=brep_curve_4.Curves)  # -> simplify(Tree)
flatten_tree = FlattenTree(Tree=clean_tree, Path="{0}")  # -> simplify(graft(Tree))
flatten_tree_2 = FlattenTree(Tree=clean_tree_2, Path="{0}")  # -> simplify(graft(Tree))
null_item = NullItem(Item=brep_curve_4.Points)  # -> NullFlags, InvalidFlags, Description
clean_tree_5 = CleanTree(RemoveNulls=True, RemoveInvalid=True, RemoveEmpty=Toggle(True), Tree=brep_curve_5.Curves)
trim_tree = TrimTree(Tree=clean_tree_3, Depth=1)
trim_tree_2 = TrimTree(Tree=clean_tree_4, Depth=1)
end_points = EndPoints(Curve=flatten_tree_2)  # -> Start, End
null_item_2 = NullItem(Item=brep_curve_3.Points)  # -> NullFlags, InvalidFlags, Description
flatten_tree_3 = FlattenTree(Tree=clean_tree_5, Path="{0}")  # -> simplify(graft(Tree))
explode_2 = Explode(Curve=trim_tree, Recursive=True)  # -> Segments, Vertices
tree_item_2 = TreeItem(Tree=flatten_tree, Path=Slider(0, range=0..100), Index=0, Wrap=True)
tree_item_3 = TreeItem(Tree=flatten_tree, Path=Slider(1, range=0..100), Index=0, Wrap=True)
dispatch_2 = Dispatch(List=brep_curve_4.Points, DispatchPattern=invert(null_item.InvalidFlags))  # -> ListA, ListB
explode_3 = Explode(Curve=trim_tree_2, Recursive=True)  # -> Segments, Vertices
tree_statistics = TreeStatistics(Tree=trim_tree)  # -> Paths, Length, Count
tree_statistics_2 = TreeStatistics(Tree=trim_tree_2)  # -> Paths, Length, Count
explode_4 = Explode(Curve=flatten_tree_3, Recursive=True)  # -> Segments, Vertices
dispatch_3 = Dispatch(List=brep_curve_3.Points, DispatchPattern=invert(null_item_2.InvalidFlags))  # -> ListA, ListB
merge_2 = Merge(Data1=graft(tree_item_2), Data2=end_points.End, Data3=graft(tree_item_3), Data4=end_points.Start)
clean_tree_6 = CleanTree(RemoveNulls=True, RemoveInvalid=True, RemoveEmpty=Toggle(True), Tree=dispatch_2.ListA)
flatten_tree_4 = FlattenTree(Tree=explode_2.Vertices, Path="{0}")
entwine = Entwine(Branch00=tree_item_2, Branch01=end_points.End, Branch02=tree_item_3, Branch03=end_points.Start, FlattenInputs=True)  # -> simplify(Result)
flatten_tree_5 = FlattenTree(Tree=explode_3.Vertices, Path="{0}")
multiplication_4 = Multiplication(A=tree_statistics.Length, B=Slider(2, range=0..10))
multiplication_5 = Multiplication(A=tree_statistics_2.Length, B=Slider(2, range=0..10))
clean_tree_7 = CleanTree(RemoveNulls=True, RemoveInvalid=True, RemoveEmpty=Toggle(True), Tree=dispatch_3.ListA)
flatten_tree_6 = FlattenTree(Tree=entwine, Path="{0}")
partition_list = PartitionList(List=flatten_tree_4, Size=multiplication_4)  # -> simplify(Chunks)
shift_paths = ShiftPaths(Data=clean_tree_6, Offset=-1)
partition_list_2 = PartitionList(List=flatten_tree_5, Size=multiplication_5)  # -> simplify(Chunks)
merge_3 = Merge(Data1=flatten_tree_6, Data2=flatten(explode_4.Vertices))
graft_tree = GraftTree(Tree=flatten_tree_6, IncludeEmptyLists=True, IncludeNullItems=True)
merge_4 = Merge(Data1=partition_list_2, Data2=shift_paths)
yz_plane = YZPlane(Origin=point)
shift_paths_2 = ShiftPaths(Data=clean_tree_7, Offset=-1)
merge_5 = Merge(Data1=partition_list, Data2=shift_paths_2)
param_viewer = ParamViewer(partition_list_2)
yz_plane_2 = YZPlane(Origin=point)
point_2 = Point(merge_5)
point_3 = Point(merge_4)
param_viewer_2 = ParamViewer(point_3)
param_viewer_3 = ParamViewer(point_2)
merge_6 = Merge(Data1=point_3, Data2=point_2, Data3=brep_curve.Points)
polyline = PolyLine(Vertices=flatten(point_2), Closed=False)
# CT Line
curve_3 = Curve(simplify(contour))
geometry_3 = Geometry(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)
explode_5 = Explode(Curve=polyline, Recursive=True)  # -> Segments, Vertices
tree_statistics_3 = TreeStatistics(Tree=curve_3)  # -> Paths, Length, Count
area = Area(Geometry=geometry_3)  # -> Area, Centroid
area_2 = Area(Geometry=geometry_3)  # -> Area, Centroid
area_3 = Area(Geometry=geometry_3)  # -> Area, Centroid
dispatch_4 = Dispatch(List=tree_statistics_3.Paths, DispatchPattern=[True, False])  # -> ListA, ListB
orient = Orient(Geometry=geometry_3, Source=area.Centroid, Target=point_2)  # -> Geometry, Transform
orient_2 = Orient(Geometry=geometry_3, Source=area_2.Centroid, Target=brep_curve.Points)  # -> Geometry, Transform
orient_3 = Orient(Geometry=geometry_3, Source=area_3.Centroid, Target=point_3)  # -> Geometry, Transform
split_tree = SplitTree(Data=curve_3, Masks=flatten(dispatch_4.ListA))  # -> Positive, Negative
geometry_4 = Geometry(orient.Geometry)
geometry_5 = Geometry(orient_2.Geometry)
geometry_6 = Geometry(orient_3.Geometry)
tree_statistics_4 = TreeStatistics(Tree=geometry_5)  # -> Paths, Length, Count
curve_4 = Curve(split_tree.Negative)
curve_5 = Curve(split_tree.Positive)
dispatch_5 = Dispatch(List=tree_statistics_4.Paths, DispatchPattern=[True, False])  # -> ListA, ListB
sort_along_curve = SortAlongCurve(Points=point_2, Curve=curve_4)  # -> Points, Indices
sort_along_curve_2 = SortAlongCurve(Points=point_3, Curve=curve_5)  # -> Points, Indices
point_4 = Point(simplify(sort_along_curve.Points))
point_5 = Point(point_4)
point_6 = Point(simplify(sort_along_curve_2.Points))
split_tree_2 = SplitTree(Data=geometry_5, Masks=flatten(dispatch_5.ListA))  # -> Positive, Negative
shift_list = ShiftList(List=point_6, Shift=1, Wrap=True)
shift_list_2 = ShiftList(List=point_4, Shift=1, Wrap=True)
point_7 = Point(brep_curve.Points)
list_item_4 = ListItem(List=point_5, Index=0, Wrap=True)
list_item_5 = ListItem(List=point_5, Index=Slider(-1, range=-1..0), Wrap=True)
merge_7 = Merge(Data1=list_item_4, Data2=list_item_5)
mirror = Mirror(Geometry=merge_7, Plane=yz_plane)  # -> Geometry, Transform
tree_statistics_5 = TreeStatistics(Tree=mirror.Geometry)  # -> Paths, Length, Count
closest_points = ClosestPoints(Point=point_5, Cloud=mirror.Geometry, Count=tree_statistics_5.Count)  # -> ClosestPoint, CPIndex, Distance
removeduplicatepts = RemoveDuplicatePts(Points=flatten(closest_points.ClosestPoint), Tolerance=0.01)
construct_path = ConstructPath(Indices=list_item_5)
partition_list_3 = PartitionList(List=removeduplicatepts, Size=tree_statistics_5.Length)  # -> simplify(Chunks)
tree_statistics_6 = TreeStatistics(Tree=partition_list_3)  # -> Paths, Length, Count
tree_statistics_7 = TreeStatistics(Tree=construct_path)  # -> Paths, Length, Count
replace_paths = ReplacePaths(Data=partition_list_3, Search=tree_statistics_6.Paths, Replace=tree_statistics_7.Paths)
dispatch_6 = Dispatch(List=replace_paths, DispatchPattern=[True, False])  # -> ListA, ListB
point_8 = Point(dispatch_6.ListA)
point_9 = Point(dispatch_6.ListB)
tree_statistics_8 = TreeStatistics(Tree=point_7)  # -> Paths, Length, Count

# ----
# Distances to add green bullets
number_slider_9 = Slider(15, range=0..100)

list_item_6 = ListItem(List=point_6, Index=0, Wrap=True)
list_item_7 = ListItem(List=point_6, Index=Slider(-1, range=-1..0), Wrap=True)
merge_8 = Merge(Data1=list_item_6, Data2=list_item_7)
mirror_2 = Mirror(Geometry=merge_8, Plane=yz_plane_2)  # -> Geometry, Transform
tree_statistics_9 = TreeStatistics(Tree=mirror_2.Geometry)  # -> Paths, Length, Count
closest_points_2 = ClosestPoints(Point=point_6, Cloud=mirror_2.Geometry, Count=tree_statistics_9.Count)  # -> ClosestPoint, CPIndex, Distance
removeduplicatepts_2 = RemoveDuplicatePts(Points=flatten(closest_points_2.ClosestPoint), Tolerance=0.01)
construct_path_2 = ConstructPath(Indices=list_item_7)
partition_list_4 = PartitionList(List=removeduplicatepts_2, Size=tree_statistics_9.Length)  # -> simplify(Chunks)
tree_statistics_10 = TreeStatistics(Tree=partition_list_4)  # -> Paths, Length, Count
tree_statistics_11 = TreeStatistics(Tree=construct_path_2)  # -> Paths, Length, Count
replace_paths_2 = ReplacePaths(Data=partition_list_4, Search=tree_statistics_10.Paths, Replace=tree_statistics_11.Paths)
dispatch_7 = Dispatch(List=replace_paths_2, DispatchPattern=[True, False])  # -> ListA, ListB
point_10 = Point(dispatch_7.ListA)
point_11 = Point(dispatch_7.ListB)
distance = Distance(PointA=point_8, PointB=point_9)
distance_2 = Distance(PointA=list_item_4, PointB=list_item_5)
param_viewer_4 = ParamViewer(point_6)
distance_3 = Distance(PointA=point_6, PointB=shift_list)  # -> simplify(Distance)
distance_4 = Distance(PointA=point_4, PointB=shift_list_2)  # -> simplify(Distance)
param_viewer_5 = ParamViewer(point_4)
dispatch_8 = Dispatch(List=tree_statistics_8.Paths, DispatchPattern=[True, False])  # -> ListA, ListB
panel = Panel(distance)
panel_2 = Panel(distance_2)
distance_5 = Distance(PointA=point_10, PointB=point_11)
distance_6 = Distance(PointA=list_item_6, PointB=list_item_7)
smaller_than = SmallerThan(FirstNumber=distance, SecondNumber=Slider(8.3, range=0..100))  # -> SmallerThan, OrEqualTo
smaller_than_2 = SmallerThan(FirstNumber=distance_2, SecondNumber=Slider(8.3, range=0..100))  # -> SmallerThan, OrEqualTo
panel_3 = Panel(distance_5)
panel_4 = Panel(distance_6)
larger_than = LargerThan(FirstNumber=distance_3, SecondNumber=Slider(20, range=0..100))  # -> LargerThan, OrEqualTo
larger_than_2 = LargerThan(FirstNumber=distance_4, SecondNumber=number_slider_9)  # -> LargerThan, OrEqualTo
split_tree_3 = SplitTree(Data=point_7, Masks=flatten(dispatch_8.ListA))  # -> Positive, Negative
smaller_than_3 = SmallerThan(FirstNumber=distance_5, SecondNumber=Slider(8.3, range=0..100))  # -> SmallerThan, OrEqualTo
smaller_than_4 = SmallerThan(FirstNumber=distance_6, SecondNumber=Slider(8.3, range=0..100))  # -> SmallerThan, OrEqualTo
panel_5 = Panel(distance_4)
dispatch_9 = Dispatch(List=point_6, DispatchPattern=simplify(larger_than.LargerThan))  # -> ListA, ListB
dispatch_10 = Dispatch(List=split_tree_2.Positive, DispatchPattern=dispatch_9.ListA)  # -> ListA, ListB
geometry_7 = Geometry(dispatch_10.ListA)
dispatch_11 = Dispatch(List=point_4, DispatchPattern=simplify(larger_than_2.LargerThan))  # -> ListA, ListB
dispatch_12 = Dispatch(List=split_tree_2.Negative, DispatchPattern=dispatch_11.ListA)  # -> ListA, ListB
geometry_8 = Geometry(dispatch_12.ListA)
dispatch_13 = Dispatch(List=[point_8, point_9], DispatchPattern=smaller_than.SmallerThan)  # -> ListA, ListB
dispatch_14 = Dispatch(List=[list_item_4, list_item_5], DispatchPattern=smaller_than_2.SmallerThan)  # -> ListA, ListB
merge_9 = Merge(Data1=point_8, Data2=point_9)
dispatch_15 = Dispatch(List=[point_10, point_11], DispatchPattern=smaller_than_3.SmallerThan)  # -> ListA, ListB
dispatch_16 = Dispatch(List=split_tree_3.Positive, DispatchPattern=dispatch_9.ListA)  # -> ListA, ListB
dispatch_17 = Dispatch(List=[list_item_6, list_item_7], DispatchPattern=smaller_than_4.SmallerThan)  # -> ListA, ListB
dispatch_18 = Dispatch(List=split_tree_3.Negative, DispatchPattern=dispatch_11.ListA)  # -> ListA, ListB
boolean_toggle = BooleanToggle(True)
boolean_toggle_2 = BooleanToggle(True)
merge_10 = Merge(Data1=point_10, Data2=point_11)
point_12 = Point(dispatch_13.ListA)
point_13 = Point(dispatch_14.ListA)
point_14 = Point(dispatch_13.ListB)
boolean_toggle_3 = BooleanToggle(True)
point_15 = Point(dispatch_14.ListB)
boolean_toggle_4 = BooleanToggle(True)
clean_tree_8 = CleanTree(RemoveNulls=True, RemoveInvalid=True, RemoveEmpty=boolean_toggle, Tree=point_14)
clean_tree_9 = CleanTree(RemoveNulls=True, RemoveInvalid=boolean_toggle_2, RemoveEmpty=boolean_toggle_2, Tree=point_13)
clean_tree_10 = CleanTree(RemoveNulls=True, RemoveInvalid=True, RemoveEmpty=boolean_toggle_2, Tree=point_15)
point_16 = Point(dispatch_16.ListA)
point_17 = Point(dispatch_18.ListA)
point_18 = Point(dispatch_15.ListA)
point_19 = Point(dispatch_17.ListA)
point_20 = Point(dispatch_15.ListB)
point_21 = Point(dispatch_17.ListB)
clean_tree_11 = CleanTree(RemoveNulls=True, RemoveInvalid=boolean_toggle, RemoveEmpty=boolean_toggle, Tree=point_12)
clean_tree_12 = CleanTree(RemoveNulls=True, RemoveInvalid=True, RemoveEmpty=boolean_toggle_3, Tree=point_20)
clean_tree_13 = CleanTree(RemoveNulls=True, RemoveInvalid=boolean_toggle_4, RemoveEmpty=boolean_toggle_4, Tree=point_19)
clean_tree_14 = CleanTree(RemoveNulls=True, RemoveInvalid=True, RemoveEmpty=boolean_toggle_4, Tree=point_21)
clean_tree_15 = CleanTree(RemoveNulls=True, RemoveInvalid=boolean_toggle_3, RemoveEmpty=boolean_toggle_3, Tree=point_18)
dispatch_19 = Dispatch(List=clean_tree_8, DispatchPattern=[True, False])  # -> ListA, ListB
dispatch_20 = Dispatch(List=clean_tree_10, DispatchPattern=[True, False])  # -> ListA, ListB
tree_statistics_12 = TreeStatistics(Tree=clean_tree_11)  # -> Paths, Length, Count
dispatch_21 = Dispatch(List=clean_tree_9, DispatchPattern=[True, False])  # -> ListA, ListB
dispatch_22 = Dispatch(List=clean_tree_11, DispatchPattern=[True, False])  # -> ListA, ListB
tree_statistics_13 = TreeStatistics(Tree=clean_tree_9)  # -> Paths, Length, Count
clean_tree_16 = CleanTree(RemoveNulls=True, RemoveInvalid=True, RemoveEmpty=Toggle(True), Tree=point_16)
clean_tree_17 = CleanTree(RemoveNulls=True, RemoveInvalid=True, RemoveEmpty=Toggle(True), Tree=point_17)
dispatch_23 = Dispatch(List=clean_tree_12, DispatchPattern=[True, False])  # -> ListA, ListB
dispatch_24 = Dispatch(List=clean_tree_14, DispatchPattern=[True, False])  # -> ListA, ListB
tree_statistics_14 = TreeStatistics(Tree=clean_tree_15)  # -> Paths, Length, Count
dispatch_25 = Dispatch(List=clean_tree_13, DispatchPattern=[True, False])  # -> ListA, ListB
dispatch_26 = Dispatch(List=clean_tree_15, DispatchPattern=[True, False])  # -> ListA, ListB
tree_statistics_15 = TreeStatistics(Tree=clean_tree_13)  # -> Paths, Length, Count
panel_6 = Panel(distance_3)
distance_7 = Distance(PointA=dispatch_19.ListA, PointB=dispatch_19.ListB)
distance_8 = Distance(PointA=dispatch_20.ListA, PointB=dispatch_20.ListB)
distance_9 = Distance(PointA=dispatch_21.ListA, PointB=dispatch_21.ListB)
distance_10 = Distance(PointA=dispatch_22.ListA, PointB=dispatch_22.ListB)
distance_11 = Distance(PointA=dispatch_23.ListA, PointB=dispatch_23.ListB)
distance_12 = Distance(PointA=dispatch_24.ListA, PointB=dispatch_24.ListB)
point_22 = Point(clean_tree_17)
point_23 = Point(clean_tree_16)
point_24 = Point(point_4)
point_25 = Point(point_6)
distance_13 = Distance(PointA=dispatch_25.ListA, PointB=dispatch_25.ListB)
distance_14 = Distance(PointA=dispatch_26.ListA, PointB=dispatch_26.ListB)
smaller_than_5 = SmallerThan(FirstNumber=distance_7, SecondNumber=Slider(15, range=0..100))  # -> SmallerThan, OrEqualTo
smaller_than_6 = SmallerThan(FirstNumber=distance_8, SecondNumber=Slider(15, range=0..100))  # -> SmallerThan, OrEqualTo
panel_7 = Panel(distance_7)
panel_8 = Panel(distance_8)
param_viewer_6 = ParamViewer(point_23)
smaller_than_7 = SmallerThan(FirstNumber=distance_11, SecondNumber=Slider(15, range=0..100))  # -> SmallerThan, OrEqualTo
smaller_than_8 = SmallerThan(FirstNumber=distance_12, SecondNumber=Slider(15, range=0..100))  # -> SmallerThan, OrEqualTo
panel_9 = Panel(distance_11)
panel_10 = Panel(distance_12)
boolean_toggle_5 = BooleanToggle(True)
boolean_toggle_6 = BooleanToggle(True)
dispatch_27 = Dispatch(List=clean_tree_8, DispatchPattern=smaller_than_5.SmallerThan)  # -> ListA, ListB
dispatch_28 = Dispatch(List=clean_tree_10, DispatchPattern=smaller_than_6.SmallerThan)  # -> ListA, ListB
boolean_toggle_7 = BooleanToggle(True)
boolean_toggle_8 = BooleanToggle(True)
dispatch_29 = Dispatch(List=clean_tree_12, DispatchPattern=smaller_than_7.SmallerThan)  # -> ListA, ListB
dispatch_30 = Dispatch(List=clean_tree_14, DispatchPattern=smaller_than_8.SmallerThan)  # -> ListA, ListB
merge_11 = Merge(Data1=point_24, Data2=point_22)
merge_12 = Merge(Data1=point_25, Data2=point_23)
clean_tree_18 = CleanTree(RemoveNulls=True, RemoveInvalid=True, RemoveEmpty=boolean_toggle_5, Tree=dispatch_27.ListA)
clean_tree_19 = CleanTree(RemoveNulls=True, RemoveInvalid=True, RemoveEmpty=boolean_toggle_6, Tree=dispatch_28.ListA)
clean_tree_20 = CleanTree(RemoveNulls=True, RemoveInvalid=True, RemoveEmpty=boolean_toggle_5, Tree=dispatch_27.ListB)
clean_tree_21 = CleanTree(RemoveNulls=True, RemoveInvalid=True, RemoveEmpty=boolean_toggle_6, Tree=dispatch_28.ListB)
clean_tree_22 = CleanTree(RemoveNulls=True, RemoveInvalid=True, RemoveEmpty=boolean_toggle_7, Tree=dispatch_29.ListA)
clean_tree_23 = CleanTree(RemoveNulls=True, RemoveInvalid=True, RemoveEmpty=boolean_toggle_8, Tree=dispatch_30.ListA)
clean_tree_24 = CleanTree(RemoveNulls=True, RemoveInvalid=True, RemoveEmpty=boolean_toggle_7, Tree=dispatch_29.ListB)
clean_tree_25 = CleanTree(RemoveNulls=True, RemoveInvalid=True, RemoveEmpty=boolean_toggle_8, Tree=dispatch_30.ListB)
param_viewer_7 = ParamViewer(merge_12)
point_26 = Point(clean_tree_18)
point_27 = Point(clean_tree_19)
polyline_2 = PolyLine(Vertices=point_26, Closed=False)
length = Length(Curve=polyline_2)
polyline_3 = PolyLine(Vertices=point_27, Closed=False)
length_2 = Length(Curve=polyline_3)
point_28 = Point(clean_tree_22)
point_29 = Point(clean_tree_23)
division_4 = Division(A=Slider(15, range=0..100), B=length)
division_5 = Division(A=Slider(15, range=0..100), B=length_2)
polyline_4 = PolyLine(Vertices=point_28, Closed=False)
length_3 = Length(Curve=polyline_4)
polyline_5 = PolyLine(Vertices=point_29, Closed=False)
length_4 = Length(Curve=polyline_5)
sort_along_curve_3 = SortAlongCurve(Points=merge_11, Curve=curve_4)  # -> simplify(Points), Indices
sort_along_curve_4 = SortAlongCurve(Points=merge_12, Curve=curve_5)  # -> simplify(Points), Indices
division_6 = Division(A=Slider(15, range=0..100), B=length_3)
division_7 = Division(A=Slider(15, range=0..100), B=length_4)
cull_duplicates = CullDuplicates(Points=clean_tree_9, Tolerance=distance_9, CullMode=3)  # -> Points, Indices, Valence
curve_middle = CurveMiddle(Curve=polyline_2)
curve_middle_2 = CurveMiddle(Curve=polyline_3)
cull_duplicates_2 = CullDuplicates(Points=clean_tree_11, Tolerance=distance_10, CullMode=3)  # -> Points, Indices, Valence
cull_duplicates_3 = CullDuplicates(Points=clean_tree_13, Tolerance=distance_13, CullMode=3)  # -> Points, Indices, Valence
curve_middle_3 = CurveMiddle(Curve=polyline_4)
curve_middle_4 = CurveMiddle(Curve=polyline_5)
cull_duplicates_4 = CullDuplicates(Points=clean_tree_15, Tolerance=distance_14, CullMode=3)  # -> Points, Indices, Valence
scale = Scale(Geometry=point_26, Center=curve_middle, Factor=division_4)  # -> Geometry, Transform
scale_2 = Scale(Geometry=point_27, Center=curve_middle_2, Factor=division_5)  # -> Geometry, Transform
point_30 = Point(cull_duplicates.Points)
point_31 = Point(clean_tree_21)
point_32 = Point(clean_tree_20)
polyline_6 = PolyLine(Vertices=flatten(sort_along_curve_4.Points), Closed=False)
polyline_7 = PolyLine(Vertices=flatten(sort_along_curve_3.Points), Closed=False)
point_33 = Point(cull_duplicates_2.Points)
shift_paths_3 = ShiftPaths(Data=point_30, Offset=-1)

custom_preview = CustomPreview(Geometry=geometry_6, Material=ColourSwatch(SwatchColor=RGBA(240, 63, 129, 197)))
custom_preview_2 = CustomPreview(Geometry=geometry_4, Material=ColourSwatch(SwatchColor=RGBA(65, 230, 231, 197)))
custom_preview_3 = CustomPreview(Geometry=geometry_7, Material=ColourSwatch(SwatchColor=RGBA(89, 252, 135, 197)))
custom_preview_4 = CustomPreview(Geometry=geometry_8, Material=ColourSwatch(SwatchColor=RGBA(89, 252, 135, 197)))

scale_3 = Scale(Geometry=point_28, Center=curve_middle_3, Factor=division_6)  # -> Geometry, Transform
scale_4 = Scale(Geometry=point_29, Center=curve_middle_4, Factor=division_7)  # -> Geometry, Transform
point_34 = Point(cull_duplicates_3.Points)
point_35 = Point(clean_tree_25)
point_36 = Point(clean_tree_24)
shift_paths_4 = ShiftPaths(Data=point_33, Offset=-1)
point_37 = Point(cull_duplicates_4.Points)
shift_paths_5 = ShiftPaths(Data=point_34, Offset=-1)
# Final Pts
merge_13 = Merge(Data1=sort_along_curve_4.Points, Data2=sort_along_curve_3.Points)
shift_paths_6 = ShiftPaths(Data=point_37, Offset=-1)
merge_14 = Merge(Data1=point_31, Data2=scale_2.Geometry, Data3=simplify(shift_paths_3))
merge_15 = Merge(Data1=point_32, Data2=scale.Geometry, Data3=simplify(shift_paths_4))
merge_16 = Merge(Data1=list_item_4, Data2=list_item_5, Data3=point_8, Data4=point_9)
polyline_8 = PolyLine(Vertices=flatten(merge_13), Closed=False)
list_item_8 = ListItem(List=flatten(merge_13), Index=Slider(0, range=0..343), Wrap=True)
merge_17 = Merge(Data1=point_35, Data2=scale_4.Geometry, Data3=simplify(shift_paths_5))
merge_18 = Merge(Data1=point_36, Data2=scale_3.Geometry, Data3=simplify(shift_paths_6))
merge_19 = Merge(Data1=list_item_6, Data2=list_item_7, Data3=point_10, Data4=point_11)
closest_point = ClosestPoint(Point=merge_16, Cloud=point_5)  # -> ClosestPoint, CPIndex, Distance
number_slider_10 = Slider(0, range=0..10)
scale_5 = Scale(Geometry=merge_13, Center=point, Factor=Slider(10, range=0..10))  # -> Geometry, Transform
closest_point_2 = ClosestPoint(Point=merge_19, Cloud=point_6)  # -> ClosestPoint, CPIndex, Distance
tree_statistics_16 = TreeStatistics(Tree=merge_13)  # -> Paths, Length, Count
cull_index = CullIndex(List=point_5, Indices=closest_point.CPIndex, Wrap=True)
addition = Addition(A=number_slider_10, B=Slider(1, range=0..1))
point_38 = Point(scale_5.Geometry)
cull_index_2 = CullIndex(List=point_6, Indices=closest_point_2.CPIndex, Wrap=True)
point_39 = Point(simplify(cull_index))
merge_20 = Merge(Data1=point_39, Data2=merge_14, Data3=merge_15)
sort_along_curve_5 = SortAlongCurve(Points=merge_20, Curve=curve_4)  # -> Points, Indices
list_item_9 = ListItem(List=tree_statistics_16.Paths, Index=number_slider_10, Wrap=True)
list_item_10 = ListItem(List=tree_statistics_16.Paths, Index=addition, Wrap=True)
number_slider_11 = Slider(107, range=0..107)
geometry_9 = Geometry(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)
point_40 = Point(simplify(cull_index_2))
merge_21 = Merge(Data1=point_40, Data2=merge_17, Data3=merge_18)
split_tree_4 = SplitTree(Data=merge_13, Masks=flatten([list_item_9, list_item_10]))  # -> Positive, Negative
area_4 = Area(Geometry=geometry_9)  # -> Area, Centroid
sort_along_curve_6 = SortAlongCurve(Points=merge_21, Curve=curve_5)  # -> Points, Indices
point_41 = Point(simplify(sort_along_curve_5.Points))
point_42 = Point(split_tree_4.Positive)
point_43 = Point(simplify(sort_along_curve_6.Points))
orient_4 = Orient(Geometry=geometry_9, Source=area_4.Centroid, Target=point_42)  # -> Geometry, Transform
geometry_10 = Geometry(orient_4.Geometry)
merge_22 = Merge(Data1=point_43, Data2=point_23)
mesh_brep = MeshBrep(
    Brep=geometry_10,
    Settings={GridMaxCount=0, GridMinCount=16, JaggedSeams=False, MaxEdgeLength=0, MinEdgeLength=0.0001, MinTolerance=0, Refine=True, RefineAngle=0, RelativeTolerance=0.65, SimplePlanes=True, Tolerance=0})
merge_23 = Merge(Data1=point_41, Data2=point_22)
sort_along_curve_7 = SortAlongCurve(Points=merge_22, Curve=curve_5)  # -> Points, Indices
mesh = Mesh(mesh_brep)
sort_along_curve_8 = SortAlongCurve(Points=merge_23, Curve=curve_4)  # -> Points, Indices
custom_preview_5 = CustomPreview(Geometry=mesh, Material=ColourSwatch(SwatchColor=RGBA(185, 219, 129, 197)))  # disabled
point_44 = Point(simplify(sort_along_curve_8.Points))
point_45 = Point(simplify(sort_along_curve_7.Points))
geometry_11 = Geometry(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)
geometry_12 = Geometry(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)
geometry_13 = Geometry(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)
area_5 = Area(Geometry=geometry_11)  # -> Area, Centroid
area_6 = Area(Geometry=geometry_13)  # -> Area, Centroid
# Fixed Final Pts
merge_24 = Merge(Data1=point_45, Data2=point_44)
area_7 = Area(Geometry=geometry_12)  # -> Area, Centroid
polyline_9 = PolyLine(Vertices=flatten(merge_24), Closed=False)
orient_5 = Orient(Geometry=geometry_11, Source=area_5.Centroid, Target=merge_24)  # -> Geometry, Transform
orient_6 = Orient(Geometry=geometry_13, Source=area_6.Centroid, Target=point_43)  # -> Geometry, Transform
orient_7 = Orient(Geometry=geometry_12, Source=area_7.Centroid, Target=point_41)  # -> Geometry, Transform
point_46 = Point(merge_24)
geometry_14 = Geometry(orient_5.Geometry)
geometry_15 = Geometry(orient_6.Geometry)
scale_6 = Scale(Geometry=point_46, Center=point, Factor=Slider(10, range=0..10))  # -> Geometry, Transform
geometry_16 = Geometry(orient_7.Geometry)
mesh_brep_2 = MeshBrep(
    Brep=geometry_14,
    Settings={GridMaxCount=0, GridMinCount=16, JaggedSeams=False, MaxEdgeLength=0, MinEdgeLength=0.0001, MinTolerance=0, Refine=True, RefineAngle=0, RelativeTolerance=0.65, SimplePlanes=True, Tolerance=0})
mesh_brep_3 = MeshBrep(
    Brep=geometry_15,
    Settings={GridMaxCount=0, GridMinCount=16, JaggedSeams=False, MaxEdgeLength=0, MinEdgeLength=0.0001, MinTolerance=0, Refine=True, RefineAngle=0, RelativeTolerance=0.65, SimplePlanes=True, Tolerance=0})
mesh_brep_4 = MeshBrep(
    Brep=geometry_16,
    Settings={GridMaxCount=0, GridMinCount=16, JaggedSeams=False, MaxEdgeLength=0, MinEdgeLength=0.0001, MinTolerance=0, Refine=True, RefineAngle=0, RelativeTolerance=0.65, SimplePlanes=True, Tolerance=0})
mesh_2 = Mesh(mesh_brep_2)
mesh_3 = Mesh(mesh_brep_3)
point_47 = Point(Tree({0}: [Point(537.0779998, -177.8772965, 0), Point(467.0779998, -334.5972965, 0), Point(397.0779998, -386.8372965, 0), Point(327.0779998, -417.2710508, 0), Point(257.0779998, -433.7999849, 0), Point(187.0779998, -439.0772965, 0), Point(117.0779998, -433.7999849, 0), Point(47.07799982, -417.2710508, 0), Point(-22.92200018, -386.8372965, 0), Point(-92.92200018, -334.5972965, 0), Point(-162.9220002, -177.8772965, 0), Point(-92.92200018, -21.15729652, 0), Point(-22.92200018, 31.08270348, 0), Point(47.07799982, 61.51645778, 0), Point(117.0779998, 78.0453918, 0), Point(187.0779998, 83.32270348, 0), Point(257.0779998, 78.0453918, 0), Point(327.0779998, 61.51645778, 0), Point(397.0779998, 31.08270348, 0), Point(467.0779998, -21.15729652, 0)], {1}: [Point(530.7143635, -177.8772965, 45), Point(502.0779998, -276.7731557, 45), Point(432.0779998, -351.3928426, 45), Point(362.0779998, -390.8399342, 45), Point(292.0779998, -413.4971428, 45), Point(222.0779998, -424.0449739, 45)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], {2}: [Point(524.3507271, -177.8772965, 90), Point(467.0779998, -308.1660288, 90), Point(397.0779998, -360.7563477, 90), Point(327.0779998, -390.5007732, 90), Point(257.0779998, -406.4973746, 90), Point(187.0779998, -411.5863874, 90)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], {3}: [Point(502.0779998, -252.8772965, 135), Point(432.0779998, -325.7332175, 135), Point(362.0779998, -364.5643295, 135), Point(292.0779998, -386.4737927, 135), Point(222.0779998, -396.6070915, 135), Point(152.0779998, -396.6070915, 135)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], {4}: [Point(511.6234544, -177.8772965, 180), Point(467.0779998, -282.1492716, 180), Point(397.0779998, -335.106304, 180), Point(327.0779998, -363.9219554, 180), Point(257.0779998, -379.2416619, 180), Point(187.0779998, -384.0954783, 180)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], {5}: [Point(502.0779998, -177.8772965, 225), Point(432.0779998, -300.6833433, 225), Point(362.0779998, -338.6237153, 225), Point(292.0779998, -359.567881, 225), Point(222.0779998, -369.1820198, 225), Point(152.0779998, -369.1820198, 225), Point(82.07799982, -359.567881, 225), Point(12.07799982, -338.6237153, 225), Point(-57.92200018, -300.6833433, 225), Point(-127.9220002, -177.8772965, 225), Point(-57.92200018, -55.07124974, 225), Point(12.07799982, -17.13087777, 225), Point(82.07799982, 3.813287953, 225), Point(152.0779998, 13.42742678, 225), Point(222.0779998, 13.42742678, 225), Point(292.0779998, 3.813287953, 225), Point(362.0779998, -17.13087777, 225), Point(432.0779998, -55.07124974, 225)], {6}: [Point(467.0779998, -256.5313709, 270), Point(397.0779998, -309.9951977, 270), Point(327.0779998, -337.5776233, 270), Point(257.0779998, -352.0428129, 270), Point(187.0779998, -356.6045693, 270), Point(117.0779998, -352.0428129, 270), Point(47.07799982, -337.5776233, 270), Point(-22.92200018, -309.9951977, 270), Point(-92.92200018, -256.5313709, 270), Point(-92.92200018, -99.22322211, 270), Point(-22.92200018, -45.75939536, 270), Point(47.07799982, -18.17696976, 270), Point(117.0779998, -3.71178012, 270), Point(187.0779998, 0.8499762026, 270), Point(257.0779998, -3.71178012, 270), Point(327.0779998, -18.17696976, 270), Point(397.0779998, -45.75939536, 270), Point(467.0779998, -99.22322211, 270)], {7}: [Point(492.5325453, -177.8772965, 315), Point(432.0779998, -276.4064393, 315), Point(362.0779998, -313.0986425, 315), Point(292.0779998, -332.8053207, 315), Point(222.0779998, -341.772485, 315), Point(152.0779998, -341.772485, 315), Point(82.07799982, -332.8053207, 315), Point(12.07799982, -313.0986425, 315), Point(-57.92200018, -276.4064393, 315), Point(-118.3765456, -177.8772965, 315), Point(-57.92200018, -79.34815373, 315), Point(12.07799982, -42.65595059, 315), Point(82.07799982, -22.94927235, 315), Point(152.0779998, -13.98210803, 315), Point(222.0779998, -13.98210803, 315), Point(292.0779998, -22.94927235, 315), Point(362.0779998, -42.65595059, 315), Point(432.0779998, -79.34815373, 315)], {8}: [Point(467.0779998, -252.8772965, 360), Point(397.0779998, -285.5653136, 360), Point(327.0779998, -311.522359, 360), Point(257.0779998, -324.9132749, 360), Point(187.0779998, -329.1136602, 360), Point(117.0779998, -324.9132749, 360), Point(47.07799982, -311.522359, 360), Point(-22.92200018, -285.5653136, 360), Point(-92.92200018, -252.8772965, 360), Point(-92.92200018, -102.8772965, 360), Point(-22.92200018, -70.18927949, 360), Point(47.07799982, -44.23223406, 360), Point(117.0779998, -30.84131812, 360), Point(187.0779998, -26.64093289, 360), Point(257.0779998, -30.84131812, 360), Point(327.0779998, -44.23223406, 360), Point(397.0779998, -70.18927949, 360), Point(467.0779998, -102.8772965, 360)], {9}: [Point(479.8052725, -177.8772965, 405), Point(432.0779998, -253.1218619, 405), Point(362.0779998, -288.0935605, 405), Point(292.0779998, -306.2188136, 405), Point(222.0779998, -314.3818938, 405), Point(152.0779998, -314.3818938, 405), Point(82.07799982, -306.2188136, 405), Point(12.07799982, -288.0935605, 405), Point(-57.92200018, -253.1218619, 405), Point(-105.6492729, -177.8772965, 405), Point(-57.92200018, -102.6327311, 405), Point(12.07799982, -67.66103254, 405), Point(82.07799982, -49.53577948, 405), Point(152.0779998, -41.37269926, 405), Point(222.0779998, -41.37269926, 405), Point(292.0779998, -49.53577948, 405), Point(362.0779998, -67.66103254, 405), Point(432.0779998, -102.6327311, 405)], {10}: [Point(467.0779998, -177.8772965, 450), Point(397.0779998, -262.0080282, 450), Point(327.0779998, -285.8261567, 450), Point(257.0779998, -297.8687222, 450), Point(187.0779998, -301.6227511, 450), Point(117.0779998, -297.8687222, 450), Point(47.07799982, -285.8261567, 450), Point(-22.92200018, -262.0080282, 450), Point(-92.92200018, -177.8772965, 450), Point(-22.92200018, -93.74656487, 450), Point(47.07799982, -69.92843639, 450), Point(117.0779998, -57.88587082, 450), Point(187.0779998, -54.13184198, 450), Point(257.0779998, -57.88587082, 450), Point(327.0779998, -69.92843639, 450), Point(397.0779998, -93.74656487, 450)]))
mesh_4 = Mesh(mesh_brep_4)
custom_preview_6 = CustomPreview(Geometry=mesh_2, Material=ColourSwatch(SwatchColor=RGBA(229, 208, 129, 197)))
custom_preview_7 = CustomPreview(Geometry=mesh_3, Material=ColourSwatch(SwatchColor=RGBA(243, 77, 129, 197)))
custom_preview_8 = CustomPreview(Geometry=mesh_4, Material=ColourSwatch(SwatchColor=RGBA(84, 223, 212, 197)))
