# Grasshopper definition 20230119 fixing column 4 git.gh (Grasshopper 1.0.7)
# plug-ins: treesloth01, Kangaroo2 Components

number_slider = Slider(12, range=0..100)
division = Division(A=Slider(360, range=0..1000), B=number_slider)
multiplication = Multiplication(A=Slider(7, range=0..10), B=Slider(5, range=0..10))
multiplication_2 = Multiplication(A=Slider(7, range=0..10), B=Slider(5, range=0..10))
point = Point(<point referenced from the Rhino model>)
point_2 = Point(<point referenced from the Rhino model>)
division_2 = Division(A=division, B=Slider(2, range=0..10))
# Distance between each bullet
# Layer Height
number_slider_2 = Slider(2, range=0..10)  # disabled
polygon = Polygon(Plane=point, Radius=multiplication, Segments=number_slider, FilletRadius=0)  # -> Polygon, Length
number_slider_3 = Slider(9, range=0..100)  # disabled
number_slider_4 = Slider(7, range=0..10)  # disabled
polygon_2 = Polygon(Plane=point_2, Radius=multiplication_2, Segments=Slider(8, range=0..10), FilletRadius=0)  # -> Polygon, Length
# Distance between each bullet
# Layer Height
number_slider_5 = Slider(2, range=0..10)
number_slider_6 = Slider(11, range=0..100)  # disabled
number_slider_7 = Slider(9, range=0..100)
number_slider_8 = Slider(7, range=0..10)
rotate = Rotate(Geometry=polygon.Polygon, Angle=degrees(division_2), Plane=point)  # -> Geometry, Transform
division_3 = Division(A=number_slider_3, B=number_slider_2)  # disabled
# IMPUT with 2 ellipses loft together
number_slider_9 = Slider(161, range=0..1000)  # disabled
division_4 = Division(A=number_slider_7, B=number_slider_5)
explode = Explode(Curve=polygon_2.Polygon, Recursive=True)  # -> Segments, Vertices
number_slider_10 = Slider(300, range=0..1000)
multiplication_3 = Multiplication(A=division_3, B=number_slider_6)  # disabled
panel = Panel("""1
0
1""")
explode_2 = Explode(Curve=rotate.Geometry, Recursive=True)  # -> Segments, Vertices
multiplication_4 = Multiplication(A=division_4, B=Slider(11, range=0..100))
number_slider_11 = Slider(4, range=0..11)  # disabled
number_slider_12 = Slider(5, range=0..11)  # disabled
unit_z = UnitZ(Factor=multiplication_3)  # disabled
dispatch = Dispatch(List=explode.Vertices, DispatchPattern=[True, False])  # -> ListA, ListB
negative = Negative(Value=number_slider_9)  # disabled
unit_z_2 = UnitZ(Factor=multiplication_4)
dispatch_2 = Dispatch(List=explode_2.Vertices, DispatchPattern=panel)  # -> ListA, ListB
number_slider_13 = Slider(11, range=0..55)  # disabled
number_slider_14 = Slider(-140, range=-150..0)  # disabled
number_slider_15 = Slider(140, range=0..1000)  # disabled
number_slider_16 = Slider(26.12, range=0..55)  # disabled

geometry = Geometry(<brep referenced from the Rhino model>)  # disabled
bounding_box = BoundingBox(Content=geometry, Plane=PlaneXY(0, 0, 0))  # -> Box, Box_2; disabled
number_slider_17 = Slider(4, range=0..10)  # disabled
deconstruct_brep = DeconstructBrep(Brep=bounding_box.Box)  # -> Faces, Edges, Vertices; disabled
list_item = ListItem(List=deconstruct_brep.Faces, Index=number_slider_17, Wrap=True)  # disabled
area = Area(Geometry=list_item)  # -> Area, Centroid; disabled
point_3 = Point(area.Centroid)  # disabled

point_4 = Point(Point(187.0779998, -177.8772965, 0))  # disabled
negative_2 = Negative(Value=number_slider_10)
point_list = PointList(Points=explode_2.Vertices, Size=Slider(5, range=0..10))
number_slider_18 = Slider(-140, range=-150..0)
number_slider_19 = Slider(140, range=0..1000)

# ----
# IMPUT with SRF
geometry_2 = Geometry(<brep referenced from the Rhino model>)
bounding_box_2 = BoundingBox(Content=geometry_2, Plane=PlaneXY(0, 0, 0))  # -> Box, Box_2
deconstruct_brep_2 = DeconstructBrep(Brep=bounding_box_2.Box)  # -> Faces, Edges, Vertices
list_item_2 = ListItem(List=deconstruct_brep_2.Faces, Index=Slider(4, range=0..10), Wrap=True)
area_2 = Area(Geometry=list_item_2)  # -> Area, Centroid
point_5 = Point(area_2.Centroid)

construct_domain = ConstructDomain(DomainStart=negative, DomainEnd=number_slider_9)  # disabled
xy_plane = XYPlane(Origin=point_4)  # disabled
move = Move(Geometry=xy_plane, Motion=unit_z)  # -> Geometry, Transform; disabled
construct_domain_2 = ConstructDomain(DomainStart=negative, DomainEnd=number_slider_9)  # disabled
multiplication_5 = Multiplication(A=number_slider_4, B=number_slider_11)  # disabled
multiplication_6 = Multiplication(A=number_slider_4, B=number_slider_12)  # disabled
xz_plane = XZPlane(Origin=point_4)  # disabled
point_6 = Point(dispatch.ListA)
point_7 = Point(dispatch.ListB)
point_8 = Point(dispatch_2.ListB)
construct_domain_3 = ConstructDomain(DomainStart=negative_2, DomainEnd=number_slider_10)
scale = Scale(Geometry=point_7, Center=point_2, Factor=Slider(0.433, range=0..1))  # -> Geometry, Transform
xy_plane_2 = XYPlane(Origin=point_5)
move_2 = Move(Geometry=xy_plane_2, Motion=unit_z_2)  # -> Geometry, Transform
point_9 = Point(dispatch_2.ListA)
construct_domain_4 = ConstructDomain(DomainStart=negative_2, DomainEnd=number_slider_10)
multiplication_7 = Multiplication(A=number_slider_8, B=Slider(4, range=0..11))
multiplication_8 = Multiplication(A=number_slider_8, B=Slider(5, range=0..11))
xz_plane_2 = XZPlane(Origin=point_5)
construct_domain_5 = ConstructDomain(DomainStart=number_slider_14, DomainEnd=number_slider_15)  # disabled
construct_domain_6 = ConstructDomain(DomainStart=number_slider_14, DomainEnd=number_slider_15)  # disabled
ellipse = Ellipse(Plane=move.Geometry, Radius1=multiplication_5, Radius2=number_slider_13)  # -> Ellipse, Focus1, Focus2; disabled
ellipse_2 = Ellipse(Plane=xy_plane, Radius1=multiplication_6, Radius2=number_slider_16)  # -> Ellipse, Focus1, Focus2; disabled
panel_2 = Panel("""1
1
0""")
construct_domain_7 = ConstructDomain(DomainStart=number_slider_18, DomainEnd=number_slider_19)
scale_2 = Scale(Geometry=point_8, Center=point, Factor=Slider(0.688, range=0..1))  # -> Geometry, Transform
construct_domain_8 = ConstructDomain(DomainStart=number_slider_18, DomainEnd=number_slider_19)
rectangle = Rectangle(Plane=xz_plane, XSize=construct_domain, YSize=construct_domain_2, Radius=0)  # -> Rectangle, Length; disabled
ellipse_3 = Ellipse(Plane=move_2.Geometry, Radius1=multiplication_7, Radius2=Slider(11, range=0..55))  # -> Ellipse, Focus1, Focus2
ellipse_4 = Ellipse(Plane=xy_plane_2, Radius1=multiplication_8, Radius2=Slider(26.12, range=0..55))  # -> Ellipse, Focus1, Focus2
weave = Weave(Pattern=[0, 1], Stream0=point_6, Stream1=scale.Geometry, NullGaps=False)
interpolate = Interpolate(Vertices=weave, Degree=Slider(3, range=0..10), Periodic=Toggle(True), KnotStyle=1)  # -> Curve, Length, Domain
number_slider_20 = Slider(2, range=0..10)  # disabled
rectangle_2 = Rectangle(Plane=xz_plane_2, XSize=construct_domain_3, YSize=construct_domain_4, Radius=0)  # -> Rectangle, Length
# IMPUT with 2 ellipses
merge = Merge(Data1=ellipse_2.Ellipse, Data2=ellipse.Ellipse)  # disabled
rectangle_3 = Rectangle(Plane=xy_plane, XSize=construct_domain_5, YSize=construct_domain_6, Radius=0)  # -> Rectangle, Length; disabled
number_slider_21 = Slider(2.5, range=0..10)  # disabled
# IMPUT with 2 ellipses
merge_2 = Merge(Data1=ellipse_4.Ellipse, Data2=ellipse_3.Ellipse)
boundary_surfaces = BoundarySurfaces(Edges=rectangle.Rectangle)  # disabled
rectangle_4 = Rectangle(Plane=xy_plane_2, XSize=construct_domain_7, YSize=construct_domain_8, Radius=0)  # -> Rectangle, Length
polyline = PolyLine(Vertices=weave, Closed=False)
number_slider_22 = Slider(2.5, range=0..10)
boundary_surfaces_2 = BoundarySurfaces(Edges=rectangle_2.Rectangle)
loft = Loft(Curves=merge, Options={Adjust=False, Closed=False, LoftEnds=0, LoftSimp=0, LoftType=0, Rebuild=10, Refit=0.01})  # disabled
number_slider_23 = Slider(2, range=0..10)  # disabled
multiplication_9 = Multiplication(A=Slider(9, range=0..10), B=Slider(20, range=0..100))
loft_2 = Loft(Curves=merge_2, Options={Adjust=False, Closed=False, LoftEnds=0, LoftSimp=0, LoftType=0, Rebuild=10, Refit=0.01})
division_5 = Division(A=number_slider_3, B=number_slider_20)  # disabled
explode_3 = Explode(Curve=rectangle_3.Rectangle, Recursive=True)  # -> Segments, Vertices; disabled
unit_z_3 = UnitZ(Factor=multiplication_9)
division_6 = Division(A=number_slider_7, B=Slider(2, range=0..10))
explode_4 = Explode(Curve=rectangle_4.Rectangle, Recursive=True)  # -> Segments, Vertices
contour = Contour(Shape=loft, Point=point_4, Direction=Vector(0, 0, 1), Distance=division_5)  # disabled
brep_curve = BrepCurve(Brep=boundary_surfaces, Curve=contour)  # -> Curves, simplify(Points); disabled
contour_2 = Contour(Shape=geometry_2, Point=point_5, Direction=Vector(0, 0, 1), Distance=division_6)
brep_curve_2 = BrepCurve(Brep=boundary_surfaces_2, Curve=contour_2)  # -> Curves, simplify(Points)
move_3 = Move(Geometry=polyline, Motion=unit_z_3)  # -> Geometry, Transform
area_3 = Area(Geometry=move_3.Geometry)  # -> Area, Centroid
number_slider_24 = Slider(7, range=0..10)  # disabled
list_item_3 = ListItem(List=explode_3.Segments, Index=0, Wrap=True)  # disabled
list_item_4 = ListItem(List=explode_3.Segments, Index=number_slider_23, Wrap=True)  # disabled
boundary_surfaces_3 = BoundarySurfaces(Edges=contour)  # -> simplify(Surfaces); disabled
number_slider_25 = Slider(2, range=0..10)  # disabled
number_slider_26 = Slider(0, range=0..100)  # disabled
number_slider_27 = Slider(7, range=0..10)
list_item_5 = ListItem(List=explode_4.Segments, Index=0, Wrap=True)
list_item_6 = ListItem(List=explode_4.Segments, Index=Slider(2, range=0..10), Wrap=True)
boundary_surfaces_4 = BoundarySurfaces(Edges=contour_2)  # -> simplify(Surfaces)
scale_3 = Scale(Geometry=move_3.Geometry, Center=area_3.Centroid, Factor=Slider(0.61, range=0..1))  # -> Geometry, Transform
dispatch_3 = Dispatch(List=flatten(boundary_surfaces_3), DispatchPattern=[True, False])  # -> ListA, ListB; disabled
dispatch_4 = Dispatch(List=flatten(boundary_surfaces_4), DispatchPattern=[True, False])  # -> ListA, ListB
divide_length = DivideLength(Curve=list_item_4, Length=number_slider_24)  # -> reverse(Points), Tangents, Parameters; disabled
divide_length_2 = DivideLength(Curve=list_item_3, Length=number_slider_24)  # -> Points, Tangents, Parameters; disabled
division_7 = Division(A=number_slider_24, B=number_slider_25)  # disabled
tree_item = TreeItem(Tree=boundary_surfaces_3, Path=number_slider_26, Index=0, Wrap=True)  # disabled
divide_length_3 = DivideLength(Curve=list_item_6, Length=number_slider_27)  # -> reverse(Points), Tangents, Parameters
divide_length_4 = DivideLength(Curve=list_item_5, Length=number_slider_27)  # -> Points, Tangents, Parameters
division_8 = Division(A=number_slider_27, B=Slider(2, range=0..10))
ruled_surface = RuledSurface(CurveA=polyline, CurveB=scale_3.Geometry)
tree_item_2 = TreeItem(Tree=boundary_surfaces_4, Path=Slider(0, range=0..100), Index=0, Wrap=True)
unit_x = UnitX(Factor=division_7)  # disabled

geometry_3 = Geometry(dispatch_3.ListA)  # disabled
geometry_4 = Geometry(dispatch_3.ListB)  # disabled

list_length = ListLength(List=geometry_4)  # disabled
list_length_2 = ListLength(List=geometry_3)  # disabled
series = Series(Start=division_5, Step=number_slider_3, Count=list_length)  # disabled
series_2 = Series(Start=0, Step=number_slider_3, Count=list_length_2)  # disabled
unit_z_4 = UnitZ(Factor=series)  # disabled
unit_z_5 = UnitZ(Factor=series_2)  # disabled
unit_x_2 = UnitX(Factor=division_8)

geometry_5 = Geometry(dispatch_4.ListA)
geometry_6 = Geometry(dispatch_4.ListB)

list_length_3 = ListLength(List=geometry_6)
list_length_4 = ListLength(List=geometry_5)
series_3 = Series(Start=division_6, Step=number_slider_7, Count=list_length_3)
series_4 = Series(Start=0, Step=number_slider_7, Count=list_length_4)
unit_z_6 = UnitZ(Factor=series_3)
unit_z_7 = UnitZ(Factor=series_4)
line = Line(StartPoint=divide_length_2.Points, EndPoint=divide_length.Points)  # disabled
geometry_7 = Geometry(ruled_surface)
line_2 = Line(StartPoint=divide_length_4.Points, EndPoint=divide_length_3.Points)
curve = Curve(line)  # disabled
move_4 = Move(Geometry=curve, Motion=simplify(graft(unit_z_5)))  # -> simplify(Geometry), Transform; disabled
move_5 = Move(Geometry=curve, Motion=unit_x)  # -> Geometry, Transform; disabled
brep_curve_3 = BrepCurve(Brep=tree_item, Curve=curve)  # -> simplify(Curves), Points; disabled
boolean_toggle = BooleanToggle(True)  # disabled
boolean_toggle_2 = BooleanToggle(True)  # disabled
unit_z_8 = UnitZ(Factor=division_5)  # disabled
curve_2 = Curve(line_2)
move_6 = Move(Geometry=curve_2, Motion=simplify(graft(unit_z_7)))  # -> simplify(Geometry), Transform
move_7 = Move(Geometry=curve_2, Motion=unit_x_2)  # -> Geometry, Transform
brep_curve_4 = BrepCurve(Brep=tree_item_2, Curve=curve_2)  # -> simplify(Curves), Points
unit_z_9 = UnitZ(Factor=division_6)
curve_3 = Curve(move_5.Geometry)  # disabled
move_8 = Move(Geometry=curve_3, Motion=simplify(graft(unit_z_4)))  # -> simplify(Geometry), Transform; disabled
clean_tree = CleanTree(RemoveNulls=True, RemoveInvalid=True, RemoveEmpty=boolean_toggle_2, Tree=brep_curve_3.Points)  # disabled
clean_tree_2 = CleanTree(RemoveNulls=True, RemoveInvalid=True, RemoveEmpty=boolean_toggle, Tree=brep_curve_3.Curves)  # disabled
curve_4 = Curve(move_7.Geometry)
move_9 = Move(Geometry=curve_4, Motion=simplify(graft(unit_z_6)))  # -> simplify(Geometry), Transform
move_10 = Move(Geometry=curve_3, Motion=unit_z_8)  # -> Geometry, Transform; disabled
brep_curve_5 = BrepCurve(Brep=graft(geometry_4), Curve=move_8.Geometry)  # -> simplify(Curves), simplify(Points); disabled
boolean_toggle_3 = BooleanToggle(True)  # disabled
brep_curve_6 = BrepCurve(Brep=graft(geometry_3), Curve=move_4.Geometry)  # -> simplify(Curves), simplify(Points); disabled
clean_tree_3 = CleanTree(RemoveNulls=True, RemoveInvalid=True, RemoveEmpty=Toggle(True), Tree=brep_curve_4.Points)
clean_tree_4 = CleanTree(RemoveNulls=True, RemoveInvalid=True, RemoveEmpty=Toggle(True), Tree=brep_curve_4.Curves)
boolean_toggle_4 = BooleanToggle(True)  # disabled
list_item_7 = ListItem(List=geometry_4, Index=0, Wrap=True)  # disabled
move_11 = Move(Geometry=curve_4, Motion=unit_z_9)  # -> Geometry, Transform
brep_curve_7 = BrepCurve(Brep=graft(geometry_6), Curve=move_9.Geometry)  # -> simplify(Curves), simplify(Points)
brep_curve_8 = BrepCurve(Brep=graft(geometry_5), Curve=move_6.Geometry)  # -> simplify(Curves), simplify(Points)
list_item_8 = ListItem(List=geometry_6, Index=0, Wrap=True)
boolean_toggle_5 = BooleanToggle(True)  # disabled
clean_tree_5 = CleanTree(RemoveNulls=True, RemoveInvalid=True, RemoveEmpty=boolean_toggle_3, Tree=brep_curve_5.Curves)  # -> simplify(Tree); disabled
brep_curve_9 = BrepCurve(Brep=list_item_7, Curve=move_10.Geometry)  # -> simplify(Curves), Points; disabled
clean_tree_6 = CleanTree(RemoveNulls=True, RemoveInvalid=True, RemoveEmpty=boolean_toggle_4, Tree=brep_curve_6.Curves)  # -> simplify(Tree); disabled
clean_tree_7 = CleanTree(RemoveNulls=True, RemoveInvalid=True, RemoveEmpty=Toggle(True), Tree=brep_curve_7.Curves)  # -> simplify(Tree)
brep_curve_10 = BrepCurve(Brep=list_item_8, Curve=move_11.Geometry)  # -> simplify(Curves), Points
clean_tree_8 = CleanTree(RemoveNulls=True, RemoveInvalid=True, RemoveEmpty=Toggle(True), Tree=brep_curve_8.Curves)  # -> simplify(Tree)
number_slider_28 = Slider(0, range=0..100)  # disabled
number_slider_29 = Slider(1, range=0..100)  # disabled
flatten_tree = FlattenTree(Tree=clean_tree, Path="{0}")  # -> simplify(graft(Tree)); disabled
flatten_tree_2 = FlattenTree(Tree=clean_tree_2, Path="{0}")  # -> simplify(graft(Tree)); disabled
null_item = NullItem(Item=brep_curve_6.Points)  # -> NullFlags, InvalidFlags, Description; disabled
clean_tree_9 = CleanTree(RemoveNulls=True, RemoveInvalid=True, RemoveEmpty=boolean_toggle_5, Tree=brep_curve_9.Curves)  # disabled
trim_tree = TrimTree(Tree=clean_tree_5, Depth=1)  # disabled
flatten_tree_3 = FlattenTree(Tree=clean_tree_3, Path="{0}")  # -> simplify(graft(Tree))
flatten_tree_4 = FlattenTree(Tree=clean_tree_4, Path="{0}")  # -> simplify(graft(Tree))
null_item_2 = NullItem(Item=brep_curve_8.Points)  # -> NullFlags, InvalidFlags, Description
clean_tree_10 = CleanTree(RemoveNulls=True, RemoveInvalid=True, RemoveEmpty=Toggle(True), Tree=brep_curve_10.Curves)
trim_tree_2 = TrimTree(Tree=clean_tree_6, Depth=1)  # disabled
trim_tree_3 = TrimTree(Tree=clean_tree_7, Depth=1)
trim_tree_4 = TrimTree(Tree=clean_tree_8, Depth=1)
end_points = EndPoints(Curve=flatten_tree_2)  # -> Start, End; disabled
null_item_3 = NullItem(Item=brep_curve_5.Points)  # -> NullFlags, InvalidFlags, Description; disabled
flatten_tree_5 = FlattenTree(Tree=clean_tree_9, Path="{0}")  # -> simplify(graft(Tree)); disabled
end_points_2 = EndPoints(Curve=flatten_tree_4)  # -> Start, End
explode_5 = Explode(Curve=trim_tree, Recursive=True)  # -> Segments, Vertices; disabled
tree_item_3 = TreeItem(Tree=flatten_tree, Path=number_slider_28, Index=0, Wrap=True)  # disabled
tree_item_4 = TreeItem(Tree=flatten_tree, Path=number_slider_29, Index=0, Wrap=True)  # disabled
dispatch_5 = Dispatch(List=brep_curve_6.Points, DispatchPattern=invert(null_item.InvalidFlags))  # -> ListA, ListB; disabled
null_item_4 = NullItem(Item=brep_curve_7.Points)  # -> NullFlags, InvalidFlags, Description
explode_6 = Explode(Curve=trim_tree_2, Recursive=True)  # -> Segments, Vertices; disabled
tree_statistics = TreeStatistics(Tree=trim_tree)  # -> Paths, Length, Count; disabled
flatten_tree_6 = FlattenTree(Tree=clean_tree_10, Path="{0}")  # -> simplify(graft(Tree))
boolean_toggle_6 = BooleanToggle(True)  # disabled
tree_statistics_2 = TreeStatistics(Tree=trim_tree_2)  # -> Paths, Length, Count; disabled
explode_7 = Explode(Curve=trim_tree_3, Recursive=True)  # -> Segments, Vertices
tree_item_5 = TreeItem(Tree=flatten_tree_3, Path=Slider(0, range=0..100), Index=0, Wrap=True)
tree_item_6 = TreeItem(Tree=flatten_tree_3, Path=Slider(1, range=0..100), Index=0, Wrap=True)
dispatch_6 = Dispatch(List=brep_curve_8.Points, DispatchPattern=invert(null_item_2.InvalidFlags))  # -> ListA, ListB
explode_8 = Explode(Curve=trim_tree_4, Recursive=True)  # -> Segments, Vertices
number_slider_30 = Slider(2, range=0..10)  # disabled
tree_statistics_3 = TreeStatistics(Tree=trim_tree_3)  # -> Paths, Length, Count
number_slider_31 = Slider(2, range=0..10)  # disabled
tree_statistics_4 = TreeStatistics(Tree=trim_tree_4)  # -> Paths, Length, Count
explode_9 = Explode(Curve=flatten_tree_5, Recursive=True)  # -> Segments, Vertices; disabled
dispatch_7 = Dispatch(List=brep_curve_5.Points, DispatchPattern=invert(null_item_3.InvalidFlags))  # -> ListA, ListB; disabled
explode_10 = Explode(Curve=flatten_tree_6, Recursive=True)  # -> Segments, Vertices
boolean_toggle_7 = BooleanToggle(True)  # disabled
merge_3 = Merge(Data1=graft(tree_item_3), Data2=end_points.End, Data3=graft(tree_item_4), Data4=end_points.Start)  # disabled
dispatch_8 = Dispatch(List=brep_curve_7.Points, DispatchPattern=invert(null_item_4.InvalidFlags))  # -> ListA, ListB
clean_tree_11 = CleanTree(RemoveNulls=True, RemoveInvalid=True, RemoveEmpty=boolean_toggle_6, Tree=dispatch_5.ListA)  # disabled
flatten_tree_7 = FlattenTree(Tree=explode_5.Vertices, Path="{0}")  # disabled
entwine = Entwine(Branch00=tree_item_3, Branch01=end_points.End, Branch02=tree_item_4, Branch03=end_points.Start, FlattenInputs=True)  # -> simplify(Result); disabled
flatten_tree_8 = FlattenTree(Tree=explode_6.Vertices, Path="{0}")  # disabled
merge_4 = Merge(Data1=graft(tree_item_5), Data2=end_points_2.End, Data3=graft(tree_item_6), Data4=end_points_2.Start)
clean_tree_12 = CleanTree(RemoveNulls=True, RemoveInvalid=True, RemoveEmpty=Toggle(True), Tree=dispatch_6.ListA)
flatten_tree_9 = FlattenTree(Tree=explode_7.Vertices, Path="{0}")
entwine_2 = Entwine(Branch00=tree_item_5, Branch01=end_points_2.End, Branch02=tree_item_6, Branch03=end_points_2.Start, FlattenInputs=True)  # -> simplify(Result)
flatten_tree_10 = FlattenTree(Tree=explode_8.Vertices, Path="{0}")
multiplication_10 = Multiplication(A=tree_statistics.Length, B=number_slider_30)  # disabled
multiplication_11 = Multiplication(A=tree_statistics_2.Length, B=number_slider_31)  # disabled
multiplication_12 = Multiplication(A=tree_statistics_3.Length, B=Slider(2, range=0..10))
clean_tree_13 = CleanTree(RemoveNulls=True, RemoveInvalid=True, RemoveEmpty=boolean_toggle_7, Tree=dispatch_7.ListA)  # disabled
flatten_tree_11 = FlattenTree(Tree=entwine, Path="{0}")  # disabled
partition_list = PartitionList(List=flatten_tree_7, Size=multiplication_10)  # -> simplify(Chunks); disabled
multiplication_13 = Multiplication(A=tree_statistics_4.Length, B=Slider(2, range=0..10))
shift_paths = ShiftPaths(Data=clean_tree_11, Offset=-1)  # disabled
partition_list_2 = PartitionList(List=flatten_tree_8, Size=multiplication_11)  # -> simplify(Chunks); disabled
clean_tree_14 = CleanTree(RemoveNulls=True, RemoveInvalid=True, RemoveEmpty=Toggle(True), Tree=dispatch_8.ListA)
flatten_tree_12 = FlattenTree(Tree=entwine_2, Path="{0}")
partition_list_3 = PartitionList(List=flatten_tree_9, Size=multiplication_12)  # -> simplify(Chunks)
shift_paths_2 = ShiftPaths(Data=clean_tree_12, Offset=-1)
partition_list_4 = PartitionList(List=flatten_tree_10, Size=multiplication_13)  # -> simplify(Chunks)
merge_5 = Merge(Data1=flatten_tree_11, Data2=flatten(explode_9.Vertices))  # disabled
graft_tree = GraftTree(Tree=flatten_tree_11, IncludeEmptyLists=True, IncludeNullItems=True)  # disabled
merge_6 = Merge(Data1=flatten_tree_12, Data2=flatten(explode_10.Vertices))
merge_7 = Merge(Data1=partition_list_2, Data2=shift_paths)  # disabled
yz_plane = YZPlane(Origin=point_4)  # disabled
shift_paths_3 = ShiftPaths(Data=clean_tree_13, Offset=-1)  # disabled
merge_8 = Merge(Data1=partition_list, Data2=shift_paths_3)  # disabled
graft_tree_2 = GraftTree(Tree=flatten_tree_12, IncludeEmptyLists=True, IncludeNullItems=True)
merge_9 = Merge(Data1=partition_list_4, Data2=shift_paths_2)
yz_plane_2 = YZPlane(Origin=point_5)
shift_paths_4 = ShiftPaths(Data=clean_tree_14, Offset=-1)
merge_10 = Merge(Data1=partition_list_3, Data2=shift_paths_4)
param_viewer = ParamViewer(partition_list_2)  # disabled
yz_plane_3 = YZPlane(Origin=point_4)  # disabled
point_10 = Point(merge_8)  # disabled
point_11 = Point(merge_7)  # disabled
param_viewer_2 = ParamViewer(point_11)  # disabled
param_viewer_3 = ParamViewer(partition_list_4)
yz_plane_4 = YZPlane(Origin=point_5)
point_12 = Point(merge_10)
point_13 = Point(merge_9)
param_viewer_4 = ParamViewer(point_13)
param_viewer_5 = ParamViewer(point_10)  # disabled
param_viewer_6 = ParamViewer(point_12)
merge_11 = Merge(Data1=point_11, Data2=point_10, Data3=brep_curve.Points)  # disabled
polyline_2 = PolyLine(Vertices=flatten(point_10), Closed=False)  # disabled
# CT Line
curve_5 = Curve(simplify(contour))  # disabled
merge_12 = Merge(Data1=point_13, Data2=point_12, Data3=brep_curve_2.Points)
polyline_3 = PolyLine(Vertices=flatten(point_12), Closed=False)
# CT Line
curve_6 = Curve(simplify(contour_2))
explode_11 = Explode(Curve=polyline_2, Recursive=True)  # -> Segments, Vertices; disabled
geometry_8 = Geometry(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)  # disabled
tree_statistics_5 = TreeStatistics(Tree=curve_5)  # -> Paths, Length, Count; disabled
geometry_9 = Geometry(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)
explode_12 = Explode(Curve=polyline_3, Recursive=True)  # -> Segments, Vertices
area_4 = Area(Geometry=geometry_8)  # -> Area, Centroid; disabled
area_5 = Area(Geometry=geometry_8)  # -> Area, Centroid; disabled
tree_statistics_6 = TreeStatistics(Tree=curve_6)  # -> Paths, Length, Count
area_6 = Area(Geometry=geometry_8)  # -> Area, Centroid; disabled
area_7 = Area(Geometry=geometry_9)  # -> Area, Centroid
area_8 = Area(Geometry=geometry_9)  # -> Area, Centroid
area_9 = Area(Geometry=geometry_9)  # -> Area, Centroid
dispatch_9 = Dispatch(List=tree_statistics_5.Paths, DispatchPattern=[True, False])  # -> ListA, ListB; disabled
dispatch_10 = Dispatch(List=tree_statistics_6.Paths, DispatchPattern=[True, False])  # -> ListA, ListB
orient = Orient(Geometry=geometry_8, Source=area_4.Centroid, Target=point_10)  # -> Geometry, Transform; disabled
orient_2 = Orient(Geometry=geometry_8, Source=area_5.Centroid, Target=brep_curve.Points)  # -> Geometry, Transform; disabled
orient_3 = Orient(Geometry=geometry_8, Source=area_6.Centroid, Target=point_11)  # -> Geometry, Transform; disabled
orient_4 = Orient(Geometry=geometry_9, Source=area_7.Centroid, Target=point_12)  # -> Geometry, Transform
orient_5 = Orient(Geometry=geometry_9, Source=area_8.Centroid, Target=brep_curve_2.Points)  # -> Geometry, Transform
split_tree = SplitTree(Data=curve_5, Masks=flatten(dispatch_9.ListA))  # -> Positive, Negative; disabled
orient_6 = Orient(Geometry=geometry_9, Source=area_9.Centroid, Target=point_13)  # -> Geometry, Transform
split_tree_2 = SplitTree(Data=curve_6, Masks=flatten(dispatch_10.ListA))  # -> Positive, Negative
geometry_10 = Geometry(orient.Geometry)  # disabled
geometry_11 = Geometry(orient_2.Geometry)  # disabled
geometry_12 = Geometry(orient_3.Geometry)  # disabled
tree_statistics_7 = TreeStatistics(Tree=geometry_11)  # -> Paths, Length, Count; disabled
geometry_13 = Geometry(orient_4.Geometry)
geometry_14 = Geometry(orient_5.Geometry)
curve_7 = Curve(split_tree.Negative)  # disabled
curve_8 = Curve(split_tree.Positive)  # disabled
geometry_15 = Geometry(orient_6.Geometry)
tree_statistics_8 = TreeStatistics(Tree=geometry_14)  # -> Paths, Length, Count
curve_9 = Curve(split_tree_2.Negative)
curve_10 = Curve(split_tree_2.Positive)
dispatch_11 = Dispatch(List=tree_statistics_7.Paths, DispatchPattern=[True, False])  # -> ListA, ListB; disabled
sort_along_curve = SortAlongCurve(Points=point_10, Curve=curve_7)  # -> Points, Indices; disabled
sort_along_curve_2 = SortAlongCurve(Points=point_11, Curve=curve_8)  # -> Points, Indices; disabled
dispatch_12 = Dispatch(List=tree_statistics_8.Paths, DispatchPattern=[True, False])  # -> ListA, ListB
sort_along_curve_3 = SortAlongCurve(Points=point_12, Curve=curve_9)  # -> Points, Indices
sort_along_curve_4 = SortAlongCurve(Points=point_13, Curve=curve_10)  # -> Points, Indices
number_slider_32 = Slider(-1, range=-1..0)  # disabled
point_14 = Point(simplify(sort_along_curve.Points))  # disabled
point_15 = Point(point_14)  # disabled
point_16 = Point(simplify(sort_along_curve_2.Points))  # disabled
split_tree_3 = SplitTree(Data=geometry_11, Masks=flatten(dispatch_11.ListA))  # -> Positive, Negative; disabled
point_17 = Point(simplify(sort_along_curve_3.Points))
point_18 = Point(point_17)
point_19 = Point(simplify(sort_along_curve_4.Points))
split_tree_4 = SplitTree(Data=geometry_14, Masks=flatten(dispatch_12.ListA))  # -> Positive, Negative
number_slider_33 = Slider(-1, range=-1..0)  # disabled
shift_list = ShiftList(List=point_16, Shift=1, Wrap=True)  # disabled
shift_list_2 = ShiftList(List=point_14, Shift=1, Wrap=True)  # disabled
point_20 = Point(brep_curve.Points)  # disabled
shift_list_3 = ShiftList(List=point_19, Shift=1, Wrap=True)
shift_list_4 = ShiftList(List=point_17, Shift=1, Wrap=True)
list_item_9 = ListItem(List=point_15, Index=0, Wrap=True)  # disabled
point_21 = Point(brep_curve_2.Points)
list_item_10 = ListItem(List=point_15, Index=number_slider_32, Wrap=True)  # disabled
merge_13 = Merge(Data1=list_item_9, Data2=list_item_10)  # disabled
mirror = Mirror(Geometry=merge_13, Plane=yz_plane)  # -> Geometry, Transform; disabled
tree_statistics_9 = TreeStatistics(Tree=mirror.Geometry)  # -> Paths, Length, Count; disabled
closest_points = ClosestPoints(Point=point_15, Cloud=mirror.Geometry, Count=tree_statistics_9.Count)  # -> ClosestPoint, CPIndex, Distance; disabled
removeduplicatepts = RemoveDuplicatePts(Points=flatten(closest_points.ClosestPoint), Tolerance=0.01)  # disabled
construct_path = ConstructPath(Indices=list_item_10)  # disabled
partition_list_5 = PartitionList(List=removeduplicatepts, Size=tree_statistics_9.Length)  # -> simplify(Chunks); disabled
tree_statistics_10 = TreeStatistics(Tree=partition_list_5)  # -> Paths, Length, Count; disabled
tree_statistics_11 = TreeStatistics(Tree=construct_path)  # -> Paths, Length, Count; disabled
replace_paths = ReplacePaths(Data=partition_list_5, Search=tree_statistics_10.Paths, Replace=tree_statistics_11.Paths)  # disabled
dispatch_13 = Dispatch(List=replace_paths, DispatchPattern=[True, False])  # -> ListA, ListB; disabled
point_22 = Point(dispatch_13.ListA)  # disabled
point_23 = Point(dispatch_13.ListB)  # disabled
tree_statistics_12 = TreeStatistics(Tree=point_20)  # -> Paths, Length, Count; disabled
list_item_11 = ListItem(List=point_18, Index=0, Wrap=True)
list_item_12 = ListItem(List=point_18, Index=Slider(-1, range=-1..0), Wrap=True)
merge_14 = Merge(Data1=list_item_11, Data2=list_item_12)
mirror_2 = Mirror(Geometry=merge_14, Plane=yz_plane_2)  # -> Geometry, Transform
tree_statistics_13 = TreeStatistics(Tree=mirror_2.Geometry)  # -> Paths, Length, Count
closest_points_2 = ClosestPoints(Point=point_18, Cloud=mirror_2.Geometry, Count=tree_statistics_13.Count)  # -> ClosestPoint, CPIndex, Distance
removeduplicatepts_2 = RemoveDuplicatePts(Points=flatten(closest_points_2.ClosestPoint), Tolerance=0.01)
construct_path_2 = ConstructPath(Indices=list_item_12)
partition_list_6 = PartitionList(List=removeduplicatepts_2, Size=tree_statistics_13.Length)  # -> simplify(Chunks)
tree_statistics_14 = TreeStatistics(Tree=partition_list_6)  # -> Paths, Length, Count
tree_statistics_15 = TreeStatistics(Tree=construct_path_2)  # -> Paths, Length, Count
replace_paths_2 = ReplacePaths(Data=partition_list_6, Search=tree_statistics_14.Paths, Replace=tree_statistics_15.Paths)
dispatch_14 = Dispatch(List=replace_paths_2, DispatchPattern=[True, False])  # -> ListA, ListB
point_24 = Point(dispatch_14.ListA)
point_25 = Point(dispatch_14.ListB)
tree_statistics_16 = TreeStatistics(Tree=point_21)  # -> Paths, Length, Count

number_slider_34 = Slider(20, range=0..100)  # disabled
# Distances to add green bullets
number_slider_35 = Slider(15, range=0..100)  # disabled

list_item_13 = ListItem(List=point_16, Index=0, Wrap=True)  # disabled
list_item_14 = ListItem(List=point_16, Index=number_slider_33, Wrap=True)  # disabled
merge_15 = Merge(Data1=list_item_13, Data2=list_item_14)  # disabled
mirror_3 = Mirror(Geometry=merge_15, Plane=yz_plane_3)  # -> Geometry, Transform; disabled
tree_statistics_17 = TreeStatistics(Tree=mirror_3.Geometry)  # -> Paths, Length, Count; disabled
closest_points_3 = ClosestPoints(Point=point_16, Cloud=mirror_3.Geometry, Count=tree_statistics_17.Count)  # -> ClosestPoint, CPIndex, Distance; disabled
removeduplicatepts_3 = RemoveDuplicatePts(Points=flatten(closest_points_3.ClosestPoint), Tolerance=0.01)  # disabled
construct_path_3 = ConstructPath(Indices=list_item_14)  # disabled
partition_list_7 = PartitionList(List=removeduplicatepts_3, Size=tree_statistics_17.Length)  # -> simplify(Chunks); disabled
tree_statistics_18 = TreeStatistics(Tree=partition_list_7)  # -> Paths, Length, Count; disabled
tree_statistics_19 = TreeStatistics(Tree=construct_path_3)  # -> Paths, Length, Count; disabled
replace_paths_3 = ReplacePaths(Data=partition_list_7, Search=tree_statistics_18.Paths, Replace=tree_statistics_19.Paths)  # disabled
dispatch_15 = Dispatch(List=replace_paths_3, DispatchPattern=[True, False])  # -> ListA, ListB; disabled
point_26 = Point(dispatch_15.ListA)  # disabled
point_27 = Point(dispatch_15.ListB)  # disabled
number_slider_36 = Slider(8.3, range=0..100)  # disabled
number_slider_37 = Slider(8.3, range=0..100)  # disabled
distance = Distance(PointA=point_22, PointB=point_23)  # disabled
distance_2 = Distance(PointA=list_item_9, PointB=list_item_10)  # disabled
param_viewer_7 = ParamViewer(point_16)  # disabled

# ----
# Distances to add green bullets
number_slider_38 = Slider(20, range=0..100)

distance_3 = Distance(PointA=point_16, PointB=shift_list)  # -> simplify(Distance); disabled
distance_4 = Distance(PointA=point_14, PointB=shift_list_2)  # -> simplify(Distance); disabled
list_item_15 = ListItem(List=point_19, Index=0, Wrap=True)
param_viewer_8 = ParamViewer(point_14)  # disabled
list_item_16 = ListItem(List=point_19, Index=Slider(-1, range=-1..0), Wrap=True)
merge_16 = Merge(Data1=list_item_15, Data2=list_item_16)
mirror_4 = Mirror(Geometry=merge_16, Plane=yz_plane_4)  # -> Geometry, Transform
tree_statistics_20 = TreeStatistics(Tree=mirror_4.Geometry)  # -> Paths, Length, Count
closest_points_4 = ClosestPoints(Point=point_19, Cloud=mirror_4.Geometry, Count=tree_statistics_20.Count)  # -> ClosestPoint, CPIndex, Distance
removeduplicatepts_4 = RemoveDuplicatePts(Points=flatten(closest_points_4.ClosestPoint), Tolerance=0.01)
construct_path_4 = ConstructPath(Indices=list_item_16)
partition_list_8 = PartitionList(List=removeduplicatepts_4, Size=tree_statistics_20.Length)  # -> simplify(Chunks)
tree_statistics_21 = TreeStatistics(Tree=partition_list_8)  # -> Paths, Length, Count
tree_statistics_22 = TreeStatistics(Tree=construct_path_4)  # -> Paths, Length, Count
replace_paths_4 = ReplacePaths(Data=partition_list_8, Search=tree_statistics_21.Paths, Replace=tree_statistics_22.Paths)
dispatch_16 = Dispatch(List=replace_paths_4, DispatchPattern=[True, False])  # -> ListA, ListB
dispatch_17 = Dispatch(List=tree_statistics_12.Paths, DispatchPattern=[True, False])  # -> ListA, ListB; disabled
point_28 = Point(dispatch_16.ListA)
point_29 = Point(dispatch_16.ListB)
distance_5 = Distance(PointA=point_24, PointB=point_25)
distance_6 = Distance(PointA=list_item_11, PointB=list_item_12)
param_viewer_9 = ParamViewer(point_19)
panel_3 = Panel(distance)  # disabled
panel_4 = Panel(distance_2)  # disabled
distance_7 = Distance(PointA=point_19, PointB=shift_list_3)  # -> simplify(Distance)
distance_8 = Distance(PointA=point_17, PointB=shift_list_4)  # -> simplify(Distance)
number_slider_39 = Slider(8.3, range=0..100)  # disabled
param_viewer_10 = ParamViewer(point_17)
number_slider_40 = Slider(8.3, range=0..100)  # disabled
distance_9 = Distance(PointA=point_26, PointB=point_27)  # disabled
dispatch_18 = Dispatch(List=tree_statistics_16.Paths, DispatchPattern=[True, False])  # -> ListA, ListB
distance_10 = Distance(PointA=list_item_13, PointB=list_item_14)  # disabled
panel_5 = Panel(distance_5)
panel_6 = Panel(distance_6)
distance_11 = Distance(PointA=point_28, PointB=point_29)
distance_12 = Distance(PointA=list_item_15, PointB=list_item_16)
smaller_than = SmallerThan(FirstNumber=distance, SecondNumber=number_slider_36)  # -> SmallerThan, OrEqualTo; disabled
smaller_than_2 = SmallerThan(FirstNumber=distance_2, SecondNumber=number_slider_37)  # -> SmallerThan, OrEqualTo; disabled
panel_7 = Panel(distance_9)  # disabled
panel_8 = Panel(distance_10)  # disabled
larger_than = LargerThan(FirstNumber=distance_3, SecondNumber=number_slider_34)  # -> LargerThan, OrEqualTo; disabled
larger_than_2 = LargerThan(FirstNumber=distance_4, SecondNumber=number_slider_35)  # -> LargerThan, OrEqualTo; disabled
split_tree_5 = SplitTree(Data=point_20, Masks=flatten(dispatch_17.ListA))  # -> Positive, Negative; disabled
smaller_than_3 = SmallerThan(FirstNumber=distance_5, SecondNumber=Slider(8.3, range=0..100))  # -> SmallerThan, OrEqualTo
smaller_than_4 = SmallerThan(FirstNumber=distance_6, SecondNumber=Slider(8.3, range=0..100))  # -> SmallerThan, OrEqualTo
panel_9 = Panel(distance_11)
panel_10 = Panel(distance_12)
larger_than_3 = LargerThan(FirstNumber=distance_7, SecondNumber=Slider(20, range=0..100))  # -> LargerThan, OrEqualTo
larger_than_4 = LargerThan(FirstNumber=distance_8, SecondNumber=number_slider_38)  # -> LargerThan, OrEqualTo
smaller_than_5 = SmallerThan(FirstNumber=distance_9, SecondNumber=number_slider_39)  # -> SmallerThan, OrEqualTo; disabled
split_tree_6 = SplitTree(Data=point_21, Masks=flatten(dispatch_18.ListA))  # -> Positive, Negative
smaller_than_6 = SmallerThan(FirstNumber=distance_10, SecondNumber=number_slider_40)  # -> SmallerThan, OrEqualTo; disabled
smaller_than_7 = SmallerThan(FirstNumber=distance_11, SecondNumber=Slider(8.3, range=0..100))  # -> SmallerThan, OrEqualTo
smaller_than_8 = SmallerThan(FirstNumber=distance_12, SecondNumber=Slider(8.3, range=0..100))  # -> SmallerThan, OrEqualTo
panel_11 = Panel(distance_4)  # disabled
dispatch_19 = Dispatch(List=point_16, DispatchPattern=simplify(larger_than.LargerThan))  # -> ListA, ListB; disabled
dispatch_20 = Dispatch(List=split_tree_3.Positive, DispatchPattern=dispatch_19.ListA)  # -> ListA, ListB; disabled
geometry_16 = Geometry(dispatch_20.ListA)  # disabled
dispatch_21 = Dispatch(List=point_14, DispatchPattern=simplify(larger_than_2.LargerThan))  # -> ListA, ListB; disabled
dispatch_22 = Dispatch(List=split_tree_3.Negative, DispatchPattern=dispatch_21.ListA)  # -> ListA, ListB; disabled
geometry_17 = Geometry(dispatch_22.ListA)  # disabled
dispatch_23 = Dispatch(List=[point_22, point_23], DispatchPattern=smaller_than.SmallerThan)  # -> ListA, ListB; disabled
dispatch_24 = Dispatch(List=[list_item_9, list_item_10], DispatchPattern=smaller_than_2.SmallerThan)  # -> ListA, ListB; disabled
merge_17 = Merge(Data1=point_22, Data2=point_23)  # disabled
panel_12 = Panel(distance_8)
dispatch_25 = Dispatch(List=point_19, DispatchPattern=simplify(larger_than_3.LargerThan))  # -> ListA, ListB
dispatch_26 = Dispatch(List=split_tree_4.Positive, DispatchPattern=dispatch_25.ListA)  # -> ListA, ListB
geometry_18 = Geometry(dispatch_26.ListA)
dispatch_27 = Dispatch(List=point_17, DispatchPattern=simplify(larger_than_4.LargerThan))  # -> ListA, ListB
dispatch_28 = Dispatch(List=split_tree_4.Negative, DispatchPattern=dispatch_27.ListA)  # -> ListA, ListB
geometry_19 = Geometry(dispatch_28.ListA)
dispatch_29 = Dispatch(List=[point_24, point_25], DispatchPattern=smaller_than_3.SmallerThan)  # -> ListA, ListB
dispatch_30 = Dispatch(List=[list_item_11, list_item_12], DispatchPattern=smaller_than_4.SmallerThan)  # -> ListA, ListB
merge_18 = Merge(Data1=point_24, Data2=point_25)
dispatch_31 = Dispatch(List=[point_26, point_27], DispatchPattern=smaller_than_5.SmallerThan)  # -> ListA, ListB; disabled
dispatch_32 = Dispatch(List=split_tree_5.Positive, DispatchPattern=dispatch_19.ListA)  # -> ListA, ListB; disabled
dispatch_33 = Dispatch(List=[list_item_13, list_item_14], DispatchPattern=smaller_than_6.SmallerThan)  # -> ListA, ListB; disabled
dispatch_34 = Dispatch(List=split_tree_5.Negative, DispatchPattern=dispatch_21.ListA)  # -> ListA, ListB; disabled
boolean_toggle_8 = BooleanToggle(True)  # disabled
boolean_toggle_9 = BooleanToggle(True)  # disabled
merge_19 = Merge(Data1=point_26, Data2=point_27)  # disabled
dispatch_35 = Dispatch(List=[point_28, point_29], DispatchPattern=smaller_than_7.SmallerThan)  # -> ListA, ListB
dispatch_36 = Dispatch(List=split_tree_6.Positive, DispatchPattern=dispatch_25.ListA)  # -> ListA, ListB
dispatch_37 = Dispatch(List=[list_item_15, list_item_16], DispatchPattern=smaller_than_8.SmallerThan)  # -> ListA, ListB
dispatch_38 = Dispatch(List=split_tree_6.Negative, DispatchPattern=dispatch_27.ListA)  # -> ListA, ListB
boolean_toggle_10 = BooleanToggle(True)
boolean_toggle_11 = BooleanToggle(True)
merge_20 = Merge(Data1=point_28, Data2=point_29)
point_30 = Point(dispatch_23.ListA)  # disabled
point_31 = Point(dispatch_24.ListA)  # disabled
point_32 = Point(dispatch_23.ListB)  # disabled
boolean_toggle_12 = BooleanToggle(True)  # disabled
point_33 = Point(dispatch_24.ListB)  # disabled
boolean_toggle_13 = BooleanToggle(True)  # disabled
point_34 = Point(dispatch_29.ListA)
point_35 = Point(dispatch_30.ListA)
point_36 = Point(dispatch_29.ListB)
boolean_toggle_14 = BooleanToggle(True)
point_37 = Point(dispatch_30.ListB)
boolean_toggle_15 = BooleanToggle(True)
clean_tree_15 = CleanTree(RemoveNulls=True, RemoveInvalid=True, RemoveEmpty=boolean_toggle_8, Tree=point_32)  # disabled
clean_tree_16 = CleanTree(RemoveNulls=True, RemoveInvalid=boolean_toggle_9, RemoveEmpty=boolean_toggle_9, Tree=point_31)  # disabled
clean_tree_17 = CleanTree(RemoveNulls=True, RemoveInvalid=True, RemoveEmpty=boolean_toggle_9, Tree=point_33)  # disabled
point_38 = Point(dispatch_32.ListA)  # disabled
point_39 = Point(dispatch_34.ListA)  # disabled
point_40 = Point(dispatch_31.ListA)  # disabled
point_41 = Point(dispatch_33.ListA)  # disabled
point_42 = Point(dispatch_31.ListB)  # disabled
point_43 = Point(dispatch_33.ListB)  # disabled
clean_tree_18 = CleanTree(RemoveNulls=True, RemoveInvalid=boolean_toggle_8, RemoveEmpty=boolean_toggle_8, Tree=point_30)  # disabled
clean_tree_19 = CleanTree(RemoveNulls=True, RemoveInvalid=True, RemoveEmpty=boolean_toggle_10, Tree=point_36)
clean_tree_20 = CleanTree(RemoveNulls=True, RemoveInvalid=boolean_toggle_11, RemoveEmpty=boolean_toggle_11, Tree=point_35)
clean_tree_21 = CleanTree(RemoveNulls=True, RemoveInvalid=True, RemoveEmpty=boolean_toggle_11, Tree=point_37)
point_44 = Point(dispatch_36.ListA)
point_45 = Point(dispatch_38.ListA)
point_46 = Point(dispatch_35.ListA)
point_47 = Point(dispatch_37.ListA)
point_48 = Point(dispatch_35.ListB)
point_49 = Point(dispatch_37.ListB)
clean_tree_22 = CleanTree(RemoveNulls=True, RemoveInvalid=boolean_toggle_10, RemoveEmpty=boolean_toggle_10, Tree=point_34)
clean_tree_23 = CleanTree(RemoveNulls=True, RemoveInvalid=True, RemoveEmpty=boolean_toggle_12, Tree=point_42)  # disabled
boolean_toggle_16 = BooleanToggle(True)  # disabled
clean_tree_24 = CleanTree(RemoveNulls=True, RemoveInvalid=boolean_toggle_13, RemoveEmpty=boolean_toggle_13, Tree=point_41)  # disabled
clean_tree_25 = CleanTree(RemoveNulls=True, RemoveInvalid=True, RemoveEmpty=boolean_toggle_13, Tree=point_43)  # disabled
boolean_toggle_17 = BooleanToggle(True)  # disabled
clean_tree_26 = CleanTree(RemoveNulls=True, RemoveInvalid=boolean_toggle_12, RemoveEmpty=boolean_toggle_12, Tree=point_40)  # disabled
clean_tree_27 = CleanTree(RemoveNulls=True, RemoveInvalid=True, RemoveEmpty=boolean_toggle_14, Tree=point_48)
clean_tree_28 = CleanTree(RemoveNulls=True, RemoveInvalid=boolean_toggle_15, RemoveEmpty=boolean_toggle_15, Tree=point_47)
clean_tree_29 = CleanTree(RemoveNulls=True, RemoveInvalid=True, RemoveEmpty=boolean_toggle_15, Tree=point_49)
dispatch_39 = Dispatch(List=clean_tree_15, DispatchPattern=[True, False])  # -> ListA, ListB; disabled
dispatch_40 = Dispatch(List=clean_tree_17, DispatchPattern=[True, False])  # -> ListA, ListB; disabled
clean_tree_30 = CleanTree(RemoveNulls=True, RemoveInvalid=boolean_toggle_14, RemoveEmpty=boolean_toggle_14, Tree=point_46)
tree_statistics_23 = TreeStatistics(Tree=clean_tree_18)  # -> Paths, Length, Count; disabled
dispatch_41 = Dispatch(List=clean_tree_16, DispatchPattern=[True, False])  # -> ListA, ListB; disabled
dispatch_42 = Dispatch(List=clean_tree_18, DispatchPattern=[True, False])  # -> ListA, ListB; disabled
tree_statistics_24 = TreeStatistics(Tree=clean_tree_16)  # -> Paths, Length, Count; disabled
dispatch_43 = Dispatch(List=clean_tree_19, DispatchPattern=[True, False])  # -> ListA, ListB
dispatch_44 = Dispatch(List=clean_tree_21, DispatchPattern=[True, False])  # -> ListA, ListB
clean_tree_31 = CleanTree(RemoveNulls=True, RemoveInvalid=True, RemoveEmpty=boolean_toggle_16, Tree=point_38)  # disabled
clean_tree_32 = CleanTree(RemoveNulls=True, RemoveInvalid=True, RemoveEmpty=boolean_toggle_17, Tree=point_39)  # disabled
dispatch_45 = Dispatch(List=clean_tree_23, DispatchPattern=[True, False])  # -> ListA, ListB; disabled
dispatch_46 = Dispatch(List=clean_tree_25, DispatchPattern=[True, False])  # -> ListA, ListB; disabled
tree_statistics_25 = TreeStatistics(Tree=clean_tree_22)  # -> Paths, Length, Count
dispatch_47 = Dispatch(List=clean_tree_20, DispatchPattern=[True, False])  # -> ListA, ListB
dispatch_48 = Dispatch(List=clean_tree_22, DispatchPattern=[True, False])  # -> ListA, ListB
tree_statistics_26 = TreeStatistics(Tree=clean_tree_20)  # -> Paths, Length, Count
tree_statistics_27 = TreeStatistics(Tree=clean_tree_26)  # -> Paths, Length, Count; disabled
dispatch_49 = Dispatch(List=clean_tree_24, DispatchPattern=[True, False])  # -> ListA, ListB; disabled
dispatch_50 = Dispatch(List=clean_tree_26, DispatchPattern=[True, False])  # -> ListA, ListB; disabled
tree_statistics_28 = TreeStatistics(Tree=clean_tree_24)  # -> Paths, Length, Count; disabled
clean_tree_33 = CleanTree(RemoveNulls=True, RemoveInvalid=True, RemoveEmpty=Toggle(True), Tree=point_44)
number_slider_41 = Slider(15, range=0..100)  # disabled
number_slider_42 = Slider(15, range=0..100)  # disabled
clean_tree_34 = CleanTree(RemoveNulls=True, RemoveInvalid=True, RemoveEmpty=Toggle(True), Tree=point_45)
dispatch_51 = Dispatch(List=clean_tree_27, DispatchPattern=[True, False])  # -> ListA, ListB
dispatch_52 = Dispatch(List=clean_tree_29, DispatchPattern=[True, False])  # -> ListA, ListB
panel_13 = Panel(distance_3)  # disabled
distance_13 = Distance(PointA=dispatch_39.ListA, PointB=dispatch_39.ListB)  # disabled
distance_14 = Distance(PointA=dispatch_40.ListA, PointB=dispatch_40.ListB)  # disabled
tree_statistics_29 = TreeStatistics(Tree=clean_tree_30)  # -> Paths, Length, Count
dispatch_53 = Dispatch(List=clean_tree_28, DispatchPattern=[True, False])  # -> ListA, ListB
dispatch_54 = Dispatch(List=clean_tree_30, DispatchPattern=[True, False])  # -> ListA, ListB
tree_statistics_30 = TreeStatistics(Tree=clean_tree_28)  # -> Paths, Length, Count
panel_14 = Panel(distance_7)
distance_15 = Distance(PointA=dispatch_41.ListA, PointB=dispatch_41.ListB)  # disabled
distance_16 = Distance(PointA=dispatch_42.ListA, PointB=dispatch_42.ListB)  # disabled
distance_17 = Distance(PointA=dispatch_43.ListA, PointB=dispatch_43.ListB)
distance_18 = Distance(PointA=dispatch_44.ListA, PointB=dispatch_44.ListB)
number_slider_43 = Slider(15, range=0..100)  # disabled
number_slider_44 = Slider(15, range=0..100)  # disabled
distance_19 = Distance(PointA=dispatch_47.ListA, PointB=dispatch_47.ListB)
distance_20 = Distance(PointA=dispatch_48.ListA, PointB=dispatch_48.ListB)
distance_21 = Distance(PointA=dispatch_45.ListA, PointB=dispatch_45.ListB)  # disabled
distance_22 = Distance(PointA=dispatch_46.ListA, PointB=dispatch_46.ListB)  # disabled
point_50 = Point(clean_tree_32)  # disabled
point_51 = Point(clean_tree_31)  # disabled
point_52 = Point(point_14)  # disabled
point_53 = Point(point_16)  # disabled
distance_23 = Distance(PointA=dispatch_49.ListA, PointB=dispatch_49.ListB)  # disabled
distance_24 = Distance(PointA=dispatch_50.ListA, PointB=dispatch_50.ListB)  # disabled
smaller_than_9 = SmallerThan(FirstNumber=distance_13, SecondNumber=number_slider_41)  # -> SmallerThan, OrEqualTo; disabled
distance_25 = Distance(PointA=dispatch_51.ListA, PointB=dispatch_51.ListB)
smaller_than_10 = SmallerThan(FirstNumber=distance_14, SecondNumber=number_slider_42)  # -> SmallerThan, OrEqualTo; disabled
distance_26 = Distance(PointA=dispatch_52.ListA, PointB=dispatch_52.ListB)
point_54 = Point(clean_tree_34)
point_55 = Point(clean_tree_33)
point_56 = Point(point_17)
point_57 = Point(point_19)
distance_27 = Distance(PointA=dispatch_53.ListA, PointB=dispatch_53.ListB)
distance_28 = Distance(PointA=dispatch_54.ListA, PointB=dispatch_54.ListB)
panel_15 = Panel(distance_13)  # disabled
panel_16 = Panel(distance_14)  # disabled
smaller_than_11 = SmallerThan(FirstNumber=distance_17, SecondNumber=Slider(15, range=0..100))  # -> SmallerThan, OrEqualTo
smaller_than_12 = SmallerThan(FirstNumber=distance_18, SecondNumber=Slider(15, range=0..100))  # -> SmallerThan, OrEqualTo
param_viewer_11 = ParamViewer(point_51)  # disabled
smaller_than_13 = SmallerThan(FirstNumber=distance_21, SecondNumber=number_slider_43)  # -> SmallerThan, OrEqualTo; disabled
panel_17 = Panel(distance_17)
smaller_than_14 = SmallerThan(FirstNumber=distance_22, SecondNumber=number_slider_44)  # -> SmallerThan, OrEqualTo; disabled
panel_18 = Panel(distance_18)
param_viewer_12 = ParamViewer(point_55)
panel_19 = Panel(distance_21)  # disabled
panel_20 = Panel(distance_22)  # disabled
smaller_than_15 = SmallerThan(FirstNumber=distance_25, SecondNumber=Slider(15, range=0..100))  # -> SmallerThan, OrEqualTo
smaller_than_16 = SmallerThan(FirstNumber=distance_26, SecondNumber=Slider(15, range=0..100))  # -> SmallerThan, OrEqualTo
panel_21 = Panel(distance_25)
panel_22 = Panel(distance_26)
boolean_toggle_18 = BooleanToggle(True)  # disabled
boolean_toggle_19 = BooleanToggle(True)  # disabled
dispatch_55 = Dispatch(List=clean_tree_15, DispatchPattern=smaller_than_9.SmallerThan)  # -> ListA, ListB; disabled
dispatch_56 = Dispatch(List=clean_tree_17, DispatchPattern=smaller_than_10.SmallerThan)  # -> ListA, ListB; disabled
boolean_toggle_20 = BooleanToggle(True)
boolean_toggle_21 = BooleanToggle(True)
dispatch_57 = Dispatch(List=clean_tree_19, DispatchPattern=smaller_than_11.SmallerThan)  # -> ListA, ListB
dispatch_58 = Dispatch(List=clean_tree_21, DispatchPattern=smaller_than_12.SmallerThan)  # -> ListA, ListB
boolean_toggle_22 = BooleanToggle(True)  # disabled
boolean_toggle_23 = BooleanToggle(True)  # disabled
dispatch_59 = Dispatch(List=clean_tree_23, DispatchPattern=smaller_than_13.SmallerThan)  # -> ListA, ListB; disabled
dispatch_60 = Dispatch(List=clean_tree_25, DispatchPattern=smaller_than_14.SmallerThan)  # -> ListA, ListB; disabled
merge_21 = Merge(Data1=point_52, Data2=point_50)  # disabled
merge_22 = Merge(Data1=point_53, Data2=point_51)  # disabled
boolean_toggle_24 = BooleanToggle(True)
boolean_toggle_25 = BooleanToggle(True)
dispatch_61 = Dispatch(List=clean_tree_27, DispatchPattern=smaller_than_15.SmallerThan)  # -> ListA, ListB
dispatch_62 = Dispatch(List=clean_tree_29, DispatchPattern=smaller_than_16.SmallerThan)  # -> ListA, ListB
clean_tree_35 = CleanTree(RemoveNulls=True, RemoveInvalid=True, RemoveEmpty=boolean_toggle_18, Tree=dispatch_55.ListA)  # disabled
clean_tree_36 = CleanTree(RemoveNulls=True, RemoveInvalid=True, RemoveEmpty=boolean_toggle_19, Tree=dispatch_56.ListA)  # disabled
merge_23 = Merge(Data1=point_56, Data2=point_54)
clean_tree_37 = CleanTree(RemoveNulls=True, RemoveInvalid=True, RemoveEmpty=boolean_toggle_18, Tree=dispatch_55.ListB)  # disabled
merge_24 = Merge(Data1=point_57, Data2=point_55)
clean_tree_38 = CleanTree(RemoveNulls=True, RemoveInvalid=True, RemoveEmpty=boolean_toggle_19, Tree=dispatch_56.ListB)  # disabled
number_slider_45 = Slider(15, range=0..100)  # disabled
number_slider_46 = Slider(15, range=0..100)  # disabled
clean_tree_39 = CleanTree(RemoveNulls=True, RemoveInvalid=True, RemoveEmpty=boolean_toggle_20, Tree=dispatch_57.ListA)
clean_tree_40 = CleanTree(RemoveNulls=True, RemoveInvalid=True, RemoveEmpty=boolean_toggle_21, Tree=dispatch_58.ListA)
clean_tree_41 = CleanTree(RemoveNulls=True, RemoveInvalid=True, RemoveEmpty=boolean_toggle_20, Tree=dispatch_57.ListB)
clean_tree_42 = CleanTree(RemoveNulls=True, RemoveInvalid=True, RemoveEmpty=boolean_toggle_21, Tree=dispatch_58.ListB)
clean_tree_43 = CleanTree(RemoveNulls=True, RemoveInvalid=True, RemoveEmpty=boolean_toggle_22, Tree=dispatch_59.ListA)  # disabled
clean_tree_44 = CleanTree(RemoveNulls=True, RemoveInvalid=True, RemoveEmpty=boolean_toggle_23, Tree=dispatch_60.ListA)  # disabled
clean_tree_45 = CleanTree(RemoveNulls=True, RemoveInvalid=True, RemoveEmpty=boolean_toggle_22, Tree=dispatch_59.ListB)  # disabled
clean_tree_46 = CleanTree(RemoveNulls=True, RemoveInvalid=True, RemoveEmpty=boolean_toggle_23, Tree=dispatch_60.ListB)  # disabled
param_viewer_13 = ParamViewer(merge_22)  # disabled
number_slider_47 = Slider(15, range=0..100)  # disabled
number_slider_48 = Slider(15, range=0..100)  # disabled
clean_tree_47 = CleanTree(RemoveNulls=True, RemoveInvalid=True, RemoveEmpty=boolean_toggle_24, Tree=dispatch_61.ListA)
clean_tree_48 = CleanTree(RemoveNulls=True, RemoveInvalid=True, RemoveEmpty=boolean_toggle_25, Tree=dispatch_62.ListA)
clean_tree_49 = CleanTree(RemoveNulls=True, RemoveInvalid=True, RemoveEmpty=boolean_toggle_24, Tree=dispatch_61.ListB)
clean_tree_50 = CleanTree(RemoveNulls=True, RemoveInvalid=True, RemoveEmpty=boolean_toggle_25, Tree=dispatch_62.ListB)
point_58 = Point(clean_tree_35)  # disabled
point_59 = Point(clean_tree_36)  # disabled
param_viewer_14 = ParamViewer(merge_24)
point_60 = Point(clean_tree_39)
point_61 = Point(clean_tree_40)
polyline_4 = PolyLine(Vertices=point_58, Closed=False)  # disabled
length = Length(Curve=polyline_4)  # disabled
polyline_5 = PolyLine(Vertices=point_59, Closed=False)  # disabled
length_2 = Length(Curve=polyline_5)  # disabled
point_62 = Point(clean_tree_43)  # disabled
point_63 = Point(clean_tree_44)  # disabled
division_9 = Division(A=number_slider_45, B=length)  # disabled
division_10 = Division(A=number_slider_46, B=length_2)  # disabled
polyline_6 = PolyLine(Vertices=point_60, Closed=False)
length_3 = Length(Curve=polyline_6)
polyline_7 = PolyLine(Vertices=point_61, Closed=False)
length_4 = Length(Curve=polyline_7)
point_64 = Point(clean_tree_47)
point_65 = Point(clean_tree_48)
division_11 = Division(A=Slider(15, range=0..100), B=length_3)
division_12 = Division(A=Slider(15, range=0..100), B=length_4)
polyline_8 = PolyLine(Vertices=point_62, Closed=False)  # disabled
length_5 = Length(Curve=polyline_8)  # disabled
polyline_9 = PolyLine(Vertices=point_63, Closed=False)  # disabled
length_6 = Length(Curve=polyline_9)  # disabled
sort_along_curve_5 = SortAlongCurve(Points=merge_21, Curve=curve_7)  # -> simplify(Points), Indices; disabled
sort_along_curve_6 = SortAlongCurve(Points=merge_22, Curve=curve_8)  # -> simplify(Points), Indices; disabled
division_13 = Division(A=number_slider_47, B=length_5)  # disabled
division_14 = Division(A=number_slider_48, B=length_6)  # disabled
cull_duplicates = CullDuplicates(Points=clean_tree_16, Tolerance=distance_15, CullMode=3)  # -> Points, Indices, Valence; disabled
polyline_10 = PolyLine(Vertices=point_64, Closed=False)
length_7 = Length(Curve=polyline_10)
polyline_11 = PolyLine(Vertices=point_65, Closed=False)
length_8 = Length(Curve=polyline_11)
curve_middle = CurveMiddle(Curve=polyline_4)  # disabled
curve_middle_2 = CurveMiddle(Curve=polyline_5)  # disabled
cull_duplicates_2 = CullDuplicates(Points=clean_tree_18, Tolerance=distance_16, CullMode=3)  # -> Points, Indices, Valence; disabled
sort_along_curve_7 = SortAlongCurve(Points=merge_23, Curve=curve_9)  # -> simplify(Points), Indices
sort_along_curve_8 = SortAlongCurve(Points=merge_24, Curve=curve_10)  # -> simplify(Points), Indices
division_15 = Division(A=Slider(15, range=0..100), B=length_7)
division_16 = Division(A=Slider(15, range=0..100), B=length_8)
cull_duplicates_3 = CullDuplicates(Points=clean_tree_20, Tolerance=distance_19, CullMode=3)  # -> Points, Indices, Valence
curve_middle_3 = CurveMiddle(Curve=polyline_6)
curve_middle_4 = CurveMiddle(Curve=polyline_7)
cull_duplicates_4 = CullDuplicates(Points=clean_tree_22, Tolerance=distance_20, CullMode=3)  # -> Points, Indices, Valence
cull_duplicates_5 = CullDuplicates(Points=clean_tree_24, Tolerance=distance_23, CullMode=3)  # -> Points, Indices, Valence; disabled
curve_middle_5 = CurveMiddle(Curve=polyline_8)  # disabled
curve_middle_6 = CurveMiddle(Curve=polyline_9)  # disabled
cull_duplicates_6 = CullDuplicates(Points=clean_tree_26, Tolerance=distance_24, CullMode=3)  # -> Points, Indices, Valence; disabled
cull_duplicates_7 = CullDuplicates(Points=clean_tree_28, Tolerance=distance_27, CullMode=3)  # -> Points, Indices, Valence
scale_4 = Scale(Geometry=point_58, Center=curve_middle, Factor=division_9)  # -> Geometry, Transform; disabled
curve_middle_7 = CurveMiddle(Curve=polyline_10)
scale_5 = Scale(Geometry=point_59, Center=curve_middle_2, Factor=division_10)  # -> Geometry, Transform; disabled
curve_middle_8 = CurveMiddle(Curve=polyline_11)
point_66 = Point(cull_duplicates.Points)  # disabled
cull_duplicates_8 = CullDuplicates(Points=clean_tree_30, Tolerance=distance_28, CullMode=3)  # -> Points, Indices, Valence
point_67 = Point(clean_tree_38)  # disabled
point_68 = Point(clean_tree_37)  # disabled
polyline_12 = PolyLine(Vertices=flatten(sort_along_curve_6.Points), Closed=False)  # disabled
polyline_13 = PolyLine(Vertices=flatten(sort_along_curve_5.Points), Closed=False)  # disabled
point_69 = Point(cull_duplicates_2.Points)  # disabled
scale_6 = Scale(Geometry=point_60, Center=curve_middle_3, Factor=division_11)  # -> Geometry, Transform
scale_7 = Scale(Geometry=point_61, Center=curve_middle_4, Factor=division_12)  # -> Geometry, Transform
point_70 = Point(cull_duplicates_3.Points)
point_71 = Point(clean_tree_42)
point_72 = Point(clean_tree_41)
polyline_14 = PolyLine(Vertices=flatten(sort_along_curve_8.Points), Closed=False)
polyline_15 = PolyLine(Vertices=flatten(sort_along_curve_7.Points), Closed=False)
point_73 = Point(cull_duplicates_4.Points)
shift_paths_5 = ShiftPaths(Data=point_66, Offset=-1)  # disabled

colour_swatch = ColourSwatch(SwatchColor=RGBA(240, 63, 129, 197))  # disabled
colour_swatch_2 = ColourSwatch(SwatchColor=RGBA(65, 230, 231, 197))  # disabled
colour_swatch_3 = ColourSwatch(SwatchColor=RGBA(89, 252, 135, 197))  # disabled
colour_swatch_4 = ColourSwatch(SwatchColor=RGBA(89, 252, 135, 197))  # disabled
custom_preview = CustomPreview(Geometry=geometry_12, Material=colour_swatch)  # disabled
custom_preview_2 = CustomPreview(Geometry=geometry_10, Material=colour_swatch_2)  # disabled
custom_preview_3 = CustomPreview(Geometry=geometry_16, Material=colour_swatch_3)  # disabled
custom_preview_4 = CustomPreview(Geometry=geometry_17, Material=colour_swatch_4)  # disabled

scale_8 = Scale(Geometry=point_62, Center=curve_middle_5, Factor=division_13)  # -> Geometry, Transform; disabled
scale_9 = Scale(Geometry=point_63, Center=curve_middle_6, Factor=division_14)  # -> Geometry, Transform; disabled
point_74 = Point(cull_duplicates_5.Points)  # disabled
point_75 = Point(clean_tree_46)  # disabled
point_76 = Point(clean_tree_45)  # disabled
shift_paths_6 = ShiftPaths(Data=point_69, Offset=-1)  # disabled
point_77 = Point(cull_duplicates_6.Points)  # disabled
shift_paths_7 = ShiftPaths(Data=point_70, Offset=-1)

custom_preview_5 = CustomPreview(Geometry=geometry_15, Material=ColourSwatch(SwatchColor=RGBA(240, 63, 129, 197)))  # disabled
custom_preview_6 = CustomPreview(Geometry=geometry_13, Material=ColourSwatch(SwatchColor=RGBA(65, 230, 231, 197)))  # disabled
custom_preview_7 = CustomPreview(Geometry=geometry_18, Material=ColourSwatch(SwatchColor=RGBA(89, 252, 135, 197)))
custom_preview_8 = CustomPreview(Geometry=geometry_19, Material=ColourSwatch(SwatchColor=RGBA(89, 252, 135, 197)))

scale_10 = Scale(Geometry=point_64, Center=curve_middle_7, Factor=division_15)  # -> Geometry, Transform
scale_11 = Scale(Geometry=point_65, Center=curve_middle_8, Factor=division_16)  # -> Geometry, Transform
point_78 = Point(cull_duplicates_7.Points)
point_79 = Point(clean_tree_50)
point_80 = Point(clean_tree_49)
shift_paths_8 = ShiftPaths(Data=point_73, Offset=-1)
point_81 = Point(cull_duplicates_8.Points)
shift_paths_9 = ShiftPaths(Data=point_74, Offset=-1)  # disabled
# Final Pts
merge_25 = Merge(Data1=sort_along_curve_6.Points, Data2=sort_along_curve_5.Points)  # disabled
shift_paths_10 = ShiftPaths(Data=point_77, Offset=-1)  # disabled
shift_paths_11 = ShiftPaths(Data=point_78, Offset=-1)
merge_26 = Merge(Data1=point_67, Data2=scale_5.Geometry, Data3=simplify(shift_paths_5))  # disabled
# Final Pts
merge_27 = Merge(Data1=sort_along_curve_8.Points, Data2=sort_along_curve_7.Points)
merge_28 = Merge(Data1=point_68, Data2=scale_4.Geometry, Data3=simplify(shift_paths_6))  # disabled
shift_paths_12 = ShiftPaths(Data=point_81, Offset=-1)
merge_29 = Merge(Data1=point_71, Data2=scale_7.Geometry, Data3=simplify(shift_paths_7))
merge_30 = Merge(Data1=point_72, Data2=scale_6.Geometry, Data3=simplify(shift_paths_8))
merge_31 = Merge(Data1=list_item_9, Data2=list_item_10, Data3=point_22, Data4=point_23)  # disabled
merge_32 = Merge(Data1=point_75, Data2=scale_9.Geometry, Data3=simplify(shift_paths_9))  # disabled
merge_33 = Merge(Data1=point_76, Data2=scale_8.Geometry, Data3=simplify(shift_paths_10))  # disabled
merge_34 = Merge(Data1=list_item_11, Data2=list_item_12, Data3=point_24, Data4=point_25)
merge_35 = Merge(Data1=point_79, Data2=scale_11.Geometry, Data3=simplify(shift_paths_11))
merge_36 = Merge(Data1=point_80, Data2=scale_10.Geometry, Data3=simplify(shift_paths_12))
merge_37 = Merge(Data1=list_item_13, Data2=list_item_14, Data3=point_26, Data4=point_27)  # disabled
merge_38 = Merge(Data1=list_item_15, Data2=list_item_16, Data3=point_28, Data4=point_29)
closest_point = ClosestPoint(Point=merge_31, Cloud=point_15)  # -> ClosestPoint, CPIndex, Distance; disabled
closest_point_2 = ClosestPoint(Point=merge_34, Cloud=point_18)  # -> ClosestPoint, CPIndex, Distance
closest_point_3 = ClosestPoint(Point=merge_37, Cloud=point_16)  # -> ClosestPoint, CPIndex, Distance; disabled
closest_point_4 = ClosestPoint(Point=merge_38, Cloud=point_19)  # -> ClosestPoint, CPIndex, Distance
cull_index = CullIndex(List=point_15, Indices=closest_point.CPIndex, Wrap=True)  # disabled
cull_index_2 = CullIndex(List=point_18, Indices=closest_point_2.CPIndex, Wrap=True)
cull_index_3 = CullIndex(List=point_16, Indices=closest_point_3.CPIndex, Wrap=True)  # disabled
point_82 = Point(simplify(cull_index))  # disabled
merge_39 = Merge(Data1=point_82, Data2=merge_26, Data3=merge_28)  # disabled
sort_along_curve_9 = SortAlongCurve(Points=merge_39, Curve=curve_7)  # -> Points, Indices; disabled
cull_index_4 = CullIndex(List=point_19, Indices=closest_point_4.CPIndex, Wrap=True)
point_83 = Point(simplify(cull_index_2))
merge_40 = Merge(Data1=point_83, Data2=merge_29, Data3=merge_30)
sort_along_curve_10 = SortAlongCurve(Points=merge_40, Curve=curve_9)  # -> Points, Indices
number_slider_49 = Slider(107, range=0..107)  # disabled
point_84 = Point(simplify(cull_index_3))  # disabled
merge_41 = Merge(Data1=point_84, Data2=merge_32, Data3=merge_33)  # disabled
number_slider_50 = Slider(107, range=0..107)
point_85 = Point(simplify(cull_index_4))
merge_42 = Merge(Data1=point_85, Data2=merge_35, Data3=merge_36)
sort_along_curve_11 = SortAlongCurve(Points=merge_41, Curve=curve_8)  # -> Points, Indices; disabled
point_86 = Point(simplify(sort_along_curve_9.Points))  # disabled
sort_along_curve_12 = SortAlongCurve(Points=merge_42, Curve=curve_10)  # -> Points, Indices
point_87 = Point(simplify(sort_along_curve_10.Points))
point_88 = Point(simplify(sort_along_curve_11.Points))  # disabled
point_89 = Point(simplify(sort_along_curve_12.Points))
merge_43 = Merge(Data1=point_88, Data2=point_51)  # disabled
merge_44 = Merge(Data1=point_86, Data2=point_50)  # disabled
merge_45 = Merge(Data1=point_89, Data2=point_55)
merge_46 = Merge(Data1=point_87, Data2=point_54)
sort_along_curve_13 = SortAlongCurve(Points=merge_43, Curve=curve_8)  # -> Points, Indices; disabled
sort_along_curve_14 = SortAlongCurve(Points=merge_45, Curve=curve_10)  # -> Points, Indices
sort_along_curve_15 = SortAlongCurve(Points=merge_44, Curve=curve_7)  # -> Points, Indices; disabled
sort_along_curve_16 = SortAlongCurve(Points=merge_46, Curve=curve_9)  # -> Points, Indices
point_90 = Point(simplify(sort_along_curve_15.Points))  # disabled
point_91 = Point(simplify(sort_along_curve_13.Points))  # disabled
geometry_20 = Geometry(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)  # disabled
geometry_21 = Geometry(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)  # disabled
point_92 = Point(simplify(sort_along_curve_16.Points))
point_93 = Point(simplify(sort_along_curve_14.Points))
geometry_22 = Geometry(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)
geometry_23 = Geometry(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)
area_10 = Area(Geometry=geometry_21)  # -> Area, Centroid; disabled
# Fixed Final Pts
merge_47 = Merge(Data1=point_91, Data2=point_90)  # disabled

geometry_24 = Geometry(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)  # disabled
area_11 = Area(Geometry=geometry_24)  # -> Area, Centroid; disabled
orient_7 = Orient(Geometry=geometry_24, Source=area_11.Centroid, Target=merge_47)  # -> Geometry, Transform; disabled
geometry_25 = Geometry(orient_7.Geometry)  # disabled
mesh_brep = MeshBrep(
    Brep=geometry_25,
    Settings={GridMaxCount=0, GridMinCount=16, JaggedSeams=False, MaxEdgeLength=0, MinEdgeLength=0.0001, MinTolerance=0, Refine=True, RefineAngle=0, RelativeTolerance=0.65, SimplePlanes=True, Tolerance=0})  # disabled
colour_swatch_5 = ColourSwatch(SwatchColor=RGBA(229, 208, 129, 197))  # disabled
mesh = Mesh(mesh_brep)  # disabled
custom_preview_9 = CustomPreview(Geometry=mesh, Material=colour_swatch_5)  # disabled

area_12 = Area(Geometry=geometry_20)  # -> Area, Centroid; disabled
area_13 = Area(Geometry=geometry_23)  # -> Area, Centroid
# Fixed Final Pts
merge_48 = Merge(Data1=point_93, Data2=point_92)

geometry_26 = Geometry(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)
area_14 = Area(Geometry=geometry_26)  # -> Area, Centroid
orient_8 = Orient(Geometry=geometry_26, Source=area_14.Centroid, Target=merge_48)  # -> Geometry, Transform; disabled
geometry_27 = Geometry(orient_8.Geometry)
mesh_brep_2 = MeshBrep(
    Brep=geometry_27,
    Settings={GridMaxCount=0, GridMinCount=16, JaggedSeams=False, MaxEdgeLength=0, MinEdgeLength=0.0001, MinTolerance=0, Refine=True, RefineAngle=0, RelativeTolerance=0.65, SimplePlanes=True, Tolerance=0})
mesh_2 = Mesh(mesh_brep_2)
custom_preview_10 = CustomPreview(Geometry=mesh_2, Material=ColourSwatch(SwatchColor=RGBA(229, 208, 129, 197)))  # disabled

area_15 = Area(Geometry=geometry_22)  # -> Area, Centroid
number_slider_51 = Slider(10, range=0..10)  # disabled
orient_9 = Orient(Geometry=geometry_21, Source=area_10.Centroid, Target=point_88)  # -> Geometry, Transform; disabled
list_item_17 = ListItem(List=flatten(merge_47), Index=0, Wrap=True)  # disabled
polyline_16 = PolyLine(Vertices=flatten(merge_47), Closed=False)  # disabled
orient_10 = Orient(Geometry=geometry_20, Source=area_12.Centroid, Target=point_86)  # -> Geometry, Transform; disabled
point_94 = Point(merge_47)  # disabled
orient_11 = Orient(Geometry=geometry_23, Source=area_13.Centroid, Target=point_89)  # -> Geometry, Transform
list_item_18 = ListItem(List=flatten(merge_48), Index=0, Wrap=True)
polyline_17 = PolyLine(Vertices=flatten(merge_48), Closed=False)
orient_12 = Orient(Geometry=geometry_22, Source=area_15.Centroid, Target=point_87)  # -> Geometry, Transform
point_95 = Point(merge_48)

number_slider_52 = Slider(3, range=0..10)  # disabled
point_list_2 = PointList(Points=flatten(merge_47), Size=number_slider_52)  # disabled

geometry_28 = Geometry(orient_9.Geometry)  # disabled
scale_12 = Scale(Geometry=point_94, Center=point_4, Factor=number_slider_51)  # -> Geometry, Transform; disabled
geometry_29 = Geometry(orient_10.Geometry)  # disabled

point_list_3 = PointList(Points=flatten(merge_48), Size=Slider(3, range=0..10))

geometry_30 = Geometry(orient_11.Geometry)
mesh_brep_3 = MeshBrep(
    Brep=geometry_28,
    Settings={GridMaxCount=0, GridMinCount=16, JaggedSeams=False, MaxEdgeLength=0, MinEdgeLength=0.0001, MinTolerance=0, Refine=True, RefineAngle=0, RelativeTolerance=0.65, SimplePlanes=True, Tolerance=0})  # disabled
scale_13 = Scale(Geometry=point_95, Center=point_5, Factor=Slider(10, range=0..10))  # -> Geometry, Transform
geometry_31 = Geometry(orient_12.Geometry)
colour_swatch_6 = ColourSwatch(SwatchColor=RGBA(243, 77, 129, 197))  # disabled
mesh_brep_4 = MeshBrep(
    Brep=geometry_29,
    Settings={GridMaxCount=0, GridMinCount=16, JaggedSeams=False, MaxEdgeLength=0, MinEdgeLength=0.0001, MinTolerance=0, Refine=True, RefineAngle=0, RelativeTolerance=0.65, SimplePlanes=True, Tolerance=0})  # disabled
colour_swatch_7 = ColourSwatch(SwatchColor=RGBA(84, 223, 212, 197))  # disabled
mesh_brep_5 = MeshBrep(
    Brep=geometry_30,
    Settings={GridMaxCount=0, GridMinCount=16, JaggedSeams=False, MaxEdgeLength=0, MinEdgeLength=0.0001, MinTolerance=0, Refine=True, RefineAngle=0, RelativeTolerance=0.65, SimplePlanes=True, Tolerance=0})
mesh_brep_6 = MeshBrep(
    Brep=geometry_31,
    Settings={GridMaxCount=0, GridMinCount=16, JaggedSeams=False, MaxEdgeLength=0, MinEdgeLength=0.0001, MinTolerance=0, Refine=True, RefineAngle=0, RelativeTolerance=0.65, SimplePlanes=True, Tolerance=0})
mesh_3 = Mesh(mesh_brep_3)  # disabled
point_96 = Point(scale_12.Geometry)  # disabled
mesh_4 = Mesh(mesh_brep_4)  # disabled
mesh_5 = Mesh(mesh_brep_5)
point_97 = Point(scale_13.Geometry)
custom_preview_11 = CustomPreview(Geometry=mesh_3, Material=colour_swatch_6)  # disabled
custom_preview_12 = CustomPreview(Geometry=mesh_4, Material=colour_swatch_7)  # disabled
mesh_6 = Mesh(mesh_brep_6)
custom_preview_13 = CustomPreview(Geometry=mesh_5, Material=ColourSwatch(SwatchColor=RGBA(243, 77, 129, 197)))
custom_preview_14 = CustomPreview(Geometry=mesh_6, Material=ColourSwatch(SwatchColor=RGBA(84, 223, 212, 197)))

# ----
# Layers Preview
point_98 = Point(merge_47)  # disabled
number_slider_53 = Slider(1, range=0..1)  # disabled
number_slider_54 = Slider(0, range=0..10)  # disabled
tree_statistics_31 = TreeStatistics(Tree=point_98)  # -> Paths, Length, Count; disabled
addition = Addition(A=number_slider_54, B=number_slider_53)  # disabled
list_item_19 = ListItem(List=tree_statistics_31.Paths, Index=number_slider_54, Wrap=True)  # disabled
list_item_20 = ListItem(List=tree_statistics_31.Paths, Index=addition, Wrap=True)  # disabled
geometry_32 = Geometry(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)  # disabled
split_tree_7 = SplitTree(Data=point_98, Masks=flatten([list_item_19, list_item_20]))  # -> Positive, Negative; disabled
area_16 = Area(Geometry=geometry_32)  # -> Area, Centroid; disabled
point_99 = Point(split_tree_7.Positive)  # disabled
orient_13 = Orient(Geometry=geometry_32, Source=area_16.Centroid, Target=point_99)  # -> Geometry, Transform; disabled
geometry_33 = Geometry(orient_13.Geometry)  # disabled
mesh_brep_7 = MeshBrep(
    Brep=geometry_33,
    Settings={GridMaxCount=0, GridMinCount=16, JaggedSeams=False, MaxEdgeLength=0, MinEdgeLength=0.0001, MinTolerance=0, Refine=True, RefineAngle=0, RelativeTolerance=0.65, SimplePlanes=True, Tolerance=0})  # disabled
colour_swatch_8 = ColourSwatch(SwatchColor=RGBA(185, 219, 129, 197))  # disabled
mesh_7 = Mesh(mesh_brep_7)  # disabled
custom_preview_15 = CustomPreview(Geometry=mesh_7, Material=colour_swatch_8)  # disabled

# ----
# Layers Preview
point_100 = Point(merge_48)
number_slider_55 = Slider(0, range=0..10)
tree_statistics_32 = TreeStatistics(Tree=point_100)  # -> Paths, Length, Count
addition_2 = Addition(A=number_slider_55, B=Slider(1, range=0..1))
list_item_21 = ListItem(List=tree_statistics_32.Paths, Index=number_slider_55, Wrap=True)
list_item_22 = ListItem(List=tree_statistics_32.Paths, Index=addition_2, Wrap=True)
geometry_34 = Geometry(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)
split_tree_8 = SplitTree(Data=point_100, Masks=flatten([list_item_21, list_item_22]))  # -> Positive, Negative
area_17 = Area(Geometry=geometry_34)  # -> Area, Centroid
point_101 = Point(split_tree_8.Positive)
orient_14 = Orient(Geometry=geometry_34, Source=area_17.Centroid, Target=point_101)  # -> Geometry, Transform
geometry_35 = Geometry(orient_14.Geometry)
mesh_brep_8 = MeshBrep(
    Brep=geometry_35,
    Settings={GridMaxCount=0, GridMinCount=16, JaggedSeams=False, MaxEdgeLength=0, MinEdgeLength=0.0001, MinTolerance=0, Refine=True, RefineAngle=0, RelativeTolerance=0.65, SimplePlanes=True, Tolerance=0})
mesh_8 = Mesh(mesh_brep_8)
custom_preview_16 = CustomPreview(Geometry=mesh_8, Material=ColourSwatch(SwatchColor=RGBA(185, 219, 129, 197)))
