# Grasshopper definition 20230125 column 4 git.gh (Grasshopper 1.0.7)
# plug-ins: treesloth01, Kangaroo2 Components

number_slider = Slider(9, range=0..100)
number_slider_2 = Slider(7, range=0..10)
division = Division(A=number_slider, B=Slider(2, range=0..10))
number_slider_3 = Slider(161, range=0..1000)
multiplication = Multiplication(A=division, B=Slider(11, range=0..100))
unit_z = UnitZ(Factor=multiplication)
negative = Negative(Value=number_slider_3)
number_slider_4 = Slider(-140, range=-150..0)
number_slider_5 = Slider(140, range=0..1000)
point = Point(Point(187.0779998, -177.8772965, 0))
construct_domain = ConstructDomain(DomainStart=negative, DomainEnd=number_slider_3)
xy_plane = XYPlane(Origin=point)
move = Move(Geometry=xy_plane, Motion=unit_z)  # -> Geometry, Transform
construct_domain_2 = ConstructDomain(DomainStart=negative, DomainEnd=number_slider_3)
multiplication_2 = Multiplication(A=number_slider_2, B=Slider(4, range=0..11))
multiplication_3 = Multiplication(A=number_slider_2, B=Slider(5, range=0..11))
xz_plane = XZPlane(Origin=point)
number_slider_6 = Slider(140, range=0..1000)
construct_domain_3 = ConstructDomain(DomainStart=number_slider_4, DomainEnd=number_slider_5)
construct_domain_4 = ConstructDomain(DomainStart=number_slider_4, DomainEnd=number_slider_5)
ellipse = Ellipse(Plane=move.Geometry, Radius1=multiplication_2, Radius2=Slider(11, range=0..55))  # -> Ellipse, Focus1, Focus2
ellipse_2 = Ellipse(Plane=xy_plane, Radius1=multiplication_3, Radius2=Slider(26.12, range=0..55))  # -> Ellipse, Focus1, Focus2
rectangle = Rectangle(Plane=xz_plane, XSize=construct_domain, YSize=construct_domain_2, Radius=0)  # -> Rectangle, Length
merge = Merge(Data1=ellipse_2.Ellipse, Data2=ellipse.Ellipse)
rectangle_2 = Rectangle(Plane=xy_plane, XSize=construct_domain_3, YSize=construct_domain_4, Radius=0)  # -> Rectangle, Length
negative_2 = Negative(Value=number_slider_6)
boundary_surfaces = BoundarySurfaces(Edges=rectangle.Rectangle)
number_slider_7 = Slider(2, range=0..10)  # disabled
loft = Loft(Curves=merge, Options={Adjust=False, Closed=False, LoftEnds=0, LoftSimp=0, LoftType=0, Rebuild=10, Refit=0.01})
number_slider_8 = Slider(9, range=0..100)  # disabled
number_slider_9 = Slider(7, range=0..10)  # disabled
number_slider_10 = Slider(11, range=0..100)  # disabled
construct_domain_5 = ConstructDomain(DomainStart=negative_2, DomainEnd=number_slider_6)
division_2 = Division(A=number_slider, B=Slider(2, range=0..10))
explode = Explode(Curve=rectangle_2.Rectangle, Recursive=True)  # -> Segments, Vertices
geometry = Geometry(loft)
multiplication_4 = Multiplication(A=Slider(7, range=0..10), B=Slider(6, range=0..10))
multiplication_5 = Multiplication(A=Slider(7, range=0..10), B=Slider(4, range=0..10))
contour = Contour(Shape=geometry, Point=point, Direction=Vector(0, 0, 1), Distance=division_2)
brep_curve = BrepCurve(Brep=boundary_surfaces, Curve=contour)  # -> Curves, simplify(Points)
curve = Curve(simplify(contour))
division_3 = Division(A=number_slider_8, B=number_slider_7)  # disabled
number_slider_11 = Slider(161, range=0..1000)  # disabled
tree_item = TreeItem(Tree=curve, Path=Slider(0, range=0..100), Index=0, Wrap=True)
area = Area(Geometry=tree_item)  # -> Area, Centroid
rectangle_3 = Rectangle(Plane=area.Centroid, XSize=construct_domain_5, YSize=construct_domain_5, Radius=0)  # -> Rectangle, Length
ellipse_3 = Ellipse(Plane=area.Centroid, Radius1=multiplication_4, Radius2=multiplication_5)  # -> Ellipse, Focus1, Focus2
multiplication_6 = Multiplication(A=division_3, B=number_slider_10)  # disabled
number_slider_12 = Slider(15, range=0..15)
list_item = ListItem(List=explode.Segments, Index=0, Wrap=True)
list_item_2 = ListItem(List=explode.Segments, Index=Slider(2, range=0..10), Wrap=True)
boundary_surfaces_2 = BoundarySurfaces(Edges=contour)  # -> simplify(Surfaces); disabled
explode_2 = Explode(Curve=rectangle_3.Rectangle, Recursive=True)  # -> Segments, Vertices
list_item_3 = ListItem(List=explode_2.Segments, Index=Slider(0, range=0..1), Wrap=True)
list_item_4 = ListItem(List=explode_2.Segments, Index=Slider(1, range=0..10), Wrap=True)
list_item_5 = ListItem(List=explode_2.Segments, Index=Slider(2, range=0..10), Wrap=True)
list_item_6 = ListItem(List=explode_2.Segments, Index=Slider(3, range=0..10), Wrap=True)
number_slider_13 = Slider(4, range=0..11)  # disabled
number_slider_14 = Slider(5, range=0..11)  # disabled
unit_z_2 = UnitZ(Factor=multiplication_6)  # disabled
curve_2 = Curve(ellipse_3.Ellipse)
divide_length = DivideLength(Curve=curve_2, Length=Slider(7, range=7..15))  # -> Points, Tangents, Parameters; disabled
negative_3 = Negative(Value=number_slider_11)  # disabled
dispatch = Dispatch(List=flatten(boundary_surfaces_2), DispatchPattern=[True, False])  # -> ListA, ListB
number_slider_15 = Slider(11, range=0..55)  # disabled
number_slider_16 = Slider(-140, range=-150..0)  # disabled
number_slider_17 = Slider(140, range=0..1000)  # disabled
number_slider_18 = Slider(26.12, range=0..55)  # disabled
point_2 = Point(Point(187.0779998, -177.8772965, 0))  # disabled
divide_length_2 = DivideLength(Curve=list_item_2, Length=number_slider_12)  # -> reverse(Points), Tangents, Parameters
divide_length_3 = DivideLength(Curve=list_item, Length=number_slider_12)  # -> Points, Tangents, Parameters
division_4 = Division(A=number_slider_12, B=Slider(2, range=0..10))
curve_middle = CurveMiddle(Curve=list_item_3)
curve_middle_2 = CurveMiddle(Curve=list_item_6)
tree_item_2 = TreeItem(Tree=boundary_surfaces_2, Path=Slider(0, range=0..100), Index=0, Wrap=True)
curve_middle_3 = CurveMiddle(Curve=list_item_5)
curve_middle_4 = CurveMiddle(Curve=list_item_4)
construct_domain_6 = ConstructDomain(DomainStart=negative_3, DomainEnd=number_slider_11)  # disabled
xy_plane_2 = XYPlane(Origin=point_2)  # disabled
move_2 = Move(Geometry=xy_plane_2, Motion=unit_z_2)  # -> Geometry, Transform; disabled
construct_domain_7 = ConstructDomain(DomainStart=negative_3, DomainEnd=number_slider_11)  # disabled
multiplication_7 = Multiplication(A=number_slider_9, B=number_slider_13)  # disabled
number_slider_19 = Slider(0, range=0..1)  # disabled
multiplication_8 = Multiplication(A=number_slider_9, B=number_slider_14)  # disabled
xz_plane_2 = XZPlane(Origin=point_2)  # disabled
unit_x = UnitX(Factor=division_4)

geometry_2 = Geometry(dispatch.ListA)
geometry_3 = Geometry(dispatch.ListB)

list_length = ListLength(List=geometry_3)
list_length_2 = ListLength(List=geometry_2)
series = Series(Start=division_2, Step=number_slider, Count=list_length)
series_2 = Series(Start=0, Step=number_slider, Count=list_length_2)
unit_z_3 = UnitZ(Factor=series)
unit_z_4 = UnitZ(Factor=series_2)
merge_2 = Merge(Data1=multiplication_4, Data2=multiplication_5)  # disabled
construct_domain_8 = ConstructDomain(DomainStart=number_slider_16, DomainEnd=number_slider_17)  # disabled
construct_domain_9 = ConstructDomain(DomainStart=number_slider_16, DomainEnd=number_slider_17)  # disabled
line = Line(StartPoint=divide_length_3.Points, EndPoint=divide_length_2.Points)
ellipse_4 = Ellipse(Plane=move_2.Geometry, Radius1=multiplication_7, Radius2=number_slider_15)  # -> Ellipse, Focus1, Focus2; disabled
ellipse_5 = Ellipse(Plane=xy_plane_2, Radius1=multiplication_8, Radius2=number_slider_18)  # -> Ellipse, Focus1, Focus2; disabled
line_2 = Line(StartPoint=curve_middle_4, EndPoint=curve_middle_2)
line_3 = Line(StartPoint=curve_middle_3, EndPoint=curve_middle)
merge_3 = Merge(Data1=line_3, Data2=line_2)
join_curves = JoinCurves(Curves=merge_3, Preserve=False)
rectangle_4 = Rectangle(Plane=xz_plane_2, XSize=construct_domain_6, YSize=construct_domain_7, Radius=0)  # -> Rectangle, Length; disabled
boolean_toggle = BooleanToggle(False)  # disabled
trim_with_regions = TrimWithRegions(Curve=curve_2, Regions=join_curves)  # -> Inside, Outside
number_slider_20 = Slider(2, range=0..10)  # disabled
collider = Collider(Objects=divide_length.Points, Radii=multiplication_4, Strength=1)  # disabled
oncurve = OnCurve(Points=divide_length.Points, Curve=curve_2, Strength=1)  # disabled
spherecollide = SphereCollide(Points=divide_length.Points, Radius=merge_2, Strength=number_slider_19)  # disabled
button = Button()  # disabled
number_slider_21 = Slider(7, range=0..10)
merge_4 = Merge(Data1=ellipse_5.Ellipse, Data2=ellipse_4.Ellipse)  # disabled
rectangle_5 = Rectangle(Plane=xy_plane_2, XSize=construct_domain_8, YSize=construct_domain_9, Radius=0)  # -> Rectangle, Length; disabled
unit_z_5 = UnitZ(Factor=division_2)
bounding_box = BoundingBox(Content=curve_2, Plane=PlaneXY(0, 0, 0), UnionBox=True)  # -> Box, Box_2
curve_3 = Curve(line)
move_3 = Move(Geometry=curve_3, Motion=simplify(graft(unit_z_4)))  # -> simplify(Geometry), Transform
move_4 = Move(Geometry=curve_3, Motion=unit_x)  # -> Geometry, Transform
brep_curve_2 = BrepCurve(Brep=tree_item_2, Curve=curve_3)  # -> simplify(Curves), Points
number_slider_22 = Slider(2.5, range=0..10)  # disabled
boundary_surfaces_3 = BoundarySurfaces(Edges=rectangle_4.Rectangle)  # disabled
curve_curve = CurveCurve(CurveA=line_3, CurveB=curve_2)  # -> Points, ParamsA, ParamsB
curve_curve_2 = CurveCurve(CurveA=line_2, CurveB=curve_2)  # -> Points, ParamsA, ParamsB
curve_4 = Curve(trim_with_regions.Outside)
loft_2 = Loft(Curves=merge_4, Options={Adjust=False, Closed=False, LoftEnds=0, LoftSimp=0, LoftType=0, Rebuild=10, Refit=0.01})  # disabled
curve_5 = Curve(move_4.Geometry)
move_5 = Move(Geometry=curve_5, Motion=simplify(graft(unit_z_3)))  # -> simplify(Geometry), Transform
bouncysolver = BouncySolver(
    GoalObjects=[oncurve, collider, spherecollide],
    Reset=button,
    Threshold=1e-15,
    Tolerance=0.0001,
    Damping=0.99,
    Iterations=10,
    On=boolean_toggle)  # -> I, V, O; disabled
clean_tree = CleanTree(RemoveNulls=True, RemoveInvalid=True, RemoveEmpty=Toggle(True), Tree=brep_curve_2.Points)
number_slider_23 = Slider(3, range=0..10)  # disabled
clean_tree_2 = CleanTree(RemoveNulls=True, RemoveInvalid=True, RemoveEmpty=Toggle(True), Tree=brep_curve_2.Curves)
number_slider_24 = Slider(1, range=0..1)  # disabled
deconstruct_brep = DeconstructBrep(Brep=bounding_box.Box)  # -> Faces, Edges, Vertices
division_5 = Division(A=number_slider_8, B=number_slider_20)  # disabled
move_6 = Move(Geometry=curve_5, Motion=unit_z_5)  # -> Geometry, Transform
brep_curve_3 = BrepCurve(Brep=graft(geometry_3), Curve=move_5.Geometry)  # -> simplify(Curves), simplify(Points)
ghpython_script = GhPythonScript(crvs=curve_4, cnt=Slider(8.15, range=0..10))  # -> out, pts; inputs crvs: list of Curve
# ---------- ghpython_script: Python ----------
import Rhino.Geometry as rg

pts = []

#mod_crv = rg.Curve.ToNurbsCurve(crvs)

#for i in range(len(crvs)):
#    pts.append(crvs[i][0])

#pts.append(crvs[0])

for i in range(len(crvs)):
    length = rg.Curve.GetLength(crvs[i])
    cna = int(length/cnt)
    ts = rg.Curve.DivideByCount(crvs[i],cna,False)
    for t in ts:
        pt = rg.Curve.PointAt(crvs[i],t)
        pts.append(pt)
# ---------- end ghpython_script ----------
explode_3 = Explode(Curve=rectangle_5.Rectangle, Recursive=True)  # -> Segments, Vertices; disabled
ghpython_script_2 = GhPythonScript(crv=curve_4, cnt=number_slider_21)  # -> out, simplify(pts); inputs crv: Curve, cnt: Int32
# ---------- ghpython_script_2: Python ----------
import Rhino.Geometry as rg

pts = []

ts = rg.Curve.DivideByCount(crv,cnt,False)
for t in ts :
    pt = rg.Curve.PointAt(crv,t)
    pts.append(pt)
# ---------- end ghpython_script_2 ----------
ghpython_script_3 = GhPythonScript(crvs=curve_4, cnt=number_slider_21)  # -> out, pts; inputs crvs: list of Curve, cnt: Int32
# ---------- ghpython_script_3: Python ----------
import Rhino.Geometry as rg

pts = []

#mod_crv = rg.Curve.ToNurbsCurve(crvs)

#for i in range(len(crvs)):
#    pts.append(crvs[i][0])

#pts.append(crvs[0])

for i in range(len(crvs)):
    ts = rg.Curve.DivideByCount(crvs[i],cnt,False)
    for t in ts:
        pt = rg.Curve.PointAt(crvs[i],t)
        pts.append(pt)
# ---------- end ghpython_script_3 ----------
brep_curve_4 = BrepCurve(Brep=graft(geometry_2), Curve=move_3.Geometry)  # -> simplify(Curves), simplify(Points)
list_item_7 = ListItem(List=geometry_3, Index=0, Wrap=True)
point_3 = Point(curve_curve.Points)
point_4 = Point(curve_curve_2.Points)
contour_2 = Contour(Shape=loft_2, Point=point_2, Direction=Vector(0, 0, 1), Distance=division_5)  # disabled
brep_curve_5 = BrepCurve(Brep=boundary_surfaces_3, Curve=contour_2)  # -> Curves, simplify(Points); disabled
number_slider_25 = Slider(7, range=0..10)
point_5 = Point(ghpython_script.pts)
clean_tree_3 = CleanTree(RemoveNulls=True, RemoveInvalid=True, RemoveEmpty=Toggle(True), Tree=brep_curve_3.Curves)  # -> simplify(Tree)
list_item_8 = ListItem(List=deconstruct_brep.Edges, Index=Slider(3, range=0..3), Wrap=True)
brep_curve_6 = BrepCurve(Brep=list_item_7, Curve=move_6.Geometry)  # -> simplify(Curves), Points
list_item_9 = ListItem(List=deconstruct_brep.Edges, Index=Slider(1, range=0..3), Wrap=True)
clean_tree_4 = CleanTree(RemoveNulls=True, RemoveInvalid=True, RemoveEmpty=Toggle(True), Tree=brep_curve_4.Curves)  # -> simplify(Tree)
number_slider_26 = Slider(7, range=0..10)  # disabled
list_item_10 = ListItem(List=explode_3.Segments, Index=number_slider_24, Wrap=True)  # disabled
list_item_11 = ListItem(List=explode_3.Segments, Index=number_slider_23, Wrap=True)  # disabled
boundary_surfaces_4 = BoundarySurfaces(Edges=contour_2)  # -> simplify(Surfaces); disabled
number_slider_27 = Slider(2, range=0..10)  # disabled
number_slider_28 = Slider(0, range=0..100)  # disabled
merge_5 = Merge(Data1=point_3, Data2=point_4)  # -> flatten(Result)
flatten_tree = FlattenTree(Tree=clean_tree, Path="{0}")  # -> simplify(graft(Tree))
flatten_tree_2 = FlattenTree(Tree=clean_tree_2, Path="{0}")  # -> simplify(graft(Tree))
ellipse_6 = Ellipse(Plane=PlaneXY(0, 0, 0), Radius1=expr("x/2", Slider(7, range=0..100)), Radius2=expr("x/2", Slider(10, range=0..10)))  # -> Ellipse, Focus1, Focus2
null_item = NullItem(Item=brep_curve_4.Points)  # -> NullFlags, InvalidFlags, Description
clean_tree_5 = CleanTree(RemoveNulls=True, RemoveInvalid=True, RemoveEmpty=Toggle(True), Tree=brep_curve_6.Curves)
divide_length_4 = DivideLength(Curve=list_item_9, Length=number_slider_25)  # -> Points, Tangents, Parameters
divide_length_5 = DivideLength(Curve=list_item_8, Length=number_slider_25)  # -> reverse(Points), Tangents, Parameters
trim_tree = TrimTree(Tree=clean_tree_3, Depth=1)
dispatch_2 = Dispatch(List=flatten(boundary_surfaces_4), DispatchPattern=[True, False])  # -> ListA, ListB; disabled
trim_tree_2 = TrimTree(Tree=clean_tree_4, Depth=1)
number_slider_29 = Slider(7, range=0..10)  # disabled
divide_length_6 = DivideLength(Curve=list_item_11, Length=number_slider_26)  # -> reverse(Points), Tangents, Parameters; disabled
divide_length_7 = DivideLength(Curve=list_item_10, Length=number_slider_26)  # -> Points, Tangents, Parameters; disabled
division_6 = Division(A=number_slider_26, B=number_slider_27)  # disabled
curve_6 = Curve(contour_2)  # disabled
tree_item_3 = TreeItem(Tree=boundary_surfaces_4, Path=number_slider_28, Index=0, Wrap=True)  # disabled
end_points = EndPoints(Curve=flatten_tree_2)  # -> Start, End
null_item_2 = NullItem(Item=brep_curve_3.Points)  # -> NullFlags, InvalidFlags, Description
curve_7 = Curve(ellipse_6.Ellipse)
area_2 = Area(Geometry=curve_7)  # -> Area, Centroid
flatten_tree_3 = FlattenTree(Tree=clean_tree_5, Path="{0}")  # -> simplify(graft(Tree))
length = Length(Curve=curve_6)  # disabled
explode_4 = Explode(Curve=trim_tree, Recursive=True)  # -> Segments, Vertices
tree_item_4 = TreeItem(Tree=flatten_tree, Path=Slider(0, range=0..100), Index=0, Wrap=True)
tree_item_5 = TreeItem(Tree=flatten_tree, Path=Slider(1, range=0..100), Index=0, Wrap=True)
dispatch_3 = Dispatch(List=brep_curve_4.Points, DispatchPattern=invert(null_item.InvalidFlags))  # -> ListA, ListB
explode_5 = Explode(Curve=trim_tree_2, Recursive=True)  # -> Segments, Vertices
tree_statistics = TreeStatistics(Tree=trim_tree)  # -> Paths, Length, Count
unit_y = UnitY(Factor=division_6)  # disabled

geometry_4 = Geometry(dispatch_2.ListA)  # disabled
geometry_5 = Geometry(dispatch_2.ListB)  # disabled

list_length_3 = ListLength(List=geometry_5)  # disabled
list_length_4 = ListLength(List=geometry_4)  # disabled
series_3 = Series(Start=division_5, Step=number_slider_8, Count=list_length_3)  # disabled
series_4 = Series(Start=0, Step=number_slider_8, Count=list_length_4)  # disabled
unit_z_6 = UnitZ(Factor=series_3)  # disabled
unit_z_7 = UnitZ(Factor=series_4)  # disabled
tree_statistics_2 = TreeStatistics(Tree=trim_tree_2)  # -> Paths, Length, Count
orient = Orient(Geometry=curve_7, Source=area_2.Centroid, Target=merge_5)  # -> Geometry, Transform
list_item_12 = ListItem(List=orient.Geometry, Index=Slider(2, range=0..3), Wrap=True)
line_4 = Line(StartPoint=divide_length_7.Points, EndPoint=divide_length_6.Points)  # disabled
division_7 = Division(A=length, B=number_slider_29)  # disabled
curve_8 = Curve(line_2)
explode_6 = Explode(Curve=flatten_tree_3, Recursive=True)  # -> Segments, Vertices
dispatch_4 = Dispatch(List=brep_curve_3.Points, DispatchPattern=invert(null_item_2.InvalidFlags))  # -> ListA, ListB
curve_curve_3 = CurveCurve(CurveA=list_item_12, CurveB=curve_8)  # -> Points, ParamsA, ParamsB
merge_6 = Merge(Data1=graft(tree_item_4), Data2=end_points.End, Data3=graft(tree_item_5), Data4=end_points.Start)
clean_tree_6 = CleanTree(RemoveNulls=True, RemoveInvalid=True, RemoveEmpty=Toggle(True), Tree=dispatch_3.ListA)
flatten_tree_4 = FlattenTree(Tree=explode_4.Vertices, Path="{0}")
entwine = Entwine(Branch00=tree_item_4, Branch01=end_points.End, Branch02=tree_item_5, Branch03=end_points.Start, FlattenInputs=True)  # -> simplify(Result)
integer = Integer(division_7)  # disabled
flatten_tree_5 = FlattenTree(Tree=explode_5.Vertices, Path="{0}")
curve_9 = Curve(line_4)  # disabled
move_7 = Move(Geometry=curve_9, Motion=simplify(graft(unit_z_7)))  # -> simplify(Geometry), Transform; disabled
move_8 = Move(Geometry=curve_9, Motion=unit_y)  # -> Geometry, Transform; disabled
brep_curve_7 = BrepCurve(Brep=tree_item_3, Curve=curve_9)  # -> simplify(Curves), Points; disabled
boolean_toggle_2 = BooleanToggle(True)  # disabled
boolean_toggle_3 = BooleanToggle(True)  # disabled
unit_z_8 = UnitZ(Factor=division_5)  # disabled
trim_with_regions_2 = TrimWithRegions(Curve=curve_2, Regions=orient.Geometry)  # -> Inside, Outside
multiplication_9 = Multiplication(A=tree_statistics.Length, B=Slider(2, range=0..10))
multiplication_10 = Multiplication(A=tree_statistics_2.Length, B=Slider(2, range=0..10))
divide_curve = DivideCurve(Curve=curve_6, Count=integer, Kinks=False)  # -> Points, Tangents, Parameters; disabled
list_item_13 = ListItem(List=curve_curve_3.Points, Index=Slider(1, range=0..1), Wrap=True)
clean_tree_7 = CleanTree(RemoveNulls=True, RemoveInvalid=True, RemoveEmpty=Toggle(True), Tree=dispatch_4.ListA)
flatten_tree_6 = FlattenTree(Tree=entwine, Path="{0}")
partition_list = PartitionList(List=flatten_tree_4, Size=multiplication_9)  # -> simplify(Chunks)
curve_10 = Curve(move_8.Geometry)  # disabled
move_9 = Move(Geometry=curve_10, Motion=simplify(graft(unit_z_6)))  # -> simplify(Geometry), Transform; disabled
shift_paths = ShiftPaths(Data=clean_tree_6, Offset=-1)
partition_list_2 = PartitionList(List=flatten_tree_5, Size=multiplication_10)  # -> simplify(Chunks)
clean_tree_8 = CleanTree(RemoveNulls=True, RemoveInvalid=True, RemoveEmpty=boolean_toggle_3, Tree=brep_curve_7.Points)  # disabled
curve_11 = Curve(trim_with_regions_2.Outside)
list_item_14 = ListItem(List=curve_11, Index=0, Wrap=True)
point_6 = Point(list_item_13)
move_10 = Move(Geometry=curve_10, Motion=unit_z_8)  # -> Geometry, Transform; disabled
clean_tree_9 = CleanTree(RemoveNulls=True, RemoveInvalid=True, RemoveEmpty=boolean_toggle_2, Tree=brep_curve_7.Curves)  # disabled
brep_curve_8 = BrepCurve(Brep=graft(geometry_5), Curve=move_9.Geometry)  # -> simplify(Curves), simplify(Points); disabled
boolean_toggle_4 = BooleanToggle(True)  # disabled
merge_7 = Merge(Data1=flatten_tree_6, Data2=flatten(explode_6.Vertices))
brep_curve_9 = BrepCurve(Brep=graft(geometry_4), Curve=move_7.Geometry)  # -> simplify(Curves), simplify(Points); disabled
graft_tree = GraftTree(Tree=flatten_tree_6, IncludeEmptyLists=True, IncludeNullItems=True)
number_slider_30 = Slider(52, range=0..100)
ghpython_script_4 = GhPythonScript(crvs=curve_11, cnt=Slider(5, range=0..10))  # -> out, pts; inputs crvs: list of Curve, cnt: Int32; same code as ghpython_script_3
boolean_toggle_5 = BooleanToggle(True)  # disabled
list_item_15 = ListItem(List=geometry_5, Index=0, Wrap=True)  # disabled
merge_8 = Merge(Data1=partition_list_2, Data2=shift_paths)
yz_plane = YZPlane(Origin=point)
line_5 = Line(StartPoint=divide_length_4.Points, EndPoint=divide_length_5.Points)
divide_distance = DivideDistance(Curve=list_item_14, Distance=Slider(9.09, range=0..20))  # -> Points, Tangents, Parameters
shift_paths_2 = ShiftPaths(Data=clean_tree_7, Offset=-1)
merge_9 = Merge(Data1=partition_list, Data2=shift_paths_2)
end_points_2 = EndPoints(Curve=list_item_14)  # -> Start, End
split_list = SplitList(List=divide_distance.Points, Index=Slider(1, range=0..100))  # -> ListA, ListB
number_slider_31 = Slider(0.01, range=0..1)  # disabled
number_slider_32 = Slider(11, range=0..100)  # disabled
list_length_5 = ListLength(List=line_5)
number_slider_33 = Slider(0.89, range=0..1)  # disabled
param_viewer = ParamViewer(partition_list_2)
yz_plane_2 = YZPlane(Origin=point)
point_7 = Point(ghpython_script_4.pts)
point_8 = Point(merge_9)
point_9 = Point(merge_8)
param_viewer_2 = ParamViewer(point_9)
boolean_toggle_6 = BooleanToggle(True)  # disabled
clean_tree_10 = CleanTree(RemoveNulls=True, RemoveInvalid=True, RemoveEmpty=boolean_toggle_4, Tree=brep_curve_8.Curves)  # -> simplify(Tree); disabled
brep_curve_10 = BrepCurve(Brep=list_item_15, Curve=move_10.Geometry)  # -> simplify(Curves), Points; disabled
clean_tree_11 = CleanTree(RemoveNulls=True, RemoveInvalid=True, RemoveEmpty=boolean_toggle_5, Tree=brep_curve_9.Curves)  # -> simplify(Tree); disabled
unit_x_2 = UnitX(Factor=number_slider_30)
subtraction = Subtraction(A=list_length_5, B=Slider(2, range=0..10))
unit_y_2 = UnitY(Factor=number_slider_30)
point_10 = Point(split_list.ListB)
param_viewer_3 = ParamViewer(point_8)
point_11 = Point(end_points_2.End)
number_slider_34 = Slider(0, range=0..100)  # disabled
number_slider_35 = Slider(1, range=0..100)  # disabled
construct_domain_10 = ConstructDomain(DomainStart=Slider(1, range=0..1), DomainEnd=subtraction)
flatten_tree_7 = FlattenTree(Tree=clean_tree_8, Path="{0}")  # -> simplify(graft(Tree)); disabled
pull_point = PullPoint(Point=point_7, Geometry=line_5, ClosestOnly=True)  # -> ClosestPoint, Distance
flatten_tree_8 = FlattenTree(Tree=clean_tree_9, Path="{0}")  # -> simplify(graft(Tree)); disabled
null_item_3 = NullItem(Item=brep_curve_9.Points)  # -> NullFlags, InvalidFlags, Description; disabled
clean_tree_12 = CleanTree(RemoveNulls=True, RemoveInvalid=True, RemoveEmpty=boolean_toggle_6, Tree=brep_curve_10.Curves)  # disabled
point_12 = Point(<point referenced from the Rhino model>)
merge_10 = Merge(Data1=point_9, Data2=point_8, Data3=brep_curve.Points)
polyline = PolyLine(Vertices=flatten(point_8), Closed=False)
collider_2 = Collider(Objects=point_10, Radii=number_slider_32, Strength=1)  # disabled
boolean_toggle_7 = BooleanToggle(True)  # disabled
trim_tree_3 = TrimTree(Tree=clean_tree_10, Depth=1)  # disabled
move_11 = Move(Geometry=point_11, Motion=unit_x_2)  # -> Geometry, Transform
curve_12 = Curve(simplify(contour))
move_12 = Move(Geometry=point_6, Motion=unit_y_2)  # -> Geometry, Transform
trim_tree_4 = TrimTree(Tree=clean_tree_11, Depth=1)  # disabled
oncurve_2 = OnCurve(Points=point_10, Curve=list_item_14, Strength=number_slider_33)  # disabled
spherecollide_2 = SphereCollide(Points=point_10, Radius=number_slider_32, Strength=number_slider_31)  # disabled
button_2 = Button()  # disabled
orient_2 = Orient(Geometry=curve_7, Source=point_12, Target=point_10)  # -> Geometry, Transform
end_points_3 = EndPoints(Curve=flatten_tree_8)  # -> Start, End; disabled
null_item_4 = NullItem(Item=brep_curve_8.Points)  # -> NullFlags, InvalidFlags, Description; disabled
flatten_tree_9 = FlattenTree(Tree=clean_tree_12, Path="{0}")  # -> simplify(graft(Tree)); disabled
sub_list = SubList(List=line_5, Domain=construct_domain_10, Wrap=True)  # -> List, Index
explode_7 = Explode(Curve=polyline, Recursive=True)  # -> Segments, Vertices
geometry_6 = Geometry(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)
explode_8 = Explode(Curve=trim_tree_3, Recursive=True)  # -> Segments, Vertices; disabled
tree_item_6 = TreeItem(Tree=flatten_tree_7, Path=number_slider_34, Index=0, Wrap=True)  # disabled
tree_item_7 = TreeItem(Tree=flatten_tree_7, Path=number_slider_35, Index=0, Wrap=True)  # disabled
tree_statistics_3 = TreeStatistics(Tree=curve_12)  # -> Paths, Length, Count
dispatch_5 = Dispatch(List=brep_curve_9.Points, DispatchPattern=invert(null_item_3.InvalidFlags))  # -> ListA, ListB; disabled
line_6 = Line(StartPoint=point_6, EndPoint=move_12.Geometry)
explode_9 = Explode(Curve=trim_tree_4, Recursive=True)  # -> Segments, Vertices; disabled
line_7 = Line(StartPoint=point_11, EndPoint=move_11.Geometry)
tree_statistics_4 = TreeStatistics(Tree=trim_tree_3)  # -> Paths, Length, Count; disabled
orient_3 = Orient(Geometry=curve_7, Source=area_2.Centroid, Target=point_10)  # -> Geometry, Transform
boolean_toggle_8 = BooleanToggle(True)  # disabled
bouncysolver_2 = BouncySolver(
    GoalObjects=[spherecollide_2, oncurve_2],
    Reset=button_2,
    Threshold=1e-15,
    Tolerance=0.0001,
    Damping=0.99,
    Iterations=10,
    On=boolean_toggle_7)  # -> I, V, O; disabled
tree_statistics_5 = TreeStatistics(Tree=trim_tree_4)  # -> Paths, Length, Count; disabled
area_3 = Area(Geometry=geometry_6)  # -> Area, Centroid
area_4 = Area(Geometry=geometry_6)  # -> Area, Centroid
area_5 = Area(Geometry=geometry_6)  # -> Area, Centroid
number_slider_36 = Slider(2, range=0..10)  # disabled
number_slider_37 = Slider(2, range=0..10)  # disabled
explode_10 = Explode(Curve=flatten_tree_9, Recursive=True)  # -> Segments, Vertices; disabled
dispatch_6 = Dispatch(List=tree_statistics_3.Paths, DispatchPattern=[True, False])  # -> ListA, ListB
curve_curve_4 = CurveCurve(CurveA=line_7, CurveB=line_6)  # -> Points, ParamsA, ParamsB
dispatch_7 = Dispatch(List=brep_curve_8.Points, DispatchPattern=invert(null_item_4.InvalidFlags))  # -> ListA, ListB; disabled
orient_4 = Orient(Geometry=curve_7, Source=area_2.Centroid, Target=bouncysolver_2.V)  # -> Geometry, Transform; disabled
boolean_toggle_9 = BooleanToggle(True)  # disabled
merge_11 = Merge(Data1=graft(tree_item_6), Data2=end_points_3.End, Data3=graft(tree_item_7), Data4=end_points_3.Start)  # disabled
clean_tree_13 = CleanTree(RemoveNulls=True, RemoveInvalid=True, RemoveEmpty=boolean_toggle_8, Tree=dispatch_5.ListA)  # disabled
flatten_tree_10 = FlattenTree(Tree=explode_8.Vertices, Path="{0}")  # disabled
entwine_2 = Entwine(Branch00=tree_item_6, Branch01=end_points_3.End, Branch02=tree_item_7, Branch03=end_points_3.Start, FlattenInputs=True)  # -> simplify(Result); disabled
flatten_tree_11 = FlattenTree(Tree=explode_9.Vertices, Path="{0}")  # disabled
orient_5 = Orient(Geometry=geometry_6, Source=area_3.Centroid, Target=point_8)  # -> Geometry, Transform
orient_6 = Orient(Geometry=geometry_6, Source=area_4.Centroid, Target=brep_curve.Points)  # -> Geometry, Transform
orient_7 = Orient(Geometry=geometry_6, Source=area_5.Centroid, Target=point_9)  # -> Geometry, Transform
multiplication_11 = Multiplication(A=tree_statistics_4.Length, B=number_slider_36)  # disabled
gene_pool = GenePool(Decimals=2, Maximum=10, Minimum=3.2, Value=[5.45, 5.85, 6.17, 6.25, 7.05, 8.73])
multiplication_12 = Multiplication(A=tree_statistics_5.Length, B=number_slider_37)  # disabled
line_8 = Line(StartPoint=point_11, EndPoint=curve_curve_4.Points)
split_tree = SplitTree(Data=curve_12, Masks=flatten(dispatch_6.ListA))  # -> Positive, Negative
clean_tree_14 = CleanTree(RemoveNulls=True, RemoveInvalid=True, RemoveEmpty=boolean_toggle_9, Tree=dispatch_7.ListA)  # disabled
flatten_tree_12 = FlattenTree(Tree=entwine_2, Path="{0}")  # disabled
partition_list_3 = PartitionList(List=flatten_tree_10, Size=multiplication_11)  # -> simplify(Chunks); disabled
shift_paths_3 = ShiftPaths(Data=clean_tree_13, Offset=-1)  # disabled
partition_list_4 = PartitionList(List=flatten_tree_11, Size=multiplication_12)  # -> simplify(Chunks); disabled
length_2 = Length(Curve=line_8)
geometry_7 = Geometry(orient_5.Geometry)
geometry_8 = Geometry(orient_6.Geometry)
geometry_9 = Geometry(orient_7.Geometry)
merge_12 = Merge(Data1=flatten_tree_12, Data2=flatten(explode_10.Vertices))  # disabled
tree_statistics_6 = TreeStatistics(Tree=geometry_8)  # -> Paths, Length, Count
graft_tree_2 = GraftTree(Tree=flatten_tree_12, IncludeEmptyLists=True, IncludeNullItems=True)  # disabled
curve_13 = Curve(split_tree.Negative)
curve_14 = Curve(split_tree.Positive)
merge_13 = Merge(Data1=partition_list_4, Data2=shift_paths_3)  # disabled
yz_plane_3 = YZPlane(Origin=point_2)  # disabled
shift_paths_4 = ShiftPaths(Data=clean_tree_14, Offset=-1)  # disabled
merge_14 = Merge(Data1=partition_list_3, Data2=shift_paths_4)  # disabled
number_slider_38 = Slider(3, range=3..3.3)
mass_addition = MassAddition(Input=gene_pool)  # -> Result, PartialResults
division_8 = Division(A=length_2, B=Slider(5.77, range=0..10))
dispatch_8 = Dispatch(List=tree_statistics_6.Paths, DispatchPattern=[True, False])  # -> ListA, ListB
construct_domain_11 = ConstructDomain(DomainStart=Slider(1, range=0..1), DomainEnd=Slider(0, range=0..1))
param_viewer_4 = ParamViewer(partition_list_4)  # disabled
sort_along_curve = SortAlongCurve(Points=point_8, Curve=curve_13)  # -> Points, Indices
sort_along_curve_2 = SortAlongCurve(Points=point_9, Curve=curve_14)  # -> Points, Indices
yz_plane_4 = YZPlane(Origin=point_2)  # disabled
bounds = Bounds(Numbers=mass_addition.PartialResults)
point_13 = Point(merge_14)  # disabled
point_14 = Point(merge_13)  # disabled
param_viewer_5 = ParamViewer(point_14)  # disabled
integer_2 = Integer(division_8)
point_15 = Point(simplify(sort_along_curve.Points))
point_16 = Point(point_15)
point_17 = Point(simplify(sort_along_curve_2.Points))
negative_4 = Negative(Value=Slider(38, range=0..100))
param_viewer_6 = ParamViewer(point_13)  # disabled
divide_curve_2 = DivideCurve(Curve=line_8, Count=integer_2, Kinks=False)  # -> Points, Tangents, Parameters
split_tree_2 = SplitTree(Data=geometry_8, Masks=flatten(dispatch_8.ListA))  # -> Positive, Negative
remap_numbers = RemapNumbers(Value=mass_addition.PartialResults, Source=bounds, Target=construct_domain_11)  # -> Mapped, Clipped
extend_curve = ExtendCurve(Curve=list_item_14, Type=0, Start=Slider(-4.97, range=-6..0), End=Slider(-3.79, range=-6..0))
divide_length_8 = DivideLength(Curve=line_8, Length=Slider(6.97, range=0..10))  # -> Points, Tangents, Parameters
ghpython_script_5 = GhPythonScript(crvs=line_8, cnt=Slider(7.24, range=0..10))  # -> out, pts; inputs crvs: list of Curve, cnt: Int32
# ---------- ghpython_script_5: Python ----------
import Rhino.Geometry as rg

pts = []

#mod_crv = rg.Curve.ToNurbsCurve(crvs)

#for i in range(len(crvs)):
#    pts.append(crvs[i][0])

#pts.append(crvs[0])

for i in range(len(crvs)):
    ts = rg.Curve.DivideByLength(crvs[i],cnt,True)
    for t in ts:
        pt = rg.Curve.PointAt(crvs[i],t)
        pts.append(pt)
# ---------- end ghpython_script_5 ----------
merge_15 = Merge(Data1=point_14, Data2=point_13, Data3=brep_curve_5.Points)  # disabled
polyline_2 = PolyLine(Vertices=flatten(point_13), Closed=False)  # disabled
curve_15 = Curve(simplify(contour_2))  # disabled
shift_list = ShiftList(List=point_17, Shift=1, Wrap=True)
unit_y_3 = UnitY(Factor=Slider(38, range=0..100))
shift_list_2 = ShiftList(List=point_15, Shift=1, Wrap=True)
unit_y_4 = UnitY(Factor=negative_4)
point_18 = Point(brep_curve.Points)
curve_16 = Curve(extend_curve)
end_points_4 = EndPoints(Curve=line_8)  # -> Start, End
point_19 = Point(ghpython_script_5.pts)
list_item_16 = ListItem(List=point_16, Index=0, Wrap=True)
list_item_17 = ListItem(List=point_16, Index=Slider(-1, range=-1..0), Wrap=True)
merge_16 = Merge(Data1=list_item_16, Data2=list_item_17)
mirror = Mirror(Geometry=merge_16, Plane=yz_plane)  # -> Geometry, Transform
tree_statistics_7 = TreeStatistics(Tree=mirror.Geometry)  # -> Paths, Length, Count
closest_points = ClosestPoints(Point=point_16, Cloud=mirror.Geometry, Count=tree_statistics_7.Count)  # -> ClosestPoint, CPIndex, Distance
removeduplicatepts = RemoveDuplicatePts(Points=flatten(closest_points.ClosestPoint), Tolerance=0.01)
construct_path = ConstructPath(Indices=list_item_17)
partition_list_5 = PartitionList(List=removeduplicatepts, Size=tree_statistics_7.Length)  # -> simplify(Chunks)
tree_statistics_8 = TreeStatistics(Tree=partition_list_5)  # -> Paths, Length, Count
tree_statistics_9 = TreeStatistics(Tree=construct_path)  # -> Paths, Length, Count
replace_paths = ReplacePaths(Data=partition_list_5, Search=tree_statistics_8.Paths, Replace=tree_statistics_9.Paths)
dispatch_9 = Dispatch(List=replace_paths, DispatchPattern=[True, False])  # -> ListA, ListB
point_20 = Point(dispatch_9.ListA)
point_21 = Point(dispatch_9.ListB)
point_22 = Point(divide_curve_2.Points)
tree_statistics_10 = TreeStatistics(Tree=point_18)  # -> Paths, Length, Count
evaluate_curve = EvaluateCurve(Curve=reparameterize(curve_16), Parameter=remap_numbers.Mapped)  # -> Point, Tangent, Angle
list_length_6 = ListLength(List=point_19)
explode_11 = Explode(Curve=polyline_2, Recursive=True)  # -> Segments, Vertices; disabled
geometry_10 = Geometry(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)  # disabled
tree_statistics_11 = TreeStatistics(Tree=curve_15)  # -> Paths, Length, Count; disabled
move_13 = Move(Geometry=point_22, Motion=unit_y_3)  # -> Geometry, Transform
move_14 = Move(Geometry=point_22, Motion=unit_y_4)  # -> Geometry, Transform
point_23 = Point(end_points_4.End)
list_item_18 = ListItem(List=point_17, Index=0, Wrap=True)
list_item_19 = ListItem(List=point_17, Index=Slider(-1, range=-1..0), Wrap=True)
merge_17 = Merge(Data1=list_item_18, Data2=list_item_19)
mirror_2 = Mirror(Geometry=merge_17, Plane=yz_plane_2)  # -> Geometry, Transform
tree_statistics_12 = TreeStatistics(Tree=mirror_2.Geometry)  # -> Paths, Length, Count
closest_points_2 = ClosestPoints(Point=point_17, Cloud=mirror_2.Geometry, Count=tree_statistics_12.Count)  # -> ClosestPoint, CPIndex, Distance
removeduplicatepts_2 = RemoveDuplicatePts(Points=flatten(closest_points_2.ClosestPoint), Tolerance=0.01)
construct_path_2 = ConstructPath(Indices=list_item_19)
partition_list_6 = PartitionList(List=removeduplicatepts_2, Size=tree_statistics_12.Length)  # -> simplify(Chunks)
tree_statistics_13 = TreeStatistics(Tree=partition_list_6)  # -> Paths, Length, Count
tree_statistics_14 = TreeStatistics(Tree=construct_path_2)  # -> Paths, Length, Count
replace_paths_2 = ReplacePaths(Data=partition_list_6, Search=tree_statistics_13.Paths, Replace=tree_statistics_14.Paths)
dispatch_10 = Dispatch(List=replace_paths_2, DispatchPattern=[True, False])  # -> ListA, ListB
point_24 = Point(dispatch_10.ListA)
point_25 = Point(dispatch_10.ListB)
distance = Distance(PointA=point_20, PointB=point_21)
area_6 = Area(Geometry=geometry_10)  # -> Area, Centroid; disabled
area_7 = Area(Geometry=geometry_10)  # -> Area, Centroid; disabled
distance_2 = Distance(PointA=list_item_16, PointB=list_item_17)
area_8 = Area(Geometry=geometry_10)  # -> Area, Centroid; disabled
param_viewer_7 = ParamViewer(point_17)
distance_3 = Distance(PointA=point_17, PointB=shift_list)  # -> simplify(Distance)
distance_4 = Distance(PointA=point_15, PointB=shift_list_2)  # -> simplify(Distance)
point_26 = Point(area.Centroid)
dispatch_11 = Dispatch(List=point_22, DispatchPattern=[True, False])  # -> ListA, ListB
param_viewer_8 = ParamViewer(point_15)
dispatch_12 = Dispatch(List=tree_statistics_10.Paths, DispatchPattern=[True, False])  # -> ListA, ListB
insert_items = InsertItems(List=point_19, Item=point_23, Indices=list_length_6, Wrap=True)
panel = Panel(distance)
panel_2 = Panel(distance_2)
dispatch_13 = Dispatch(List=tree_statistics_11.Paths, DispatchPattern=[True, False])  # -> ListA, ListB; disabled
point_27 = Point(evaluate_curve.Point)
distance_5 = Distance(PointA=point_24, PointB=point_25)
distance_6 = Distance(PointA=list_item_18, PointB=list_item_19)
yz_plane_5 = YZPlane(Origin=point_26)
line_9 = Line(StartPoint=move_13.Geometry, EndPoint=move_14.Geometry)
smaller_than = SmallerThan(FirstNumber=distance, SecondNumber=Slider(8.3, range=0..100))  # -> SmallerThan, OrEqualTo
smaller_than_2 = SmallerThan(FirstNumber=distance_2, SecondNumber=Slider(8.3, range=0..100))  # -> SmallerThan, OrEqualTo
panel_3 = Panel(distance_5)
panel_4 = Panel(distance_6)
larger_than = LargerThan(FirstNumber=distance_3, SecondNumber=Slider(20, range=0..100))  # -> LargerThan, OrEqualTo
larger_than_2 = LargerThan(FirstNumber=distance_4, SecondNumber=Slider(15, range=0..100))  # -> LargerThan, OrEqualTo
orient_8 = Orient(Geometry=curve_7, Source=area_2.Centroid, Target=point_27)  # -> Geometry, Transform
split_tree_3 = SplitTree(Data=point_18, Masks=flatten(dispatch_12.ListA))  # -> Positive, Negative
point_28 = Point(dispatch_11.ListB)
orient_9 = Orient(Geometry=geometry_10, Source=area_6.Centroid, Target=point_13)  # -> Geometry, Transform; disabled
orient_10 = Orient(Geometry=geometry_10, Source=area_7.Centroid, Target=brep_curve_5.Points)  # -> Geometry, Transform; disabled
orient_11 = Orient(Geometry=geometry_10, Source=area_8.Centroid, Target=point_14)  # -> Geometry, Transform; disabled
mirror_3 = Mirror(Geometry=point_27, Plane=yz_plane_5)  # -> Geometry, Transform
smaller_than_3 = SmallerThan(FirstNumber=distance_5, SecondNumber=Slider(8.3, range=0..100))  # -> SmallerThan, OrEqualTo
smaller_than_4 = SmallerThan(FirstNumber=distance_6, SecondNumber=Slider(8.3, range=0..100))  # -> SmallerThan, OrEqualTo
split_tree_4 = SplitTree(Data=curve_15, Masks=flatten(dispatch_13.ListA))  # -> Positive, Negative; disabled
curve_curve_5 = CurveCurve(CurveA=list_item_14, CurveB=line_9)  # -> simplify(Points), ParamsA, ParamsB
panel_5 = Panel(distance_4)
dispatch_14 = Dispatch(List=point_17, DispatchPattern=simplify(larger_than.LargerThan))  # -> ListA, ListB
dispatch_15 = Dispatch(List=split_tree_2.Positive, DispatchPattern=dispatch_14.ListA)  # -> ListA, ListB
geometry_11 = Geometry(dispatch_15.ListA)
dispatch_16 = Dispatch(List=point_15, DispatchPattern=simplify(larger_than_2.LargerThan))  # -> ListA, ListB
dispatch_17 = Dispatch(List=split_tree_2.Negative, DispatchPattern=dispatch_16.ListA)  # -> ListA, ListB
geometry_12 = Geometry(dispatch_17.ListA)
dispatch_18 = Dispatch(List=[point_20, point_21], DispatchPattern=smaller_than.SmallerThan)  # -> ListA, ListB
dispatch_19 = Dispatch(List=[list_item_16, list_item_17], DispatchPattern=smaller_than_2.SmallerThan)  # -> ListA, ListB
merge_18 = Merge(Data1=point_20, Data2=point_21)
multiple_curves = MultipleCurves(Curves=[curve_16, orient_8.Geometry])  # -> flatten(Points), IndexA, IndexB, ParamA, ParamB
geometry_13 = Geometry(orient_9.Geometry)  # disabled
geometry_14 = Geometry(orient_10.Geometry)  # disabled
geometry_15 = Geometry(orient_11.Geometry)  # disabled
xz_plane_3 = XZPlane(Origin=point_26)
tree_statistics_15 = TreeStatistics(Tree=geometry_14)  # -> Paths, Length, Count; disabled
merge_19 = Merge(Data1=point_27, Data2=mirror_3.Geometry)
dispatch_20 = Dispatch(List=[point_24, point_25], DispatchPattern=smaller_than_3.SmallerThan)  # -> ListA, ListB
dispatch_21 = Dispatch(List=split_tree_3.Positive, DispatchPattern=dispatch_14.ListA)  # -> ListA, ListB
dispatch_22 = Dispatch(List=[list_item_18, list_item_19], DispatchPattern=smaller_than_4.SmallerThan)  # -> ListA, ListB
curve_17 = Curve(split_tree_4.Negative)  # disabled
dispatch_23 = Dispatch(List=split_tree_3.Negative, DispatchPattern=dispatch_16.ListA)  # -> ListA, ListB
curve_18 = Curve(split_tree_4.Positive)  # disabled
boolean_toggle_10 = BooleanToggle(True)
boolean_toggle_11 = BooleanToggle(True)
merge_20 = Merge(Data1=point_24, Data2=point_25)
cull_index = CullIndex(List=simplify(flatten(curve_curve_5.Points)), Indices=Slider(0, range=0..100), Wrap=True)
mirror_4 = Mirror(Geometry=merge_19, Plane=xz_plane_3)  # -> Geometry, Transform
point_29 = Point(dispatch_18.ListA)
dispatch_24 = Dispatch(List=tree_statistics_15.Paths, DispatchPattern=[True, False])  # -> ListA, ListB; disabled
point_30 = Point(dispatch_19.ListA)
point_31 = Point(dispatch_18.ListB)
boolean_toggle_12 = BooleanToggle(True)
point_32 = Point(dispatch_19.ListB)
boolean_toggle_13 = BooleanToggle(True)
sort_along_curve_3 = SortAlongCurve(Points=point_13, Curve=curve_17)  # -> Points, Indices; disabled
sort_along_curve_4 = SortAlongCurve(Points=point_14, Curve=curve_18)  # -> Points, Indices; disabled
sort_along_curve_5 = SortAlongCurve(Points=multiple_curves.Points, Curve=curve_16)  # -> Points, Indices
clean_tree_15 = CleanTree(RemoveNulls=True, RemoveInvalid=True, RemoveEmpty=boolean_toggle_10, Tree=point_31)
clean_tree_16 = CleanTree(RemoveNulls=True, RemoveInvalid=boolean_toggle_11, RemoveEmpty=boolean_toggle_11, Tree=point_30)
clean_tree_17 = CleanTree(RemoveNulls=True, RemoveInvalid=True, RemoveEmpty=boolean_toggle_11, Tree=point_32)
point_33 = Point(dispatch_21.ListA)
point_34 = Point(dispatch_23.ListA)
point_35 = Point(dispatch_20.ListA)
point_36 = Point(dispatch_22.ListA)
point_37 = Point(dispatch_20.ListB)
point_38 = Point(dispatch_22.ListB)
point_39 = Point(cull_index)
clean_tree_18 = CleanTree(RemoveNulls=True, RemoveInvalid=boolean_toggle_10, RemoveEmpty=boolean_toggle_10, Tree=point_29)
number_slider_39 = Slider(-1, range=-1..0)  # disabled
point_40 = Point(simplify(sort_along_curve_3.Points))  # disabled
point_41 = Point(point_40)  # disabled
point_42 = Point(simplify(sort_along_curve_4.Points))  # disabled
dispatch_25 = Dispatch(List=sort_along_curve_5.Points, DispatchPattern=[True, False])  # -> ListA, ListB
split_tree_5 = SplitTree(Data=geometry_14, Masks=flatten(dispatch_24.ListA))  # -> Positive, Negative; disabled
orient_12 = Orient(Geometry=curve_7, Source=area_2.Centroid, Target=point_39)  # -> Geometry, Transform
clean_tree_19 = CleanTree(RemoveNulls=True, RemoveInvalid=True, RemoveEmpty=boolean_toggle_12, Tree=point_37)
clean_tree_20 = CleanTree(RemoveNulls=True, RemoveInvalid=boolean_toggle_13, RemoveEmpty=boolean_toggle_13, Tree=point_36)
clean_tree_21 = CleanTree(RemoveNulls=True, RemoveInvalid=True, RemoveEmpty=boolean_toggle_13, Tree=point_38)
clean_tree_22 = CleanTree(RemoveNulls=True, RemoveInvalid=boolean_toggle_12, RemoveEmpty=boolean_toggle_12, Tree=point_35)
merge_21 = Merge(Data1=merge_19, Data2=mirror_4.Geometry)
number_slider_40 = Slider(-1, range=-1..0)  # disabled
point_43 = Point(point_4)
dispatch_26 = Dispatch(List=clean_tree_15, DispatchPattern=[True, False])  # -> ListA, ListB
point_44 = Point(point_3)
dispatch_27 = Dispatch(List=clean_tree_17, DispatchPattern=[True, False])  # -> ListA, ListB
shift_list_3 = ShiftList(List=point_42, Shift=1, Wrap=True)  # disabled
shift_list_4 = ShiftList(List=point_40, Shift=1, Wrap=True)  # disabled
point_45 = Point(brep_curve_5.Points)  # disabled
tree_statistics_16 = TreeStatistics(Tree=clean_tree_18)  # -> Paths, Length, Count
dispatch_28 = Dispatch(List=clean_tree_16, DispatchPattern=[True, False])  # -> ListA, ListB
dispatch_29 = Dispatch(List=clean_tree_18, DispatchPattern=[True, False])  # -> ListA, ListB
tree_statistics_17 = TreeStatistics(Tree=clean_tree_16)  # -> Paths, Length, Count
distance_7 = Distance(PointA=dispatch_25.ListA, PointB=dispatch_25.ListB)
geometry_16 = Geometry(orient_12.Geometry)
curve_19 = Curve(list_item_14)
clean_tree_23 = CleanTree(RemoveNulls=True, RemoveInvalid=True, RemoveEmpty=Toggle(True), Tree=point_33)
list_item_20 = ListItem(List=point_41, Index=0, Wrap=True)  # disabled
clean_tree_24 = CleanTree(RemoveNulls=True, RemoveInvalid=True, RemoveEmpty=Toggle(True), Tree=point_34)
dispatch_30 = Dispatch(List=clean_tree_19, DispatchPattern=[True, False])  # -> ListA, ListB
dispatch_31 = Dispatch(List=clean_tree_21, DispatchPattern=[True, False])  # -> ListA, ListB
list_item_21 = ListItem(List=point_41, Index=number_slider_39, Wrap=True)  # disabled
merge_22 = Merge(Data1=list_item_20, Data2=list_item_21)  # disabled
mirror_5 = Mirror(Geometry=merge_22, Plane=yz_plane_3)  # -> Geometry, Transform; disabled
tree_statistics_18 = TreeStatistics(Tree=mirror_5.Geometry)  # -> Paths, Length, Count; disabled
closest_points_3 = ClosestPoints(Point=point_41, Cloud=mirror_5.Geometry, Count=tree_statistics_18.Count)  # -> ClosestPoint, CPIndex, Distance; disabled
removeduplicatepts_3 = RemoveDuplicatePts(Points=flatten(closest_points_3.ClosestPoint), Tolerance=0.01)  # disabled
construct_path_3 = ConstructPath(Indices=list_item_21)  # disabled
partition_list_7 = PartitionList(List=removeduplicatepts_3, Size=tree_statistics_18.Length)  # -> simplify(Chunks); disabled
tree_statistics_19 = TreeStatistics(Tree=partition_list_7)  # -> Paths, Length, Count; disabled
tree_statistics_20 = TreeStatistics(Tree=construct_path_3)  # -> Paths, Length, Count; disabled
replace_paths_3 = ReplacePaths(Data=partition_list_7, Search=tree_statistics_19.Paths, Replace=tree_statistics_20.Paths)  # disabled
dispatch_32 = Dispatch(List=replace_paths_3, DispatchPattern=[True, False])  # -> ListA, ListB; disabled
point_46 = Point(dispatch_32.ListA)  # disabled
point_47 = Point(dispatch_32.ListB)  # disabled
tree_statistics_21 = TreeStatistics(Tree=point_45)  # -> Paths, Length, Count; disabled
merge_23 = Merge(Data1=merge_21, Data2=point_44, Data3=point_43)  # -> flatten(Result)
tree_statistics_22 = TreeStatistics(Tree=clean_tree_22)  # -> Paths, Length, Count
dispatch_33 = Dispatch(List=clean_tree_20, DispatchPattern=[True, False])  # -> ListA, ListB
dispatch_34 = Dispatch(List=clean_tree_22, DispatchPattern=[True, False])  # -> ListA, ListB
tree_statistics_23 = TreeStatistics(Tree=clean_tree_20)  # -> Paths, Length, Count
panel_6 = Panel(distance_3)

number_slider_41 = Slider(20, range=0..100)  # disabled
number_slider_42 = Slider(15, range=0..100)  # disabled

distance_8 = Distance(PointA=dispatch_26.ListA, PointB=dispatch_26.ListB)
distance_9 = Distance(PointA=dispatch_27.ListA, PointB=dispatch_27.ListB)
list_item_22 = ListItem(List=point_42, Index=0, Wrap=True)  # disabled
list_item_23 = ListItem(List=point_42, Index=number_slider_40, Wrap=True)  # disabled
merge_24 = Merge(Data1=list_item_22, Data2=list_item_23)  # disabled
mirror_6 = Mirror(Geometry=merge_24, Plane=yz_plane_4)  # -> Geometry, Transform; disabled
tree_statistics_24 = TreeStatistics(Tree=mirror_6.Geometry)  # -> Paths, Length, Count; disabled
closest_points_4 = ClosestPoints(Point=point_42, Cloud=mirror_6.Geometry, Count=tree_statistics_24.Count)  # -> ClosestPoint, CPIndex, Distance; disabled
removeduplicatepts_4 = RemoveDuplicatePts(Points=flatten(closest_points_4.ClosestPoint), Tolerance=0.01)  # disabled
construct_path_4 = ConstructPath(Indices=list_item_23)  # disabled
partition_list_8 = PartitionList(List=removeduplicatepts_4, Size=tree_statistics_24.Length)  # -> simplify(Chunks); disabled
tree_statistics_25 = TreeStatistics(Tree=partition_list_8)  # -> Paths, Length, Count; disabled
tree_statistics_26 = TreeStatistics(Tree=construct_path_4)  # -> Paths, Length, Count; disabled
replace_paths_4 = ReplacePaths(Data=partition_list_8, Search=tree_statistics_25.Paths, Replace=tree_statistics_26.Paths)  # disabled
dispatch_35 = Dispatch(List=replace_paths_4, DispatchPattern=[True, False])  # -> ListA, ListB; disabled
point_48 = Point(dispatch_35.ListA)  # disabled
point_49 = Point(dispatch_35.ListB)  # disabled
number_slider_43 = Slider(8.3, range=0..100)  # disabled
number_slider_44 = Slider(8.3, range=0..100)  # disabled
distance_10 = Distance(PointA=point_46, PointB=point_47)  # disabled
distance_11 = Distance(PointA=list_item_20, PointB=list_item_21)  # disabled
mass_addition_2 = MassAddition(Input=distance_7)  # -> Result, PartialResults
distance_12 = Distance(PointA=dispatch_28.ListA, PointB=dispatch_28.ListB)
distance_13 = Distance(PointA=dispatch_29.ListA, PointB=dispatch_29.ListB)
param_viewer_9 = ParamViewer(point_42)  # disabled
distance_14 = Distance(PointA=point_42, PointB=shift_list_3)  # -> simplify(Distance); disabled
distance_15 = Distance(PointA=point_40, PointB=shift_list_4)  # -> simplify(Distance); disabled
param_viewer_10 = ParamViewer(point_40)  # disabled
dispatch_36 = Dispatch(List=tree_statistics_21.Paths, DispatchPattern=[True, False])  # -> ListA, ListB; disabled
distance_16 = Distance(PointA=dispatch_30.ListA, PointB=dispatch_30.ListB)
sort_along_curve_6 = SortAlongCurve(Points=merge_23, Curve=curve_2)  # -> Points, Indices
distance_17 = Distance(PointA=dispatch_31.ListA, PointB=dispatch_31.ListB)
point_50 = Point(clean_tree_24)
panel_7 = Panel(distance_10)  # disabled
panel_8 = Panel(distance_11)  # disabled
point_51 = Point(clean_tree_23)
point_52 = Point(point_15)
point_53 = Point(point_17)
number_slider_45 = Slider(8.3, range=0..100)  # disabled
number_slider_46 = Slider(8.3, range=0..100)  # disabled
distance_18 = Distance(PointA=point_48, PointB=point_49)  # disabled
distance_19 = Distance(PointA=list_item_22, PointB=list_item_23)  # disabled
distance_20 = Distance(PointA=dispatch_33.ListA, PointB=dispatch_33.ListB)
distance_21 = Distance(PointA=dispatch_34.ListA, PointB=dispatch_34.ListB)
smaller_than_5 = SmallerThan(FirstNumber=distance_8, SecondNumber=Slider(15, range=0..100))  # -> SmallerThan, OrEqualTo
smaller_than_6 = SmallerThan(FirstNumber=distance_9, SecondNumber=Slider(15, range=0..100))  # -> SmallerThan, OrEqualTo
galapagos = Galapagos(fitness=mass_addition_2, gene=gene_pool)
panel_9 = Panel(distance_8)
smaller_than_7 = SmallerThan(FirstNumber=distance_10, SecondNumber=number_slider_43)  # -> SmallerThan, OrEqualTo; disabled
panel_10 = Panel(distance_9)
smaller_than_8 = SmallerThan(FirstNumber=distance_11, SecondNumber=number_slider_44)  # -> SmallerThan, OrEqualTo; disabled
panel_11 = Panel(distance_18)  # disabled
panel_12 = Panel(distance_19)  # disabled
larger_than_3 = LargerThan(FirstNumber=distance_14, SecondNumber=number_slider_41)  # -> LargerThan, OrEqualTo; disabled
larger_than_4 = LargerThan(FirstNumber=distance_15, SecondNumber=number_slider_42)  # -> LargerThan, OrEqualTo; disabled
param_viewer_11 = ParamViewer(point_51)
point_54 = Point(sort_along_curve_6.Points)
shift_list_5 = ShiftList(List=point_54, Shift=1, Wrap=True)
split_tree_6 = SplitTree(Data=point_45, Masks=flatten(dispatch_36.ListA))  # -> Positive, Negative; disabled
smaller_than_9 = SmallerThan(FirstNumber=distance_16, SecondNumber=Slider(15, range=0..100))  # -> SmallerThan, OrEqualTo
smaller_than_10 = SmallerThan(FirstNumber=distance_17, SecondNumber=Slider(15, range=0..100))  # -> SmallerThan, OrEqualTo
panel_13 = Panel(distance_16)
smaller_than_11 = SmallerThan(FirstNumber=distance_18, SecondNumber=number_slider_45)  # -> SmallerThan, OrEqualTo; disabled
panel_14 = Panel(distance_17)
smaller_than_12 = SmallerThan(FirstNumber=distance_19, SecondNumber=number_slider_46)  # -> SmallerThan, OrEqualTo; disabled
orient_13 = Orient(Geometry=curve_7, Source=area_2.Centroid, Target=point_54)  # -> Geometry, Transform
line_10 = Line(StartPoint=point_54, EndPoint=shift_list_5)
boolean_toggle_14 = BooleanToggle(True)
boolean_toggle_15 = BooleanToggle(True)
dispatch_37 = Dispatch(List=clean_tree_15, DispatchPattern=smaller_than_5.SmallerThan)  # -> ListA, ListB
dispatch_38 = Dispatch(List=clean_tree_17, DispatchPattern=smaller_than_6.SmallerThan)  # -> ListA, ListB
panel_15 = Panel(distance_15)  # disabled
dispatch_39 = Dispatch(List=point_42, DispatchPattern=simplify(larger_than_3.LargerThan))  # -> ListA, ListB; disabled
dispatch_40 = Dispatch(List=split_tree_5.Positive, DispatchPattern=dispatch_39.ListA)  # -> ListA, ListB; disabled
geometry_17 = Geometry(dispatch_40.ListA)  # disabled
dispatch_41 = Dispatch(List=point_40, DispatchPattern=simplify(larger_than_4.LargerThan))  # -> ListA, ListB; disabled
dispatch_42 = Dispatch(List=split_tree_5.Negative, DispatchPattern=dispatch_41.ListA)  # -> ListA, ListB; disabled
geometry_18 = Geometry(dispatch_42.ListA)  # disabled
dispatch_43 = Dispatch(List=[point_46, point_47], DispatchPattern=smaller_than_7.SmallerThan)  # -> ListA, ListB; disabled
dispatch_44 = Dispatch(List=[list_item_20, list_item_21], DispatchPattern=smaller_than_8.SmallerThan)  # -> ListA, ListB; disabled
merge_25 = Merge(Data1=point_46, Data2=point_47)  # disabled
boolean_toggle_16 = BooleanToggle(True)
boolean_toggle_17 = BooleanToggle(True)
dispatch_45 = Dispatch(List=clean_tree_19, DispatchPattern=smaller_than_9.SmallerThan)  # -> ListA, ListB
dispatch_46 = Dispatch(List=clean_tree_21, DispatchPattern=smaller_than_10.SmallerThan)  # -> ListA, ListB
merge_26 = Merge(Data1=point_52, Data2=point_50)
merge_27 = Merge(Data1=point_53, Data2=point_51)
unit_z_9 = UnitZ(Factor=Slider(4.5, range=0..10))
dispatch_47 = Dispatch(List=[point_48, point_49], DispatchPattern=smaller_than_11.SmallerThan)  # -> ListA, ListB; disabled
dispatch_48 = Dispatch(List=split_tree_6.Positive, DispatchPattern=dispatch_39.ListA)  # -> ListA, ListB; disabled
curve_middle_5 = CurveMiddle(Curve=line_10)
dispatch_49 = Dispatch(List=[list_item_22, list_item_23], DispatchPattern=smaller_than_12.SmallerThan)  # -> ListA, ListB; disabled
dispatch_50 = Dispatch(List=split_tree_6.Negative, DispatchPattern=dispatch_41.ListA)  # -> ListA, ListB; disabled
boolean_toggle_18 = BooleanToggle(True)  # disabled
boolean_toggle_19 = BooleanToggle(True)  # disabled
merge_28 = Merge(Data1=point_48, Data2=point_49)  # disabled
list_item_24 = ListItem(List=orient_13.Geometry, Index=Slider(0, range=0..27), Wrap=True)
clean_tree_25 = CleanTree(RemoveNulls=True, RemoveInvalid=True, RemoveEmpty=boolean_toggle_14, Tree=dispatch_37.ListA)
clean_tree_26 = CleanTree(RemoveNulls=True, RemoveInvalid=True, RemoveEmpty=boolean_toggle_15, Tree=dispatch_38.ListA)
clean_tree_27 = CleanTree(RemoveNulls=True, RemoveInvalid=True, RemoveEmpty=boolean_toggle_14, Tree=dispatch_37.ListB)
clean_tree_28 = CleanTree(RemoveNulls=True, RemoveInvalid=True, RemoveEmpty=boolean_toggle_15, Tree=dispatch_38.ListB)
point_55 = Point(dispatch_43.ListA)  # disabled
point_56 = Point(dispatch_44.ListA)  # disabled
point_57 = Point(dispatch_43.ListB)  # disabled
boolean_toggle_20 = BooleanToggle(True)  # disabled
point_58 = Point(dispatch_44.ListB)  # disabled
boolean_toggle_21 = BooleanToggle(True)  # disabled
yz_plane_6 = YZPlane(Origin=point_26)
clean_tree_29 = CleanTree(RemoveNulls=True, RemoveInvalid=True, RemoveEmpty=boolean_toggle_16, Tree=dispatch_45.ListA)
clean_tree_30 = CleanTree(RemoveNulls=True, RemoveInvalid=True, RemoveEmpty=boolean_toggle_17, Tree=dispatch_46.ListA)
clean_tree_31 = CleanTree(RemoveNulls=True, RemoveInvalid=True, RemoveEmpty=boolean_toggle_16, Tree=dispatch_45.ListB)
clean_tree_32 = CleanTree(RemoveNulls=True, RemoveInvalid=True, RemoveEmpty=boolean_toggle_17, Tree=dispatch_46.ListB)
move_15 = Move(Geometry=curve_middle_5, Motion=unit_z_9)  # -> Geometry, Transform
param_viewer_12 = ParamViewer(merge_27)
clean_tree_33 = CleanTree(RemoveNulls=True, RemoveInvalid=True, RemoveEmpty=boolean_toggle_18, Tree=point_57)  # disabled
clean_tree_34 = CleanTree(RemoveNulls=True, RemoveInvalid=boolean_toggle_19, RemoveEmpty=boolean_toggle_19, Tree=point_56)  # disabled
clean_tree_35 = CleanTree(RemoveNulls=True, RemoveInvalid=True, RemoveEmpty=boolean_toggle_19, Tree=point_58)  # disabled
point_59 = Point(dispatch_48.ListA)  # disabled
point_60 = Point(dispatch_50.ListA)  # disabled
point_61 = Point(dispatch_47.ListA)  # disabled
point_62 = Point(dispatch_49.ListA)  # disabled
point_63 = Point(dispatch_47.ListB)  # disabled
point_64 = Point(dispatch_49.ListB)  # disabled
clean_tree_36 = CleanTree(RemoveNulls=True, RemoveInvalid=boolean_toggle_18, RemoveEmpty=boolean_toggle_18, Tree=point_55)  # disabled
point_65 = Point(clean_tree_25)
point_66 = Point(clean_tree_26)
clean_tree_37 = CleanTree(RemoveNulls=True, RemoveInvalid=True, RemoveEmpty=boolean_toggle_20, Tree=point_63)  # disabled
boolean_toggle_22 = BooleanToggle(True)  # disabled
clean_tree_38 = CleanTree(RemoveNulls=True, RemoveInvalid=boolean_toggle_21, RemoveEmpty=boolean_toggle_21, Tree=point_62)  # disabled
clean_tree_39 = CleanTree(RemoveNulls=True, RemoveInvalid=True, RemoveEmpty=boolean_toggle_21, Tree=point_64)  # disabled
boolean_toggle_23 = BooleanToggle(True)  # disabled
polyline_3 = PolyLine(Vertices=point_65, Closed=False)
length_3 = Length(Curve=polyline_3)
geometry_19 = Geometry(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)
polyline_4 = PolyLine(Vertices=point_66, Closed=False)
length_4 = Length(Curve=polyline_4)
point_67 = Point(clean_tree_29)
clean_tree_40 = CleanTree(RemoveNulls=True, RemoveInvalid=boolean_toggle_20, RemoveEmpty=boolean_toggle_20, Tree=point_61)  # disabled
point_68 = Point(clean_tree_30)
division_9 = Division(A=Slider(15, range=0..100), B=length_3)
division_10 = Division(A=Slider(15, range=0..100), B=length_4)
area_9 = Area(Geometry=geometry_19)  # -> Area, Centroid
shift_paths_5 = ShiftPaths(Data=move_15.Geometry, Offset=-1)
dispatch_51 = Dispatch(List=clean_tree_33, DispatchPattern=[True, False])  # -> ListA, ListB; disabled
dispatch_52 = Dispatch(List=clean_tree_35, DispatchPattern=[True, False])  # -> ListA, ListB; disabled
list_item_25 = ListItem(List=move_15.Geometry, Index=0, Wrap=True)  # -> Item1, Item
polyline_5 = PolyLine(Vertices=point_67, Closed=False)
length_5 = Length(Curve=polyline_5)
polyline_6 = PolyLine(Vertices=point_68, Closed=False)
length_6 = Length(Curve=polyline_6)
tree_statistics_27 = TreeStatistics(Tree=clean_tree_36)  # -> Paths, Length, Count; disabled
dispatch_53 = Dispatch(List=clean_tree_34, DispatchPattern=[True, False])  # -> ListA, ListB; disabled
dispatch_54 = Dispatch(List=clean_tree_36, DispatchPattern=[True, False])  # -> ListA, ListB; disabled
tree_statistics_28 = TreeStatistics(Tree=clean_tree_34)  # -> Paths, Length, Count; disabled
sort_along_curve_7 = SortAlongCurve(Points=merge_26, Curve=curve_13)  # -> simplify(Points), Indices
sort_along_curve_8 = SortAlongCurve(Points=merge_27, Curve=curve_14)  # -> simplify(Points), Indices
# 1&2 layer pts
merge_29 = Merge(Data1=point_54, Data2=shift_paths_5)  # -> simplify(Result)
division_11 = Division(A=Slider(15, range=0..100), B=length_5)
division_12 = Division(A=Slider(15, range=0..100), B=length_6)
cull_duplicates = CullDuplicates(Points=clean_tree_16, Tolerance=distance_12, CullMode=3)  # -> Points, Indices, Valence
clean_tree_41 = CleanTree(RemoveNulls=True, RemoveInvalid=True, RemoveEmpty=boolean_toggle_22, Tree=point_59)  # disabled
curve_middle_6 = CurveMiddle(Curve=polyline_3)
clean_tree_42 = CleanTree(RemoveNulls=True, RemoveInvalid=True, RemoveEmpty=boolean_toggle_23, Tree=point_60)  # disabled
curve_middle_7 = CurveMiddle(Curve=polyline_4)
dispatch_55 = Dispatch(List=clean_tree_37, DispatchPattern=[True, False])  # -> ListA, ListB; disabled
dispatch_56 = Dispatch(List=clean_tree_39, DispatchPattern=[True, False])  # -> ListA, ListB; disabled
cull_duplicates_2 = CullDuplicates(Points=clean_tree_18, Tolerance=distance_13, CullMode=3)  # -> Points, Indices, Valence
tree_statistics_29 = TreeStatistics(Tree=clean_tree_40)  # -> Paths, Length, Count; disabled
dispatch_57 = Dispatch(List=clean_tree_38, DispatchPattern=[True, False])  # -> ListA, ListB; disabled
dispatch_58 = Dispatch(List=clean_tree_40, DispatchPattern=[True, False])  # -> ListA, ListB; disabled
tree_statistics_30 = TreeStatistics(Tree=clean_tree_38)  # -> Paths, Length, Count; disabled
number_slider_47 = Slider(15, range=0..100)  # disabled
number_slider_48 = Slider(15, range=0..100)  # disabled
merge_30 = Merge(Data1=list_item_25.Item1, Data2=list_item_25.Item)
mirror_7 = Mirror(Geometry=merge_30, Plane=yz_plane_6)  # -> Geometry, Transform
closest_points_5 = ClosestPoints(Point=mirror_7.Geometry, Cloud=move_15.Geometry, Count=Slider(1, range=0..10))  # -> simplify(ClosestPoint), CPIndex, Distance
panel_16 = Panel(distance_14)  # disabled
distance_22 = Distance(PointA=dispatch_51.ListA, PointB=dispatch_51.ListB)  # disabled
orient_14 = Orient(Geometry=geometry_19, Source=area_9.Centroid, Target=merge_29)  # -> Geometry, Transform
cull_duplicates_3 = CullDuplicates(Points=clean_tree_20, Tolerance=distance_20, CullMode=3)  # -> Points, Indices, Valence
distance_23 = Distance(PointA=dispatch_52.ListA, PointB=dispatch_52.ListB)  # disabled
curve_middle_8 = CurveMiddle(Curve=polyline_5)
curve_middle_9 = CurveMiddle(Curve=polyline_6)
cull_duplicates_4 = CullDuplicates(Points=clean_tree_22, Tolerance=distance_21, CullMode=3)  # -> Points, Indices, Valence
distance_24 = Distance(PointA=dispatch_53.ListA, PointB=dispatch_53.ListB)  # disabled
distance_25 = Distance(PointA=dispatch_54.ListA, PointB=dispatch_54.ListB)  # disabled
number_slider_49 = Slider(15, range=0..100)  # disabled
number_slider_50 = Slider(15, range=0..100)  # disabled
scale = Scale(Geometry=point_65, Center=curve_middle_6, Factor=division_9)  # -> Geometry, Transform
scale_2 = Scale(Geometry=point_66, Center=curve_middle_7, Factor=division_10)  # -> Geometry, Transform
point_69 = Point(cull_duplicates.Points)
point_70 = Point(clean_tree_28)
point_71 = Point(clean_tree_27)
polyline_7 = PolyLine(Vertices=flatten(sort_along_curve_8.Points), Closed=False)
polyline_8 = PolyLine(Vertices=flatten(sort_along_curve_7.Points), Closed=False)
point_72 = Point(cull_duplicates_2.Points)
distance_26 = Distance(PointA=dispatch_55.ListA, PointB=dispatch_55.ListB)  # disabled
distance_27 = Distance(PointA=dispatch_56.ListA, PointB=dispatch_56.ListB)  # disabled
point_73 = Point(clean_tree_42)  # disabled
point_74 = Point(clean_tree_41)  # disabled
point_75 = Point(point_40)  # disabled
point_76 = Point(point_42)  # disabled
point_77 = Point(merge_30)
point_78 = Point(closest_points_5.ClosestPoint)
distance_28 = Distance(PointA=dispatch_57.ListA, PointB=dispatch_57.ListB)  # disabled
distance_29 = Distance(PointA=dispatch_58.ListA, PointB=dispatch_58.ListB)  # disabled
shift_paths_6 = ShiftPaths(Data=point_69, Offset=-1)

custom_preview = CustomPreview(Geometry=geometry_9, Material=ColourSwatch(SwatchColor=RGBA(240, 63, 129, 197)))
custom_preview_2 = CustomPreview(Geometry=geometry_7, Material=ColourSwatch(SwatchColor=RGBA(65, 230, 231, 197)))
custom_preview_3 = CustomPreview(Geometry=geometry_11, Material=ColourSwatch(SwatchColor=RGBA(89, 252, 135, 197)))
custom_preview_4 = CustomPreview(Geometry=geometry_12, Material=ColourSwatch(SwatchColor=RGBA(89, 252, 135, 197)))

smaller_than_13 = SmallerThan(FirstNumber=distance_22, SecondNumber=number_slider_47)  # -> SmallerThan, OrEqualTo; disabled
smaller_than_14 = SmallerThan(FirstNumber=distance_23, SecondNumber=number_slider_48)  # -> SmallerThan, OrEqualTo; disabled
scale_3 = Scale(Geometry=point_67, Center=curve_middle_8, Factor=division_11)  # -> Geometry, Transform
scale_4 = Scale(Geometry=point_68, Center=curve_middle_9, Factor=division_12)  # -> Geometry, Transform
point_79 = Point(cull_duplicates_3.Points)
point_80 = Point(clean_tree_32)
point_81 = Point(clean_tree_31)
shift_paths_7 = ShiftPaths(Data=point_72, Offset=-1)
point_82 = Point(cull_duplicates_4.Points)
panel_17 = Panel(distance_22)  # disabled
panel_18 = Panel(distance_23)  # disabled
custom_preview_5 = CustomPreview(Geometry=orient_14.Geometry, Material=ColourSwatch(SwatchColor=RGBA(152, 224, 255, 122)))
param_viewer_13 = ParamViewer(point_74)  # disabled
shift_paths_8 = ShiftPaths(Data=point_79, Offset=-1)
smaller_than_15 = SmallerThan(FirstNumber=distance_26, SecondNumber=number_slider_49)  # -> SmallerThan, OrEqualTo; disabled
smaller_than_16 = SmallerThan(FirstNumber=distance_27, SecondNumber=number_slider_50)  # -> SmallerThan, OrEqualTo; disabled
merge_31 = Merge(Data1=sort_along_curve_8.Points, Data2=sort_along_curve_7.Points)
shift_paths_9 = ShiftPaths(Data=point_82, Offset=-1)
panel_19 = Panel(distance_26)  # disabled
panel_20 = Panel(distance_27)  # disabled
merge_32 = Merge(Data1=point_70, Data2=scale_2.Geometry, Data3=simplify(shift_paths_6))
merge_33 = Merge(Data1=point_71, Data2=scale.Geometry, Data3=simplify(shift_paths_7))
boolean_toggle_24 = BooleanToggle(True)  # disabled
boolean_toggle_25 = BooleanToggle(True)  # disabled
dispatch_59 = Dispatch(List=clean_tree_33, DispatchPattern=smaller_than_13.SmallerThan)  # -> ListA, ListB; disabled
dispatch_60 = Dispatch(List=clean_tree_35, DispatchPattern=smaller_than_14.SmallerThan)  # -> ListA, ListB; disabled
merge_34 = Merge(Data1=list_item_16, Data2=list_item_17, Data3=point_20, Data4=point_21)
merge_35 = Merge(Data1=point_80, Data2=scale_4.Geometry, Data3=simplify(shift_paths_8))
merge_36 = Merge(Data1=point_81, Data2=scale_3.Geometry, Data3=simplify(shift_paths_9))
boolean_toggle_26 = BooleanToggle(True)  # disabled
boolean_toggle_27 = BooleanToggle(True)  # disabled
dispatch_61 = Dispatch(List=clean_tree_37, DispatchPattern=smaller_than_15.SmallerThan)  # -> ListA, ListB; disabled
dispatch_62 = Dispatch(List=clean_tree_39, DispatchPattern=smaller_than_16.SmallerThan)  # -> ListA, ListB; disabled
merge_37 = Merge(Data1=point_75, Data2=point_73)  # disabled
merge_38 = Merge(Data1=point_76, Data2=point_74)  # disabled
merge_39 = Merge(Data1=list_item_18, Data2=list_item_19, Data3=point_24, Data4=point_25)
clean_tree_43 = CleanTree(RemoveNulls=True, RemoveInvalid=True, RemoveEmpty=boolean_toggle_24, Tree=dispatch_59.ListA)  # disabled
clean_tree_44 = CleanTree(RemoveNulls=True, RemoveInvalid=True, RemoveEmpty=boolean_toggle_25, Tree=dispatch_60.ListA)  # disabled
clean_tree_45 = CleanTree(RemoveNulls=True, RemoveInvalid=True, RemoveEmpty=boolean_toggle_24, Tree=dispatch_59.ListB)  # disabled
clean_tree_46 = CleanTree(RemoveNulls=True, RemoveInvalid=True, RemoveEmpty=boolean_toggle_25, Tree=dispatch_60.ListB)  # disabled
closest_point = ClosestPoint(Point=merge_34, Cloud=point_16)  # -> ClosestPoint, CPIndex, Distance
number_slider_51 = Slider(15, range=0..100)  # disabled
number_slider_52 = Slider(15, range=0..100)  # disabled
clean_tree_47 = CleanTree(RemoveNulls=True, RemoveInvalid=True, RemoveEmpty=boolean_toggle_26, Tree=dispatch_61.ListA)  # disabled
clean_tree_48 = CleanTree(RemoveNulls=True, RemoveInvalid=True, RemoveEmpty=boolean_toggle_27, Tree=dispatch_62.ListA)  # disabled
clean_tree_49 = CleanTree(RemoveNulls=True, RemoveInvalid=True, RemoveEmpty=boolean_toggle_26, Tree=dispatch_61.ListB)  # disabled
clean_tree_50 = CleanTree(RemoveNulls=True, RemoveInvalid=True, RemoveEmpty=boolean_toggle_27, Tree=dispatch_62.ListB)  # disabled
param_viewer_14 = ParamViewer(merge_38)  # disabled
closest_point_2 = ClosestPoint(Point=merge_39, Cloud=point_17)  # -> ClosestPoint, CPIndex, Distance
number_slider_53 = Slider(15, range=0..100)  # disabled
number_slider_54 = Slider(15, range=0..100)  # disabled
point_83 = Point(clean_tree_43)  # disabled
point_84 = Point(clean_tree_44)  # disabled
cull_index_2 = CullIndex(List=point_16, Indices=closest_point.CPIndex, Wrap=True)
polyline_9 = PolyLine(Vertices=point_83, Closed=False)  # disabled
length_7 = Length(Curve=polyline_9)  # disabled
polyline_10 = PolyLine(Vertices=point_84, Closed=False)  # disabled
length_8 = Length(Curve=polyline_10)  # disabled
point_85 = Point(clean_tree_47)  # disabled
point_86 = Point(clean_tree_48)  # disabled
division_13 = Division(A=number_slider_51, B=length_7)  # disabled
division_14 = Division(A=number_slider_52, B=length_8)  # disabled
cull_index_3 = CullIndex(List=point_17, Indices=closest_point_2.CPIndex, Wrap=True)
polyline_11 = PolyLine(Vertices=point_85, Closed=False)  # disabled
length_9 = Length(Curve=polyline_11)  # disabled
polyline_12 = PolyLine(Vertices=point_86, Closed=False)  # disabled
length_10 = Length(Curve=polyline_12)  # disabled
sort_along_curve_9 = SortAlongCurve(Points=merge_37, Curve=curve_17)  # -> simplify(Points), Indices; disabled
point_87 = Point(simplify(cull_index_2))
merge_40 = Merge(Data1=point_87, Data2=merge_32, Data3=merge_33)
sort_along_curve_10 = SortAlongCurve(Points=merge_40, Curve=curve_13)  # -> Points, Indices
sort_along_curve_11 = SortAlongCurve(Points=merge_38, Curve=curve_18)  # -> simplify(Points), Indices; disabled
division_15 = Division(A=number_slider_53, B=length_9)  # disabled
division_16 = Division(A=number_slider_54, B=length_10)  # disabled
cull_duplicates_5 = CullDuplicates(Points=clean_tree_34, Tolerance=distance_24, CullMode=3)  # -> Points, Indices, Valence; disabled
curve_middle_10 = CurveMiddle(Curve=polyline_9)  # disabled
curve_middle_11 = CurveMiddle(Curve=polyline_10)  # disabled
cull_duplicates_6 = CullDuplicates(Points=clean_tree_36, Tolerance=distance_25, CullMode=3)  # -> Points, Indices, Valence; disabled
number_slider_55 = Slider(107, range=0..107)
point_88 = Point(simplify(cull_index_3))
merge_41 = Merge(Data1=point_88, Data2=merge_35, Data3=merge_36)
cull_duplicates_7 = CullDuplicates(Points=clean_tree_38, Tolerance=distance_28, CullMode=3)  # -> Points, Indices, Valence; disabled
curve_middle_12 = CurveMiddle(Curve=polyline_11)  # disabled
curve_middle_13 = CurveMiddle(Curve=polyline_12)  # disabled
cull_duplicates_8 = CullDuplicates(Points=clean_tree_40, Tolerance=distance_29, CullMode=3)  # -> Points, Indices, Valence; disabled
scale_5 = Scale(Geometry=point_83, Center=curve_middle_10, Factor=division_13)  # -> Geometry, Transform; disabled
scale_6 = Scale(Geometry=point_84, Center=curve_middle_11, Factor=division_14)  # -> Geometry, Transform; disabled
sort_along_curve_12 = SortAlongCurve(Points=merge_41, Curve=curve_14)  # -> Points, Indices
point_89 = Point(cull_duplicates_5.Points)  # disabled
point_90 = Point(clean_tree_46)  # disabled
point_91 = Point(clean_tree_45)  # disabled
polyline_13 = PolyLine(Vertices=flatten(sort_along_curve_11.Points), Closed=False)  # disabled
polyline_14 = PolyLine(Vertices=flatten(sort_along_curve_9.Points), Closed=False)  # disabled
point_92 = Point(cull_duplicates_6.Points)  # disabled
point_93 = Point(simplify(sort_along_curve_10.Points))
shift_paths_10 = ShiftPaths(Data=point_89, Offset=-1)  # disabled

colour_swatch = ColourSwatch(SwatchColor=RGBA(240, 63, 129, 197))  # disabled
colour_swatch_2 = ColourSwatch(SwatchColor=RGBA(65, 230, 231, 197))  # disabled
colour_swatch_3 = ColourSwatch(SwatchColor=RGBA(89, 252, 135, 197))  # disabled
colour_swatch_4 = ColourSwatch(SwatchColor=RGBA(89, 252, 135, 197))  # disabled
custom_preview_6 = CustomPreview(Geometry=geometry_15, Material=colour_swatch)  # disabled
custom_preview_7 = CustomPreview(Geometry=geometry_13, Material=colour_swatch_2)  # disabled
custom_preview_8 = CustomPreview(Geometry=geometry_17, Material=colour_swatch_3)  # disabled
custom_preview_9 = CustomPreview(Geometry=geometry_18, Material=colour_swatch_4)  # disabled

scale_7 = Scale(Geometry=point_85, Center=curve_middle_12, Factor=division_15)  # -> Geometry, Transform; disabled
scale_8 = Scale(Geometry=point_86, Center=curve_middle_13, Factor=division_16)  # -> Geometry, Transform; disabled
point_94 = Point(cull_duplicates_7.Points)  # disabled
point_95 = Point(clean_tree_50)  # disabled
point_96 = Point(clean_tree_49)  # disabled
shift_paths_11 = ShiftPaths(Data=point_92, Offset=-1)  # disabled
point_97 = Point(cull_duplicates_8.Points)  # disabled
point_98 = Point(simplify(sort_along_curve_12.Points))
shift_paths_12 = ShiftPaths(Data=point_94, Offset=-1)  # disabled
merge_42 = Merge(Data1=sort_along_curve_11.Points, Data2=sort_along_curve_9.Points)  # disabled
shift_paths_13 = ShiftPaths(Data=point_97, Offset=-1)  # disabled
merge_43 = Merge(Data1=point_90, Data2=scale_6.Geometry, Data3=simplify(shift_paths_10))  # disabled
merge_44 = Merge(Data1=point_91, Data2=scale_5.Geometry, Data3=simplify(shift_paths_11))  # disabled
merge_45 = Merge(Data1=list_item_20, Data2=list_item_21, Data3=point_46, Data4=point_47)  # disabled
merge_46 = Merge(Data1=point_95, Data2=scale_8.Geometry, Data3=simplify(shift_paths_12))  # disabled
merge_47 = Merge(Data1=point_96, Data2=scale_7.Geometry, Data3=simplify(shift_paths_13))  # disabled
merge_48 = Merge(Data1=list_item_22, Data2=list_item_23, Data3=point_48, Data4=point_49)  # disabled
merge_49 = Merge(Data1=point_98, Data2=point_51)
merge_50 = Merge(Data1=point_93, Data2=point_50)
closest_point_3 = ClosestPoint(Point=merge_45, Cloud=point_41)  # -> ClosestPoint, CPIndex, Distance; disabled
sort_along_curve_13 = SortAlongCurve(Points=merge_49, Curve=curve_14)  # -> Points, Indices
sort_along_curve_14 = SortAlongCurve(Points=merge_50, Curve=curve_13)  # -> Points, Indices
closest_point_4 = ClosestPoint(Point=merge_48, Cloud=point_42)  # -> ClosestPoint, CPIndex, Distance; disabled
point_99 = Point(simplify(sort_along_curve_14.Points))
point_100 = Point(simplify(sort_along_curve_13.Points))
cull_index_4 = CullIndex(List=point_41, Indices=closest_point_3.CPIndex, Wrap=True)  # disabled
geometry_20 = Geometry(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)
geometry_21 = Geometry(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)
area_10 = Area(Geometry=geometry_21)  # -> Area, Centroid
cull_index_5 = CullIndex(List=point_42, Indices=closest_point_4.CPIndex, Wrap=True)  # disabled
merge_51 = Merge(Data1=point_100, Data2=point_99)

geometry_22 = Geometry(<brep referenced from the Rhino model>)
area_11 = Area(Geometry=geometry_22)  # -> Area, Centroid
orient_15 = Orient(Geometry=geometry_22, Source=area_11.Centroid, Target=merge_51)  # -> Geometry, Transform
geometry_23 = Geometry(orient_15.Geometry)
mesh_brep = MeshBrep(
    Brep=geometry_23,
    Settings={GridMaxCount=0, GridMinCount=16, JaggedSeams=False, MaxEdgeLength=0, MinEdgeLength=0.0001, MinTolerance=0, Refine=True, RefineAngle=0, RelativeTolerance=0.65, SimplePlanes=True, Tolerance=0})
mesh = Mesh(mesh_brep)
custom_preview_10 = CustomPreview(Geometry=mesh, Material=ColourSwatch(SwatchColor=RGBA(229, 208, 129, 197)))

area_12 = Area(Geometry=geometry_20)  # -> Area, Centroid
point_101 = Point(simplify(cull_index_4))  # disabled
merge_52 = Merge(Data1=point_101, Data2=merge_43, Data3=merge_44)  # disabled
sort_along_curve_15 = SortAlongCurve(Points=merge_52, Curve=curve_17)  # -> Points, Indices; disabled
number_slider_56 = Slider(107, range=0..107)  # disabled
point_102 = Point(simplify(cull_index_5))  # disabled
merge_53 = Merge(Data1=point_102, Data2=merge_46, Data3=merge_47)  # disabled
orient_16 = Orient(Geometry=geometry_21, Source=area_10.Centroid, Target=point_98)  # -> Geometry, Transform
list_item_26 = ListItem(List=flatten(merge_51), Index=0, Wrap=True)
polyline_15 = PolyLine(Vertices=flatten(merge_51), Closed=False)
point_103 = Point(merge_51)
orient_17 = Orient(Geometry=geometry_20, Source=area_12.Centroid, Target=point_93)  # -> Geometry, Transform
sort_along_curve_16 = SortAlongCurve(Points=merge_53, Curve=curve_18)  # -> Points, Indices; disabled
point_104 = Point(simplify(sort_along_curve_15.Points))  # disabled

point_list = PointList(Points=flatten(merge_51), Size=Slider(3, range=0..10))

point_105 = Point(simplify(sort_along_curve_16.Points))  # disabled
geometry_24 = Geometry(orient_16.Geometry)
scale_9 = Scale(Geometry=point_103, Center=point, Factor=Slider(10, range=0..10))  # -> Geometry, Transform
geometry_25 = Geometry(orient_17.Geometry)
mesh_brep_2 = MeshBrep(
    Brep=geometry_24,
    Settings={GridMaxCount=0, GridMinCount=16, JaggedSeams=False, MaxEdgeLength=0, MinEdgeLength=0.0001, MinTolerance=0, Refine=True, RefineAngle=0, RelativeTolerance=0.65, SimplePlanes=True, Tolerance=0})
mesh_brep_3 = MeshBrep(
    Brep=geometry_25,
    Settings={GridMaxCount=0, GridMinCount=16, JaggedSeams=False, MaxEdgeLength=0, MinEdgeLength=0.0001, MinTolerance=0, Refine=True, RefineAngle=0, RelativeTolerance=0.65, SimplePlanes=True, Tolerance=0})
number_slider_57 = Slider(90, range=0..100)  # disabled
point_106 = Point(scale_9.Geometry)
mesh_2 = Mesh(mesh_brep_2)
mesh_3 = Mesh(mesh_brep_3)
custom_preview_11 = CustomPreview(Geometry=mesh_2, Material=ColourSwatch(SwatchColor=RGBA(243, 77, 129, 197)))
custom_preview_12 = CustomPreview(Geometry=mesh_3, Material=ColourSwatch(SwatchColor=RGBA(84, 223, 212, 197)))
merge_54 = Merge(Data1=point_105, Data2=point_74)  # disabled
merge_55 = Merge(Data1=point_104, Data2=point_73)  # disabled
sort_along_curve_17 = SortAlongCurve(Points=merge_54, Curve=curve_18)  # -> Points, Indices; disabled
sort_along_curve_18 = SortAlongCurve(Points=merge_55, Curve=curve_17)  # -> Points, Indices; disabled
point_107 = Point(simplify(sort_along_curve_18.Points))  # disabled
point_108 = Point(simplify(sort_along_curve_17.Points))  # disabled
geometry_26 = Geometry(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)  # disabled
geometry_27 = Geometry(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)  # disabled
area_13 = Area(Geometry=geometry_27)  # -> Area, Centroid; disabled
merge_56 = Merge(Data1=point_108, Data2=point_107)  # disabled
area_14 = Area(Geometry=geometry_26)  # -> Area, Centroid; disabled

point_109 = Point(merge_51)
number_slider_58 = Slider(0, range=0..10)
tree_statistics_31 = TreeStatistics(Tree=point_109)  # -> Paths, Length, Count
addition = Addition(A=number_slider_58, B=Slider(1, range=0..1))
list_item_27 = ListItem(List=tree_statistics_31.Paths, Index=number_slider_58, Wrap=True)
list_item_28 = ListItem(List=tree_statistics_31.Paths, Index=addition, Wrap=True)
geometry_28 = Geometry(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)
split_tree_7 = SplitTree(Data=point_109, Masks=flatten([list_item_27, list_item_28]))  # -> Positive, Negative
area_15 = Area(Geometry=geometry_28)  # -> Area, Centroid
point_110 = Point(split_tree_7.Positive)
orient_18 = Orient(Geometry=geometry_28, Source=area_15.Centroid, Target=point_110)  # -> Geometry, Transform
geometry_29 = Geometry(orient_18.Geometry)
mesh_brep_4 = MeshBrep(
    Brep=geometry_29,
    Settings={GridMaxCount=0, GridMinCount=16, JaggedSeams=False, MaxEdgeLength=0, MinEdgeLength=0.0001, MinTolerance=0, Refine=True, RefineAngle=0, RelativeTolerance=0.65, SimplePlanes=True, Tolerance=0})
mesh_4 = Mesh(mesh_brep_4)
custom_preview_13 = CustomPreview(Geometry=mesh_4, Material=ColourSwatch(SwatchColor=RGBA(185, 219, 129, 197)))

number_slider_59 = Slider(10, range=0..10)  # disabled
orient_19 = Orient(Geometry=geometry_27, Source=area_13.Centroid, Target=point_105)  # -> Geometry, Transform; disabled
list_item_29 = ListItem(List=flatten(merge_56), Index=0, Wrap=True)  # disabled
polyline_16 = PolyLine(Vertices=flatten(merge_56), Closed=False)  # disabled
orient_20 = Orient(Geometry=geometry_26, Source=area_14.Centroid, Target=point_104)  # -> Geometry, Transform; disabled
point_111 = Point(merge_56)  # disabled

number_slider_60 = Slider(3, range=0..10)  # disabled
point_list_2 = PointList(Points=flatten(merge_56), Size=number_slider_60)  # disabled

geometry_30 = Geometry(orient_19.Geometry)  # disabled
scale_10 = Scale(Geometry=point_111, Center=point_2, Factor=number_slider_59)  # -> Geometry, Transform; disabled
geometry_31 = Geometry(orient_20.Geometry)  # disabled
mesh_brep_5 = MeshBrep(
    Brep=geometry_30,
    Settings={GridMaxCount=0, GridMinCount=16, JaggedSeams=False, MaxEdgeLength=0, MinEdgeLength=0.0001, MinTolerance=0, Refine=True, RefineAngle=0, RelativeTolerance=0.65, SimplePlanes=True, Tolerance=0})  # disabled
colour_swatch_5 = ColourSwatch(SwatchColor=RGBA(243, 77, 129, 197))  # disabled
mesh_brep_6 = MeshBrep(
    Brep=geometry_31,
    Settings={GridMaxCount=0, GridMinCount=16, JaggedSeams=False, MaxEdgeLength=0, MinEdgeLength=0.0001, MinTolerance=0, Refine=True, RefineAngle=0, RelativeTolerance=0.65, SimplePlanes=True, Tolerance=0})  # disabled
colour_swatch_6 = ColourSwatch(SwatchColor=RGBA(84, 223, 212, 197))  # disabled
mesh_5 = Mesh(mesh_brep_5)  # disabled
point_112 = Point(scale_10.Geometry)  # disabled
mesh_6 = Mesh(mesh_brep_6)  # disabled
custom_preview_14 = CustomPreview(Geometry=mesh_5, Material=colour_swatch_5)  # disabled
custom_preview_15 = CustomPreview(Geometry=mesh_6, Material=colour_swatch_6)  # disabled

point_113 = Point(merge_56)  # disabled
number_slider_61 = Slider(1, range=0..1)  # disabled
number_slider_62 = Slider(0, range=0..10)  # disabled
tree_statistics_32 = TreeStatistics(Tree=point_113)  # -> Paths, Length, Count; disabled
addition_2 = Addition(A=number_slider_62, B=number_slider_61)  # disabled
list_item_30 = ListItem(List=tree_statistics_32.Paths, Index=number_slider_62, Wrap=True)  # disabled
list_item_31 = ListItem(List=tree_statistics_32.Paths, Index=addition_2, Wrap=True)  # disabled
geometry_32 = Geometry(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)  # disabled
split_tree_8 = SplitTree(Data=point_113, Masks=flatten([list_item_30, list_item_31]))  # -> Positive, Negative; disabled
area_16 = Area(Geometry=geometry_32)  # -> Area, Centroid; disabled
point_114 = Point(split_tree_8.Positive)  # disabled
orient_21 = Orient(Geometry=geometry_32, Source=area_16.Centroid, Target=point_114)  # -> Geometry, Transform; disabled
geometry_33 = Geometry(orient_21.Geometry)  # disabled
mesh_brep_7 = MeshBrep(
    Brep=geometry_33,
    Settings={GridMaxCount=0, GridMinCount=16, JaggedSeams=False, MaxEdgeLength=0, MinEdgeLength=0.0001, MinTolerance=0, Refine=True, RefineAngle=0, RelativeTolerance=0.65, SimplePlanes=True, Tolerance=0})  # disabled
colour_swatch_7 = ColourSwatch(SwatchColor=RGBA(185, 219, 129, 197))  # disabled
mesh_7 = Mesh(mesh_brep_7)  # disabled
custom_preview_16 = CustomPreview(Geometry=mesh_7, Material=colour_swatch_7)  # disabled

geometry_34 = Geometry(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)  # disabled
colour_swatch_8 = ColourSwatch(SwatchColor=RGBA(229, 208, 129, 197))  # disabled

area_17 = Area(Geometry=geometry_34)  # -> Area, Centroid; disabled
rotate = Rotate(Geometry=geometry_34, Angle=degrees(number_slider_57), Plane=area_17.Centroid)  # -> Geometry, Transform; disabled

area_18 = Area(Geometry=rotate.Geometry)  # -> Area, Centroid; disabled
orient_22 = Orient(Geometry=rotate.Geometry, Source=area_18.Centroid, Target=merge_56)  # -> Geometry, Transform; disabled
geometry_35 = Geometry(orient_22.Geometry)  # disabled
mesh_brep_8 = MeshBrep(
    Brep=geometry_35,
    Settings={GridMaxCount=0, GridMinCount=16, JaggedSeams=False, MaxEdgeLength=0, MinEdgeLength=0.0001, MinTolerance=0, Refine=True, RefineAngle=0, RelativeTolerance=0.65, SimplePlanes=True, Tolerance=0})  # disabled
mesh_8 = Mesh(mesh_brep_8)  # disabled
custom_preview_17 = CustomPreview(Geometry=mesh_8, Material=colour_swatch_8)  # disabled
