# Grasshopper definition 20230127 4 git column.gh (Grasshopper 1.0.7)
# plug-ins: Kangaroo2 Components, treesloth01

number_slider = Slider(140, range=0..1000)
negative = Negative(Value=number_slider)
construct_domain = ConstructDomain(DomainStart=negative, DomainEnd=number_slider)
multiplication = Multiplication(A=Slider(7, range=0..10), B=Slider(3.51, range=0..10))
multiplication_2 = Multiplication(A=Slider(7, range=0..10), B=Slider(2.27, range=0..10))
curve = Curve(simplify(Tree({0}: [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], {1}: [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], {2}: [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], {3}: [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], {4}: [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], {5}: [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], {6}: [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], {7}: [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], {8}: [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], {9}: [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], {10}: [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])))
tree_item = TreeItem(Tree=curve, Path=Slider(0, range=0..100), Index=0, Wrap=True)
area = Area(Geometry=tree_item)  # -> Area, Centroid
rectangle = Rectangle(Plane=area.Centroid, XSize=construct_domain, YSize=construct_domain, Radius=0)  # -> Rectangle, Length
ellipse = Ellipse(Plane=area.Centroid, Radius1=multiplication, Radius2=multiplication_2)  # -> Ellipse, Focus1, Focus2
explode = Explode(Curve=rectangle.Rectangle, Recursive=True)  # -> Segments, Vertices
list_item = ListItem(List=explode.Segments, Index=Slider(0, range=0..1), Wrap=True)
list_item_2 = ListItem(List=explode.Segments, Index=Slider(1, range=0..10), Wrap=True)
list_item_3 = ListItem(List=explode.Segments, Index=Slider(2, range=0..10), Wrap=True)
list_item_4 = ListItem(List=explode.Segments, Index=Slider(3, range=0..10), Wrap=True)
area_2 = Area(Geometry=ellipse.Ellipse)  # -> Area, Centroid
curve_2 = Curve(ellipse.Ellipse)
divide_length = DivideLength(Curve=curve_2, Length=Slider(7, range=7..15))  # -> Points, Tangents, Parameters; disabled
curve_3 = Curve(ellipse.Ellipse)  # disabled
curve_middle = CurveMiddle(Curve=list_item)
curve_middle_2 = CurveMiddle(Curve=list_item_4)
curve_middle_3 = CurveMiddle(Curve=list_item_3)
curve_middle_4 = CurveMiddle(Curve=list_item_2)
number_slider_2 = Slider(0, range=0..1)  # disabled
merge = Merge(Data1=multiplication, Data2=multiplication_2)  # disabled
line = Line(StartPoint=curve_middle_4, EndPoint=curve_middle_2)
line_2 = Line(StartPoint=curve_middle_3, EndPoint=curve_middle)
merge_2 = Merge(Data1=line_2, Data2=line)
join_curves = JoinCurves(Curves=merge_2, Preserve=False)
boolean_toggle = BooleanToggle(False)  # disabled
trim_with_regions = TrimWithRegions(Curve=curve_2, Regions=join_curves)  # -> Inside, Outside
collider = Collider(Objects=divide_length.Points, Radii=multiplication, Strength=1)  # disabled
oncurve = OnCurve(Points=divide_length.Points, Curve=curve_2, Strength=1)  # disabled
spherecollide = SphereCollide(Points=divide_length.Points, Radius=merge, Strength=number_slider_2)  # disabled
button = Button()  # disabled
number_slider_3 = Slider(7, range=0..10)
bounding_box = BoundingBox(Content=curve_2, Plane=PlaneXY(0, 0, 0), UnionBox=True)  # -> Box, Box_2
curve_curve = CurveCurve(CurveA=line_2, CurveB=curve_2)  # -> Points, ParamsA, ParamsB
curve_curve_2 = CurveCurve(CurveA=line, CurveB=curve_2)  # -> Points, ParamsA, ParamsB
curve_4 = Curve(trim_with_regions.Outside)
bouncysolver = BouncySolver(
    GoalObjects=[oncurve, collider, spherecollide],
    Reset=button,
    Threshold=1e-15,
    Tolerance=0.0001,
    Damping=0.99,
    Iterations=10,
    On=boolean_toggle)  # -> I, V, O; disabled
deconstruct_brep = DeconstructBrep(Brep=bounding_box.Box)  # -> Faces, Edges, Vertices
ghpython_script = GhPythonScript(crvs=curve_4, cnt=Slider(8.15, range=0..10))  # -> out, pts; inputs crvs: list of Curve
# ---------- ghpython_script: Python ----------
import Rhino.Geometry as rg

pts = []

#mod_crv = rg.Curve.ToNurbsCurve(crvs)

#for i in range(len(crvs)):
#    pts.append(crvs[i][0])

#pts.append(crvs[0])

for i in range(len(crvs)):
    length = rg.Curve.GetLength(crvs[i])
    cna = int(length/cnt)
    ts = rg.Curve.DivideByCount(crvs[i],cna,False)
    for t in ts:
        pt = rg.Curve.PointAt(crvs[i],t)
        pts.append(pt)
# ---------- end ghpython_script ----------
ghpython_script_2 = GhPythonScript(crv=curve_4, cnt=number_slider_3)  # -> out, simplify(pts); inputs crv: Curve, cnt: Int32
# ---------- ghpython_script_2: Python ----------
import Rhino.Geometry as rg

pts = []

ts = rg.Curve.DivideByCount(crv,cnt,False)
for t in ts :
    pt = rg.Curve.PointAt(crv,t)
    pts.append(pt)
# ---------- end ghpython_script_2 ----------
ghpython_script_3 = GhPythonScript(crvs=curve_4, cnt=number_slider_3)  # -> out, pts; inputs crvs: list of Curve, cnt: Int32
# ---------- ghpython_script_3: Python ----------
import Rhino.Geometry as rg

pts = []

#mod_crv = rg.Curve.ToNurbsCurve(crvs)

#for i in range(len(crvs)):
#    pts.append(crvs[i][0])

#pts.append(crvs[0])

for i in range(len(crvs)):
    ts = rg.Curve.DivideByCount(crvs[i],cnt,False)
    for t in ts:
        pt = rg.Curve.PointAt(crvs[i],t)
        pts.append(pt)
# ---------- end ghpython_script_3 ----------
point = Point(curve_curve.Points)
point_2 = Point(curve_curve_2.Points)
number_slider_4 = Slider(7, range=0..10)
point_3 = Point(ghpython_script.pts)
list_item_5 = ListItem(List=deconstruct_brep.Edges, Index=Slider(3, range=0..3), Wrap=True)
list_item_6 = ListItem(List=deconstruct_brep.Edges, Index=Slider(1, range=0..3), Wrap=True)
merge_3 = Merge(Data1=point, Data2=point_2)  # -> flatten(Result)
ellipse_2 = Ellipse(Plane=PlaneXY(0, 0, 0), Radius1=expr("x/2", Slider(7, range=0..100)), Radius2=expr("x/2", Slider(10, range=0..10)))  # -> Ellipse, Focus1, Focus2
divide_length_2 = DivideLength(Curve=list_item_6, Length=number_slider_4)  # -> Points, Tangents, Parameters
divide_length_3 = DivideLength(Curve=list_item_5, Length=number_slider_4)  # -> reverse(Points), Tangents, Parameters
curve_5 = Curve(ellipse_2.Ellipse)
area_3 = Area(Geometry=curve_5)  # -> Area, Centroid
orient = Orient(Geometry=curve_5, Source=area_3.Centroid, Target=merge_3)  # -> Geometry, Transform
list_item_7 = ListItem(List=orient.Geometry, Index=Slider(2, range=0..3), Wrap=True)
curve_6 = Curve(line)
curve_curve_3 = CurveCurve(CurveA=list_item_7, CurveB=curve_6)  # -> Points, ParamsA, ParamsB
trim_with_regions_2 = TrimWithRegions(Curve=curve_2, Regions=orient.Geometry)  # -> Inside, Outside
list_item_8 = ListItem(List=curve_curve_3.Points, Index=Slider(1, range=0..1), Wrap=True)
curve_7 = Curve(trim_with_regions_2.Outside)
list_item_9 = ListItem(List=curve_7, Index=0, Wrap=True)
point_4 = Point(list_item_8)
number_slider_5 = Slider(52, range=0..100)
ghpython_script_4 = GhPythonScript(crvs=curve_7, cnt=Slider(5, range=0..10))  # -> out, pts; inputs crvs: list of Curve, cnt: Int32; same code as ghpython_script_3
line_3 = Line(StartPoint=divide_length_2.Points, EndPoint=divide_length_3.Points)
divide_distance = DivideDistance(Curve=list_item_9, Distance=Slider(9.09, range=0..20))  # -> Points, Tangents, Parameters
end_points = EndPoints(Curve=list_item_9)  # -> Start, End
split_list = SplitList(List=divide_distance.Points, Index=Slider(1, range=0..100))  # -> ListA, ListB
number_slider_6 = Slider(0.01, range=0..1)  # disabled
number_slider_7 = Slider(11, range=0..100)  # disabled
number_slider_8 = Slider(0.89, range=0..1)  # disabled
point_5 = Point(ghpython_script_4.pts)
unit_x = UnitX(Factor=number_slider_5)
unit_y = UnitY(Factor=number_slider_5)
point_6 = Point(split_list.ListB)
point_7 = Point(end_points.End)
pull_point = PullPoint(Point=point_5, Geometry=line_3, ClosestOnly=True)  # -> ClosestPoint, Distance
point_8 = Point(<point referenced from the Rhino model>)
collider_2 = Collider(Objects=point_6, Radii=number_slider_7, Strength=1)  # disabled
boolean_toggle_2 = BooleanToggle(True)  # disabled
move = Move(Geometry=point_7, Motion=unit_x)  # -> Geometry, Transform
move_2 = Move(Geometry=point_4, Motion=unit_y)  # -> Geometry, Transform
oncurve_2 = OnCurve(Points=point_6, Curve=list_item_9, Strength=number_slider_8)  # disabled
spherecollide_2 = SphereCollide(Points=point_6, Radius=number_slider_7, Strength=number_slider_6)  # disabled
button_2 = Button()  # disabled
orient_2 = Orient(Geometry=curve_5, Source=point_8, Target=point_6)  # -> Geometry, Transform
line_4 = Line(StartPoint=point_4, EndPoint=move_2.Geometry)
line_5 = Line(StartPoint=point_7, EndPoint=move.Geometry)
orient_3 = Orient(Geometry=curve_5, Source=area_3.Centroid, Target=point_6)  # -> Geometry, Transform
bouncysolver_2 = BouncySolver(
    GoalObjects=[spherecollide_2, oncurve_2],
    Reset=button_2,
    Threshold=1e-15,
    Tolerance=0.0001,
    Damping=0.99,
    Iterations=10,
    On=boolean_toggle_2)  # -> I, V, O; disabled
curve_curve_4 = CurveCurve(CurveA=line_5, CurveB=line_4)  # -> Points, ParamsA, ParamsB
orient_4 = Orient(Geometry=curve_5, Source=area_3.Centroid, Target=bouncysolver_2.V)  # -> Geometry, Transform; disabled
gene_pool = GenePool(Decimals=2, Maximum=10, Minimum=5.2, Value=[7.47, 7.76, 9.12])
line_6 = Line(StartPoint=point_7, EndPoint=curve_curve_4.Points)
length = Length(Curve=line_6)
mass_addition = MassAddition(Input=gene_pool)  # -> Result, PartialResults
number_slider_9 = Slider(3, range=3..3.3)
division = Division(A=length, B=Slider(5.77, range=0..10))
construct_domain_2 = ConstructDomain(DomainStart=Slider(1, range=0..1), DomainEnd=Slider(0, range=0..1))
bounds = Bounds(Numbers=mass_addition.PartialResults)
integer = Integer(division)
negative_2 = Negative(Value=Slider(38, range=0..100))
divide_curve = DivideCurve(Curve=line_6, Count=integer, Kinks=False)  # -> Points, Tangents, Parameters
remap_numbers = RemapNumbers(Value=mass_addition.PartialResults, Source=bounds, Target=construct_domain_2)  # -> Mapped, Clipped
extend_curve = ExtendCurve(Curve=list_item_9, Type=0, Start=Slider(-4.72, range=-6..0), End=Slider(-3.66, range=-6..0))
divide_length_4 = DivideLength(Curve=line_6, Length=Slider(6.97, range=0..10))  # -> Points, Tangents, Parameters
ghpython_script_5 = GhPythonScript(crvs=line_6, cnt=Slider(7.24, range=0..10))  # -> out, pts; inputs crvs: list of Curve, cnt: Int32
# ---------- ghpython_script_5: Python ----------
import Rhino.Geometry as rg

pts = []

#mod_crv = rg.Curve.ToNurbsCurve(crvs)

#for i in range(len(crvs)):
#    pts.append(crvs[i][0])

#pts.append(crvs[0])

for i in range(len(crvs)):
    ts = rg.Curve.DivideByLength(crvs[i],cnt,True)
    for t in ts:
        pt = rg.Curve.PointAt(crvs[i],t)
        pts.append(pt)
# ---------- end ghpython_script_5 ----------
unit_y_2 = UnitY(Factor=Slider(38, range=0..100))
unit_y_3 = UnitY(Factor=negative_2)
curve_8 = Curve(extend_curve)
end_points_2 = EndPoints(Curve=line_6)  # -> Start, End
point_9 = Point(ghpython_script_5.pts)
point_10 = Point(divide_curve.Points)
evaluate_curve = EvaluateCurve(Curve=reparameterize(curve_8), Parameter=remap_numbers.Mapped)  # -> Point, Tangent, Angle
list_length = ListLength(List=point_9)
move_3 = Move(Geometry=point_10, Motion=unit_y_2)  # -> Geometry, Transform
move_4 = Move(Geometry=point_10, Motion=unit_y_3)  # -> Geometry, Transform
point_11 = Point(end_points_2.End)
dispatch = Dispatch(List=point_10, DispatchPattern=[True, False])  # -> ListA, ListB
point_12 = Point(area.Centroid)
insert_items = InsertItems(List=point_9, Item=point_11, Indices=list_length, Wrap=True)
point_13 = Point(evaluate_curve.Point)
yz_plane = YZPlane(Origin=point_12)
orient_5 = Orient(Geometry=curve_5, Source=area_3.Centroid, Target=point_13)  # -> Geometry, Transform
line_7 = Line(StartPoint=move_3.Geometry, EndPoint=move_4.Geometry)
point_14 = Point(dispatch.ListB)
mirror = Mirror(Geometry=point_13, Plane=yz_plane)  # -> Geometry, Transform
curve_curve_5 = CurveCurve(CurveA=list_item_9, CurveB=line_7)  # -> simplify(Points), ParamsA, ParamsB
multiple_curves = MultipleCurves(Curves=[curve_8, orient_5.Geometry])  # -> flatten(Points), IndexA, IndexB, ParamA, ParamB
xz_plane = XZPlane(Origin=point_12)
merge_4 = Merge(Data1=point_13, Data2=mirror.Geometry)
cull_index = CullIndex(List=simplify(flatten(curve_curve_5.Points)), Indices=Slider(0, range=0..100), Wrap=True)
mirror_2 = Mirror(Geometry=merge_4, Plane=xz_plane)  # -> Geometry, Transform
sort_along_curve = SortAlongCurve(Points=multiple_curves.Points, Curve=curve_8)  # -> Points, Indices
point_15 = Point(cull_index)
dispatch_2 = Dispatch(List=sort_along_curve.Points, DispatchPattern=[True, False])  # -> ListA, ListB
orient_6 = Orient(Geometry=curve_5, Source=area_3.Centroid, Target=point_15)  # -> Geometry, Transform
merge_5 = Merge(Data1=merge_4, Data2=mirror_2.Geometry)
point_16 = Point(point_2)
point_17 = Point(point)
distance = Distance(PointA=dispatch_2.ListA, PointB=dispatch_2.ListB)
geometry = Geometry(orient_6.Geometry)
curve_9 = Curve(list_item_9)
merge_6 = Merge(Data1=merge_5, Data2=point_17, Data3=point_16)  # -> flatten(Result)
mass_addition_2 = MassAddition(Input=distance)  # -> Result, PartialResults
sort_along_curve_2 = SortAlongCurve(Points=merge_6, Curve=curve_2)  # -> Points, Indices
point_18 = Point(sort_along_curve_2.Points)
shift_list = ShiftList(List=point_18, Shift=1, Wrap=True)
# To Visualize Result
orient_7 = Orient(Geometry=curve_5, Source=area_3.Centroid, Target=sort_along_curve_2.Points)  # -> Geometry, Transform
galapagos = Galapagos(fitness=mass_addition_2, gene=gene_pool)
line_8 = Line(StartPoint=point_18, EndPoint=shift_list)
unit_z = UnitZ(Factor=Slider(4.5, range=0..10))
curve_middle_5 = CurveMiddle(Curve=line_8)
yz_plane_2 = YZPlane(Origin=point_12)
move_5 = Move(Geometry=curve_middle_5, Motion=unit_z)  # -> Geometry, Transform
shift_paths = ShiftPaths(Data=move_5.Geometry, Offset=-1)
list_item_10 = ListItem(List=move_5.Geometry, Index=0, Wrap=True)  # -> Item1, Item
point_19 = Point(shift_paths)
merge_7 = Merge(Data1=list_item_10.Item1, Data2=list_item_10.Item)
mirror_3 = Mirror(Geometry=merge_7, Plane=yz_plane_2)  # -> Geometry, Transform
closest_points = ClosestPoints(Point=mirror_3.Geometry, Cloud=move_5.Geometry, Count=Slider(1, range=0..10))  # -> simplify(ClosestPoint), CPIndex, Distance
point_20 = Point(flatten(closest_points.ClosestPoint))
point_21 = Point(merge_7)
polyline = PolyLine(Vertices=point_21, Closed=False)
polyline_2 = PolyLine(Vertices=point_20, Closed=False)
length_2 = Length(Curve=polyline)
length_3 = Length(Curve=polyline_2)
curve_middle_6 = CurveMiddle(Curve=polyline)
curve_middle_7 = CurveMiddle(Curve=polyline_2)
division_2 = Division(A=Slider(15, range=0..100), B=length_2)
division_3 = Division(A=Slider(15, range=0..100), B=length_3)
scale = Scale(Geometry=polyline, Center=curve_middle_6, Factor=division_2)  # -> Geometry, Transform
scale_2 = Scale(Geometry=polyline_2, Center=curve_middle_7, Factor=division_3)  # -> Geometry, Transform
end_points_3 = EndPoints(Curve=scale.Geometry)  # -> Start, End
end_points_4 = EndPoints(Curve=scale_2.Geometry)  # -> Start, End
merge_8 = Merge(Data1=point_21, Data2=point_20)  # -> flatten(Result)
unit_x_2 = UnitX(Factor=Slider(2.7, range=0..3.5))
merge_9 = Merge(Data1=end_points_3.Start, Data2=end_points_3.End)
merge_10 = Merge(Data1=end_points_4.Start, Data2=end_points_4.End)
closest_points_2 = ClosestPoints(Point=merge_8, Cloud=point_19, Count=Slider(1, range=0..10))  # -> ClosestPoint, flatten(CPIndex), Distance
negative_3 = Negative(Value=unit_x_2)
move_6 = Move(Geometry=merge_9, Motion=unit_x_2)  # -> Geometry, Transform
move_7 = Move(Geometry=merge_10, Motion=negative_3)  # -> Geometry, Transform
cull_index_2 = CullIndex(List=point_19, Indices=closest_points_2.CPIndex, Wrap=True)
point_22 = Point(merge_9)
point_23 = Point(merge_10)
merge_11 = Merge(Data1=point_22, Data2=point_23)  # -> flatten(Result)
geometry_2 = Geometry(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)
insert_items_2 = InsertItems(List=cull_index_2, Item=merge_11, Indices=closest_points_2.CPIndex, Wrap=True)
area_4 = Area(Geometry=geometry_2)  # -> Area, Centroid
interpolate = Interpolate(Vertices=point_19, Degree=3, Periodic=invert(False), KnotStyle=1)  # -> Curve, Length, Domain
sort_along_curve_3 = SortAlongCurve(Points=insert_items_2, Curve=interpolate.Curve)  # -> Points, Indices
point_24 = Point(sort_along_curve_3.Points)
list_item_11 = ListItem(List=flatten(point_24), Index=Slider(27, range=0..27), Wrap=True)
# 1&2 layer pts
merge_12 = Merge(Data1=point_18, Data2=point_24)  # -> simplify(Result)
orient_8 = Orient(Geometry=geometry_2, Source=area_4.Centroid, Target=merge_12)  # -> Geometry, Transform

number_slider_10 = Slider(17, range=0..20)
number_slider_11 = Slider(9, range=0..10)

custom_preview = CustomPreview(Geometry=orient_8.Geometry, Material=ColourSwatch(SwatchColor=RGBA(211, 84, 255, 122)))
series = Series(Start=0, Step=number_slider_11, Count=number_slider_10)  # -> graft(Series)
series_2 = Series(Start=0, Step=number_slider_11, Count=number_slider_10)  # -> graft(Series)
unit_z_2 = UnitZ(Factor=series)
unit_z_3 = UnitZ(Factor=series_2)
move_8 = Move(Geometry=point_18, Motion=unit_z_2)  # -> simplify(Geometry), Transform
move_9 = Move(Geometry=point_24, Motion=unit_z_3)  # -> simplify(Geometry), Transform
merge_13 = Merge(Data1=move_8.Geometry, Data2=move_9.Geometry)
# CT PT
point_25 = Point(area_2.Centroid)
# final PTS
point_26 = Point(merge_13)
orient_9 = Orient(Geometry=geometry_2, Source=area_4.Centroid, Target=point_26)  # -> Geometry, Transform
scale_3 = Scale(Geometry=point_26, Center=point_25, Factor=Slider(10, range=0..10))  # -> Geometry, Transform
polyline_3 = PolyLine(Vertices=flatten(point_26), Closed=False)
# scaled PTS
point_27 = Point(scale_3.Geometry)
geometry_3 = Geometry(flatten(orient_9.Geometry))
custom_preview_2 = CustomPreview(Geometry=geometry_3, Material=ColourSwatch(SwatchColor=RGBA(152, 224, 255, 122)))
custom_preview_3 = CustomPreview(Geometry=geometry_3, Material=ColourSwatch(SwatchColor=RGB(255, 255, 255)))
volume = Volume(Geometry=geometry_3)  # -> Volume, flatten(Centroid)
flatten = FlattenTree(Tree=geometry_3, Path="{0}")
prox = Proximity3D(Points=volume.Centroid, Group=Slider(6, range=0..10), MaxRadius=Slider(13, range=0..100))  # -> Links, Topology
pdecon = Deconstruct(Point=graft(volume.Centroid))  # -> XComponent, YComponent, ZComponent
graft = GraftTree(Tree=flatten, IncludeEmptyLists=True, IncludeNullItems=True)
item = ListItem(List=volume.Centroid, Index=prox.Topology, Wrap=True)
addition = Addition(A=pdecon.ZComponent, B="1")
pdecon_2 = Deconstruct(Point=item)  # -> XComponent, YComponent, ZComponent
smaller = SmallerThan(FirstNumber=pdecon_2.ZComponent, SecondNumber=addition)  # -> SmallerThan, OrEqualTo
dispatch_3 = Dispatch(List=prox.Topology, DispatchPattern=smaller.SmallerThan)  # -> ListA, ListB
item_2 = ListItem(List=flatten, Index=dispatch_3.ListA, Wrap=True)
sunion = SolidUnion(Breps=item_2)
c_script = CSharpScript(x=item_2)  # -> out, a; inputs x: list of Brep; disabled
# ---------- c_script: C# ----------
    Brep[] b = Brep.CreateBooleanUnion(x, 0.001);
    a = b;
# ---------- end c_script ----------
python = GhPythonScript(x=item_2)  # -> out, a; inputs x: list of Brep; disabled
# ---------- python: Python ----------
import Rhino.Geometry as rg

a = rg.Brep.CreateBooleanUnion(x, 0.01)
# ---------- end python ----------
number_slider_12 = Slider(7, range=0..137)
sint = SolidIntersection(BrepsA=sunion, BrepsB=graft)
volume_2 = Volume(Geometry=sint)  # -> Volume, Centroid
null = NullItem(Item=volume_2.Volume)  # -> NullFlags, InvalidFlags, Description
item_3 = ListItem(List=geometry_3, Index=number_slider_12, Wrap=True)
cluster = BranchLook(data=sint, i=number_slider_12)
cluster_2 = BranchLook(data=item_2, i=number_slider_12)
volume_3 = Volume(Geometry=sint)  # -> Volume, Centroid
weave = Weave(Pattern=null.NullFlags, Stream0=volume_2.Volume, Stream1="0", NullGaps=False)
smaller_2 = SmallerThan(FirstNumber=weave, SecondNumber="0")  # -> SmallerThan, OrEqualTo
ma = MassAddition(Input=weave)  # -> flatten(Result), PartialResults
dispatch_4 = Dispatch(List=weave, DispatchPattern=smaller_2.SmallerThan)  # -> ListA, ListB
bnd = Bounds(Numbers=flatten(dispatch_4.ListB))
dedomain = DeconstructDomain(Domain=bnd)  # -> Start, End
graph = QuickGraph(ma.Result, SortOrder=0)
gradient = Gradient(
    LowerLimit=dedomain.End,
    UpperLimit=dedomain.Start,
    Parameter=ma.Result,
    stops=[0: RGB(234, 38, 0), 0.25: RGB(234, 126, 0), 0.5: RGB(254, 244, 84), 0.75: RGB(173, 203, 249), 1: RGB(75, 107, 169)])
swatch = ColourSwatch(SwatchColor=RGB(255, 255, 255))
preview = CustomPreview(Geometry=flatten(geometry_3), Material=gradient)

# ==== cluster BranchLook: To see the condition of branch data.
data = ClusterInput()
data_2 = Data(data)
tstat = TreeStatistics(Tree=data_2)  # -> Paths, Length, Count
i = ClusterInput()
item = ListItem(List=tstat.Paths, Index=i, Wrap=True)
branch = TreeBranch(Tree=data_2, Path=item, MaintainPaths=True)
B = ClusterOutput(branch)
