# Grasshopper definition 20230201 column w wall 4 git.gh (Grasshopper 1.0.7)
# plug-ins: treesloth01

geometry = Geometry(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)
number_slider = Slider(200, range=0..200)
bbox = BoundingBox(Content=geometry, Plane=PlaneXY(0, 0, 0))  # -> Box, Box_2
edges = BrepEdges(Brep=bbox.Box)  # -> Naked, Interior, NonManifold
# even crv
# odd crv
len = Length(Curve=edges.Interior)
unit_z = UnitZ(Factor=number_slider)
cset = CreateSet(List=len)  # -> Set, Map
unit_z_2 = UnitZ(Factor=Slider(78.53, range=0..200))
panel = Panel(cset.Set)
point = Point(Point(-8.755820966, -97.54357692, 0))
line_sdl = LineSDL(Start=point, Direction=unit_z, Length=number_slider)
divide_length = DivideLength(Curve=line_sdl, Length=Slider(4.5, range=0..10))  # -> Points, Tangents, Parameters
divide_curve = DivideCurve(Curve=reparameterize(line_sdl), Count=Slider(15, range=0..100), Kinks=False)  # -> Points, Tangents, Parameters
move = Move(Geometry=point, Motion=unit_z)  # -> Geometry, Transform
move_2 = Move(Geometry=point, Motion=unit_z_2)  # -> Geometry, Transform
multiplication = Multiplication(A=Slider(7, range=0..10), B=Slider(1.7, range=0..10))
multiplication_2 = Multiplication(A=Slider(7, range=0..10), B=Slider(1.4, range=0..10))
multiplication_3 = Multiplication(A=Slider(7, range=0..10), B=Slider(3.1, range=0..10))
multiplication_4 = Multiplication(A=Slider(7, range=0..10), B=Slider(5.2, range=0..10))
multiplication_5 = Multiplication(A=Slider(7, range=0..10), B=Slider(2.5, range=0..10))
multiplication_6 = Multiplication(A=Slider(7, range=0..10), B=Slider(3, range=0..10))
graph_mapper = GraphMapper(
    divide_curve.Parameters,
    x0=0,
    x1=1,
    y0=0,
    y1=1,
    container_name="Bezier",
    cpx=[0, 0.25, 0.7408792377, 1],
    cpy=[0.8142974377, 0.25, 0.1456634998, 0.2045261264])
graph_mapper_2 = GraphMapper(
    divide_curve.Parameters,
    x0=0,
    x1=1,
    y0=0,
    y1=1,
    container_name="Bezier",
    cpx=[0, 0.1962651759, 0.6588408947, 1],
    cpy=[0.8033288121, 0.2566378117, 0.1220703125, 0.2314170003])
xy_plane = XYPlane(Origin=divide_curve.Points)
ellipse = Ellipse(Plane=move.Geometry, Radius1=multiplication, Radius2=multiplication_2)  # -> Ellipse, Focus1, Focus2
ellipse_2 = Ellipse(Plane=move_2.Geometry, Radius1=multiplication_3, Radius2=multiplication_5)  # -> Ellipse, Focus1, Focus2
ellipse_3 = Ellipse(Plane=point, Radius1=multiplication_4, Radius2=multiplication_6)  # -> Ellipse, Focus1, Focus2
geometry_2 = Geometry(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)
multiplication_7 = Multiplication(A=Slider(7, range=0..10), B=Slider(3, range=0..10))
multiplication_8 = Multiplication(A=graph_mapper, B=multiplication_7)
multiplication_9 = Multiplication(A=Slider(7, range=0..10), B=Slider(5, range=0..10))
multiplication_10 = Multiplication(A=graph_mapper_2, B=multiplication_9)
merge = Merge(Data1=ellipse_3.Ellipse, Data2=ellipse_2.Ellipse, Data3=ellipse.Ellipse)
loft = Loft(Curves=merge, Options={Adjust=False, Closed=False, LoftEnds=0, LoftSimp=0, LoftType=0, Rebuild=10, Refit=0.01})
geometry_3 = Geometry(loft)
bounding_box = BoundingBox(Content=geometry_3, Plane=PlaneXY(0, 0, 0))  # -> Box, Box_2
deconstruct_brep = DeconstructBrep(Brep=bounding_box.Box)  # -> Faces, Edges, Vertices
ellipse_4 = Ellipse(Plane=xy_plane, Radius1=multiplication_10, Radius2=multiplication_8)  # -> Ellipse, Focus1, Focus2
geometry_4 = Geometry(loft)
list_item = ListItem(List=deconstruct_brep.Edges, Index=Slider(8, range=0..12), Wrap=True)
multiplication_11 = Multiplication(A=Slider(7, range=0..10), B=Slider(8, range=0..10))
area = Area(Geometry=bounding_box.Box)  # -> Area, Centroid
length = Length(Curve=list_item)
division = Division(A=length, B=Slider(2, range=0..10))
negative = Negative(Value=division)
negative_2 = Negative(Value=multiplication_11)
xz_plane = XZPlane(Origin=area.Centroid)
construct_domain = ConstructDomain(DomainStart=negative_2, DomainEnd=multiplication_11)
construct_domain_2 = ConstructDomain(DomainStart=negative, DomainEnd=division)
rectangle = Rectangle(Plane=xz_plane, XSize=construct_domain, YSize=construct_domain_2, Radius=0)  # -> Rectangle, Length
boundary_surfaces = BoundarySurfaces(Edges=rectangle.Rectangle)
yz_plane = YZPlane(Origin=area.Centroid)
brep_edges = BrepEdges(Brep=geometry_3)  # -> Naked, Interior, NonManifold
curve = Curve(brep_edges.Interior)
mirror = Mirror(Geometry=curve, Plane=yz_plane)  # -> Geometry, Transform
merge_2 = Merge(Data1=curve, Data2=mirror.Geometry)
surface_split = SurfaceSplit(Surface=boundary_surfaces, Curves=merge_2)
split_brep = SplitBrep(Brep=geometry_3, Cutter=rectangle.Rectangle)
list_item_2 = ListItem(List=split_brep, Index=0, Wrap=True)  # -> Item, Item1
list_item_3 = ListItem(List=surface_split, Index=0, Wrap=True)  # -> Item1, Item, Item1_2
geometry_5 = Geometry(list_item_3.Item)
geometry_6 = Geometry(list_item_3.Item1_2)
geometry_7 = Geometry(list_item_2.Item1)
curve_2 = Curve(list_item_3.Item1)
geometry_8 = Geometry(list_item_2.Item)
merge_3 = Merge(Data1=curve_2, Data2=geometry_8)
merge_4 = Merge(Data1=geometry_6, Data2=geometry_7)
list_item_4 = ListItem(List=deconstruct_brep.Faces, Index=Slider(4, range=0..12), Wrap=True)
area_2 = Area(Geometry=list_item_4)  # -> Area, Centroid
brep_join = BrepJoin(Breps=merge_3)  # -> Breps, Closed
brep_join_2 = BrepJoin(Breps=merge_4)  # -> Breps, Closed
number_slider_2 = Slider(4.5, range=0..10)
point_2 = Point(area_2.Centroid)
unit_z_3 = UnitZ(Factor=1)

geometry_9 = Geometry(brep_join.Breps)
geometry_10 = Geometry(brep_join_2.Breps)

merge_5 = Merge(Data1=geometry_9, Data2=geometry_7)
number_slider_3 = Slider(-140, range=-150..0)
number_slider_4 = Slider(140, range=0..1000)
brep_join_3 = BrepJoin(Breps=merge_5)  # -> Breps, Closed
contour = Contour(Shape=brep_join_3.Breps, Point=point_2, Direction=unit_z_3, Distance=number_slider_2)  # -> simplify(Contours)
construct_domain_3 = ConstructDomain(DomainStart=number_slider_3, DomainEnd=number_slider_4)
construct_domain_4 = ConstructDomain(DomainStart=number_slider_3, DomainEnd=number_slider_4)
rectangle_2 = Rectangle(Plane=point_2, XSize=construct_domain_3, YSize=construct_domain_4, Radius=0)  # -> Rectangle, Length
tree_statistics = TreeStatistics(Tree=contour)  # -> Paths, Length, Count
line = Line(contour)
explode = Explode(Curve=rectangle_2.Rectangle, Recursive=True)  # -> Segments, Vertices
null_item = NullItem(Item=line)  # -> NullFlags, InvalidFlags, Description
dispatch = Dispatch(List=tree_statistics.Paths, DispatchPattern=[True, False])  # -> ListA, ListB
dispatch_2 = Dispatch(List=contour, DispatchPattern=null_item.NullFlags)  # -> ListA, ListB
number_slider_5 = Slider(7, range=0..10)
list_item_5 = ListItem(List=explode.Segments, Index=0, Wrap=True)
list_item_6 = ListItem(List=explode.Segments, Index=Slider(2, range=0..10), Wrap=True)
division_2 = Division(A=number_slider_5, B=Slider(2, range=0..10))
extend_curve = ExtendCurve(Curve=dispatch_2.ListA, Type=0, Start="0", End="-1")
unit_x = UnitX(Factor=division_2)
divide_length_2 = DivideLength(Curve=list_item_6, Length=number_slider_5)  # -> reverse(Points), Tangents, Parameters
divide_length_3 = DivideLength(Curve=list_item_5, Length=number_slider_5)  # -> Points, Tangents, Parameters
merge_6 = Merge(Data1=extend_curve, Data2=dispatch_2.ListB)
join_curves = JoinCurves(Curves=merge_6, Preserve=False)  # -> simplify(Curves)
split_tree = SplitTree(Data=join_curves, Masks=flatten(dispatch.ListA))  # -> Positive, Negative

curve_3 = Curve(split_tree.Positive)
curve_4 = Curve(split_tree.Negative)

flatten_tree = FlattenTree(Tree=curve_3, Path="{0}")  # -> simplify(graft(Tree))
line_2 = Line(StartPoint=divide_length_3.Points, EndPoint=divide_length_2.Points)
list_length = ListLength(List=flatten(flatten_tree))
list_length_2 = ListLength(List=flatten(curve_4))
panel_2 = Panel(flatten_tree)
series = Series(Start=number_slider_2, Step=expr("x*2", number_slider_2), Count=list_length_2)  # -> graft(Series)
curve_5 = Curve(line_2)
move_3 = Move(Geometry=curve_5, Motion=unit_x)  # -> Geometry, Transform
curve_6 = Curve(move_3.Geometry)
series_2 = Series(Start=0, Step=expr("x*2", number_slider_2), Count=list_length)  # -> graft(Series)
unit_z_4 = UnitZ(Factor=series)
panel_3 = Panel(series_2)
unit_z_5 = UnitZ(Factor=series_2)
move_4 = Move(Geometry=curve_6, Motion=unit_z_4)  # -> simplify(Geometry), Transform
move_5 = Move(Geometry=curve_5, Motion=unit_z_5)  # -> simplify(Geometry), Transform
merge_7 = Merge(Data1=flatten_tree, Data2=simplify(move_5.Geometry))  # -> flatten(Result)
number_slider_6 = Slider(263, range=0..1000)
multiple_curves = MultipleCurves(Curves=merge_7)  # -> Points, IndexA, IndexB, ParamA, ParamB
curve_curve = CurveCurve(CurveA=simplify(move_4.Geometry), CurveB=simplify(curve_4))  # -> simplify(Points), ParamsA, ParamsB
curve_curve_2 = CurveCurve(CurveA=simplify(move_5.Geometry), CurveB=simplify(flatten_tree))  # -> simplify(Points), ParamsA, ParamsB
negative_3 = Negative(Value=number_slider_6)
param_viewer = ParamViewer(multiple_curves.Points)
construct_domain_5 = ConstructDomain(DomainStart=negative_3, DomainEnd=number_slider_6)
construct_domain_6 = ConstructDomain(DomainStart=negative_3, DomainEnd=number_slider_6)
clean_tree = CleanTree(RemoveNulls=True, RemoveInvalid=True, RemoveEmpty=Toggle(True), Tree=curve_curve_2.Points)
xz_plane_2 = XZPlane(Origin=point_2)
clean_tree_2 = CleanTree(RemoveNulls=True, RemoveInvalid=True, RemoveEmpty=Toggle(True), Tree=curve_curve.Points)
rectangle_3 = Rectangle(Plane=xz_plane_2, XSize=construct_domain_5, YSize=construct_domain_6, Radius=0)  # -> Rectangle, Length
shift_paths = ShiftPaths(Data=clean_tree, Offset=-1)
shift_paths_2 = ShiftPaths(Data=clean_tree_2, Offset=-1)
point_3 = Point(shift_paths)
boundary_surfaces_2 = BoundarySurfaces(Edges=rectangle_3.Rectangle)
point_4 = Point(shift_paths_2)
brep_curve = BrepCurve(Brep=boundary_surfaces_2, Curve=contour)  # -> Curves, simplify(Points)
sort_along_curve = SortAlongCurve(Points=point_4, Curve=curve_4)  # -> Points, Indices
sort_along_curve_2 = SortAlongCurve(Points=point_3, Curve=curve_3)  # -> Points, Indices
dispatch_3 = Dispatch(List=brep_curve.Points, DispatchPattern=[True, False])  # -> ListA, ListB

point_5 = Point(simplify(sort_along_curve.Points))
point_6 = Point(simplify(sort_along_curve_2.Points))

shift_list = ShiftList(List=point_3, Shift=1, Wrap=True)
point_7 = Point(dispatch_3.ListB)
distance = Distance(PointA=shift_list, PointB=point_3)  # -> simplify(Distance)
clean_tree_3 = CleanTree(RemoveNulls=True, RemoveInvalid=True, RemoveEmpty=Toggle(True), Tree=point_7)
cull_duplicates = CullDuplicates(Points=point_5, Tolerance=Slider(3, range=0..10), CullMode=3)  # -> Points, Indices, Valence
cull_duplicates_2 = CullDuplicates(Points=point_6, Tolerance=Slider(3, range=0..10), CullMode=3)  # -> Points, Indices, Valence
shift_paths_3 = ShiftPaths(Data=clean_tree_3, Offset=-1)
panel_4 = Panel(distance)
crv = Curve(dispatch_2.ListB)
tstat = TreeStatistics(Tree=shift_paths_3)  # -> Paths, Length, Count
point_8 = Point(cull_duplicates.Points)
point_9 = Point(cull_duplicates_2.Points)
cull_i = CullIndex(List=reverse(tstat.Paths), Indices="0", Wrap=True)  # -> reverse(List)
branch = TreeBranch(Tree=shift_paths_3, Path=cull_i, MaintainPaths=True)
merge_8 = Merge(Data1=point_9, Data2=point_8)
point_10 = Point(shift_paths_3)
cps = ClosestPoints(Point=point_10, Cloud=merge_8, Count="2")  # -> ClosestPoint, CPIndex, Distance
cull_i_2 = CullIndex(List=merge_8, Indices=cps.CPIndex, Wrap=True)  # -> simplify(List)
item = ListItem(List=merge_8, Index=cps.CPIndex, Wrap=True)  # -> simplify(Item)
geometry_11 = Geometry(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)
geometry_12 = Geometry(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)
geometry_13 = Geometry(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)
area_3 = Area(Geometry=geometry_12)  # -> Area, Centroid
area_4 = Area(Geometry=geometry_11)  # -> Area, Centroid
area_5 = Area(Geometry=geometry_13)  # -> Area, Centroid
mesh_brep = MeshBrep(
    Brep=geometry_13,
    Settings={GridMaxCount=0, GridMinCount=16, JaggedSeams=False, MaxEdgeLength=0, MinEdgeLength=0.0001, MinTolerance=0, Refine=True, RefineAngle=0, RelativeTolerance=0.65, SimplePlanes=True, Tolerance=0})
mesh_brep_2 = MeshBrep(
    Brep=geometry_12,
    Settings={GridMaxCount=0, GridMinCount=16, JaggedSeams=False, MaxEdgeLength=0, MinEdgeLength=0.0001, MinTolerance=0, Refine=True, RefineAngle=0, RelativeTolerance=0.65, SimplePlanes=True, Tolerance=0})
mesh_brep_3 = MeshBrep(
    Brep=geometry_11,
    Settings={GridMaxCount=0, GridMinCount=16, JaggedSeams=False, MaxEdgeLength=0, MinEdgeLength=0.0001, MinTolerance=0, Refine=True, RefineAngle=0, RelativeTolerance=0.65, SimplePlanes=True, Tolerance=0})
crv_2 = Curve(dispatch_2.ListB)
ext = ExtendCurve(Curve=crv_2, Type=0, Start="-1", End="0")
end = EndPoints(Curve=crv_2)  # -> Start, End
python = GhPythonScript(
    chunkLength=Slider(15, range=0..100),
    iMiddlePt=point_10,
    iSidePts=item,
    iAllPts=cull_i_2,
    iTolerance=Slider(15.08, range=10..20))  # -> out, simplify(sideNewPts); inputs iMiddlePt: tree of Point3d, iSidePts: tree of Point3d, iAllPts: tree of Point3d
# ---------- python: Python ----------
import Rhino.Geometry as rg
import ghpythonlib.treehelpers as th



sideNewPts = []
for i, sidePts in enumerate(iSidePts.Branches):
    temp = []
    pt_0 = sidePts[0]
    pt_1 = sidePts[1]
    dist = rg.Point3d.DistanceTo(pt_0, pt_1)
    if dist > iTolerance:
        temp.extend(iMiddlePt.Branches[i])
        temp.extend([pt_0])
        temp.extend([pt_1])
    if dist < chunkLength:
        apart = (chunkLength - dist)/2
        vec_0 = pt_0 - pt_1
        vec_1 = pt_1 - pt_0
        vec_0.Unitize()
        vec_1.Unitize()
        vec_0 = rg.Vector3d.Multiply(vec_0, apart)
        vec_1 = rg.Vector3d.Multiply(vec_1, apart)
        tran_0 = rg.Transform.Translation(vec_0)
        tran_1 = rg.Transform.Translation(vec_1)
        pt_0.Transform(tran_0)
        pt_1.Transform(tran_1)
        temp.extend([pt_0])
        temp.extend([pt_1])
    sideNewPts.append(temp)
        
sideNewPts = th.list_to_tree(sideNewPts)
# ---------- end python ----------
orient = Orient(Geometry=mesh_brep_2, Source=area_3.Centroid, Target=point_9)  # -> Geometry, Transform; disabled
orient_2 = Orient(Geometry=mesh_brep_3, Source=area_4.Centroid, Target=point_8)  # -> Geometry, Transform; disabled
orient_3 = Orient(Geometry=mesh_brep, Source=area_5.Centroid, Target=point_10)  # -> Geometry, Transform; disabled
geometry_14 = Geometry(orient.Geometry)
geometry_15 = Geometry(orient_2.Geometry)
geometry_16 = Geometry(orient_3.Geometry)
merge_9 = Merge(Data1=cull_i_2, Data2=python.sideNewPts)
pt = Point(merge_9)
pull = PullPoint(Point=pt, Geometry=ext, ClosestOnly=True)  # -> ClosestPoint, Distance
dispatch_4 = Dispatch(List=pt, DispatchPattern=pull.Distance)  # -> ListA, ListB
pt_2 = Point(end.Start)
pt_3 = Point(dispatch_4.ListA)
custom_preview = CustomPreview(Geometry=geometry_14, Material=ColourSwatch(SwatchColor=RGBA(243, 77, 129, 197)))  # disabled
custom_preview_2 = CustomPreview(Geometry=geometry_15, Material=ColourSwatch(SwatchColor=RGBA(84, 223, 212, 197)))  # disabled
custom_preview_3 = CustomPreview(Geometry=geometry_16, Material=ColourSwatch(SwatchColor=RGBA(89, 252, 135, 197)))  # disabled
cps_2 = ClosestPoints(Point=pt_2, Cloud=pt_3, Count="2")  # -> ClosestPoint, CPIndex, Distance
geometry_17 = Geometry(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)
cull_i_3 = CullIndex(List=pt_3, Indices=cps_2.CPIndex, Wrap=True)  # -> simplify(List)
item_2 = ListItem(List=pt_3, Index=cps_2.CPIndex, Wrap=True)
area_6 = Area(Geometry=geometry_17)  # -> Area, Centroid
python_2 = GhPythonScript(
    chunkLength=Slider(15, range=0..100),
    iMiddlePt=pt_2,
    iSidePts=item_2,
    iAllPts=cull_i_3,
    iTolerance=Slider(15.08, range=10..20))  # -> out, simplify(sideNewPts); inputs iMiddlePt: tree of Point3d, iSidePts: tree of Point3d, iAllPts: tree of Point3d; same code as python
orient_4 = Orient(Geometry=geometry_17, Source=area_6.Centroid, Target=merge_9)  # -> Geometry, Transform; disabled
custom_preview_4 = CustomPreview(Geometry=orient_4.Geometry, Material=ColourSwatch(SwatchColor=RGBA(84, 223, 212, 197)))
pt_4 = Point(python_2.sideNewPts)
merge_10 = Merge(Data1=cull_i_3, Data2=pt_4)
pt_5 = Point(dispatch_4.ListB)
merge_11 = Merge(Data1=merge_10, Data2=pt_5)
cullpt = CullDuplicates(Points=merge_11, Tolerance=Slider(3, range=0..10), CullMode=3)  # -> Points, Indices, Valence
tstat_2 = TreeStatistics(Tree=cullpt.Points)  # -> Paths, Length, Count
dispatch_5 = Dispatch(List=tstat_2.Paths, DispatchPattern=[True, False])  # -> ListA, ListB
branch_2 = TreeBranch(Tree=cullpt.Points, Path=dispatch_5.ListA, MaintainPaths=True)  # -> simplify(Branch)
branch_3 = TreeBranch(Tree=cullpt.Points, Path=dispatch_5.ListB, MaintainPaths=True)  # -> simplify(Branch)

curve_7 = Curve(split_tree.Negative)
curve_8 = Curve(split_tree.Positive)

pt_6 = Point(branch_2)
pt_7 = Point(branch_3)
alongcrv = SortAlongCurve(Points=pt_7, Curve=curve_7)  # -> simplify(Points), Indices
tree_statistics_2 = TreeStatistics(Tree=alongcrv.Points)  # -> Paths, Length, Count
alongcrv_2 = SortAlongCurve(Points=pt_6, Curve=curve_8)  # -> simplify(Points), Indices
tree_statistics_3 = TreeStatistics(Tree=alongcrv_2.Points)  # -> Paths, Length, Count
list_item_7 = ListItem(List=tree_statistics_3.Paths, Index=0, Wrap=True)
list_item_8 = ListItem(List=tree_statistics_2.Paths, Index=0, Wrap=True)
split_tree_2 = SplitTree(Data=alongcrv_2.Points, Masks=flatten(list_item_7))  # -> Positive, Negative
split_tree_3 = SplitTree(Data=alongcrv.Points, Masks=flatten(list_item_8))  # -> Positive, Negative

point_11 = Point(split_tree_2.Negative)
point_12 = Point(split_tree_3.Negative)

geometry_18 = Geometry(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)
geometry_19 = Geometry(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)
merge_12 = Merge(Data1=point_11, Data2=point_12)
area_7 = Area(Geometry=geometry_19)  # -> Area, Centroid
area_8 = Area(Geometry=geometry_18)  # -> Area, Centroid
mesh_brep_4 = MeshBrep(
    Brep=geometry_19,
    Settings={GridMaxCount=0, GridMinCount=16, JaggedSeams=False, MaxEdgeLength=0, MinEdgeLength=0.0001, MinTolerance=0, Refine=True, RefineAngle=0, RelativeTolerance=0.65, SimplePlanes=True, Tolerance=0})
mesh_brep_5 = MeshBrep(
    Brep=geometry_18,
    Settings={GridMaxCount=0, GridMinCount=16, JaggedSeams=False, MaxEdgeLength=0, MinEdgeLength=0.0001, MinTolerance=0, Refine=True, RefineAngle=0, RelativeTolerance=0.65, SimplePlanes=True, Tolerance=0})
# Final PTS
point_13 = Point(merge_12)
bounding_box_2 = BoundingBox(Content=flatten(point_13), Plane=PlaneXY(0, 0, 0), UnionBox=True)  # -> Box, Box_2
deconstruct_brep_2 = DeconstructBrep(Brep=bounding_box_2.Box)  # -> Faces, Edges, Vertices
list_item_9 = ListItem(List=flatten(deconstruct_brep_2.Faces), Index=Slider(4, range=0..10), Wrap=True)
area_9 = Area(Geometry=list_item_9)  # -> Area, Centroid
scale = Scale(Geometry=point_13, Center=area_9.Centroid, Factor=Slider(10, range=0..10))  # -> Geometry, Transform
list_item_10 = ListItem(List=flatten(point_13), Index=Slider(0, range=0..756), Wrap=True)
pline = PolyLine(Vertices=flatten(point_13), Closed=False)
orient_5 = Orient(Geometry=mesh_brep_4, Source=area_7.Centroid, Target=point_11)  # -> Geometry, Transform
# Scaled PTS
point_14 = Point(scale.Geometry)
orient_6 = Orient(Geometry=mesh_brep_5, Source=area_8.Centroid, Target=point_12)  # -> Geometry, Transform
number_slider_7 = Slider(0, range=0..43)
geometry_20 = Geometry(simplify(orient_5.Geometry))
geometry_21 = Geometry(simplify(orient_6.Geometry))
cluster = BranchLook(data=geometry_20, i=number_slider_7)
cluster_2 = BranchLook(data=geometry_21, i=number_slider_7)
custom_preview_5 = CustomPreview(Geometry=geometry_20, Material=ColourSwatch(SwatchColor=RGBA(243, 77, 129, 197)))
custom_preview_6 = CustomPreview(Geometry=geometry_21, Material=ColourSwatch(SwatchColor=RGBA(84, 223, 212, 197)))
custom_preview_7 = CustomPreview(Geometry=[cluster, cluster_2], Material=ColourSwatch(SwatchColor=RGBA(249, 146, 78, 197)))

# ==== cluster BranchLook: To see the condition of branch data.
data = ClusterInput()
data_2 = Data(data)
tstat = TreeStatistics(Tree=data_2)  # -> Paths, Length, Count
i = ClusterInput()
item = ListItem(List=tstat.Paths, Index=i, Wrap=True)
branch = TreeBranch(Tree=data_2, Path=item, MaintainPaths=True)
B = ClusterOutput(branch)
