# Grasshopper definition 20230307 rooof.gh (Grasshopper 1.0.7)
# plug-ins: Pufferfish, Human, Kangaroo2 Components

point = Point(Point(-8.755820966, -97.54357692, 0))
point_2 = Point(Point(-8.755820966, -97.54357692, 0))
point_3 = Point(Point(-8.755820966, -97.54357692, 0))
unit_z = UnitZ(Factor=Slider(200, range=0..200))
unit_z_2 = UnitZ(Factor=Slider(200, range=0..200))
unit_z_3 = UnitZ(Factor=Slider(200, range=0..200))
unit_z_4 = UnitZ(Factor=Slider(78.53, range=0..200))
unit_z_5 = UnitZ(Factor=Slider(78.53, range=0..200))
unit_z_6 = UnitZ(Factor=Slider(78.53, range=0..200))
move = Move(Geometry=point, Motion=unit_z)  # -> Geometry, Transform
move_2 = Move(Geometry=point_2, Motion=unit_z_2)  # -> Geometry, Transform
move_3 = Move(Geometry=point_3, Motion=unit_z_3)  # -> Geometry, Transform
move_4 = Move(Geometry=point, Motion=unit_z_4)  # -> Geometry, Transform
multiplication = Multiplication(A=Slider(7, range=0..10), B=Slider(1.5, range=0..10))
multiplication_2 = Multiplication(A=Slider(7, range=0..10), B=Slider(1.3, range=0..10))
move_5 = Move(Geometry=point_2, Motion=unit_z_5)  # -> Geometry, Transform
move_6 = Move(Geometry=point_3, Motion=unit_z_6)  # -> Geometry, Transform
multiplication_3 = Multiplication(A=Slider(7, range=0..10), B=Slider(1.5, range=0..10))
multiplication_4 = Multiplication(A=Slider(7, range=0..10), B=Slider(1.5, range=0..10))
multiplication_5 = Multiplication(A=Slider(7, range=0..10), B=Slider(1.3, range=0..10))
multiplication_6 = Multiplication(A=Slider(7, range=0..10), B=Slider(1.3, range=0..10))
multiplication_7 = Multiplication(A=Slider(7, range=0..10), B=Slider(3.1, range=0..10))
multiplication_8 = Multiplication(A=Slider(7, range=0..10), B=Slider(6.4, range=0..10))
multiplication_9 = Multiplication(A=Slider(7, range=0..10), B=Slider(2.5, range=0..10))
multiplication_10 = Multiplication(A=Slider(7, range=0..10), B=Slider(5.6, range=0..10))
multiplication_11 = Multiplication(A=Slider(7, range=0..10), B=Slider(3.1, range=0..10))
multiplication_12 = Multiplication(A=Slider(7, range=0..10), B=Slider(3.1, range=0..10))
multiplication_13 = Multiplication(A=Slider(7, range=0..10), B=Slider(6.4, range=0..10))
multiplication_14 = Multiplication(A=Slider(7, range=0..10), B=Slider(2.5, range=0..10))
multiplication_15 = Multiplication(A=Slider(7, range=0..10), B=Slider(6.4, range=0..10))
multiplication_16 = Multiplication(A=Slider(7, range=0..10), B=Slider(2.5, range=0..10))
multiplication_17 = Multiplication(A=Slider(7, range=0..10), B=Slider(4, range=0..10))
multiplication_18 = Multiplication(A=Slider(7, range=0..10), B=Slider(4, range=0..10))
ellipse = Ellipse(Plane=move.Geometry, Radius1=multiplication, Radius2=multiplication_2)  # -> Ellipse, Focus1, Focus2
ellipse_2 = Ellipse(Plane=move_2.Geometry, Radius1=multiplication_3, Radius2=multiplication_5)  # -> Ellipse, Focus1, Focus2
ellipse_3 = Ellipse(Plane=move_3.Geometry, Radius1=multiplication_4, Radius2=multiplication_6)  # -> Ellipse, Focus1, Focus2
ellipse_4 = Ellipse(Plane=move_4.Geometry, Radius1=multiplication_7, Radius2=multiplication_9)  # -> Ellipse, Focus1, Focus2
ellipse_5 = Ellipse(Plane=move_5.Geometry, Radius1=multiplication_11, Radius2=multiplication_14)  # -> Ellipse, Focus1, Focus2
ellipse_6 = Ellipse(Plane=move_6.Geometry, Radius1=multiplication_12, Radius2=multiplication_16)  # -> Ellipse, Focus1, Focus2
ellipse_7 = Ellipse(Plane=point, Radius1=multiplication_8, Radius2=multiplication_10)  # -> Ellipse, Focus1, Focus2
ellipse_8 = Ellipse(Plane=point_2, Radius1=multiplication_13, Radius2=multiplication_17)  # -> Ellipse, Focus1, Focus2
ellipse_9 = Ellipse(Plane=point_3, Radius1=multiplication_15, Radius2=multiplication_18)  # -> Ellipse, Focus1, Focus2
merge = Merge(Data1=ellipse_7.Ellipse, Data2=ellipse_4.Ellipse, Data3=ellipse.Ellipse)
merge_2 = Merge(Data1=ellipse_8.Ellipse, Data2=ellipse_5.Ellipse, Data3=ellipse_2.Ellipse)
merge_3 = Merge(Data1=ellipse_9.Ellipse, Data2=ellipse_6.Ellipse, Data3=ellipse_3.Ellipse)
loft = Loft(Curves=merge, Options={Adjust=False, Closed=False, LoftEnds=0, LoftSimp=0, LoftType=0, Rebuild=10, Refit=0.01})
loft_2 = Loft(Curves=merge_2, Options={Adjust=False, Closed=False, LoftEnds=0, LoftSimp=0, LoftType=0, Rebuild=10, Refit=0.01})
loft_3 = Loft(Curves=merge_3, Options={Adjust=False, Closed=False, LoftEnds=0, LoftSimp=0, LoftType=0, Rebuild=10, Refit=0.01})
Y = UnitY(Factor=Slider(155, range=0..1000))
move_7 = Move(Geometry=loft, Motion=Y)  # -> Geometry, Transform
geometry = Geometry(loft_2)
area = Area(Geometry=geometry)  # -> Area, Centroid
X = UnitX(Factor=Slider(70, range=50..200))
move_8 = Move(Geometry=area.Centroid, Motion=X)  # -> Geometry, Transform
yz = YZPlane(Origin=area.Centroid)
orient = Orient(Geometry=geometry, Source=move_8.Geometry, Target=area.Centroid)  # -> Geometry, Transform
orient_2 = Orient(Geometry=loft_3, Source=move_8.Geometry, Target=area.Centroid)  # -> Geometry, Transform
mirror = Mirror(Geometry=orient_2.Geometry, Plane=yz)  # -> Geometry, Transform
brep = Brep(mirror.Geometry)
brep_2 = Brep(orient.Geometry)

# ----
# Roof
edges = BrepEdges(Brep=brep_2)  # -> Naked, Interior, NonManifold
edges_2 = BrepEdges(Brep=move_7.Geometry)  # -> Naked, Interior, NonManifold
edges_3 = BrepEdges(Brep=brep)  # -> Naked, Interior, NonManifold
item = ListItem(List=edges.Naked, Index=0, Wrap=True)
item_2 = ListItem(List=edges_2.Naked, Index=0, Wrap=True)
item_3 = ListItem(List=edges_3.Naked, Index=0, Wrap=True)
Z = UnitZ(Factor=Slider(3, range=0..10))
move_9 = Move(Geometry=[item, item_3, item_2], Motion=Z)  # -> Geometry, Transform
offset = OffsetCurve(Curve=move_9.Geometry, Distance=Slider(7, range=0..10), Corners=1)
offset_2 = OffsetCurve(Curve=move_9.Geometry, Distance=Slider(1.39, range=0..10), Corners=1)  # -> flatten(Curve)
area_2 = Area(Geometry=move_9.Geometry)  # -> Area, Centroid
Z_2 = UnitZ(Factor=1)
boundary = BoundarySurfaces(Edges=offset)  # -> flatten(Surfaces)
item_4 = ListItem(List=offset_2, Index=0, Wrap=True)  # -> Item, Item1, Item2
Z_3 = UnitZ(Factor=1)
line = LineSDL(Start=area_2.Centroid, Direction=Z_2, Length=Slider(10, range=0..10))
item_5 = ListItem(List=boundary, Index=0, Wrap=True)  # -> Item, Item1, Item2
extr = Extrude(Base=boundary, Direction=Z_3)
pipe = Pipe(Curve=line, Radius=1, Caps=0)
seam = Seam(Curve=reparameterize(item_4.Item), Seam=Slider(0.375, range=0..1))
divide = DivideCurve(Curve=seam, Count=Slider(4, range=0..10), Kinks=False)  # -> Points, Tangents, Parameters
Z_4 = UnitZ(Factor=Slider(4, range=0..10))
move_10 = Move(Geometry=area_2.Centroid, Motion=Z_4)  # -> Geometry, Transform
avr = Average(Input=move_10.Geometry)
scale = Scale(Geometry=move_10.Geometry, Center=avr, Factor=Slider(1.2, range=1..2))  # -> Geometry, Transform
pline = PolyLine(Vertices=scale.Geometry, Closed=invert(False))
explode = Explode(Curve=pline, Recursive=True)  # -> Segments, Vertices
neg = Negative(Value=Slider(5, range=0..10))
number_slider = Slider(3, range=0..10)
ext = ExtendCurve(Curve=explode.Segments, Type=0, Start=neg, End=neg)
division = Division(A=Slider(6, range=0..10), B=2)
Z_5 = UnitZ(Factor=division)
move_11 = Move(Geometry=pline, Motion=Z_5)  # -> Geometry, Transform
boundary_2 = BoundarySurfaces(Edges=move_11.Geometry)
X_2 = UnitX(Factor=1)
number_slider_2 = Slider(3.9, range=0..10)
number_slider_3 = Slider(7.21, range=0..10)
contour = Contour(Shape=boundary_2, Point=Point(0, 0, 0), Direction=X_2, Distance=Slider(15, range=0..100))
offset_3 = OffsetCurve(Curve=boundary_2, Distance=Slider(9, range=0..10), Corners=1)
number_slider_4 = Slider(1.5, range=0..10)
division_2 = Division(A=number_slider_2, B=2)
number_slider_5 = Slider(4.29, range=0..10)
Z_6 = UnitZ(Factor=number_slider_2)
ext_2 = ExtendCurve(Curve=contour, Type=0, Start=number_slider_3, End=number_slider_3)
end = EndPoints(Curve=line)  # -> Start, End
Z_7 = UnitZ(Factor=division_2)
move_12 = Move(Geometry=offset_3, Motion=Z_6)  # -> Geometry, Transform
move_13 = Move(Geometry=ext_2, Motion=Z_7)  # -> Geometry, Transform
neg_2 = Negative(Value=number_slider_5)
pt = Point(end.End)
dom = ConstructDomain(DomainStart=neg_2, DomainEnd=number_slider_5)
boundary_3 = BoundarySurfaces(Edges=move_12.Geometry)
pline_2 = PolyLine(Vertices=pt, Closed=invert(False))
Z_8 = UnitZ(Factor=1)
rectangle = Rectangle(Plane=pt, XSize=dom, YSize=dom, Radius=0)  # -> Rectangle, Length
rectangle_2 = Rectangle(Plane=area_2.Centroid, XSize=dom, YSize=dom, Radius=0)  # -> Rectangle, Length
offset_4 = OffsetCurve(Curve=pline_2, Distance=Slider(10, range=0..10), Corners=1)
extr_2 = Extrude(Base=boundary_3, Direction=Z_8)
neg_3 = Negative(Value=Slider(1, range=0..10))
Z_9 = UnitZ(Factor=neg_3)
boundary_4 = BoundarySurfaces(Edges=rectangle.Rectangle)
boundary_5 = BoundarySurfaces(Edges=rectangle_2.Rectangle)
Z_10 = UnitZ(Factor=Slider(2, range=0..10))
Z_11 = UnitZ(Factor=Slider(2, range=0..10))
boundary_6 = BoundarySurfaces(Edges=offset_4)
extr_3 = Extrude(Base=boundary_4, Direction=Z_9)
extr_4 = Extrude(Base=boundary_6, Direction=Z_10)
extr_5 = Extrude(Base=boundary_5, Direction=Z_11)
edges_4 = BrepEdges(Brep=[pipe, extr, extr_5, extr_4, extr_3])  # -> Naked, Interior, NonManifold
capex = CapHolesEx()  # -> Brep, Caps, Solid
capex_2 = CapHolesEx()  # -> Brep, Caps, Solid
brep_3 = Brep([pipe, extr])
brep_4 = Brep(extr_2)
preview = CustomPreview(Geometry=[pipe, extr, extr_5, extr_4, extr_3], Material=ColourSwatch(SwatchColor=RGB(255, 255, 255)))  # disabled
previewlw = CustomPreviewLineweights(Geometry=[edges_4.Naked, edges_4.Interior], Shader=ColourSwatch(SwatchColor=RGB(0, 0, 0)), Absolute=False)  # disabled
edges_5 = BrepEdges(Brep=[brep_3, capex.Brep, brep_4, capex_2.Brep])  # -> Naked, Interior, NonManifold

area_3 = Area(Geometry=item_2)  # -> Area, Centroid
area_4 = Area(Geometry=item_3)  # -> Area, Centroid
area_5 = Area(Geometry=item)  # -> Area, Centroid
merge_4 = Merge(Data1=area_5.Centroid, Data2=area_4.Centroid, Data3=area_3.Centroid)
polygon = Polygon(Plane=merge_4, Radius=Slider(14.5, range=0..100), Segments=Slider(12, range=0..100), FilletRadius=0)  # -> Polygon, Length
circle = Circle(Plane=merge_4, Radius=Slider(14.2, range=0..100))
unit_z_7 = UnitZ(Factor=Slider(1.5, range=0..10))
extrude = Extrude(Base=polygon.Polygon, Direction=unit_z_7)
negative = Negative(Value=Slider(2.4, range=0..10))
offset_curve = OffsetCurve(Curve=circle, Distance=negative, Corners=1)
cap_holes = CapHoles(Brep=extrude)
unit_z_8 = UnitZ(Factor=Slider(4.1, range=0..100))
number_slider_6 = Slider(0.3, range=0..1)
geometry_2 = Geometry(cap_holes)
number_slider_7 = Slider(15, range=10..20)
divide_curve = DivideCurve(Curve=offset_curve, Count=Slider(12, range=0..12), Kinks=False)  # -> Points, Tangents, Parameters
number_slider_8 = Slider(4.69, range=0..10)
number_slider_9 = Slider(4.5, range=0..10)
move_14 = Move(Geometry=geometry_2, Motion=unit_z_8)  # -> Geometry, Transform
area_6 = Area(Geometry=offset_curve)  # -> Area, Centroid
brep_5 = Brep([brep_2, brep])
unit_z_9 = UnitZ(Factor=Slider(10, range=0..10))
deconstruct_brep = DeconstructBrep(Brep=move_14.Geometry)  # -> Faces, Edges, Vertices
list_item = ListItem(List=deconstruct_brep.Faces, Index=Slider(13, range=0..13), Wrap=True)
brep_6 = Brep([brep_2, brep, move_7.Geometry])
circle_2 = Circle(Plane=divide_curve.Points, Radius=number_slider_6)
number_slider_10 = Slider(4.5, range=0..10)
wall = Wall(
    B=brep_5,
    l1=Slider(-20, range=-200..0),
    l1_2=Slider(-20, range=-200..0),
    G=area.Centroid,
    D=number_slider_9,
    F=Slider(90, range=0..200),
    D_2="7")
number_slider_11 = Slider(7.44, range=0..10)
area_7 = Area(Geometry=list_item)  # -> Area, Centroid
column = Column(S=brep_2, layerheight=number_slider_9, ichunklength=number_slider_7, itolerance=number_slider_8)
column_2 = Column(S=brep, layerheight=number_slider_9, ichunklength=number_slider_7, itolerance=number_slider_8)
column_3 = Column(S=move_7.Geometry, layerheight=number_slider_9, ichunklength=number_slider_7, itolerance=number_slider_8)
custom_mesh_settings = SettingsCustom(
    StitchSeams=True,
    SimplePlanes=False,
    Refine=True,
    MinCount=16,
    MaxCount=400,
    AspectRatio=20,
    MaxDistance=0,
    MaxAngle=20,
    MinEdge=0,
    MaxEdge=0)
path = Path(brep=brep_6, D=number_slider_9)
extrude_2 = Extrude(Base=circle_2, Direction=unit_z_9)
list_item_2 = ListItem(List=deconstruct_brep.Faces, Index=Slider(12, range=0..13), Wrap=True)
geometry_3 = Geometry(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)
area_8 = Area(Geometry=geometry_3)  # -> Area, Centroid
area_9 = Area(Geometry=list_item_2)  # -> Area, Centroid
orient_3 = Orient(Geometry=divide_curve.Points, Source=area_6.Centroid, Target=area_7.Centroid)  # -> simplify(Geometry), Transform
mesh_brep = MeshBrep(Brep=geometry_3, Settings=custom_mesh_settings)
cap_holes_2 = CapHoles(Brep=extrude_2)
solid_difference = SolidDifference(BrepsA=move_14.Geometry, BrepsB=cap_holes_2)  # -> simplify(Result)
point_4 = Point(area_7.Centroid)
polyline = PolyLine(Vertices=flatten(point_4), Closed=invert(False))
line_2 = Line(StartPoint=divide_curve.Points, EndPoint=orient_3.Geometry)
orient_4 = Orient(Geometry=geometry_3, Source=area_8.Centroid, Target=[column, column_2])  # -> Geometry, Transform
pt_2 = Point(simplify(column_3))
pt_3 = Point(simplify(column_2))
pt_4 = Point(simplify(column))
# size of the roof
number_slider_12 = Slider(1.8, range=0..10)
brep_7 = Brep(orient_4.Geometry)  # disabled
merge_5 = Merge(Data1=pt_4, Data2=wall, Data3=pt_3, Data4=pt_2)
swatch = ColourSwatch(SwatchColor=RGB(255, 255, 255))  # disabled
overlapcompute = OverlapCompute(T=brep_7)  # -> T_2, C; disabled
custom_mesh_settings_2 = SettingsCustom(
    StitchSeams=True,
    SimplePlanes=False,
    Refine=True,
    MinCount=16,
    MaxCount=400,
    AspectRatio=20,
    MaxDistance=0,
    MaxAngle=20,
    MinEdge=0,
    MaxEdge=0)
preview_2 = CustomPreview(Geometry=flatten(overlapcompute.T_2), Material=overlapcompute.C)
geometry_4 = Geometry(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)
custom_mesh_settings_3 = SettingsCustom(
    StitchSeams=True,
    SimplePlanes=False,
    Refine=True,
    MinCount=16,
    MaxCount=400,
    AspectRatio=20,
    MaxDistance=0,
    MaxAngle=20,
    MinEdge=0,
    MaxEdge=0)
area_10 = Area(Geometry=geometry_4)  # -> Area, Centroid
cullpt = CullDuplicates(Points=merge_5, Tolerance=Slider(2.84, range=0..10), CullMode=3)  # -> Points, Indices, Valence
geometry_5 = Geometry(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)
mesh_brep_2 = MeshBrep(Brep=geometry_4, Settings=custom_mesh_settings_2)
area_11 = Area(Geometry=geometry_5)  # -> Area, Centroid
mesh_brep_3 = MeshBrep(Brep=geometry_5, Settings=custom_mesh_settings_3)
alongcrv = SortAlongCurve(Points=cullpt.Points, Curve=path)  # -> Points, Indices
pline_3 = PolyLine(Vertices=flatten(alongcrv.Points), Closed=False)
point_list = PointList(Points=flatten(alongcrv.Points), Size=Slider(3, range=0..10))
orient_5 = Orient(Geometry=mesh_brep_2, Source=area_10.Centroid, Target=alongcrv.Points)  # -> Geometry, Transform
pt_5 = Point(simplify(Tree({0}: [Point(33.83075903, 69.62563181, 0), Point(28.46864932, 79.26796024, 0), Point(22.1711301, 85.8172734, 0), Point(15.50727322, 90.40969747, 0), Point(8.664545573, 93.57146727, 0), Point(1.726842534, 95.56821066, 0)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], {1}: [Point(-38.15649457, -88.35366505, 4.5), Point(-44.29497842, -81.14429104, 4.5), Point(-50.97718182, -76.67595459, 4.5), Point(-57.83666698, -73.6855644, 4.5), Point(-64.77711255, -71.73307545, 4.5), Point(-71.75785661, -70.62123944, 4.5)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], {2}: [Point(32.35821145, 64.95642308, 9), Point(28.0825595, 73.97547418, 9), Point(22.04294869, 81.55861577, 9), Point(15.46321389, 86.67779784, 9), Point(8.651362573, 90.13217503, 9), Point(1.724167867, 92.28995185, 9)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], {3}: [Point(-39.22005434, -90.04357692, 13.5), Point(-44.50444693, -84.27294256, 13.5), Point(-51.04342352, -78.91932153, 13.5), Point(-57.85778401, -75.48774395, 13.5), Point(-64.78226396, -73.29032016, 13.5), Point(-71.7583298, -72.05096775, 13.5)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], {4}: [Point(27.44885783, 68.22167638, 18), Point(21.86661985, 77.2722027, 18), Point(15.40744256, 83.05356172, 18), Point(8.635391339, 86.8503044, 18), Point(1.721004264, 89.18911431, 18), Point(-5.259438585, 90.30960043, 18)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], {5}: [Point(-44.86077571, -87.93291146, 22.5), Point(-51.13781415, -81.29393042, 22.5), Point(-57.88595364, -77.30648067, 22.5), Point(-64.78892706, -74.81766673, 22.5), Point(-71.75893302, -73.43056283, 22.5), Point(-78.75582097, -72.98333118, 22.5)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]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)))
orient_6 = Orient(Geometry=geometry_5, Source=area_11.Centroid, Target=column_3)  # -> Geometry, Transform
tstat = TreeStatistics(Tree=orient_4.Geometry)  # -> Paths, Length, Count; disabled
dispatch = Dispatch(List=tstat.Paths, DispatchPattern=[True, False])  # -> ListA, ListB; disabled
flatten = FlattenTree(Tree=orient_5.Geometry, Path="{0}")
overlapcompute_2 = OverlapCompute(T=flatten)  # -> T_2, C; disabled
branch = TreeBranch(Tree=orient_4.Geometry, Path=dispatch.ListB, MaintainPaths=True)  # disabled
branch_2 = TreeBranch(Tree=orient_4.Geometry, Path=dispatch.ListA, MaintainPaths=True)  # disabled
split = SplitList(List=flatten, Index=Slider(2202, range=0..2249))  # -> ListA, ListB
cluster = Cluster_2(
    plane_2=area_9.Centroid,
    radius=Slider(0.8, range=0..10),
    factor_3=Slider(12.7, range=0..100),
    geometry=solid_difference,
    factor=number_slider_11,
    plane=area_7.Centroid,
    domain_end_2=number_slider_10,
    value=number_slider_10,
    domain_end=number_slider_10,
    factor_2=Slider(0.3, range=0..1))  # -> geometry_3, simplify(result)
number_slider_13 = Slider(15, range=0..20)  # disabled
cluster_2 = Cluster(
    curve=polyline,
    distance=Slider(2.5, range=0..10),
    factor=Slider(4.8, range=0..10),
    distance_2=Slider(5, range=0..10),
    factor_2=number_slider_11)
deconstruct_brep_2 = DeconstructBrep(Brep=cluster_2)  # -> Faces, simplify(Edges), simplify(Vertices)
explode_tree = ExplodeTree(Data=deconstruct_brep_2.Vertices)  # -> Branch0, Branch1, Branch2
list_item_3 = ListItem(List=explode_tree.Branch2, Index=Slider(5, range=0..7), Wrap=True)
list_item_4 = ListItem(List=explode_tree.Branch0, Index=Slider(5, range=0..7), Wrap=True)
list_item_5 = ListItem(List=explode_tree.Branch1, Index=Slider(5, range=0..7), Wrap=True)
merge_6 = Merge(Data1=list_item_4, Data2=list_item_5, Data3=list_item_3)
polyline_2 = PolyLine(Vertices=flatten(merge_6), Closed=invert(False))
boundary_surfaces = BoundarySurfaces(Edges=polyline_2)
area_12 = Area(Geometry=boundary_surfaces)  # -> Area, Centroid
scale_2 = Scale(Geometry=merge_6, Center=area_12.Centroid, Factor=number_slider_12)  # -> Geometry, Transform
polyline_3 = PolyLine(Vertices=flatten(scale_2.Geometry), Closed=invert(False))
curve = Curve(polyline_3)
explode_2 = Explode(Curve=curve, Recursive=True)  # -> Segments, Vertices
area_13 = Area(Geometry=curve)  # -> Area, Centroid
removeduplicatepts = RemoveDuplicatePts(Points=explode_2.Vertices, Tolerance=0.01)
curve_middle = CurveMiddle(Curve=explode_2.Segments)
cluster_3 = Cluster_3(brep=cluster_2, factor_2=Slider(1.8, range=0..10), factor=Slider(1, range=0..10))
preview_3 = CustomPreview(Geometry=flatten(overlapcompute_2.T_2), Material=overlapcompute_2.C)
tstat_2 = TreeStatistics(Tree=orient_6.Geometry)  # -> Paths, Length, Count
pipe_2 = Pipe(Curve=line_2, Radius=number_slider_6, Caps=0)
line_3 = Line(StartPoint=area_13.Centroid, EndPoint=curve_middle)
preview_4 = CustomPreview(Geometry=flatten, Material=ColourSwatch(SwatchColor=RGBA(188, 187, 142, 137)))
dispatch_2 = Dispatch(List=tstat_2.Paths, DispatchPattern=[True, False])  # -> ListA, ListB
geometry_6 = Geometry(simplify(branch))  # disabled
geometry_7 = Geometry(simplify(branch_2))  # disabled
line_4 = Line(StartPoint=removeduplicatepts, EndPoint=area_13.Centroid)
panel = Panel(move_13.Geometry)
addition = Addition(A=number_slider_13, B=1)  # disabled
geometry_8 = Geometry(cluster.geometry_3)
addition_2 = Addition(A=number_slider_13, B=2)  # disabled
curve_2 = Curve(line_3)
addition_3 = Addition(A=number_slider_13, B=1)  # disabled
addition_4 = Addition(A=number_slider_13, B=2)  # disabled
branch_3 = TreeBranch(Tree=orient_6.Geometry, Path=dispatch_2.ListB, MaintainPaths=True)
branch_4 = TreeBranch(Tree=orient_6.Geometry, Path=dispatch_2.ListA, MaintainPaths=True)
number_slider_14 = Slider(7, range=0..10)
number_slider_15 = Slider(0, range=0..20)
number_slider_16 = Slider(13, range=0..20)
cluster_4 = BranchLook(data=geometry_6, i=number_slider_13)  # disabled
bounding_box = BoundingBox(Content=geometry_8, Plane=PlaneXY(0, 0, 0), UnionBox=False)  # -> Box, Box_2
cluster_5 = BranchLook(data=geometry_7, i=number_slider_13)  # disabled
cluster_6 = BranchLook(data=geometry_6, i=addition)  # disabled
cluster_7 = BranchLook(data=geometry_6, i=addition_2)  # disabled
cluster_8 = BranchLook(data=geometry_7, i=addition_3)  # disabled
cluster_9 = BranchLook(data=geometry_7, i=addition_4)  # disabled
swatch_2 = ColourSwatch(SwatchColor=RGB(255, 255, 255))  # disabled
boundary_surfaces_2 = BoundarySurfaces(Edges=curve)
extend_curve = ExtendCurve(Curve=curve_2, Type=0, Start=Slider(0, range=0..100), End=Slider(1.5, range=0..10))
swatch_3 = ColourSwatch(SwatchColor=RGB(255, 255, 255))  # disabled
merge_7 = Merge(Data1=solid_difference, Data3=pipe_2)
geometry_9 = Geometry(simplify(branch_4))
geometry_10 = Geometry(simplify(branch_3))
divide_length = DivideLength(Curve=curve_2, Length=Slider(10, range=0..10))  # -> simplify(Points), Tangents, Parameters
curve_middle_2 = CurveMiddle(Curve=line_4)  # -> graft(Midpoint)
deconstruct_brep_3 = DeconstructBrep(Brep=bounding_box.Box)  # -> Faces, Edges, Vertices
preview_5 = CustomPreview(Geometry=cluster_3, Material=ColourSwatch(SwatchColor=RGBA(128, 242, 115, 106)))  # disabled
preview_6 = CustomPreview(
    Geometry=geometry_7,
    Material={diffuse=RGB(221, 160, 221), emission=RGB(66, 48, 66), shine=0.5, specular=RGB(255, 255, 255), transparency=0})  # disabled
preview_7 = CustomPreview(Geometry=geometry_6, Material=swatch_2)  # disabled
addition_5 = Addition(A=number_slider_15, B=1)
addition_6 = Addition(A=number_slider_15, B=2)  # disabled
addition_7 = Addition(A=number_slider_15, B=1)
addition_8 = Addition(A=number_slider_15, B=2)  # disabled
preview_8 = CustomPreview(Geometry=[cluster_4, cluster_6, cluster_7], Material=swatch_3)  # disabled
preview_9 = CustomPreview(
    Geometry=[cluster_5, cluster_8, cluster_9],
    Material={diffuse=RGB(221, 160, 221), emission=RGB(66, 48, 66), shine=0.5, specular=RGB(255, 255, 255), transparency=0})  # disabled
series = Series(Start=0, Step=number_slider_14, Count=number_slider_16)
series_2 = Series(Start=0, Step=number_slider_14, Count=number_slider_16)
point_list_2 = PointList(Points=flatten(curve_middle_2), Size=Slider(2, range=0..10))
list_item_6 = ListItem(List=deconstruct_brep_3.Faces, Index=Slider(4, range=0..4), Wrap=True)
cluster_10 = BranchLook(data=geometry_10, i=number_slider_15)
cluster_11 = BranchLook(data=geometry_9, i=number_slider_15)
negative_2 = Negative(Value=series_2)
cluster_12 = BranchLook(data=geometry_10, i=addition_5)
surface_split = SurfaceSplit(Surface=boundary_surfaces_2, Curves=extend_curve)
cluster_13 = BranchLook(data=geometry_10, i=addition_6)  # disabled
cluster_14 = BranchLook(data=geometry_9, i=addition_7)
cluster_15 = BranchLook(data=geometry_9, i=addition_8)  # disabled
offset_curve_2 = OffsetCurve(Curve=graft(line_4), Distance=series, Corners=1)  # -> simplify(Curve)
offset_curve_3 = OffsetCurve(Curve=graft(line_4), Distance=negative_2, Corners=1)  # -> simplify(Curve)
area_14 = Area(Geometry=list_item_6)  # -> Area, Centroid
pull_point = PullPoint(Point=curve_middle_2, Geometry=surface_split, ClosestOnly=False)  # -> ClosestPoint, Distance
preview_10 = CustomPreview(
    Geometry=geometry_9,
    Material={diffuse=RGB(221, 160, 221), emission=RGB(66, 48, 66), shine=0.5, specular=RGB(255, 255, 255), transparency=0})  # disabled
preview_11 = CustomPreview(Geometry=geometry_10, Material=ColourSwatch(SwatchColor=RGB(255, 255, 255)))  # disabled
preview_12 = CustomPreview(Geometry=[cluster_10, cluster_12, cluster_13], Material=ColourSwatch(SwatchColor=RGB(255, 255, 255)))  # disabled
preview_13 = CustomPreview(
    Geometry=[cluster_11, cluster_14, cluster_15],
    Material={diffuse=RGB(221, 160, 221), emission=RGB(66, 48, 66), shine=0.5, specular=RGB(255, 255, 255), transparency=0})  # disabled

preview_14 = CustomPreview(Geometry=[brep_3, capex.Brep, brep_4, capex_2.Brep], Material=ColourSwatch(SwatchColor=RGB(255, 255, 255)))  # disabled
previewlw_2 = CustomPreviewLineweights(Geometry=[edges_5.Naked, edges_5.Interior], Shader=ColourSwatch(SwatchColor=RGB(0, 0, 0)), Absolute=False)  # disabled

merge_8 = Merge(Data1=offset_curve_2, Data2=offset_curve_3)
# size of beams
number_slider_17 = Slider(191, range=0..300)
removeduplicatepts_2 = RemoveDuplicatePts(Points=simplify(flatten(area_14.Centroid)), Tolerance=Slider(0.1, range=0..0.1))
dispatch_3 = Dispatch(List=surface_split, DispatchPattern=pull_point.Distance)  # -> ListA, ListB
tstat_3 = TreeStatistics(Tree=orient_5.Geometry)  # -> Paths, Length, Count
surface_split_2 = SurfaceSplit(Surface=surface_split, Curves=merge_8)  # -> simplify(Fragments)
vector = Vector(line_4)
dispatch_4 = Dispatch(List=tstat_3.Paths, DispatchPattern=[True, False])  # -> ListA, ListB
number_slider_18 = Slider(6, range=0..100)
list_item_7 = ListItem(List=removeduplicatepts_2, Index=0, Wrap=True)  # -> Item, Item1, Item2
number_slider_19 = Slider(4, range=0..100)

number_slider_20 = Slider(49, range=0..100)

brep_8 = Brep(flatten(dispatch_3.ListB))
pull_point_2 = PullPoint(Point=flatten(divide_length.Points), Geometry=simplify(graft(brep_8)), ClosestOnly=True)  # -> ClosestPoint, Distance
boolean = Boolean(pull_point_2.Distance)
panel_2 = Panel(boolean)
dispatch_5 = Dispatch(List=pull_point_2.ClosestPoint, DispatchPattern=boolean)  # -> ListA, ListB
area_15 = Area(Geometry=brep_8)  # -> Area, Centroid
point_5 = Point(dispatch_5.ListB)
tree_branch = TreeBranch(Tree=point_5, Path=Slider(0, range=0..2), MaintainPaths=True)
branch_5 = TreeBranch(Tree=orient_5.Geometry, Path=dispatch_4.ListB, MaintainPaths=True)
branch_6 = TreeBranch(Tree=orient_5.Geometry, Path=dispatch_4.ListA, MaintainPaths=True)
amplitude = Amplitude(Vector=vector, Amplitude=number_slider_17)  # -> simplify(graft(Vector))
point_6 = Point(list_item_7.Item)
point_7 = Point(list_item_7.Item1)
number_slider_21 = Slider(0, range=0..20)
point_8 = Point(list_item_7.Item2)
merge_9 = Merge(Data1=point_6, Data2=point_7, Data3=point_8)
point_list_3 = PointList(Points=area_15.Centroid, Size=Slider(2, range=0..10))
polyline_4 = PolyLine(Vertices=flatten(merge_9), Closed=invert(False))
negative_3 = Negative(Value=number_slider_18)
geometry_11 = Geometry(simplify(branch_5))
negative_4 = Negative(Value=number_slider_19)
line_5 = Line(StartPoint=point_6, EndPoint=point_7)
geometry_12 = Geometry(simplify(branch_6))
extend_curve_2 = ExtendCurve(Curve=line_5, Type=0, Start=number_slider_20, End=number_slider_20)
curve_middle_3 = CurveMiddle(Curve=extend_curve_2)
construct_domain = ConstructDomain(DomainStart=negative_3, DomainEnd=number_slider_18)

# ----
# Measure
brec = BoundingRectangle(Geometry=flatten(orient_5.Geometry), Plane=PlaneXY(0, 0, 0), Axis=0, Slide=0, Union=True)  # -> Bounding, DimensionX, DimensionY
bbox = BoundingBox(Content=flatten(orient_5.Geometry), Plane=PlaneXY(0, 0, 0), UnionBox=True)  # -> Box, Box_2
edges_6 = BrepEdges(Brep=bbox.Box)  # -> Naked, Interior, NonManifold
number_slider_22 = Slider(10, range=0..10)
explode_3 = Explode(Curve=brec.Bounding, Recursive=True)  # -> Segments, Vertices
item_6 = ListItem(List=edges_6.Interior, Index=Slider(9, range=0..10), Wrap=True)
item_7 = ListItem(List=explode_3.Vertices, Index=0, Wrap=True)  # -> Item, Item1, Item2
end_2 = EndPoints(Curve=item_6)  # -> Start, End
neg_4 = Negative(Value=Slider(10, range=0..10))
xz = XZPlane(Origin=end_2.Start)
aligndim = AlignedDimension(Plane=xz, PointA=end_2.Start, PointB=end_2.End, Offset=neg_4, Text="{0:0.00}", Size=number_slider_22)
aligndim_2 = AlignedDimension(Plane=PlaneXY(0, 0, 0), PointA=item_7.Item, PointB=item_7.Item1, Offset=neg_4, Text="{0:0.00}", Size=number_slider_22)
aligndim_3 = AlignedDimension(Plane=PlaneXY(0, 0, 0), PointA=item_7.Item1, PointB=item_7.Item2, Offset=neg_4, Text="{0:0.00}", Size=number_slider_22)

construct_domain_2 = ConstructDomain(DomainStart=negative_4, DomainEnd=number_slider_19)
panel_3 = Panel(pull_point.Distance)
negative_5 = Negative(Value=amplitude)
move_15 = Move(Geometry=point_5, Motion=simplify(negative_5))  # -> Geometry, Transform
point_9 = Point(area_7.Centroid)
number_slider_23 = Slider(36, range=0..100)
line_6 = Line(StartPoint=curve_middle_3, EndPoint=point_8)
addition_9 = Addition(A=number_slider_21, B=1)
addition_10 = Addition(A=number_slider_21, B=2)  # disabled
addition_11 = Addition(A=number_slider_21, B=1)
unit_z_10 = UnitZ(Factor=Slider(13, range=0..100))
addition_12 = Addition(A=number_slider_21, B=2)  # disabled
explode_4 = Explode(Curve=polyline_4, Recursive=True)  # -> Segments, Vertices
extend_curve_3 = ExtendCurve(Curve=line_6, Type=0, Start=Slider(0, range=0..100), End=Slider(37, range=0..100))
cluster_16 = BranchLook(data=geometry_11, i=number_slider_21)
rectangle_3 = Rectangle(Plane=point_9, XSize=construct_domain, YSize=construct_domain, Radius=0)  # -> simplify(Rectangle), Length
cluster_17 = BranchLook(data=geometry_12, i=number_slider_21)
rectangle_4 = Rectangle(Plane=removeduplicatepts_2, XSize=construct_domain_2, YSize=construct_domain_2, Radius=0)  # -> simplify(graft(Rectangle)), Length
cluster_18 = BranchLook(data=geometry_11, i=addition_9)
cluster_19 = BranchLook(data=geometry_11, i=addition_10)  # disabled
cluster_20 = BranchLook(data=geometry_12, i=addition_11)
cluster_21 = BranchLook(data=geometry_12, i=addition_12)  # disabled
extrude_3 = Extrude(Base=brep_8, Direction=unit_z_10)
line_7 = Line(StartPoint=point_5, EndPoint=move_15.Geometry)
xy_plane = XYPlane(Origin=Point(0, 0, 0))
number_slider_24 = Slider(8, range=0..10)
extend_curve_4 = ExtendCurve(Curve=explode_4.Segments, Type=0, Start=number_slider_23, End=number_slider_23)
merge_10 = Merge(Data1=rectangle_3.Rectangle, Data2=rectangle_4.Rectangle)
preview_15 = CustomPreview(
    Geometry=geometry_12,
    Material={diffuse=RGB(221, 160, 221), emission=RGB(66, 48, 66), shine=0.5, specular=RGB(255, 255, 255), transparency=0})  # disabled
trim_with_regions = TrimWithRegions(Curve=line_7, Regions=curve, Plane=xy_plane)  # -> Inside, Outside
preview_16 = CustomPreview(Geometry=geometry_11, Material=ColourSwatch(SwatchColor=RGB(255, 255, 255)))  # disabled
cluster_22 = Cluster_4(curve=[extend_curve_2, extend_curve_3], A=Slider(8, range=0..10), A_2=Slider(6, range=0..10))
unit_z_11 = UnitZ(Factor=Slider(12, range=0..100))
preview_17 = CustomPreview(Geometry=[cluster_16, cluster_18, cluster_19], Material=ColourSwatch(SwatchColor=RGB(255, 255, 255)))  # disabled
preview_18 = CustomPreview(
    Geometry=[cluster_17, cluster_20, cluster_21],
    Material={diffuse=RGB(221, 160, 221), emission=RGB(66, 48, 66), shine=0.5, specular=RGB(255, 255, 255), transparency=0})  # disabled
end_points = EndPoints(Curve=extend_curve_4)  # -> Start, End
cluster_23 = Cluster_4(curve=extend_curve_4, A=number_slider_24, A_2=Slider(6, range=0..10))
curve_3 = Curve(trim_with_regions.Inside)
brep_9 = Brep(cluster_22)
extrude_4 = Extrude(Base=curve, Direction=unit_z_11)
unit_z_12 = UnitZ(Factor=Slider(4, range=0.8..10))
unit_z_13 = UnitZ(Factor=Slider(4, range=0.8..10))
move_16 = Move(Geometry=brep_9, Motion=unit_z_12)  # -> Geometry, Transform
list_item_8 = ListItem(List=end_points.End, Index=0, Wrap=True)  # -> Item, Item1, Item2
list_item_9 = ListItem(List=end_points.Start, Index=0, Wrap=True)  # -> Item, Item1, Item2
loft_4 = Loft(Curves=merge_10, Options={Adjust=False, Closed=False, LoftEnds=0, LoftSimp=0, LoftType=0, Rebuild=10, Refit=0.01})
move_17 = Move(Geometry=cluster_23, Motion=unit_z_13)  # -> Geometry, Transform
cap_holes_ex = CapHolesEx(Brep=extrude_4)  # -> Brep, Caps, Solid
trim_with_brep = TrimWithBrep(Curve=line_7, Brep=cap_holes_ex.Brep)  # -> Inside, Outside
curve_4 = Curve(trim_with_brep.Inside)
length = Length(Curve=curve_4)
geometry_13 = Geometry(move_16.Geometry)
merge_11 = Merge(
    Data1=list_item_9.Item,
    Data2=list_item_8.Item2,
    Data3=list_item_9.Item1,
    Data4=list_item_8.Item,
    Data5=list_item_9.Item2,
    Data6=list_item_8.Item1)  # -> flatten(Result)
cap_holes_3 = CapHoles(Brep=move_17.Geometry)
unit_z_14 = UnitZ(Factor=Slider(5.7, range=0..10))
bounding_box_2 = BoundingBox(Content=move_16.Geometry, Plane=PlaneXY(0, 0, 0), UnionBox=True)  # -> Box, Box_2
cap_holes_4 = CapHoles(Brep=geometry_13)
smaller_than = SmallerThan(FirstNumber=length, SecondNumber=Slider(10, range=0..10))  # -> SmallerThan, OrEqualTo
dispatch_6 = Dispatch(List=curve_4, DispatchPattern=smaller_than.SmallerThan)  # -> ListA, ListB
extrude_5 = Extrude(Base=dispatch_6.ListB, Direction=unit_z_14)
polyline_5 = PolyLine(Vertices=merge_11, Closed=invert(False))
deconstruct_brep_4 = DeconstructBrep(Brep=bounding_box_2.Box)  # -> Faces, Edges, Vertices
unit_z_15 = UnitZ(Factor=number_slider_24)
number_slider_25 = Slider(1, range=0..1)
extrude_6 = Extrude(Base=curve, Direction=unit_z_14)
list_item_10 = ListItem(List=deconstruct_brep_4.Faces, Index=Slider(5, range=0..5), Wrap=True)
move_18 = Move(Geometry=polyline_5, Motion=unit_z_15)  # -> Geometry, Transform
area_16 = Area(Geometry=move_18.Geometry)  # -> Area, Centroid
negative_6 = Negative(Value=number_slider_25)
explode_5 = Explode(Curve=list_item_10, Recursive=True)  # -> Segments, Vertices
extrude_7 = Extrude(Base=curve_2, Direction=unit_z_14)
area_17 = Area(Geometry=list_item_10)  # -> Area, Centroid
negative_7 = Negative(Value=number_slider_25)
scale_3 = Scale(Geometry=move_18.Geometry, Center=area_16.Centroid, Factor=Slider(1.3, range=0..10))  # -> Geometry, Transform
offset_surface = OffsetSurface(Surface=extrude_5, Distance=number_slider_25, BothSides=negative_6, CreateSolid=True)  # -> simplify(Offset)
move_19 = Move(Geometry=brep_8, Motion=unit_z_14)  # -> Geometry, Transform
offset_surface_2 = OffsetSurface(Surface=extrude_6, Distance=Slider(1, range=0..10), BothSides=0, CreateSolid=True)
explode_6 = Explode(Curve=scale_3.Geometry, Recursive=True)  # -> Segments, Vertices
shatter = Shatter()
offset_surface_3 = OffsetSurface(Surface=extrude_7, Distance=number_slider_25, BothSides=negative_7, CreateSolid=True)  # -> simplify(Offset)
boundary_surfaces_3 = BoundarySurfaces(Edges=scale_3.Geometry)
scale_4 = Scale(Geometry=explode_5.Segments, Center=area_17.Centroid, Factor=Slider(1.06, range=0..10))  # -> Geometry, Transform
unit_z_16 = UnitZ(Factor=Slider(0.9, range=0..10))
number_slider_26 = Slider(2, range=0..10)
list_item_11 = ListItem(List=explode_6.Segments, Index=Slider(1, range=0..5), Wrap=True)
list_item_12 = ListItem(List=explode_6.Segments, Index=Slider(3, range=0..5), Wrap=True)
list_item_13 = ListItem(List=explode_6.Segments, Index=Slider(5, range=0..5), Wrap=True)
unit_z_17 = UnitZ(Factor=number_slider_26)
curve_middle_4 = CurveMiddle(Curve=list_item_11)
curve_middle_5 = CurveMiddle(Curve=list_item_12)
curve_middle_6 = CurveMiddle(Curve=list_item_13)
extrude_8 = Extrude(Base=move_19.Geometry, Direction=unit_z_16)
merge_12 = Merge(Data1=extrude_8, Data2=offset_surface_2, Data3=offset_surface, Data4=offset_surface_3)
boundary_surfaces_4 = BoundarySurfaces(Edges=scale_4.Geometry)
unit_z_18 = UnitZ(Factor=number_slider_26)
line_8 = Line(StartPoint=area_16.Centroid, EndPoint=curve_middle_4)
line_9 = Line(StartPoint=area_16.Centroid, EndPoint=curve_middle_5)
line_10 = Line(StartPoint=area_16.Centroid, EndPoint=curve_middle_6)
surface_split_3 = SurfaceSplit(Surface=boundary_surfaces_3, Curves=[line_8, line_9, line_10])
extrude_9 = Extrude(Base=surface_split_3, Direction=unit_z_17)
extrude_10 = Extrude(Base=boundary_surfaces_4, Direction=unit_z_18)
colour_swatch = ColourSwatch(SwatchColor=RGBA(41, 90, 86, 86))
colour_swatch_2 = ColourSwatch(SwatchColor=RGBA(242, 129, 226, 106))
geometry_14 = Geometry(extrude_9)
geometry_15 = Geometry(extrude_10)
scale_nu = ScaleNU(Geometry=geometry_15, Plane=PlaneXY(0, 0, 0), ScaleX=1, ScaleY=Slider(1.2, range=0..10), ScaleZ=1)  # -> Geometry, Transform

# ----
# roof1
# beam1
preview_19 = CustomPreview(Geometry=cap_holes_4, Material=colour_swatch_2)
preview_20 = CustomPreview(Geometry=scale_nu.Geometry, Material=colour_swatch)

preview_21 = CustomPreview(Geometry=merge_7, Material=ColourSwatch(SwatchColor=RGBA(24, 255, 226, 106)))
preview_22 = CustomPreview(Geometry=cluster.result, Material=ColourSwatch(SwatchColor=RGBA(227, 228, 50, 106)))
preview_23 = CustomPreview(Geometry=cluster_2, Material=ColourSwatch(SwatchColor=RGBA(228, 96, 23, 106)))  # disabled
# old roof
preview_24 = CustomPreview(Geometry=merge_12, Material=ColourSwatch(SwatchColor=RGBA(171, 197, 196, 175)))  # disabled
# cup
preview_25 = CustomPreview(Geometry=loft_4, Material=ColourSwatch(SwatchColor=RGBA(75, 214, 79, 106)))

# ----
# roof2
# beam2
preview_26 = CustomPreview(Geometry=cap_holes_3, Material=colour_swatch_2)
preview_27 = CustomPreview(Geometry=geometry_14, Material=colour_swatch)

# ==== cluster BranchLook: To see the condition of branch data.
data = ClusterInput()
data_2 = Data(data)
tstat = TreeStatistics(Tree=data_2)  # -> Paths, Length, Count
i = ClusterInput()
item = ListItem(List=tstat.Paths, Index=i, Wrap=True)
branch = TreeBranch(Tree=data_2, Path=item, MaintainPaths=True)
B = ClusterOutput(branch)

# ==== cluster OverlapCompute
T = ClusterInput()
flatten = FlattenTree(Tree=T, Path="{0}")
T_2 = ClusterOutput(flatten)
volume = Volume(Geometry=flatten)  # -> Volume, flatten(Centroid)
prox = Proximity3D(Points=volume.Centroid, Group=Slider(6, range=0..10), MaxRadius=Slider(13, range=0..100))  # -> Links, Topology
pdecon = Deconstruct(Point=graft(volume.Centroid))  # -> XComponent, YComponent, ZComponent
graft = GraftTree(Tree=flatten, IncludeEmptyLists=True, IncludeNullItems=True)
item = ListItem(List=volume.Centroid, Index=prox.Topology, Wrap=True)
addition = Addition(A=pdecon.ZComponent, B="1")
pdecon_2 = Deconstruct(Point=item)  # -> XComponent, YComponent, ZComponent
smaller = SmallerThan(FirstNumber=pdecon_2.ZComponent, SecondNumber=addition)  # -> SmallerThan, OrEqualTo
dispatch = Dispatch(List=prox.Topology, DispatchPattern=smaller.SmallerThan)  # -> ListA, ListB
item_2 = ListItem(List=flatten, Index=dispatch.ListA, Wrap=True)
sunion = SolidUnion(Breps=item_2)
c_script = CSharpScript(x=item_2)  # -> out, a; inputs x: list of Brep; disabled
# ---------- c_script: C# ----------
    Brep[] b = Brep.CreateBooleanUnion(x, 0.001);
    a = b;
# ---------- end c_script ----------
python = GhPythonScript(x=item_2)  # -> out, a; inputs x: list of Brep; disabled
# ---------- python: Python ----------
import Rhino.Geometry as rg

a = rg.Brep.CreateBooleanUnion(x, 0.01)
# ---------- end python ----------
sint = SolidIntersection(BrepsA=sunion, BrepsB=graft)
volume_2 = Volume(Geometry=sint)  # -> Volume, Centroid
null = NullItem(Item=volume_2.Volume)  # -> NullFlags, InvalidFlags, Description
volume_3 = Volume(Geometry=sint)  # -> Volume, Centroid
weave = Weave(Pattern=null.NullFlags, Stream0=volume_2.Volume, Stream1="0", NullGaps=False)
smaller_2 = SmallerThan(FirstNumber=weave, SecondNumber="0")  # -> SmallerThan, OrEqualTo
ma = MassAddition(Input=weave)  # -> flatten(Result), PartialResults
dispatch_2 = Dispatch(List=weave, DispatchPattern=smaller_2.SmallerThan)  # -> ListA, ListB
bnd = Bounds(Numbers=flatten(dispatch_2.ListB))
dedomain = DeconstructDomain(Domain=bnd)  # -> Start, End
gradient = Gradient(
    LowerLimit=dedomain.End,
    UpperLimit=dedomain.Start,
    Parameter=ma.Result,
    stops=[0: RGB(234, 38, 0), 0.25: RGB(234, 126, 0), 0.5: RGB(254, 244, 84), 0.75: RGB(173, 203, 249), 1: RGB(75, 107, 169)])
C = ClusterOutput(gradient)

# ==== cluster Column
S = ClusterInput()
layerheight = ClusterInput()
contour = Contour(Shape=S, Point=Point(0, 0, 0), Direction=Vector(0, 0, 1), Distance=layerheight)  # -> flatten(Contours)
panel = Panel("""0
0.25""")
midpt = CurveMiddle(Curve=contour)
shatter = Shatter(Curve=reparameterize(contour), Parameters=panel)
item = ListItem(List=shatter, Index=0, Wrap=True)  # -> flatten(Item)
flip = FlipCurve(Curve=item)  # -> Curve, Flag
dispatch = Dispatch(List=flip.Curve, DispatchPattern=[True, False])  # -> ListA, ListB
ext = ExtendCurve(Curve=dispatch.ListA, Type=0, Start="-3.5", End="0")
weave = Weave(Pattern=[0, 1], Stream0=ext, Stream1=dispatch.ListB, NullGaps=False)
crv = Curve(weave)
crv_2 = Curve(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)
python = GhPythonScript(iCurve=crv, iChunkOutline=crv_2)  # -> oChunkOutline, oPt; inputs iCurve: Curve, iChunkOutline: Curve
# ---------- python: Python ----------
import Rhino.Geometry as rg
from ghpythonlib.components import Area, Length, Seam
from copy import deepcopy

class Model:
    def __init__(self, curve, chunkOutline):
        self.curve = curve
        self.chunkOutline = chunkOutline
        self.chunks = self.chunkProcess(self.chunkOutline, self.curve)
    
    def chunkProcess(self, chunk, crv):
        self.pttt = []

        self.check = []
        crv.Domain = rg.Interval(0,1)
        
        ptList = [crv.PointAtStart]
        self.chunkCrvList = []
        stPt = crv.PointAt(0)
        self.crv = crv
        self.chunkArray(chunk, crv, stPt, [50,0], ptList, self.chunkCrvList)

    def chunkArray(self, chunk, layerCrv, pt, counter, ptList, chunkCrvList):
        chunkClone = deepcopy(chunk)
        centPt = Area(chunk)[1]
        trans = rg.Transform.Translation(pt - centPt)
        chunkClone.Transform(trans)
        
        vec = rg.Point3d.Add(rg.Point3d(0,0,0),(pt - centPt))
        chunkClone2 = deepcopy(chunkClone)
        trans2 = rg.Transform.Scale(Area(chunkClone)[1],2)
        chunkClone2.Transform(trans2)
        
        pts = []
        events = rg.Intersect.Intersection.CurveCurve(layerCrv, chunkClone2, tolerance=0.1, overlapTolerance=0.1)
        
        self.layerCrv = layerCrv
        self.chunkClone2 = chunkClone2
        
        for i in range(len(events)):
            pts.append(events[i].PointA)
        
        
        if counter[1]==0:
            nextPt = pts
        elif len(pts)>1:
            t_0 = layerCrv.ClosestPoint(pts[0])[1]
            t_1 = layerCrv.ClosestPoint(pts[1])[1]
            if t_0<t_1:
                pts = pts
            else:
                pts.reverse()
        
            pts.reverse()
        
        nextPt = pts[0]
        ptList.append(nextPt)
        chunkCrvList.append(chunkClone)
        
        counter[0] = counter[0]-1
        counter[1] = counter[1]+1
        if len(pts)>1 and counter[0]>0:
            self.chunkArray(chunk, layerCrv, nextPt, counter, ptList, chunkCrvList)
        
        elif counter[1]==1 and counter[0]>0:
            self.chunkArray(chunk, layerCrv, nextPt, counter, ptList, chunkCrvList)
            
        
        
    def remap(self, value, low1, high1, low2, high2):
        new_value = low2 + (value-low1)*(high2-low2)/(high1-low1)
        return new_value



testModel = Model(iCurve, iChunkOutline)

oChunkOutline = testModel.chunkCrvList
oPt = Area(oChunkOutline)[1]
# ---------- end python ----------
item_2 = ListItem(List=contour, Index=0, Wrap=True)
area = Area(Geometry=item_2)  # -> Area, Centroid
xz = XZPlane(Origin=area.Centroid)
mirror = Mirror(Geometry=python.oPt, Plane=xz)  # -> Geometry, Transform
graft = GraftTree(Tree=simplify(mirror.Geometry), IncludeEmptyLists=True, IncludeNullItems=True)
graft_2 = GraftTree(Tree=simplify(python.oPt), IncludeEmptyLists=True, IncludeNullItems=True)
merge = Merge(Data1=graft_2, Data2=graft)
eval = EvaluateCurve(Curve=reparameterize(contour), Parameter="0")  # -> graft(Point), Tangent, Angle
cullpt = CullDuplicates(Points=merge, Tolerance=Slider(0, range=0..20), CullMode=3)  # -> simplify(Points), Indices, Valence
lng = ListLength(List=cullpt.Points)
shift = ShiftPaths(Data=merge, Offset=-1)
panel_2 = Panel(lng)
centpt = Point(simplify(eval.Point))
allpt = Point(shift)
cps = ClosestPoints(Point=centpt, Cloud=allpt, Count="2")  # -> ClosestPoint, CPIndex, Distance
item_3 = ListItem(List=allpt, Index=cps.CPIndex, Wrap=True)  # -> simplify(Item)
cull_i = CullIndex(List=allpt, Indices=cps.CPIndex, Wrap=True)  # -> simplify(List)
ichunklength = ClusterInput()
itolerance = ClusterInput()
python_2 = GhPythonScript(iChunkLength=ichunklength, iMiddlePt=centpt, iSidePts=item_3, iAllPts=cull_i, iTolerance=itolerance)  # -> out, simplify(sideNewPts), addType; inputs iMiddlePt: tree of Point3d, iSidePts: tree of Point3d, iAllPts: tree of Point3d
# ---------- python_2: Python ----------
import Rhino.Geometry as rg
import ghpythonlib.treehelpers as th


sideNewPts = []
addType = [0]
for i, sidePts in enumerate(iSidePts.Branches):
    temp = []
    pt_0 = sidePts[0]
    pt_1 = sidePts[1]
    dist = rg.Point3d.DistanceTo(pt_0, pt_1)
    
    # Merge if dist within iTolerance
    if dist < iTolerance:
        temp.extend(iMiddlePt.Branches[i])
        addType.append(0)
        
    # Add new middle pt between far dist
    elif dist > iChunkLength:
        temp.extend([iMiddlePt.Branches[i][0]])
        temp.extend([pt_0])
        temp.extend([pt_1])
        addType.append(0)
        
    # Move two pts farther if a little overlap 
    elif dist < iChunkLength:
        apart = (iChunkLength - dist)/2
        vec_0 = pt_0 - pt_1
        vec_1 = pt_1 - pt_0
        vec_0.Unitize()
        vec_1.Unitize()
        vec_0 = rg.Vector3d.Multiply(vec_0, apart)
        vec_1 = rg.Vector3d.Multiply(vec_1, apart)
        tran_0 = rg.Transform.Translation(vec_0)
        tran_1 = rg.Transform.Translation(vec_1)
        pt_0.Transform(tran_0)
        pt_1.Transform(tran_1)
        temp.extend([pt_0])
        temp.extend([pt_1])
        addType.append(1)
        
    
    if addType[i+1]==1 and addType[i]==1:
        if i == 0:
            x = rg.Vector3d(2,0,0)
        else:
            x = rg.Vector3d(0,0,0)
        tran = rg.Transform.Translation(x)
        pp = iMiddlePt.Branches[i][0]
        print(pp)
        pp.Transform(tran)
        temp.extend([pp])
        addType[i+1]=0
        
        
    sideNewPts.append(temp)
        
sideNewPts = th.list_to_tree(sideNewPts)
# ---------- end python_2 ----------
item_4 = ListItem(List=contour, Index=0, Wrap=True)
custom_mesh_settings = SettingsCustom(
    StitchSeams=True,
    SimplePlanes=False,
    Refine=True,
    MinCount=16,
    MaxCount=400,
    AspectRatio=20,
    MaxDistance=0,
    MaxAngle=20,
    MinEdge=0,
    MaxEdge=0)
area_2 = Area(Geometry=item_4)  # -> Area, Centroid
geometry = Geometry(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)
yz = YZPlane(Origin=area_2.Centroid)
pt = Point(python_2.sideNewPts)
merge_2 = Merge(Data1=cull_i, Data2=python_2.sideNewPts)
area_3 = Area(Geometry=geometry)  # -> Area, Centroid
mesh_brep = MeshBrep(Brep=geometry, Settings=custom_mesh_settings)
mirror_2 = Mirror(Geometry=merge_2, Plane=yz)  # -> Geometry, Transform
orient = Orient(Geometry=geometry, Source=area_3.Centroid, Target=merge_2)  # -> Geometry, Transform
merge_3 = Merge(Data1=merge_2, Data2=mirror_2.Geometry)
duppt = RemoveDuplicatePts(Points=merge_3, Tolerance=0.01)
brep = Brep(orient.Geometry)
Q = ClusterOutput(duppt)
preview = CustomPreview(Geometry=flatten(brep), Material=ColourSwatch(SwatchColor=RGB(189, 189, 189)))  # disabled

# ==== cluster Wall
B = ClusterInput()
edges = BrepEdges(Brep=B)  # -> Naked, Interior, NonManifold
item = ListItem(List=flatten(edges.Interior), Index=0, Wrap=True)  # -> Item, Item1
l1 = ClusterInput()
l1_2 = ClusterInput()
G = ClusterInput()
ext = ExtendCurve(Curve=item.Item, Type=0, Start="0", End=l1)
F = ClusterInput()
ext_2 = ExtendCurve(Curve=item.Item1, Type=0, Start="0", End=l1_2)
project = Project(Geometry=G, Plane=PlaneXY(0, 0, 0))  # -> Geometry, Transform
Z = UnitZ(Factor=F)
entwine = Entwine(Branch00=ext, Branch01=ext_2, FlattenInputs=True)
move = Move(Geometry=project.Geometry, Motion=Z)  # -> Geometry, Transform
end = EndPoints(Curve=entwine)  # -> Start, End
item_2 = ListItem(List=flatten(end.End), Index=0, Wrap=True)  # -> Item, Item1
item_3 = ListItem(List=flatten(end.Start), Index=0, Wrap=True)  # -> Item, Item1
entwine_2 = Entwine(Branch00=item_2.Item, Branch01=move.Geometry, Branch02=item_2.Item1, FlattenInputs=True)  # -> flatten(Result)
ln = Line(StartPoint=item_3.Item, EndPoint=item_3.Item1)
intcrv = Interpolate(Vertices=entwine_2, Degree=3, Periodic=False, KnotStyle=1)  # -> Curve, Length, Domain
entwine_3 = Entwine(Branch00=intcrv.Curve, Branch01=entwine, Branch02=ln, FlattenInputs=True)  # -> flatten(Result)
boundary = BoundarySurfaces(Edges=entwine_3)
X = UnitX(Factor=1)
D = ClusterInput()
D_2 = ClusterInput()
contour = Contour(Shape=boundary, Point=Point(0, 0, 0), Direction=Vector(0, 0, 1), Distance=D)
contour_2 = Contour(Shape=boundary, Point=project.Geometry, Direction=X, Distance=D_2)
midpt = CurveMiddle(Curve=contour_2)  # -> flatten(Midpoint)
tstat = TreeStatistics(Tree=contour)  # -> Paths, Length, Count
dispatch = Dispatch(List=tstat.Paths, DispatchPattern=[True, False])  # -> ListA, ListB
project_2 = Project(Geometry=midpt, Plane=PlaneXY(0, 0, 0))  # -> Geometry, Transform
yz = YZPlane(Origin=project_2.Geometry)
branch = TreeBranch(Tree=contour, Path=dispatch.ListA, MaintainPaths=True)
branch_2 = TreeBranch(Tree=contour, Path=dispatch.ListB, MaintainPaths=True)
crv = Curve(branch)
crv_2 = Curve(branch_2)
lng = ListLength(List=yz)
shift = ShiftList(List=yz, Shift=1, Wrap=invert(True))  # -> graft(List)
culln = CullNth(List=yz, CullFrequency=lng)  # -> graft(List)
avrpln = AveragePlane(Planes=[culln, shift])  # -> flatten(ArithmeticMean)
pcx = CurvePlane(Curve=graft(crv_2), Plane=avrpln)  # -> Points, ParamsC, ParamsP
pcx_2 = CurvePlane(Curve=graft(crv), Plane=yz)  # -> Points, ParamsC, ParamsP
shift_2 = ShiftPaths(Data=pcx_2.Points, Offset="-2")  # -> simplify(Data)
shift_3 = ShiftPaths(Data=pcx.Points, Offset="-2")  # -> simplify(Data)
merge = Merge(Data1=shift_2, Data2=shift_3)
R = ClusterOutput(merge)

# ==== cluster Path
brep = ClusterInput()
brep_2 = Brep(simplify(graft(brep)))
D = ClusterInput()
contour = Contour(Shape=brep_2, Point=Point(0, 0, 0), Direction=Vector(0, 0, 1), Distance=D)
shift = ShiftPaths(Data=contour, Offset=-1)
bang = ExplodeTree(Data=shift)  # -> Branch0, Branch1, Branch2
flip = FlipCurve(Curve=bang.Branch1)  # -> Curve, Flag
merge = Merge(Data1=bang.Branch0, Data2=flip.Curve, Data3=bang.Branch2)
panel = Panel("-5")
ext = ExtendCurve(Curve=merge, Type=0, Start="0", End="-0.2")
end = EndPoints(Curve=ext)  # -> Start, End
flip_2 = FlipMatrix(Data=end.End)
flip_3 = FlipMatrix(Data=end.Start)
flip_4 = FlipMatrix(Data=ext)
item = ListItem(List=flip_3, Index=0, Wrap=True)  # -> Item, Item1, Item2
item_2 = ListItem(List=flip_2, Index="1", Wrap=True)
ln = Line(StartPoint=item.Item, EndPoint=item_2)
ln_2 = Line(StartPoint=item.Item1, EndPoint=item.Item2)
merge_2 = Merge(Data1=ln, Data2=ln_2, Data3=flip_4)
join = JoinCurves(Curves=merge_2, Preserve=False)  # -> flatten(Curves)
panel_2 = Panel("""0
1""")
sift = SiftPattern(List=join, SiftPattern=panel_2)  # -> Output0, Output1
flip_5 = FlipCurve(Curve=sift.Output0)  # -> Curve, Flag
combine = CombineData(Input0=flip_5.Curve, Input1=sift.Output1)  # -> Result, Index
divlength = DivideLength(Curve=combine.Result, Length="1")  # -> Points, Tangents, Parameters
lng = ListLength(List=divlength.Points)
divide = DivideCurve(Curve=graft(combine.Result), Count=lng, Kinks=False)  # -> flatten(Points), Tangents, Parameters
pline = PolyLine(Vertices=divide.Points, Closed=False)
pl = ClusterOutput(pline)

# ==== cluster Cluster
curve = ClusterInput()
distance = ClusterInput()
offset_curve = OffsetCurve(Curve=curve, Distance=distance, Corners=1)
explode = Explode(Curve=offset_curve, Recursive=True)  # -> simplify(graft(Segments)), Vertices
distance_2 = ClusterInput()
offset_curve_2 = OffsetCurve(Curve=explode.Segments, Distance=distance_2, Corners=1)  # -> simplify(Curve)
loft = Loft(
    Curves=[offset_curve_2, explode.Segments],
    Options={Adjust=False, Closed=False, LoftEnds=0, LoftSimp=0, LoftType=0, Rebuild=10, Refit=0.01})
factor = ClusterInput()
unit_z = UnitZ(Factor=factor)
factor_2 = ClusterInput()
extrude = Extrude(Base=loft, Direction=unit_z)
unit_z_2 = UnitZ(Factor=factor_2)
move = Move(Geometry=extrude, Motion=unit_z_2)  # -> Geometry, Transform
geometry = ClusterOutput(move.Geometry)

# ==== cluster Cluster_2
value = ClusterInput()
negative = Negative(Value=value)
domain_end = ClusterInput()
domain_end_2 = ClusterInput()
construct_domain = ConstructDomain(DomainStart=negative, DomainEnd=domain_end)
construct_domain_2 = ConstructDomain(DomainStart=negative, DomainEnd=domain_end_2)
plane = ClusterInput()
factor = ClusterInput()
rectangle = Rectangle(Plane=plane, XSize=construct_domain_2, YSize=construct_domain, Radius=0)  # -> Rectangle, Length
unit_z = UnitZ(Factor=factor)
geometry = ClusterInput()
factor_2 = ClusterInput()
move = Move(Geometry=geometry, Motion=unit_z)  # -> Geometry, Transform
boundary_surfaces = BoundarySurfaces(Edges=rectangle.Rectangle)
division = Division(A=Slider(3.5, range=0..10), B=domain_end_2)
unit_z_2 = UnitZ(Factor=factor_2)
extrude = Extrude(Base=boundary_surfaces, Direction=unit_z_2)
geometry_2 = Geometry(move.Geometry)
geometry_3 = ClusterOutput(geometry_2)
bounding_box = BoundingBox(Content=geometry_2, Plane=PlaneXY(0, 0, 0))  # -> Box, Box_2
bounding_box_2 = BoundingBox(Content=extrude, Plane=PlaneXY(0, 0, 0))  # -> Box, Box_2
deconstruct_brep = DeconstructBrep(Brep=bounding_box.Box)  # -> Faces, Edges, Vertices
deconstruct_brep_2 = DeconstructBrep(Brep=bounding_box_2.Box)  # -> Faces, Edges, Vertices
list_item = ListItem(List=deconstruct_brep.Faces, Index=Slider(4, range=0..5), Wrap=True)
plane_2 = ClusterInput()
radius = ClusterInput()
factor_3 = ClusterInput()
list_item_2 = ListItem(List=deconstruct_brep_2.Faces, Index=Slider(5, range=0..5), Wrap=True)
circle = Circle(Plane=plane_2, Radius=radius)
unit_z_3 = UnitZ(Factor=factor_3)
area = Area(Geometry=list_item_2)  # -> Area, Centroid
area_2 = Area(Geometry=list_item)  # -> Area, Centroid
extrude_2 = Extrude(Base=circle, Direction=unit_z_3)  # -> simplify(Extrusion)
orient = Orient(Geometry=extrude, Source=area.Centroid, Target=area_2.Centroid)  # -> Geometry, Transform
cap_holes = CapHoles(Brep=extrude_2)
geometry_4 = Geometry(orient.Geometry)
area_3 = Area(Geometry=geometry_4)  # -> Area, Centroid
scale = Scale(Geometry=geometry_4, Center=area_3.Centroid, Factor=division)  # -> Geometry, Transform
merge = Merge(Data1=scale.Geometry, Data2=cap_holes, Data3=extrude)
result = ClusterOutput(merge)

# ==== cluster Cluster_3
brep = ClusterInput()
deconstruct_brep = DeconstructBrep(Brep=brep)  # -> Faces, simplify(Edges), simplify(Vertices)
explode_tree = ExplodeTree(Data=deconstruct_brep.Vertices)  # -> Branch0, Branch1, Branch2
list_item = ListItem(List=explode_tree.Branch2, Index=Slider(5, range=0..7), Wrap=True)
list_item_2 = ListItem(List=explode_tree.Branch0, Index=Slider(5, range=0..7), Wrap=True)
list_item_3 = ListItem(List=explode_tree.Branch1, Index=Slider(5, range=0..7), Wrap=True)
merge = Merge(Data1=list_item_2, Data2=list_item_3, Data3=list_item)
polyline = PolyLine(Vertices=flatten(merge), Closed=invert(False))
boundary_surfaces = BoundarySurfaces(Edges=polyline)
area = Area(Geometry=boundary_surfaces)  # -> Area, Centroid
factor = ClusterInput()
factor_2 = ClusterInput()
unit_z = UnitZ(Factor=factor)
scale = Scale(Geometry=boundary_surfaces, Center=area.Centroid, Factor=factor_2)  # -> Geometry, Transform
extrude = Extrude(Base=scale.Geometry, Direction=unit_z)
extrusion = ClusterOutput(extrude)

# ==== cluster Cluster_4
A = ClusterInput()
A_2 = ClusterInput()
division = Division(A=A, B=2)
division_2 = Division(A=A_2, B=2)
curve = ClusterInput()
negative = Negative(Value=division)
negative_2 = Negative(Value=division_2)
perp_frame = PerpFrame(Curve=reparameterize(graft(curve)), Parameter=[Slider(0, range=0..100), Slider(1, range=0..1)])
construct_domain = ConstructDomain(DomainStart=division, DomainEnd=negative)
construct_domain_2 = ConstructDomain(DomainStart=division_2, DomainEnd=negative_2)
rectangle = Rectangle(Plane=PlaneXY(0, 0, 0), XSize=construct_domain, YSize=construct_domain_2, Radius=0)  # -> Rectangle, Length
orient = Orient(Geometry=rectangle.Rectangle, Source=PlaneXY(0, 0, 0), Target=perp_frame)  # -> Geometry, Transform
loft = Loft(Curves=orient.Geometry, Options={Adjust=False, Closed=False, LoftEnds=0, LoftSimp=0, LoftType=0, Rebuild=10, Refit=0.01})  # -> flatten(Loft)
loft_2 = ClusterOutput(loft)
