# Grasshopper definition Lie_Flat.ghx (Grasshopper 1.0.7)
# plug-ins: Pufferfish

point = Point(Point(-8.755820966, -97.54357692, 0))
point_2 = Point(Point(-8.755820966, -97.54357692, 0))
unit_z = UnitZ(Factor=Slider(200, range=0..200))
unit_z_2 = UnitZ(Factor=Slider(200, range=0..200))
unit_z_3 = UnitZ(Factor=Slider(78.53, range=0..200))
unit_z_4 = UnitZ(Factor=Slider(78.53, range=0..200))
move = Move(Geometry=point, Motion=unit_z)  # -> Geometry, Transform
move_2 = Move(Geometry=point_2, Motion=unit_z_2)  # -> Geometry, Transform
move_3 = Move(Geometry=point, Motion=unit_z_3)  # -> Geometry, Transform
move_4 = Move(Geometry=point_2, Motion=unit_z_4)  # -> Geometry, Transform
multiplication = Multiplication(A=Slider(7, range=0..10), B=Slider(1.5, range=0..10))
multiplication_2 = Multiplication(A=Slider(7, range=0..10), B=Slider(1.5, range=0..10))
multiplication_3 = Multiplication(A=Slider(7, range=0..10), B=Slider(1.3, range=0..10))
multiplication_4 = Multiplication(A=Slider(7, range=0..10), B=Slider(1.3, range=0..10))
multiplication_5 = Multiplication(A=Slider(7, range=0..10), B=Slider(3.1, range=0..10))
multiplication_6 = Multiplication(A=Slider(7, range=0..10), B=Slider(3.1, range=0..10))
multiplication_7 = Multiplication(A=Slider(7, range=0..10), B=Slider(6.4, range=0..10))
multiplication_8 = Multiplication(A=Slider(7, range=0..10), B=Slider(2.5, range=0..10))
multiplication_9 = Multiplication(A=Slider(7, range=0..10), B=Slider(6.4, range=0..10))
multiplication_10 = Multiplication(A=Slider(7, range=0..10), B=Slider(2.5, range=0..10))
multiplication_11 = Multiplication(A=Slider(7, range=0..10), B=Slider(3, range=0..10))
multiplication_12 = Multiplication(A=Slider(7, range=0..10), B=Slider(3, range=0..10))
ellipse = Ellipse(Plane=move.Geometry, Radius1=multiplication, Radius2=multiplication_3)  # -> Ellipse, Focus1, Focus2
ellipse_2 = Ellipse(Plane=move_2.Geometry, Radius1=multiplication_2, Radius2=multiplication_4)  # -> Ellipse, Focus1, Focus2
ellipse_3 = Ellipse(Plane=move_3.Geometry, Radius1=multiplication_5, Radius2=multiplication_8)  # -> Ellipse, Focus1, Focus2
ellipse_4 = Ellipse(Plane=move_4.Geometry, Radius1=multiplication_6, Radius2=multiplication_10)  # -> Ellipse, Focus1, Focus2
ellipse_5 = Ellipse(Plane=point, Radius1=multiplication_7, Radius2=multiplication_11)  # -> Ellipse, Focus1, Focus2
ellipse_6 = Ellipse(Plane=point_2, Radius1=multiplication_9, Radius2=multiplication_12)  # -> Ellipse, Focus1, Focus2
merge = Merge(Data1=ellipse_5.Ellipse, Data2=ellipse_3.Ellipse, Data3=ellipse.Ellipse)
merge_2 = Merge(Data1=ellipse_6.Ellipse, Data2=ellipse_4.Ellipse, Data3=ellipse_2.Ellipse)
loft = Loft(Curves=merge, Options={Adjust=False, Closed=False, LoftEnds=0, LoftSimp=0, LoftType=0, Rebuild=10, Refit=0.01})
loft_2 = Loft(Curves=merge_2, Options={Adjust=False, Closed=False, LoftEnds=0, LoftSimp=0, LoftType=0, Rebuild=10, Refit=0.01})
geometry = Geometry(loft)
area = Area(Geometry=geometry)  # -> Area, Centroid
X = UnitX(Factor=Slider(70, range=50..200))
move_5 = Move(Geometry=area.Centroid, Motion=X)  # -> Geometry, Transform
yz = YZPlane(Origin=area.Centroid)
orient = Orient(Geometry=geometry, Source=move_5.Geometry, Target=area.Centroid)  # -> Geometry, Transform
orient_2 = Orient(Geometry=loft_2, Source=move_5.Geometry, Target=area.Centroid)  # -> Geometry, Transform
mirror = Mirror(Geometry=orient_2.Geometry, Plane=yz)  # -> Geometry, Transform
brep = Brep(mirror.Geometry)
brep_2 = Brep(orient.Geometry)
number_slider = Slider(15, range=10..20)
number_slider_2 = Slider(4.69, range=0..10)
number_slider_3 = Slider(4.5, range=0..10)
brep_3 = Brep([brep_2, brep])
brep_4 = Brep([brep_2, brep])
wall = Wall(
    B=brep_3,
    l1=Slider(-20, range=-200..0),
    l1_2=Slider(-20, range=-200..0),
    G=area.Centroid,
    D=number_slider_3,
    F=Slider(40, range=0..200),
    D_2="7")
column = Column(S=brep_2, layerheight=number_slider_3, ichunklength=number_slider, itolerance=number_slider_2)
column_2 = Column(S=brep, layerheight=number_slider_3, ichunklength=number_slider, itolerance=number_slider_2)
path = Path(brep=brep_4, D=number_slider_3)
custom_mesh_settings = SettingsCustom(
    StitchSeams=True,
    SimplePlanes=False,
    Refine=True,
    MinCount=16,
    MaxCount=400,
    AspectRatio=20,
    MaxDistance=0,
    MaxAngle=20,
    MinEdge=0,
    MaxEdge=0)
geometry_2 = Geometry(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)
area_2 = Area(Geometry=geometry_2)  # -> Area, Centroid
mesh_brep = MeshBrep(Brep=geometry_2, Settings=custom_mesh_settings)
orient_3 = Orient(Geometry=geometry_2, Source=area_2.Centroid, Target=[column, column_2])  # -> Geometry, Transform
pt = Point(simplify(column_2))
pt_2 = Point(simplify(column))
brep_5 = Brep(orient_3.Geometry)
merge_3 = Merge(Data1=pt_2, Data2=wall, Data3=pt)
swatch = ColourSwatch(SwatchColor=RGB(255, 255, 255))  # disabled
overlapcompute = OverlapCompute(T=brep_5)  # -> T_2, C; disabled
custom_mesh_settings_2 = SettingsCustom(
    StitchSeams=True,
    SimplePlanes=False,
    Refine=True,
    MinCount=16,
    MaxCount=400,
    AspectRatio=20,
    MaxDistance=0,
    MaxAngle=20,
    MinEdge=0,
    MaxEdge=0)
preview = CustomPreview(Geometry=flatten(overlapcompute.T_2), Material=overlapcompute.C)
geometry_3 = Geometry(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)
area_3 = Area(Geometry=geometry_3)  # -> Area, Centroid
cullpt = CullDuplicates(Points=merge_3, Tolerance=Slider(2.84, range=0..10), CullMode=3)  # -> Points, Indices, Valence
mesh_brep_2 = MeshBrep(Brep=geometry_3, Settings=custom_mesh_settings_2)
alongcrv = SortAlongCurve(Points=cullpt.Points, Curve=path)  # -> Points, Indices
orient_4 = Orient(Geometry=mesh_brep_2, Source=area_3.Centroid, Target=alongcrv.Points)  # -> Geometry, Transform
pline = PolyLine(Vertices=alongcrv.Points, Closed=False)
tstat = TreeStatistics(Tree=orient_3.Geometry)  # -> Paths, Length, Count; disabled
number_slider_4 = Slider(1477, range=0..1499)  # disabled
pt_3 = Point(Tree({0;0;0}: [Point(17.09987444, -105.0435769, 0), Point(23.16628115, -108.6076048, 0), Point(29.91932942, -112.5567104, 0), Point(36.81421074, -115.1464767, 0), Point(43.76732249, -116.879725, 0), Point(50.74917216, -117.9592129, 0)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], {1;0;0}: [Point(-37.67674081, -90.04357692, 4.5), Point(-44.08173777, -85.15261742, 4.5), Point(-50.88694388, -81.63861279, 4.5), Point(-57.80330413, -79.32674803, 4.5), Point(-64.76827327, -77.82796556, 4.5), Point(-71.75700905, -76.97735074, 4.5)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], {2;0;0}: [Point(23.41241108, -106.031393, 9), Point(29.99309214, -111.1449869, 9), Point(36.83978048, -114.2671369, 9), Point(43.77514727, -116.3008061, 9), Point(50.75079057, -117.5510316, 9), Point(57.74521189, -118.1497686, 9)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], {3;0;0}: [Point(-38.85978113, -97.54357692, 13.5), Point(-44.2487152, -87.24866262, 13.5), Point(-50.93947385, -82.83950368, 13.5), Point(-57.82024109, -80.08275125, 13.5), Point(-64.77244602, -78.33287974, 13.5), Point(-71.75739469, -77.34974918, 13.5)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], {4;0;0}: [Point(23.95121531, -105.0435769, 18), Point(30.10864476, -109.4167045, 18), Point(36.87643993, -113.2481357, 18), Point(43.78594587, -115.6522723, 18), Point(50.75298229, -117.1062658, 18), Point(57.74554877, -117.797363, 18)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], {5;0;0}: [Point(-44.55709721, -90.04302225, 22.5), Point(-51.01867937, -84.27401624, 22.5), Point(-57.84415459, -80.94541476, 22.5), Point(-64.77816674, -78.89064427, 22.5), Point(-71.75791623, -77.75049715, 22.5), Point(-78.75582097, -77.38351584, 22.5)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]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))
dispatch = Dispatch(List=tstat.Paths, DispatchPattern=[True, False])  # -> ListA, ListB; disabled
flatten = FlattenTree(Tree=orient_4.Geometry, Path="{0}")
brec = BoundingRectangle(Geometry=flatten(orient_4.Geometry), Plane=PlaneXY(0, 0, 0), Axis=0, Slide=0, Union=True)  # -> Bounding, DimensionX, DimensionY
branch = TreeBranch(Tree=orient_3.Geometry, Path=dispatch.ListB, MaintainPaths=True)  # disabled
branch_2 = TreeBranch(Tree=orient_3.Geometry, Path=dispatch.ListA, MaintainPaths=True)  # disabled
split = SplitList(List=flatten, Index=number_slider_4)  # -> ListA, ListB
number_slider_5 = Slider(15, range=0..20)  # disabled
preview_2 = CustomPreview(
    Geometry=split.ListA,
    Material={diffuse=RGB(221, 160, 221), emission=RGB(66, 48, 66), shine=0.5, specular=RGB(255, 255, 255), transparency=0})  # disabled
geometry_4 = Geometry(simplify(branch))  # disabled
geometry_5 = Geometry(simplify(branch_2))  # disabled
addition = Addition(A=number_slider_5, B=1)  # disabled
addition_2 = Addition(A=number_slider_5, B=2)  # disabled
addition_3 = Addition(A=number_slider_5, B=1)  # disabled
addition_4 = Addition(A=number_slider_5, B=2)  # disabled
cluster = BranchLook(data=geometry_4, i=number_slider_5)  # disabled
cluster_2 = BranchLook(data=geometry_5, i=number_slider_5)  # disabled
cluster_3 = BranchLook(data=geometry_4, i=addition)  # disabled
cluster_4 = BranchLook(data=geometry_4, i=addition_2)  # disabled
cluster_5 = BranchLook(data=geometry_5, i=addition_3)  # disabled
cluster_6 = BranchLook(data=geometry_5, i=addition_4)  # disabled
swatch_2 = ColourSwatch(SwatchColor=RGB(255, 255, 255))  # disabled
swatch_3 = ColourSwatch(SwatchColor=RGB(255, 255, 255))  # disabled
preview_3 = CustomPreview(
    Geometry=geometry_5,
    Material={diffuse=RGB(221, 160, 221), emission=RGB(66, 48, 66), shine=0.5, specular=RGB(255, 255, 255), transparency=0})  # disabled
preview_4 = CustomPreview(Geometry=geometry_4, Material=swatch_2)  # disabled
preview_5 = CustomPreview(Geometry=[cluster, cluster_3, cluster_4], Material=swatch_3)  # disabled
preview_6 = CustomPreview(
    Geometry=[cluster_2, cluster_5, cluster_6],
    Material={diffuse=RGB(221, 160, 221), emission=RGB(66, 48, 66), shine=0.5, specular=RGB(255, 255, 255), transparency=0})  # disabled
tstat_2 = TreeStatistics(Tree=orient_4.Geometry)  # -> Paths, Length, Count
dispatch_2 = Dispatch(List=tstat_2.Paths, DispatchPattern=[True, False])  # -> ListA, ListB
branch_3 = TreeBranch(Tree=orient_4.Geometry, Path=dispatch_2.ListB, MaintainPaths=True)
branch_4 = TreeBranch(Tree=orient_4.Geometry, Path=dispatch_2.ListA, MaintainPaths=True)
number_slider_6 = Slider(0, range=0..20)
geometry_6 = Geometry(simplify(branch_3))
geometry_7 = Geometry(simplify(branch_4))
addition_5 = Addition(A=number_slider_6, B=1)
addition_6 = Addition(A=number_slider_6, B=2)  # disabled
addition_7 = Addition(A=number_slider_6, B=1)
addition_8 = Addition(A=number_slider_6, B=2)  # disabled
cluster_7 = BranchLook(data=geometry_6, i=number_slider_6)
cluster_8 = BranchLook(data=geometry_7, i=number_slider_6)
cluster_9 = BranchLook(data=geometry_6, i=addition_5)
cluster_10 = BranchLook(data=geometry_6, i=addition_6)  # disabled
cluster_11 = BranchLook(data=geometry_7, i=addition_7)
cluster_12 = BranchLook(data=geometry_7, i=addition_8)  # disabled
preview_7 = CustomPreview(
    Geometry=geometry_7,
    Material={diffuse=RGB(221, 160, 221), emission=RGB(66, 48, 66), shine=0.5, specular=RGB(255, 255, 255), transparency=0})
preview_8 = CustomPreview(Geometry=geometry_6, Material=ColourSwatch(SwatchColor=RGB(255, 255, 255)))
preview_9 = CustomPreview(Geometry=[cluster_7, cluster_9, cluster_10], Material=ColourSwatch(SwatchColor=RGB(255, 255, 255)))  # disabled
preview_10 = CustomPreview(
    Geometry=[cluster_8, cluster_11, cluster_12],
    Material={diffuse=RGB(221, 160, 221), emission=RGB(66, 48, 66), shine=0.5, specular=RGB(255, 255, 255), transparency=0})  # disabled

# ==== cluster BranchLook: To see the condition of branch data.
data = ClusterInput()
data_2 = Data(data)
tstat = TreeStatistics(Tree=data_2)  # -> Paths, Length, Count
i = ClusterInput()
item = ListItem(List=tstat.Paths, Index=i, Wrap=True)
branch = TreeBranch(Tree=data_2, Path=item, MaintainPaths=True)
B = ClusterOutput(branch)

# ==== cluster OverlapCompute
T = ClusterInput()
flatten = FlattenTree(Tree=T, Path="{0}")
T_2 = ClusterOutput(flatten)
volume = Volume(Geometry=flatten)  # -> Volume, flatten(Centroid)
prox = Proximity3D(Points=volume.Centroid, Group=Slider(6, range=0..10), MaxRadius=Slider(13, range=0..100))  # -> Links, Topology
pdecon = Deconstruct(Point=graft(volume.Centroid))  # -> XComponent, YComponent, ZComponent
graft = GraftTree(Tree=flatten, IncludeEmptyLists=True, IncludeNullItems=True)
item = ListItem(List=volume.Centroid, Index=prox.Topology, Wrap=True)
addition = Addition(A=pdecon.ZComponent, B="1")
pdecon_2 = Deconstruct(Point=item)  # -> XComponent, YComponent, ZComponent
smaller = SmallerThan(FirstNumber=pdecon_2.ZComponent, SecondNumber=addition)  # -> SmallerThan, OrEqualTo
dispatch = Dispatch(List=prox.Topology, DispatchPattern=smaller.SmallerThan)  # -> ListA, ListB
item_2 = ListItem(List=flatten, Index=dispatch.ListA, Wrap=True)
sunion = SolidUnion(Breps=item_2)
c_script = CSharpScript(x=item_2)  # -> out, a; inputs x: list of Brep; disabled
# ---------- c_script: C# ----------
    Brep[] b = Brep.CreateBooleanUnion(x, 0.001);
    a = b;
# ---------- end c_script ----------
python = GhPythonScript(x=item_2)  # -> out, a; inputs x: list of Brep; disabled
# ---------- python: Python ----------
import Rhino.Geometry as rg

a = rg.Brep.CreateBooleanUnion(x, 0.01)
# ---------- end python ----------
sint = SolidIntersection(BrepsA=sunion, BrepsB=graft)
volume_2 = Volume(Geometry=sint)  # -> Volume, Centroid
null = NullItem(Item=volume_2.Volume)  # -> NullFlags, InvalidFlags, Description
volume_3 = Volume(Geometry=sint)  # -> Volume, Centroid
weave = Weave(Pattern=null.NullFlags, Stream0=volume_2.Volume, Stream1="0", NullGaps=False)
smaller_2 = SmallerThan(FirstNumber=weave, SecondNumber="0")  # -> SmallerThan, OrEqualTo
ma = MassAddition(Input=weave)  # -> flatten(Result), PartialResults
dispatch_2 = Dispatch(List=weave, DispatchPattern=smaller_2.SmallerThan)  # -> ListA, ListB
bnd = Bounds(Numbers=flatten(dispatch_2.ListB))
dedomain = DeconstructDomain(Domain=bnd)  # -> Start, End
gradient = Gradient(
    LowerLimit=dedomain.End,
    UpperLimit=dedomain.Start,
    Parameter=ma.Result,
    stops=[0: RGB(234, 38, 0), 0.25: RGB(234, 126, 0), 0.5: RGB(254, 244, 84), 0.75: RGB(173, 203, 249), 1: RGB(75, 107, 169)])
C = ClusterOutput(gradient)

# ==== cluster Column
S = ClusterInput()
layerheight = ClusterInput()
contour = Contour(Shape=S, Point=Point(0, 0, 0), Direction=Vector(0, 0, 1), Distance=layerheight)  # -> flatten(Contours)
panel = Panel("""0
0.25""")
midpt = CurveMiddle(Curve=contour)
shatter = Shatter(Curve=reparameterize(contour), Parameters=panel)
item = ListItem(List=shatter, Index=0, Wrap=True)  # -> flatten(Item)
flip = FlipCurve(Curve=item)  # -> Curve, Flag
dispatch = Dispatch(List=flip.Curve, DispatchPattern=[True, False])  # -> ListA, ListB
ext = ExtendCurve(Curve=dispatch.ListA, Type=0, Start="-3.5", End="0")
weave = Weave(Pattern=[0, 1], Stream0=ext, Stream1=dispatch.ListB, NullGaps=False)
crv = Curve(weave)
crv_2 = Curve(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)
python = GhPythonScript(iCurve=crv, iChunkOutline=crv_2)  # -> oChunkOutline, oPt; inputs iCurve: Curve, iChunkOutline: Curve
# ---------- python: Python ----------
import Rhino.Geometry as rg
from ghpythonlib.components import Area, Length, Seam
from copy import deepcopy

class Model:
    def __init__(self, curve, chunkOutline):
        self.curve = curve
        self.chunkOutline = chunkOutline
        self.chunks = self.chunkProcess(self.chunkOutline, self.curve)
    
    def chunkProcess(self, chunk, crv):
        self.pttt = []

        self.check = []
        crv.Domain = rg.Interval(0,1)
        
        ptList = [crv.PointAtStart]
        self.chunkCrvList = []
        stPt = crv.PointAt(0)
        self.crv = crv
        self.chunkArray(chunk, crv, stPt, [50,0], ptList, self.chunkCrvList)

    def chunkArray(self, chunk, layerCrv, pt, counter, ptList, chunkCrvList):
        chunkClone = deepcopy(chunk)
        centPt = Area(chunk)[1]
        trans = rg.Transform.Translation(pt - centPt)
        chunkClone.Transform(trans)
        
        vec = rg.Point3d.Add(rg.Point3d(0,0,0),(pt - centPt))
        chunkClone2 = deepcopy(chunkClone)
        trans2 = rg.Transform.Scale(Area(chunkClone)[1],2)
        chunkClone2.Transform(trans2)
        
        pts = []
        events = rg.Intersect.Intersection.CurveCurve(layerCrv, chunkClone2, tolerance=0.1, overlapTolerance=0.1)
        
        self.layerCrv = layerCrv
        self.chunkClone2 = chunkClone2
        
        for i in range(len(events)):
            pts.append(events[i].PointA)
        
        
        if counter[1]==0:
            nextPt = pts
        elif len(pts)>1:
            t_0 = layerCrv.ClosestPoint(pts[0])[1]
            t_1 = layerCrv.ClosestPoint(pts[1])[1]
            if t_0<t_1:
                pts = pts
            else:
                pts.reverse()
        
            pts.reverse()
        
        nextPt = pts[0]
        ptList.append(nextPt)
        chunkCrvList.append(chunkClone)
        
        counter[0] = counter[0]-1
        counter[1] = counter[1]+1
        if len(pts)>1 and counter[0]>0:
            self.chunkArray(chunk, layerCrv, nextPt, counter, ptList, chunkCrvList)
        
        elif counter[1]==1 and counter[0]>0:
            self.chunkArray(chunk, layerCrv, nextPt, counter, ptList, chunkCrvList)
            
        
        
    def remap(self, value, low1, high1, low2, high2):
        new_value = low2 + (value-low1)*(high2-low2)/(high1-low1)
        return new_value



testModel = Model(iCurve, iChunkOutline)

oChunkOutline = testModel.chunkCrvList
oPt = Area(oChunkOutline)[1]
# ---------- end python ----------
item_2 = ListItem(List=contour, Index=0, Wrap=True)
area = Area(Geometry=item_2)  # -> Area, Centroid
xz = XZPlane(Origin=area.Centroid)
mirror = Mirror(Geometry=python.oPt, Plane=xz)  # -> Geometry, Transform
graft = GraftTree(Tree=simplify(mirror.Geometry), IncludeEmptyLists=True, IncludeNullItems=True)
graft_2 = GraftTree(Tree=simplify(python.oPt), IncludeEmptyLists=True, IncludeNullItems=True)
merge = Merge(Data1=graft_2, Data2=graft)
eval = EvaluateCurve(Curve=reparameterize(contour), Parameter="0")  # -> graft(Point), Tangent, Angle
cullpt = CullDuplicates(Points=merge, Tolerance=Slider(0, range=0..20), CullMode=3)  # -> simplify(Points), Indices, Valence
lng = ListLength(List=cullpt.Points)
shift = ShiftPaths(Data=merge, Offset=-1)
panel_2 = Panel(lng)
centpt = Point(simplify(eval.Point))
allpt = Point(shift)
cps = ClosestPoints(Point=centpt, Cloud=allpt, Count="2")  # -> ClosestPoint, CPIndex, Distance
item_3 = ListItem(List=allpt, Index=cps.CPIndex, Wrap=True)  # -> simplify(Item)
cull_i = CullIndex(List=allpt, Indices=cps.CPIndex, Wrap=True)  # -> simplify(List)
ichunklength = ClusterInput()
itolerance = ClusterInput()
python_2 = GhPythonScript(iChunkLength=ichunklength, iMiddlePt=centpt, iSidePts=item_3, iAllPts=cull_i, iTolerance=itolerance)  # -> out, simplify(sideNewPts), addType; inputs iMiddlePt: tree of Point3d, iSidePts: tree of Point3d, iAllPts: tree of Point3d
# ---------- python_2: Python ----------
import Rhino.Geometry as rg
import ghpythonlib.treehelpers as th


sideNewPts = []
addType = [0]
for i, sidePts in enumerate(iSidePts.Branches):
    temp = []
    pt_0 = sidePts[0]
    pt_1 = sidePts[1]
    dist = rg.Point3d.DistanceTo(pt_0, pt_1)
    
    # Merge if dist within iTolerance
    if dist < iTolerance:
        temp.extend(iMiddlePt.Branches[i])
        addType.append(0)
        
    # Add new middle pt between far dist
    elif dist > iChunkLength:
        temp.extend([iMiddlePt.Branches[i][0]])
        temp.extend([pt_0])
        temp.extend([pt_1])
        addType.append(0)
        
    # Move two pts farther if a little overlap 
    elif dist < iChunkLength:
        apart = (iChunkLength - dist)/2
        vec_0 = pt_0 - pt_1
        vec_1 = pt_1 - pt_0
        vec_0.Unitize()
        vec_1.Unitize()
        vec_0 = rg.Vector3d.Multiply(vec_0, apart)
        vec_1 = rg.Vector3d.Multiply(vec_1, apart)
        tran_0 = rg.Transform.Translation(vec_0)
        tran_1 = rg.Transform.Translation(vec_1)
        pt_0.Transform(tran_0)
        pt_1.Transform(tran_1)
        temp.extend([pt_0])
        temp.extend([pt_1])
        addType.append(1)
        
    
    if addType[i+1]==1 and addType[i]==1:
        if i == 0:
            x = rg.Vector3d(2,0,0)
        else:
            x = rg.Vector3d(0,0,0)
        tran = rg.Transform.Translation(x)
        pp = iMiddlePt.Branches[i][0]
        print(pp)
        pp.Transform(tran)
        temp.extend([pp])
        addType[i+1]=0
        
        
    sideNewPts.append(temp)
        
sideNewPts = th.list_to_tree(sideNewPts)
# ---------- end python_2 ----------
item_4 = ListItem(List=contour, Index=0, Wrap=True)
custom_mesh_settings = SettingsCustom(
    StitchSeams=True,
    SimplePlanes=False,
    Refine=True,
    MinCount=16,
    MaxCount=400,
    AspectRatio=20,
    MaxDistance=0,
    MaxAngle=20,
    MinEdge=0,
    MaxEdge=0)
area_2 = Area(Geometry=item_4)  # -> Area, Centroid
geometry = Geometry(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)
yz = YZPlane(Origin=area_2.Centroid)
pt = Point(python_2.sideNewPts)
merge_2 = Merge(Data1=cull_i, Data2=python_2.sideNewPts)
area_3 = Area(Geometry=geometry)  # -> Area, Centroid
mesh_brep = MeshBrep(Brep=geometry, Settings=custom_mesh_settings)
mirror_2 = Mirror(Geometry=merge_2, Plane=yz)  # -> Geometry, Transform
orient = Orient(Geometry=geometry, Source=area_3.Centroid, Target=merge_2)  # -> Geometry, Transform
merge_3 = Merge(Data1=merge_2, Data2=mirror_2.Geometry)
duppt = RemoveDuplicatePts(Points=merge_3, Tolerance=0.01)
brep = Brep(orient.Geometry)
Q = ClusterOutput(duppt)
preview = CustomPreview(Geometry=flatten(brep), Material=ColourSwatch(SwatchColor=RGB(189, 189, 189)))  # disabled

# ==== cluster Wall
B = ClusterInput()
edges = BrepEdges(Brep=B)  # -> Naked, Interior, NonManifold
item = ListItem(List=flatten(edges.Interior), Index=0, Wrap=True)  # -> Item, Item1
l1 = ClusterInput()
l1_2 = ClusterInput()
G = ClusterInput()
ext = ExtendCurve(Curve=item.Item, Type=0, Start="0", End=l1)
F = ClusterInput()
ext_2 = ExtendCurve(Curve=item.Item1, Type=0, Start="0", End=l1_2)
project = Project(Geometry=G, Plane=PlaneXY(0, 0, 0))  # -> Geometry, Transform
Z = UnitZ(Factor=F)
entwine = Entwine(Branch00=ext, Branch01=ext_2, FlattenInputs=True)
move = Move(Geometry=project.Geometry, Motion=Z)  # -> Geometry, Transform
end = EndPoints(Curve=entwine)  # -> Start, End
item_2 = ListItem(List=flatten(end.End), Index=0, Wrap=True)  # -> Item, Item1
item_3 = ListItem(List=flatten(end.Start), Index=0, Wrap=True)  # -> Item, Item1
entwine_2 = Entwine(Branch00=item_2.Item, Branch01=move.Geometry, Branch02=item_2.Item1, FlattenInputs=True)  # -> flatten(Result)
ln = Line(StartPoint=item_3.Item, EndPoint=item_3.Item1)
intcrv = Interpolate(Vertices=entwine_2, Degree=3, Periodic=False, KnotStyle=1)  # -> Curve, Length, Domain
entwine_3 = Entwine(Branch00=intcrv.Curve, Branch01=entwine, Branch02=ln, FlattenInputs=True)  # -> flatten(Result)
boundary = BoundarySurfaces(Edges=entwine_3)
X = UnitX(Factor=1)
D = ClusterInput()
D_2 = ClusterInput()
contour = Contour(Shape=boundary, Point=Point(0, 0, 0), Direction=Vector(0, 0, 1), Distance=D)
contour_2 = Contour(Shape=boundary, Point=project.Geometry, Direction=X, Distance=D_2)
midpt = CurveMiddle(Curve=contour_2)  # -> flatten(Midpoint)
tstat = TreeStatistics(Tree=contour)  # -> Paths, Length, Count
dispatch = Dispatch(List=tstat.Paths, DispatchPattern=[True, False])  # -> ListA, ListB
project_2 = Project(Geometry=midpt, Plane=PlaneXY(0, 0, 0))  # -> Geometry, Transform
yz = YZPlane(Origin=project_2.Geometry)
branch = TreeBranch(Tree=contour, Path=dispatch.ListA, MaintainPaths=True)
branch_2 = TreeBranch(Tree=contour, Path=dispatch.ListB, MaintainPaths=True)
crv = Curve(branch)
crv_2 = Curve(branch_2)
lng = ListLength(List=yz)
shift = ShiftList(List=yz, Shift=1, Wrap=invert(True))  # -> graft(List)
culln = CullNth(List=yz, CullFrequency=lng)  # -> graft(List)
avrpln = AveragePlane(Planes=[culln, shift])  # -> flatten(ArithmeticMean)
pcx = CurvePlane(Curve=graft(crv_2), Plane=avrpln)  # -> Points, ParamsC, ParamsP
pcx_2 = CurvePlane(Curve=graft(crv), Plane=yz)  # -> Points, ParamsC, ParamsP
shift_2 = ShiftPaths(Data=pcx_2.Points, Offset="-2")  # -> simplify(Data)
shift_3 = ShiftPaths(Data=pcx.Points, Offset="-2")  # -> simplify(Data)
merge = Merge(Data1=shift_2, Data2=shift_3)
R = ClusterOutput(merge)

# ==== cluster Path
brep = ClusterInput()
brep_2 = Brep(simplify(graft(brep)))
D = ClusterInput()
contour = Contour(Shape=brep_2, Point=Point(0, 0, 0), Direction=Vector(0, 0, 1), Distance=D)
shift = ShiftPaths(Data=contour, Offset=-1)
bang = ExplodeTree(Data=shift)  # -> Branch0, Branch1
flip = FlipCurve(Curve=bang.Branch1)  # -> Curve, Flag
merge = Merge(Data1=bang.Branch0, Data2=flip.Curve)
ext = ExtendCurve(Curve=merge, Type=0, Start="0", End="-0.2")
end = EndPoints(Curve=ext)  # -> Start, End
flip_2 = FlipMatrix(Data=end.Start)
pline = PolyLine(Vertices=flip_2, Closed=False)
flip_3 = FlipMatrix(Data=ext)
merge_2 = Merge(Data1=pline, Data2=flip_3)
join = JoinCurves(Curves=merge_2, Preserve=False)  # -> flatten(Curves)
panel = Panel("""0
1""")
sift = SiftPattern(List=join, SiftPattern=panel)  # -> Output0, Output1
flip_4 = FlipCurve(Curve=sift.Output0)  # -> Curve, Flag
combine = CombineData(Input0=flip_4.Curve, Input1=sift.Output1)  # -> Result, Index
divlength = DivideLength(Curve=combine.Result, Length="3")  # -> flatten(Points), Tangents, Parameters
pline_2 = PolyLine(Vertices=divlength.Points, Closed=False)
pl = ClusterOutput(pline_2)
