# Grasshopper definition chunk_model.ghx (Grasshopper 1.0.7)

custom_mesh_settings = SettingsCustom(
    StitchSeams=True,
    SimplePlanes=False,
    Refine=True,
    MinCount=16,
    MaxCount=400,
    AspectRatio=20,
    MaxDistance=0,
    MaxAngle=20,
    MinEdge=0,
    MaxEdge=0)
geometry = Geometry(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)
area = Area(Geometry=geometry)  # -> Area, Centroid
mesh_brep = MeshBrep(Brep=geometry, Settings=custom_mesh_settings)
pt = Point(Tree({0;0;0}: [Point(17.09987444, -105.0435769, 0), Point(23.16628115, -108.6076048, 0), Point(29.91932942, -112.5567104, 0), Point(36.81421074, -115.1464767, 0), Point(43.76732249, -116.879725, 0), Point(50.74917216, -117.9592129, 0)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], {1;0;0}: [Point(-37.67674081, -90.04357692, 4.5), Point(-44.08173777, -85.15261742, 4.5), Point(-50.88694388, -81.63861279, 4.5), Point(-57.80330413, -79.32674803, 4.5), Point(-64.76827327, -77.82796556, 4.5), Point(-71.75700905, -76.97735074, 4.5)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], {2;0;0}: [Point(23.41241108, -106.031393, 9), Point(29.99309214, -111.1449869, 9), Point(36.83978048, -114.2671369, 9), Point(43.77514727, -116.3008061, 9), Point(50.75079057, -117.5510316, 9), Point(57.74521189, -118.1497686, 9)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], {3;0;0}: [Point(-38.85978113, -97.54357692, 13.5), Point(-44.2487152, -87.24866262, 13.5), Point(-50.93947385, -82.83950368, 13.5), Point(-57.82024109, -80.08275125, 13.5), Point(-64.77244602, -78.33287974, 13.5), Point(-71.75739469, -77.34974918, 13.5)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], {4;0;0}: [Point(23.95121531, -105.0435769, 18), Point(30.10864476, -109.4167045, 18), Point(36.87643993, -113.2481357, 18), Point(43.78594587, -115.6522723, 18), Point(50.75298229, -117.1062658, 18), Point(57.74554877, -117.797363, 18)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], {5;0;0}: [Point(-44.55709721, -90.04302225, 22.5), Point(-51.01867937, -84.27401624, 22.5), Point(-57.84415459, -80.94541476, 22.5), Point(-64.77816674, -78.89064427, 22.5), Point(-71.75791623, -77.75049715, 22.5), Point(-78.75582097, -77.38351584, 22.5)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]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))
orient = Orient(Geometry=mesh_brep, Source=area.Centroid, Target=pt)  # -> Geometry, Transform
