# Grasshopper definition connection.ghx (Grasshopper 1.0.7)
# plug-ins: Heteroptera, Human

crv = Curve(<curve referenced from the Rhino model>)
boundary = BoundarySurfaces(Edges=crv)
dpipeline = DynamicGeometryPipeline(
    LayerFilter="Layer 01",
    TypeFilter="curve",
    NameFilter="*",
    GroupByLayer=False,
    GroupByType=False,
    IncludeHidden=True,
    IncludeLocked=True,
    enableFullPath=False,
    listenToAttributes=True)
crv_2 = Curve([<curve referenced from the Rhino model> x2])
sweepq = SweepQuick(Rail=dpipeline, X=Slider(6, range=0..10), Y=Slider(10, range=0..10))
capex = CapHolesEx(Brep=sweepq)  # -> Brep, Caps, Solid
