# Grasshopper definition impact_print_ver2.ghx (Grasshopper 1.0.7)
# plug-ins: treesloth01

pt = Point(Point(327.0446139, 0, 5))

# ----
# Srf
srf = Surface(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)

scale = Scale(Geometry=srf, Center=pt, Factor=Slider(1.1, range=0..10))  # -> Geometry, Transform
number_slider = Slider(10, range=0..10)
contour = Contour(Shape=scale.Geometry, Point=Point(0, 0, 0), Direction=Vector(0, 0, 1), Distance=Slider(4.5, range=0..10))  # -> flatten(Contours)
neg = Negative(Value=Slider(7, range=0..10))
split = SplitList(List=contour, Index=Slider(49, range=0..100))  # -> ListA, ListB
offset = OffsetCurve(Curve=split.ListA, Distance=neg, Corners=1)  # -> flatten(Curve)
midpt = CurveMiddle(Curve=split.ListA)
end = EndPoints(Curve=split.ListA)  # -> Start, End
shatter = Shatter(Curve=reparameterize(split.ListA), Parameters="0.5")  # -> simplify(Segments)
# LayerAmount
# ShitDist
midpt_2 = CurveMiddle(Curve=split.ListA)
end_2 = EndPoints(Curve=split.ListA)  # -> Start, End
explode = Explode(Curve=shatter, Recursive=True)  # -> Segments, Vertices
item = ListItem(List=explode.Segments, Index=0, Wrap=True)
crv = Curve(item)
divide = DivideCurve(Curve=crv, Count=Slider(13, range=0..100), Kinks=False)  # -> Points, Tangents, Parameters

# ----
# endPtsExtend
number_slider_2 = Slider(9, range=0..10)

number_slider_3 = Slider(35, range=0..100)

shatter_2 = Shatter(Curve=reparameterize(split.ListA), Parameters="0.5")  # -> simplify(Segments)
explode_2 = Explode(Curve=shatter_2, Recursive=True)  # -> Segments, Vertices
item_2 = ListItem(List=explode_2.Segments, Index=0, Wrap=True)
crv_2 = Curve(item_2)
divide_2 = DivideCurve(Curve=crv_2, Count=Slider(13, range=0..100), Kinks=False)  # -> Points, Tangents, Parameters
end_3 = EndPoints(Curve=crv_2)  # -> Start, End
item_3 = ListItem(List=divide_2.Points, Index=0, Wrap=True)  # -> Item1, Item
avr = Average(Input=[item_3.Item1, item_3.Item])
vec2pt = Vector2Pt(PointA=avr, PointB=item_3.Item1, Unitize=invert(False))  # -> Vector, Length
vec2pt_2 = Vector2Pt(PointA=avr, PointB=item_3.Item, Unitize=invert(False))  # -> Vector, Length
amp = Amplitude(Vector=vec2pt.Vector, Amplitude=number_slider_3)
amp_2 = Amplitude(Vector=vec2pt_2.Vector, Amplitude=number_slider_3)
move = Move(Geometry=item_3.Item1, Motion=amp)  # -> Geometry, Transform
move_2 = Move(Geometry=item_3.Item, Motion=amp_2)  # -> Geometry, Transform
merge = Merge(Data1=move.Geometry, Data2=move_2.Geometry)
lng = ListLength(List=divide_2.Points)
subtraction = Subtraction(A=lng, B=1)  # -> simplify(Result)
lng_2 = ListLength(List=flatten(subtraction))
repeat = RepeatData(Data="0", Length=lng_2)  # -> simplify(graft(Data))
merge_2 = Merge(Data1=subtraction, Data2=repeat)
replace = ReplaceItems(List=divide_2.Points, Item=merge, Indices=merge_2, Wrap=False)
intcrv = Interpolate(Vertices=replace, Degree=3, Periodic=False, KnotStyle=1)  # -> Curve, Length, Domain

# ----
# endPtsExtend
number_slider_4 = Slider(7, range=0..10)

shatter_3 = Shatter(Curve=reparameterize(offset), Parameters="0.5")  # -> simplify(Segments)
explode_3 = Explode(Curve=shatter_3, Recursive=True)  # -> Segments, Vertices
item_4 = ListItem(List=explode_3.Segments, Index=0, Wrap=True)
crv_3 = Curve(item_4)
divide_3 = DivideCurve(Curve=crv_3, Count=Slider(13, range=0..100), Kinks=False)  # -> Points, Tangents, Parameters
end_4 = EndPoints(Curve=crv_3)  # -> Start, End
item_5 = ListItem(List=divide_3.Points, Index=0, Wrap=True)  # -> Item1, Item
avr_2 = Average(Input=[item_5.Item1, item_5.Item])
vec2pt_3 = Vector2Pt(PointA=avr_2, PointB=item_5.Item1, Unitize=invert(False))  # -> Vector, Length
vec2pt_4 = Vector2Pt(PointA=avr_2, PointB=item_5.Item, Unitize=invert(False))  # -> Vector, Length
amp_3 = Amplitude(Vector=vec2pt_3.Vector, Amplitude=number_slider_4)
amp_4 = Amplitude(Vector=vec2pt_4.Vector, Amplitude=number_slider_4)
move_3 = Move(Geometry=item_5.Item1, Motion=amp_3)  # -> Geometry, Transform
move_4 = Move(Geometry=item_5.Item, Motion=amp_4)  # -> Geometry, Transform
merge_3 = Merge(Data1=move_3.Geometry, Data2=move_4.Geometry)
lng_3 = ListLength(List=divide_3.Points)
subtraction_2 = Subtraction(A=lng_3, B=1)  # -> simplify(Result)
lng_4 = ListLength(List=flatten(subtraction_2))
repeat_2 = RepeatData(Data="0", Length=lng_4)  # -> simplify(graft(Data))
merge_4 = Merge(Data1=subtraction_2, Data2=repeat_2)
replace_2 = ReplaceItems(List=divide_3.Points, Item=merge_3, Indices=merge_4, Wrap=False)
intcrv_2 = Interpolate(Vertices=replace_2, Degree=3, Periodic=False, KnotStyle=1)  # -> flatten(Curve), Length, Domain

end_5 = EndPoints(Curve=crv)  # -> Start, End

# ----
# endPtsExtend
number_slider_5 = Slider(25, range=0..100)
number_slider_6 = Slider(9, range=0..10)

item_6 = ListItem(List=divide.Points, Index=0, Wrap=True)  # -> Item1, Item
division = Division(A=number_slider_5, B="10")
division_2 = Division(A=number_slider_3, B="6")
avr_3 = Average(Input=[item_6.Item1, item_6.Item])
series = Series(Start="1", Step=1, Count=division)
series_2 = Series(Start="1", Step=1, Count=division_2)
vec2pt_5 = Vector2Pt(PointA=avr_3, PointB=item_6.Item1, Unitize=invert(False))  # -> Vector, Length
vec2pt_6 = Vector2Pt(PointA=avr_3, PointB=item_6.Item, Unitize=invert(False))  # -> Vector, Length
multiplication = Multiplication(A="10", B=series)
multiplication_2 = Multiplication(A="6", B=series_2)
amp_5 = Amplitude(Vector=vec2pt_5.Vector, Amplitude=multiplication)
amp_6 = Amplitude(Vector=vec2pt_6.Vector, Amplitude=multiplication)
cull_i = CullIndex(List=divide.Points, Indices="0", Wrap=True)
move_5 = Move(Geometry=item_6.Item1, Motion=amp_5)  # -> Geometry, Transform
move_6 = Move(Geometry=item_6.Item, Motion=amp_6)  # -> Geometry, Transform
cull_i_2 = CullIndex(List=reverse(cull_i), Indices="0", Wrap=True)  # -> reverse(simplify(List))
merge_5 = Merge(Data1=move_5.Geometry, Data2=move_6.Geometry)
merge_6 = Merge(Data1=simplify(merge_5), Data2=cull_i_2)  # -> simplify(Result)
sort_pt = SortPoints(Points=merge_6)  # -> Points, Indices
panel = Panel(merge_2)
intcrv_3 = Interpolate(Vertices=sort_pt.Points, Degree=3, Periodic=False, KnotStyle=1)  # -> Curve, Length, Domain

# ----
# chunkDist
number_slider_7 = Slider(7.5, range=0..10)

flatten = FlattenTree(Tree=intcrv_3.Curve, Path="{0}")
dispatch = Dispatch(List=flatten, DispatchPattern=[True, False])  # -> ListA, ListB
item_7 = ListItem(List=flatten(intcrv_3.Curve), Index=0, Wrap=True)
crv_4 = Curve(dispatch.ListB)
len = Length(Curve=item_7)
end_6 = EndPoints(Curve=item_7)  # -> Start, End
division_3 = Division(A=len, B=number_slider_7)
round = Round(Number=division_3)  # -> Nearest, Floor, Ceiling
ln = Line(StartPoint=end_6.Start, EndPoint=end_6.End)
divide_4 = DivideCurve(Curve=ln, Count=round.Floor, Kinks=False)  # -> Points, Tangents, Parameters
lng_5 = ListLength(List=divide_4.Points)
crv_5 = Curve(graft(dispatch.ListB))
crv_6 = Curve(graft(dispatch.ListA))
shift = ShiftList(List=divide_4.Points, Shift=1, Wrap=invert(True))  # -> simplify(graft(List))
culln = CullNth(List=divide_4.Points, CullFrequency=lng_5)  # -> simplify(graft(List))
avr_4 = Average(Input=[culln, shift])
shift_2 = ShiftPaths(Data=avr_4, Offset=-1)
yz = YZPlane(Origin=divide_4.Points)
yz_2 = YZPlane(Origin=shift_2)
pcx = CurvePlane(Curve=crv_6, Plane=yz)  # -> Points, ParamsC, ParamsP
pcx_2 = CurvePlane(Curve=crv_5, Plane=yz_2)  # -> Points, ParamsC, ParamsP
shift_3 = ShiftPaths(Data=pcx.Points, Offset=-1)
shift_4 = ShiftPaths(Data=pcx_2.Points, Offset=-1)
tstat = TreeStatistics(Tree=shift_3)  # -> Paths, Length, Count
tstat_2 = TreeStatistics(Tree=shift_3)  # -> Paths, Length, Count
series_3 = Series(Start=0, Step="2", Count=tstat.Count)  # -> graft(Series)
series_4 = Series(Start="1", Step="2", Count=tstat_2.Count)  # -> graft(Series)
path = ConstructPath(Indices=series_4)  # -> flatten(Branch)
path_2 = ConstructPath(Indices=series_3)  # -> flatten(Branch)
replace_3 = ReplacePaths(Data=shift_3, Search=tstat.Paths, Replace=path_2)
replace_4 = ReplacePaths(Data=shift_4, Search=tstat_2.Paths, Replace=path)
merge_7 = Merge(Data1=replace_3, Data2=replace_4)

dispatch_2 = Dispatch(List=flatten(intcrv_2.Curve), DispatchPattern=[True, False])  # -> graft(ListA), graft(ListB)
pt_2 = Point(divide_4.Points)
pt_3 = Point(shift_2)
number_slider_8 = Slider(0.16, range=0..0.49)
len_2 = Length(Curve=dispatch_2.ListB)
len_3 = Length(Curve=dispatch_2.ListA)
addition = Addition(A="0.5", B=number_slider_8)
subtraction_3 = Subtraction(A="0.5", B=number_slider_8)
addition_2 = Addition(A="0.5", B=number_slider_8)
subtraction_4 = Subtraction(A="0.5", B=number_slider_8)
multiplication_3 = Multiplication(A=len_2, B=subtraction_3)
multiplication_4 = Multiplication(A=len_2, B=addition)
multiplication_5 = Multiplication(A=len_3, B=subtraction_4)
multiplication_6 = Multiplication(A=len_3, B=addition_2)
eval = EvaluateLength(Curve=reparameterize(dispatch_2.ListB), Length=multiplication_3, Normalized=invert(True))  # -> Point, Tangent, Parameter
eval_2 = EvaluateLength(Curve=reparameterize(dispatch_2.ListB), Length=multiplication_4, Normalized=invert(True))  # -> Point, Tangent, Parameter
eval_3 = EvaluateLength(Curve=reparameterize(dispatch_2.ListA), Length=multiplication_5, Normalized=invert(True))  # -> Point, Tangent, Parameter
eval_4 = EvaluateLength(Curve=reparameterize(dispatch_2.ListA), Length=multiplication_6, Normalized=invert(True))  # -> Point, Tangent, Parameter
shatter_4 = Shatter(Curve=reparameterize(dispatch_2.ListB), Parameters=[eval_2.Parameter, eval.Parameter])
shatter_5 = Shatter(Curve=reparameterize(dispatch_2.ListA), Parameters=[eval_4.Parameter, eval_3.Parameter])
item_8 = ListItem(List=shatter_4, Index=0, Wrap=True)  # -> Item, Item1, Item2
item_9 = ListItem(List=shatter_5, Index=0, Wrap=True)  # -> Item, Item1, Item2
crv_7 = Curve(graft([item_8.Item, item_8.Item2]))
crv_8 = Curve(graft([item_9.Item, item_9.Item2]))
yz_3 = YZPlane(Origin=pt_2)
yz_4 = YZPlane(Origin=pt_3)
pcx_3 = CurvePlane(Curve=crv_7, Plane=yz_3)  # -> Points, ParamsC, ParamsP
pcx_4 = CurvePlane(Curve=crv_8, Plane=yz_4)  # -> Points, ParamsC, ParamsP
shift_5 = ShiftPaths(Data=pcx_4.Points, Offset="-2")
shift_6 = ShiftPaths(Data=pcx_3.Points, Offset="-2")
tstat_3 = TreeStatistics(Tree=shift_5)  # -> Paths, Length, Count
tstat_4 = TreeStatistics(Tree=shift_5)  # -> Paths, Length, Count
series_5 = Series(Start=0, Step="2", Count=tstat_3.Count)  # -> graft(Series)
series_6 = Series(Start="1", Step="2", Count=tstat_4.Count)  # -> graft(Series)
path_3 = ConstructPath(Indices=series_6)  # -> flatten(Branch)
path_4 = ConstructPath(Indices=series_5)  # -> flatten(Branch)
replace_5 = ReplacePaths(Data=shift_5, Search=tstat_3.Paths, Replace=path_4)
replace_6 = ReplacePaths(Data=shift_6, Search=tstat_4.Paths, Replace=path_3)
merge_8 = Merge(Data1=replace_5, Data2=replace_6)
neg_2 = Negative(Value=Slider(0, range=0..10))
item_10 = ListItem(List=flatten(avr), Index=0, Wrap=True)
Y = UnitY(Factor=neg_2)
move_7 = Move(Geometry=item_10, Motion=Y)  # -> Geometry, Transform
pt_4 = Point(graft(merge_7))
pt_5 = Point(graft(merge_8))
xz = XZPlane(Origin=move_7.Geometry)
number_slider_9 = Slider(0, range=0..21)
mirror = Mirror(Geometry=pt_4, Plane=xz)  # -> Geometry, Transform
mirror_2 = Mirror(Geometry=pt_5, Plane=xz)  # -> Geometry, Transform
merge_9 = Merge(Data1=mirror.Geometry, Data2=pt_4)
brep = Brep(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)
merge_10 = Merge(Data1=mirror_2.Geometry, Data2=pt_5)
brep_2 = Brep(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)
area = Area(Geometry=brep)  # -> Area, Centroid
cullpt = CullDuplicates(Points=merge_9, Tolerance=Slider(6, range=0..10), CullMode=3)  # -> simplify(Points), Indices, Valence
area_2 = Area(Geometry=brep_2)  # -> Area, Centroid
cullpt_2 = CullDuplicates(Points=merge_10, Tolerance=Slider(6, range=0..10), CullMode=3)  # -> simplify(Points), Indices, Valence
orient = Orient(Geometry=brep, Source=area.Centroid, Target=cullpt.Points)  # -> simplify(Geometry), Transform
orient_2 = Orient(Geometry=brep_2, Source=area_2.Centroid, Target=cullpt_2.Points)  # -> simplify(Geometry), Transform
shift_7 = ShiftPaths(Data=orient.Geometry, Offset=-1)
shift_8 = ShiftPaths(Data=orient_2.Geometry, Offset=-1)
addition_3 = Addition(A=number_slider_9, B=1)
addition_4 = Addition(A=number_slider_9, B=2)
addition_5 = Addition(A=number_slider_9, B=3)
addition_6 = Addition(A=number_slider_9, B=1)
addition_7 = Addition(A=number_slider_9, B=2)
addition_8 = Addition(A=number_slider_9, B=3)
cluster = BranchLook(data=shift_7, i=addition_3)
cluster_2 = BranchLook(data=shift_7, i=number_slider_9)
cluster_3 = BranchLook(data=shift_7, i=addition_4)
cluster_4 = BranchLook(data=shift_7, i=addition_5)
swatch = ColourSwatch(SwatchColor=RGBA(130, 130, 130, 153))
cluster_5 = BranchLook(data=shift_8, i=addition_6)
cluster_6 = BranchLook(data=shift_8, i=number_slider_9)
swatch_2 = ColourSwatch(SwatchColor=RGB(255, 122, 122))
lng_6 = ListLength(List=cluster_2)
cluster_7 = BranchLook(data=shift_8, i=addition_7)
cluster_8 = BranchLook(data=shift_8, i=addition_8)
swatch_3 = ColourSwatch(SwatchColor=RGBA(130, 130, 130, 153))
preview = CustomPreview(Geometry=orient.Geometry, Material=ColourSwatch(SwatchColor=RGB(130, 130, 130)))  # disabled
swatch_4 = ColourSwatch(SwatchColor=RGB(255, 122, 122))

preview_2 = CustomPreview(Geometry=cluster, Material=swatch_2)  # disabled
preview_3 = CustomPreview(Geometry=cluster_2, Material=swatch)  # disabled

lng_7 = ListLength(List=cluster_6)
preview_4 = CustomPreview(Geometry=cluster_3, Material=swatch)  # disabled
preview_5 = CustomPreview(Geometry=cluster_4, Material=swatch_2)  # disabled

preview_6 = CustomPreview(Geometry=cluster_5, Material=swatch_4)  # disabled
preview_7 = CustomPreview(Geometry=cluster_6, Material=swatch_3)  # disabled

preview_8 = CustomPreview(Geometry=cluster_7, Material=swatch_3)  # disabled
preview_9 = CustomPreview(Geometry=cluster_8, Material=swatch_4)  # disabled
addition_9 = Addition(A=lng_6, B=lng_7)
panel_2 = Panel(addition_9)
shift_9 = ShiftPaths(Data=cullpt_2.Points, Offset=-1)
shift_10 = ShiftPaths(Data=cullpt.Points, Offset=-1)
tstat_5 = TreeStatistics(Tree=shift_9)  # -> Paths, Length, Count
split_2 = SplitList(List=tstat_5.Paths, Index=Slider(32, range=0..48))  # -> ListA, ListB
branch = TreeBranch(Tree=shift_9, Path=split_2.ListA, MaintainPaths=True)
avr_5 = Average(Input=flatten(branch))
brep_3 = Brep(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)
cir = Circle(Plane=avr_5, Radius="200")
area_3 = Area(Geometry=brep_3)  # -> Area, Centroid
alongcrv = SortAlongCurve(Points=shift_10, Curve=cir)  # -> Points, Indices
alongcrv_2 = SortAlongCurve(Points=branch, Curve=cir)  # -> Points, Indices
orient_3 = Orient(Geometry=brep_3, Source=area_3.Centroid, Target=alongcrv_2.Points)  # -> simplify(Geometry), Transform
orient_4 = Orient(Geometry=brep_3, Source=area_3.Centroid, Target=alongcrv.Points)  # -> simplify(Geometry), Transform
merge_11 = Merge(Data1=alongcrv_2.Points, Data2=alongcrv.Points)
number_slider_10 = Slider(22, range=0..48)
split_3 = SplitList(List=merge_11, Index=Slider(111, range=0..366))  # -> ListA, ListB
tstat_6 = TreeStatistics(Tree=orient_3.Geometry)  # -> Paths, Length, Count
tstat_7 = TreeStatistics(Tree=orient_4.Geometry)  # -> Paths, Length, Count
flatten_2 = FlattenTree(Tree=merge_11, Path="{0}")  # disabled
pline = PolyLine(Vertices=split_3.ListA, Closed=False)
number_slider_11 = Slider(10, range=0..10)  # disabled
split_4 = SplitList(List=tstat_6.Paths, Index=number_slider_10)  # -> ListA, ListB
split_5 = SplitList(List=tstat_7.Paths, Index=number_slider_10)  # -> ListA, ListB
avr_6 = Average(Input=flatten_2)  # disabled
brep_4 = Brep(flatten(orient_3.Geometry))
branch_2 = TreeBranch(Tree=orient_3.Geometry, Path=split_4.ListA, MaintainPaths=True)
branch_3 = TreeBranch(Tree=orient_4.Geometry, Path=split_5.ListA, MaintainPaths=True)
cluster_9 = BranchLook(data=orient_3.Geometry, i=number_slider_10)
cluster_10 = BranchLook(data=orient_4.Geometry, i=number_slider_10)
number_slider_12 = Slider(111, range=0..366)  # disabled
scale_2 = Scale(Geometry=merge_11, Center=avr_6, Factor=number_slider_11)  # -> Geometry, Transform; disabled
number_slider_13 = Slider(0, range=0..9)  # disabled
preview_10 = CustomPreview(Geometry=branch_2, Material=ColourSwatch(SwatchColor=RGBA(130, 130, 130, 153)))
preview_11 = CustomPreview(Geometry=branch_3, Material=ColourSwatch(SwatchColor=RGBA(130, 130, 130, 153)))
volume = Volume(Geometry=brep_4)  # -> Volume, flatten(Centroid)
flatten_3 = FlattenTree(Tree=brep_4, Path="{0}")
brep_5 = Brep(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)  # disabled
split_6 = SplitList(List=scale_2.Geometry, Index=number_slider_12)  # -> ListA, ListB; disabled
cluster_11 = BranchLook(data=scale_2.Geometry, i=number_slider_13)  # disabled
area_4 = Area(Geometry=brep_5)  # -> Area, Centroid; disabled
pline_2 = PolyLine(Vertices=split_6.ListA, Closed=False)  # disabled
prox = Proximity3D(Points=volume.Centroid, Group=Slider(6, range=0..10), MaxRadius=Slider(13, range=0..100))  # -> Links, Topology
pdecon = Deconstruct(Point=graft(volume.Centroid))  # -> XComponent, YComponent, ZComponent
graft = GraftTree(Tree=flatten_3, IncludeEmptyLists=True, IncludeNullItems=True)
orient_5 = Orient(Geometry=brep_5, Source=area_4.Centroid, Target=scale_2.Geometry)  # -> simplify(Geometry), Transform; disabled
item_11 = ListItem(List=volume.Centroid, Index=prox.Topology, Wrap=True)
pt_6 = Point(Tree({0;0}: [Point(684.4993247, 0, -157.8214286), Point(617.8652062, 55.42231747, -157.8214286), Point(551.2310878, 137.5067858, -157.8214286), Point(484.5969693, 179.0059471, -157.8214286), Point(84.79225853, 179.0061017, -157.8214286), Point(18.15814007, 137.5066531, -157.8214286)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], {1;0}: [Point(651.1822654, 0, -112.8214286), Point(584.548147, 76.80975926, -112.8214286), Point(517.9140285, 149.033466, -112.8214286), Point(51.4751993, 149.0335394, -112.8214286), Point(-15.15891916, 76.80942763, -112.8214286), Point(-81.79303762, 0, -112.8214286)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], {2;0}: [Point(617.8652062, 0, -67.82142857), Point(551.2310878, 103.7201419, -67.82142857), Point(484.5969693, 158.1685699, -67.82142857), Point(84.79225853, 158.1685886, -67.82142857), Point(18.15814007, 103.7200996, -67.82142857), Point(-48.47597839, 0, -67.82142857)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], {3;0}: [Point(584.548147, 40.19490432, -22.82142857), Point(517.9140285, 123.5148395, -22.82142857), Point(51.4751993, 123.5149456, -22.82142857), Point(-15.15891916, 40.19494988, -22.82142857), Point(-15.15891916, -40.19494988, -22.82142857), Point(51.4751993, -123.5149456, -22.82142857)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], {4;0}: [Point(617.8652062, 0, 22.17857143), Point(551.2310878, 60.00634067, 22.17857143), Point(484.5969693, 136.5471693, 22.17857143), Point(84.79225853, 136.5473605, 22.17857143), Point(18.15814007, 60.00654696, 22.17857143), Point(-48.47597839, 0, 22.17857143)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], {5;0}: [Point(584.548147, 0, 67.17857143), Point(517.9140285, 90.47660308, 67.17857143), Point(451.2799101, 146.7544994, 67.17857143), Point(118.1093178, 146.754389, 67.17857143), Point(51.4751993, 90.47642439, 67.17857143), Point(-15.15891916, 0, 67.17857143)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], {6;0}: [Point(551.2310878, 0, 112.1785714), Point(484.5969693, 113.0056675, 112.1785714), Point(84.79225853, 113.006076, 112.1785714), Point(18.15814007, 0, 112.1785714), Point(84.79225853, -113.006076, 112.1785714), Point(484.5969693, -113.0056675, 112.1785714)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], {7;0}: [Point(584.548147, 0, 157.1785714), Point(517.9140285, 48.49302627, 157.1785714), Point(451.2799101, 127.091163, 157.1785714), Point(118.1093178, 127.0911177, 157.1785714), Point(51.4751993, 48.49306509, 157.1785714), Point(-15.15891916, 0, 157.1785714)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], {8;0}: [Point(551.2310878, 0, 202.1785714), Point(484.5969693, 82.50257775, 202.1785714), Point(84.79225853, 82.50247692, 202.1785714), Point(18.15814007, 0, 202.1785714), Point(84.79225853, -82.50247692, 202.1785714), Point(484.5969693, -82.50257775, 202.1785714)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], {9;0}: [Point(517.9140285, 0, 247.1785714), Point(451.2799101, 106.0209035, 247.1785714), Point(118.1093178, 106.0208703, 247.1785714), Point(51.4751993, 0, 247.1785714), Point(118.1093178, -106.0208703, 247.1785714), Point(451.2799101, -106.0209035, 247.1785714)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]))  # disabled
addition_10 = Addition(A=pdecon.ZComponent, B="1")
pdecon_2 = Deconstruct(Point=item_11)  # -> XComponent, YComponent, ZComponent
smaller = SmallerThan(FirstNumber=pdecon_2.ZComponent, SecondNumber=addition_10)  # -> SmallerThan, OrEqualTo
dispatch_3 = Dispatch(List=prox.Topology, DispatchPattern=smaller.SmallerThan)  # -> ListA, ListB
item_12 = ListItem(List=flatten_3, Index=dispatch_3.ListA, Wrap=True)
sunion = SolidUnion(Breps=item_12)
c_script = CSharpScript(x=item_12)  # -> out, a; inputs x: list of Brep; disabled
# ---------- c_script: C# ----------
    Brep[] b = Brep.CreateBooleanUnion(x, 0.001);
    a = b;
# ---------- end c_script ----------
python = GhPythonScript(x=item_12)  # -> out, a; inputs x: list of Brep; disabled
# ---------- python: Python ----------
import Rhino.Geometry as rg

a = rg.Brep.CreateBooleanUnion(x, 0.01)
# ---------- end python ----------
number_slider_14 = Slider(7, range=0..137)
sint = SolidIntersection(BrepsA=sunion, BrepsB=graft)
volume_2 = Volume(Geometry=sint)  # -> Volume, Centroid
null = NullItem(Item=volume_2.Volume)  # -> NullFlags, InvalidFlags, Description
cluster_12 = BranchLook(data=sint, i=number_slider_14)
cluster_13 = BranchLook(data=item_12, i=number_slider_14)
volume_3 = Volume(Geometry=sint)  # -> Volume, Centroid
item_13 = ListItem(List=brep_4, Index=number_slider_14, Wrap=True)
weave = Weave(Pattern=null.NullFlags, Stream0=volume_2.Volume, Stream1="0", NullGaps=False)
smaller_2 = SmallerThan(FirstNumber=weave, SecondNumber="0")  # -> SmallerThan, OrEqualTo
ma = MassAddition(Input=weave)  # -> flatten(Result), PartialResults
dispatch_4 = Dispatch(List=weave, DispatchPattern=smaller_2.SmallerThan)  # -> ListA, ListB
bnd = Bounds(Numbers=flatten(dispatch_4.ListB))
dedomain = DeconstructDomain(Domain=bnd)  # -> Start, End
avr_7 = Average(Input=[dedomain.Start, dedomain.End])
graph = QuickGraph(ma.Result, SortOrder=0)
gradient = Gradient(
    LowerLimit=dedomain.End,
    UpperLimit=dedomain.Start,
    Parameter=ma.Result,
    stops=[0: RGB(234, 38, 0), 0.25: RGB(234, 126, 0), 0.5: RGB(254, 244, 84), 0.75: RGB(173, 203, 249), 1: RGB(75, 107, 169)])
swatch_5 = ColourSwatch(SwatchColor=RGB(255, 255, 255))
preview_12 = CustomPreview(Geometry=flatten(brep_4), Material=gradient)  # disabled

# ==== cluster BranchLook: To see the condition of branch data.
data = ClusterInput()
data_2 = Data(data)
tstat = TreeStatistics(Tree=data_2)  # -> Paths, Length, Count
i = ClusterInput()
item = ListItem(List=tstat.Paths, Index=i, Wrap=True)
branch = TreeBranch(Tree=data_2, Path=item, MaintainPaths=True)
B = ClusterOutput(branch)
