# Grasshopper definition mock.ghx (Grasshopper 1.0.7)
# plug-ins: MarchingCubes, treesloth01

crv = Curve(<curve referenced from the Rhino model>)
srf = Surface(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)
number_slider = Slider(227, range=0..1000)
divide = DivideCurve(Curve=crv, Count=Slider(3, range=0..10), Kinks=False)  # -> Points, Tangents, Parameters
midpt = CurveMiddle(Curve=crv)
neg = Negative(Value=number_slider)
dom = ConstructDomain(DomainStart=neg, DomainEnd=number_slider)
curve_charge = CurveCharge(Curve=crv, Radius=Slider(25, range=0..100), ChargeStrengths=Slider(6, range=0..100))
rectangle = Rectangle(Plane=midpt, XSize=dom, YSize=dom, Radius=0)  # -> Rectangle, Length
point_charge = PointCharge(Point=divide.Points, Radius=Slider(44, range=0..100), ChargeStrength=Slider(58, range=0..100))
boundary = BoundarySurfaces(Edges=rectangle.Rectangle)
cocoon = Cocoon(
    Charges=flatten([point_charge, curve_charge]),
    Iso=Slider(0.48, range=0..1),
    CellSize=Slider(9, range=0..100),
    Execute=Toggle(True),
    Simple=False)  # -> Mesh, RefinementData
mesh = Mesh(boundary)
msmooth = SmoothMesh(Mesh=cocoon.Mesh, Strength=Slider(1, range=0..10), SkipNaked=True, Iterations=Slider(17, range=0..100))
mmx = MeshMesh(MeshA=msmooth, MeshB=mesh)
divide_2 = DivideCurve(Curve=mmx, Count=Slider(37, range=0..100), Kinks=False)  # -> Points, Tangents, Parameters
intcrv = Interpolate(Vertices=divide_2.Points, Degree=3, Periodic=invert(False), KnotStyle=1)  # -> Curve, Length, Domain
crv_2 = Curve(intcrv.Curve)
crv_3 = Curve(crv)
divlength = DivideLength(Curve=crv_2, Length=Slider(2, range=0..10))  # -> Points, Tangents, Parameters
pull = PullPoint(Point=divlength.Points, Geometry=crv_3, ClosestOnly=True)  # -> ClosestPoint, Distance
ln = Line(StartPoint=divlength.Points, EndPoint=pull.ClosestPoint)
eval = EvaluateCurve(Curve=reparameterize(ln), Parameter=Slider(0.68, range=0..1))  # -> Point, Tangent, Angle
eval_2 = EvaluateCurve(Curve=reparameterize(ln), Parameter=Slider(0.39, range=0..1))  # -> Point, Tangent, Angle
intcrv_2 = Interpolate(Vertices=eval.Point, Degree=3, Periodic=invert(False), KnotStyle=1)  # -> Curve, Length, Domain
intcrv_3 = Interpolate(Vertices=eval_2.Point, Degree=3, Periodic=invert(False), KnotStyle=1)  # -> Curve, Length, Domain
Z = UnitZ(Factor=Slider(25, range=0..1000))
Z_2 = UnitZ(Factor=Slider(97, range=0..1000))
Z_3 = UnitZ(Factor=Slider(62, range=0..1000))
move = Move(Geometry=intcrv_3.Curve, Motion=Z)  # -> Geometry, Transform
move_2 = Move(Geometry=intcrv_2.Curve, Motion=Z_2)  # -> Geometry, Transform
move_3 = Move(Geometry=intcrv_2.Curve, Motion=Z_3)  # -> Geometry, Transform
entwine = Entwine(Branch00=crv_2, Branch01=move.Geometry, Branch02=move_3.Geometry, Branch03=move_2.Geometry, FlattenInputs=True)  # -> flatten(Result)
loft = Loft(Curves=entwine, Options={Adjust=False, Closed=False, LoftEnds=0, LoftSimp=0, LoftType=0, Rebuild=10, Refit=0.01})

P = Point(Point(0, 0, 0))
Z_4 = UnitZ(Factor=1)
move_4 = Move(Geometry=P, Motion=Z_4)  # -> Geometry, Transform
contour = Contour(Shape=loft, Point=move_4.Geometry, Direction=Vector(0, 0, 1), Distance=Slider(7, range=0..10))  # -> flatten(Contours)
end = EndPoints(Curve=contour)  # -> Start, End
number_slider_2 = Slider(10, range=0..10)
dispatch = Dispatch(List=contour, DispatchPattern=[True, False])  # -> ListA, ListB
divdist = DivideDistance(Curve=dispatch.ListA, Distance=number_slider_2)  # -> Points, Tangents, Parameters
divdist_2 = DivideDistance(Curve=dispatch.ListB, Distance=number_slider_2)  # -> Points, Tangents, Parameters
dispatch_2 = Dispatch(List=divdist.Points, DispatchPattern=[True, False])  # -> ListA, ListB
dispatch_3 = Dispatch(List=divdist_2.Points, DispatchPattern=[True, False])  # -> ListA, ListB
pt = Point(dispatch_2.ListA)
pt_2 = Point(dispatch_3.ListB)

divide_3 = DivideDomain²(Domain=loft, UCount=Slider(1, range=0..1), VCount=Slider(7, range=0..10))
P_2 = Point(Point(0, 0, 0))
Z_5 = UnitZ(Factor=1)
subsrf = Isotrim(Surface=loft, Domain=divide_3)  # -> graft(Surface)
move_5 = Move(Geometry=P_2, Motion=Z_5)  # -> Geometry, Transform
contour_2 = Contour(Shape=subsrf, Point=move_5.Geometry, Direction=Vector(0, 0, 1), Distance=Slider(7, range=0..10))
shift = ShiftPaths(Data=contour_2, Offset=-1)
number_slider_3 = Slider(10, range=0..10)
dispatch_4 = Dispatch(List=flatten(shift), DispatchPattern=[True, False])  # -> ListA, ListB
divdist_3 = DivideDistance(Curve=dispatch_4.ListA, Distance=number_slider_3)  # -> Points, Tangents, Parameters
divdist_4 = DivideDistance(Curve=dispatch_4.ListB, Distance=number_slider_3)  # -> Points, Tangents, Parameters
dispatch_5 = Dispatch(List=divdist_3.Points, DispatchPattern=[True, False])  # -> ListA, ListB
dispatch_6 = Dispatch(List=divdist_4.Points, DispatchPattern=[True, False])  # -> ListA, ListB
pt_3 = Point(dispatch_5.ListA)
pt_4 = Point(dispatch_6.ListB)

item = ListItem(List=flatten(contour), Index=0, Wrap=True)
divide_4 = DivideCurve(Curve=item, Count=10, Kinks=False)  # -> Points, Tangents, Parameters
crv_4 = Curve(contour)
python = GhPythonScript(iCurves=crv_4, iPoints=divide_4.Points)  # -> out, oPoints; inputs iCurves: list of Curve, iPoints: list of Point3d
# ---------- python: Python ----------
import Rhino.Geometry as rg
import ghpythonlib.treehelpers as th

pts = []

ptTemp = []
for pt in iPoints:
    param = iCurves[0].ClosestPoint(pt)[1]
    pt = iCurves[0].PointAt(param)
    ptTemp.append(pt)
pts.append(ptTemp)

for i in range(len(iCurves)-1):
    ptTemp = []
    for pt in iPoints:
        t = iCurves[i+1].ClosestPoint(pt)[1]
        pt = iCurves[i+1].PointAt(t)
        ptTemp.append(pt)
    pts.append(ptTemp)

pts = th.list_to_tree(pts)
oPoints = pts
# ---------- end python ----------
graft = GraftTree(Tree=crv_4, IncludeEmptyLists=True, IncludeNullItems=True)
pull_2 = PullPoint(Point=python.oPoints, Geometry=graft, ClosestOnly=True)  # -> ClosestPoint, Distance
flip = FlipMatrix(Data=python.oPoints)
intcrv_4 = Interpolate(Vertices=flip, Degree=3, Periodic=False, KnotStyle=1)  # -> Curve, Length, Domain
crv_cp = CurveClosestPoint(Point=pull_2.ClosestPoint, Curve=graft)  # -> Point, Parameter, Distance
shatter = Shatter(Curve=graft, Parameters=crv_cp.Parameter)
flip_2 = FlipMatrix(Data=shatter)
midpt_2 = CurveMiddle(Curve=flip_2)
dispatch_7 = Dispatch(List=flip_2, DispatchPattern=[True, False])  # -> ListA, ListB
crv_5 = Curve(dispatch_7.ListA)
crv_6 = Curve(dispatch_7.ListB)
number_slider_4 = Slider(10, range=0..10)
shatter_2 = Shatter(Curve=reparameterize(crv_6), Parameters="0.5")
shatter_3 = Shatter(Curve=reparameterize(crv_5), Parameters="0.5")
item_2 = ListItem(List=shatter_2, Index=0, Wrap=True)  # -> Item, Item1
item_3 = ListItem(List=shatter_3, Index=0, Wrap=True)  # -> Item, Item1
division = Division(A=number_slider_4, B=2)
flip_3 = FlipCurve(Curve=item_2.Item)  # -> Curve, Flag
flip_4 = FlipCurve(Curve=item_3.Item)  # -> Curve, Flag
merge = Merge(Data1=flip_3.Curve, Data2=item_2.Item1)
merge_2 = Merge(Data1=flip_4.Curve, Data2=item_3.Item1)
neg_2 = Negative(Value=division)
ext = ExtendCurve(Curve=merge_2, Type=0, Start=neg_2, End="0")
divdist_5 = DivideDistance(Curve=ext, Distance=number_slider_4)  # -> Points, Tangents, Parameters
divdist_6 = DivideDistance(Curve=merge, Distance=number_slider_4)  # -> Points, Tangents, Parameters
tstat = TreeStatistics(Tree=divdist_5.Points)  # -> Paths, Length, Count
tstat_2 = TreeStatistics(Tree=divdist_6.Points)  # -> Paths, Length, Count
panel = Panel("""0
1""")
panel_2 = Panel("""0
1""")
unweave = Unweave(List=tstat.Paths, UnweavePattern=panel)  # -> Data0, Data1
unweave_2 = Unweave(List=tstat_2.Paths, UnweavePattern=panel_2)  # -> Data0, Data1
branch = TreeBranch(Tree=divdist_5.Points, Path=unweave.Data1, MaintainPaths=True)
branch_2 = TreeBranch(Tree=divdist_5.Points, Path=unweave.Data0, MaintainPaths=True)  # -> reverse(Branch)
branch_3 = TreeBranch(Tree=divdist_6.Points, Path=unweave_2.Data1, MaintainPaths=True)
branch_4 = TreeBranch(Tree=divdist_6.Points, Path=unweave_2.Data0, MaintainPaths=True)  # -> reverse(Branch)
merge_3 = Merge(Data1=branch, Data2=branch_2)
merge_4 = Merge(Data1=branch_4, Data2=branch_3)
shift_2 = ShiftPaths(Data=merge_3, Offset=-1)  # -> simplify(Data)
shift_3 = ShiftPaths(Data=merge_4, Offset=-1)  # -> simplify(Data)
path_mapper = PathMapper(shift_3, source="{A;B}", target="{A;B*2+1}")
path_mapper_2 = PathMapper(shift_2, source="{A;B}", target="{A;B*2}")
merge_5 = Merge(Data1=path_mapper_2, Data2=path_mapper)
cullpt = CullDuplicates(Points=merge_5, Tolerance=0.1, CullMode=3)  # -> simplify(Points), Indices, Valence
path_mapper_3 = PathMapper(cullpt.Points, source="{A;B}", target="{B}")
cullpt_2 = CullDuplicates(Points=path_mapper_3, Tolerance=Slider(5.18, range=0..10), CullMode=3)  # -> simplify(Points), Indices, Valence
cluster = BranchLook(data=cullpt_2.Points, i=Slider(4, range=0..13))
points = PointList(Points=cluster, Size=Slider(5, range=0..10))
srf_2 = Surface(loft)
python_2 = GhPythonScript(iPoints=cullpt_2.Points, iSurface=srf_2, iTolerance=Slider(12.1, range=0..20))  # -> out, oPoints, oAddPt; inputs iPoints: tree of Point3d, iSurface: Surface
# ---------- python_2: Python ----------
import Rhino.Geometry as rg
from ghpythonlib.components import Average
import ghpythonlib.treehelpers as th

mainPtList = []
addPt = []
for ptList in iPoints.Branches:
    tempPtList = []
    for i in range(len(ptList)-1):
        pt_0 = ptList[i]
        pt_1 = ptList[i+1]
        dist = rg.Point3d.DistanceTo(pt_0, pt_1)
        if dist>iTolerance:
            midPt = Average([pt_0, pt_1])
            u = iSurface.ClosestPoint(midPt)[1]
            v = iSurface.ClosestPoint(midPt)[2]
            midPt = iSurface.PointAt(u,v)
            addPt.append(midPt)
            tempPtList.append(pt_0)
            tempPtList.append(midPt)
            
        else:
            tempPtList.append(pt_0)
    tempPtList.append(ptList[len(ptList)-1])
    mainPtList.append(tempPtList)

for i, ptList in enumerate(mainPtList):
    startPt = ptList[0]
    endPt = ptList[len(ptList)-1]
    dist = rg.Point3d.DistanceTo(startPt, endPt)
    if dist>iTolerance:
        midPt = Average([startPt, endPt])
        u = iSurface.ClosestPoint(midPt)[1]
        v = iSurface.ClosestPoint(midPt)[2]
        midPt = iSurface.PointAt(u,v)
        mainPtList[i].append(midPt)
        addPt.append(midPt)



mainPtList = th.list_to_tree(mainPtList)
oPoints = mainPtList
oAddPt = addPt
# ---------- end python_2 ----------
pt_5 = Point(python_2.oAddPt)
pt_6 = Point(python_2.oPoints)
msphere = MeshSphere(Base=pt_6, Radius=Slider(6, range=0..10), UCount=10, VCount=20)
pline = PolyLine(Vertices=flatten(pt_6), Closed=False)
preview = CustomPreview(
    Geometry=msphere,
    Material={diffuse=RGB(221, 160, 221), emission=RGB(66, 48, 66), shine=0.5, specular=RGB(255, 255, 255), transparency=0})

# ==== cluster BranchLook: To see the condition of branch data.
data = ClusterInput()
data_2 = Data(data)
tstat = TreeStatistics(Tree=data_2)  # -> Paths, Length, Count
i = ClusterInput()
item = ListItem(List=tstat.Paths, Index=i, Wrap=True)
branch = TreeBranch(Tree=data_2, Path=item, MaintainPaths=True)
B = ClusterOutput(branch)
