# Grasshopper definition ver3.ghx (Grasshopper 1.0.7)
# plug-ins: Anemone, treesloth01

number_slider = Slider(4.5, range=0..10)  # disabled
srf = Surface(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)  # disabled
contour = Contour(Shape=srf, Point=Point(0, 0, 0), Direction=Vector(0, 0, 1), Distance=number_slider)  # -> flatten(Contours); disabled
brep = Brep(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)  # disabled
number_slider_2 = Slider(3, range=0..10)  # disabled
area = Area(Geometry=brep)  # -> Area, Centroid; disabled
toggle = BooleanToggle(False)  # disabled
crv = Curve(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)
srf_2 = Surface(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)
number_slider_3 = Slider(4, range=0..100)  # disabled
orient = Orient(Geometry=brep, Source=area.Centroid, Target=PlaneXY(0, 0, 0))  # -> simplify(Geometry), Transform; disabled
python = GhPythonScript(iSurface=srf_2, iChunkOutline=crv, iLayerHeight=Slider(3.7, range=0..10), iAdjust=Toggle(False))  # -> out, oContourLine, oChunkOutline, oChunkCentral, oCheck, oStartPt; inputs iSurface: Surface, iChunkOutline: Curve, iAdjust: Boolean
# ---------- python: Python ----------
import Rhino.Geometry as rg
from ghpythonlib.components import Area, Length, Seam
from copy import deepcopy

class Model:
    def __init__(self, surface, layerHeight, chunkOutline):
        global iAdjust
        self.surface = surface
        self.layerHeight = layerHeight
        self.chunkOutline = chunkOutline
        self.contourCrvs = self.contour(self.surface, self.layerHeight)
        self.chunks = self.chunkProcess(self.chunkOutline, self.contourCrvs)
    
    
    def contour(self, surface, height):
        surface = rg.Surface.ToBrep(surface)
        return rg.Brep.CreateContourCurves(surface, rg.Point3d(0,0,0), rg.Point3d(0,0,900), height)
    
    
    def chunkProcess(self, chunk, crvList):
        self.pttt = []
        ptBranch = []
        chunkCrvBranch = []
        self.check = []
        for i, crv in enumerate(crvList):
            crv.Domain = rg.Interval(0,1)
            if i == 0:
                ptList = [crv.PointAtStart]
                chunkCrvList = []
                stPt = crv.PointAt(0)
                self.chunkArray(chunk, crv, stPt, 50, ptList, chunkCrvList)
                ptBranch.append(ptList[:-1])
                chunkCrvBranch.append(chunkCrvList[:-1])

            else:
                startSeam = (ptBranch[i-1][0] + ptBranch[i-1][1])/2
                
                self.pttt.append(crv.PointAt(crv.ClosestPoint(startSeam, 100)[1]))
                crv = Seam(crv, crv.ClosestPoint(startSeam, 100)[1])
                
                #crv.ChangeClosedCurveSeam(crv.ClosestPoint(startSeam, 10)[1])
                ptList = [crv.PointAtStart]
                chunkCrvList = []
                stPt = crv.PointAt(0)
                self.chunkArray(chunk, crv, stPt, 50, ptList, chunkCrvList)
                
                #remap the ptList
                if iAdjust:
                    ptList = ptList[:-1]
                    startT = crv.ClosestPoint(ptList[0], 100)[1]
                    endT = crv.ClosestPoint(ptList[-1], 100)[1]
                    for i, pt in enumerate(ptList):
                        t = crv.ClosestPoint(pt, 100)[1]
                        newT = self.remap(t,startT, endT, 0, 1)
                        ptList[i] = crv.PointAt(newT)
                        print newT
                
                ptBranch.append(ptList[:-1])
                chunkCrvBranch.append(chunkCrvList[:-1])
            
        return [chunkCrvBranch, ptBranch]
    
    
    def chunkArray(self, chunk, layerCrv, pt, time, ptList, chunkCrvList):
        chunkClone = deepcopy(chunk)
        centPt = Area(chunk)[1]
        trans = rg.Transform.Translation(pt - centPt)
        chunkClone.Transform(trans)
        
        vec = rg.Point3d.Add(rg.Point3d(0,0,0),(pt - centPt))
        chunkClone2 = deepcopy(chunkClone)
        trans2 = rg.Transform.Scale(vec,2)
        chunkClone2.Transform(trans2)
        
        pts = []
        events = rg.Intersect.Intersection.CurveCurve(layerCrv, chunkClone2, tolerance=0.1, overlapTolerance=0.1)
        for i in range(len(events)):
            pts.append(events[i].PointA)
        
        v1 = pts[0] - Area(layerCrv)[1]
        v2 = pts[1] - Area(layerCrv)[1]
        z = rg.Vector3d.CrossProduct(v1, v2).Z
        if z>0:
            pts = pts
        else:
            pts.reverse()
        
        nextPt = pts[0]
        ptList.append(nextPt)
        chunkCrvList.append(chunkClone)
        
        time = time-1
        if len(ptList)>3 and time>0:
            connectCrv = rg.Curve.CreateInterpolatedCurve(ptList, 3)
            self.check.append(connectCrv)
            if Length(connectCrv) < Length(layerCrv):
                self.chunkArray(chunk, layerCrv, nextPt, time, ptList, chunkCrvList)
        
        elif time>0:
            self.chunkArray(chunk, layerCrv, nextPt, time, ptList, chunkCrvList)
        
        
    def remap(self, value, low1, high1, low2, high2):
        new_value = low2 + (value-low1)*(high2-low2)/(high1-low1)
        return new_value




testModel = Model(iSurface, iLayerHeight, iChunkOutline)
oContourLine = testModel.contourCrvs
oChunkOutline = testModel.chunks[0] #before adjust
oChunkCentral = testModel.chunks[1]
oCheck = testModel.check
oStartPt = testModel.pttt
# ---------- end python ----------
loop_start = LoopStart(N=number_slider_2, T=toggle, D0=contour)  # -> port, Counter, Data, Data_2; disabled
number_slider_4 = Slider(3, range=0..10)  # disabled
series = Series(Start=0, Step=1, Count=number_slider_3)  # disabled
toggle_2 = BooleanToggle(False)  # disabled
sec = BrepPlane(Brep=orient.Geometry, Plane=PlaneXY(0, 0, 0))  # -> Curves, Points; disabled
panel = Panel("2")  # disabled
item = ListItem(List=python.oCheck, Index=Slider(0, range=0..10), Wrap=True)
item_2 = ListItem(List=loop_start.Data, Index=loop_start.Counter, Wrap=True)  # disabled
partition = PartitionList(List=series, Size=panel)  # disabled
panel_2 = Panel(loop_start.Counter)  # disabled
area_2 = Area(Geometry=sec.Curves)  # -> Area, Centroid; disabled
crv_2 = Curve(item_2)  # disabled
brep_2 = Brep(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)
crv_3 = Curve(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)
crv_4 = Curve(python.oContourLine)
item_3 = ListItem(List=crv_4, Index=0, Wrap=True)
python_2 = GhPythonScript(x=python.oChunkOutline)  # -> out, a
# ---------- python_2: Python ----------
a = x
# ---------- end python_2 ----------
panel_3 = Panel("2")  # disabled
python_3 = GhPythonScript(x=python.oChunkCentral)  # -> out, a; same code as python_2
len = Length(Curve=item)
loop_start_2 = LoopStart(N=number_slider_4, T=toggle_2, D0=partition)  # -> port, Counter, Data, Data_2; disabled
len_2 = Length(Curve=item_3)
number_slider_5 = Slider(10, range=0..10)  # disabled
cluster = BranchLook(data=loop_start_2.Data, i=loop_start_2.Counter)  # disabled
scale = Scale(Geometry=sec.Curves, Center=area_2.Centroid, Factor=panel_3)  # -> Geometry, Transform; disabled
number_slider_6 = Slider(21, range=0..100)  # disabled
area_3 = Area(Geometry=brep_2)  # -> Area, Centroid
end = EndPoints(Curve=crv_2)  # -> Start, End; disabled
pt = Point(python.oStartPt)
end_2 = EndPoints(Curve=crv_4)  # -> Start, End
toggle_3 = BooleanToggle(False)  # disabled
series_2 = Series(Start=cluster, Step=1, Count=10)  # disabled
crv_5 = Curve(sec.Curves)  # disabled
panel_4 = Panel(loop_start_2.Counter)  # disabled
area_4 = Area(Geometry=python_2.a)  # -> Area, Centroid
orient_2 = Orient(Geometry=brep_2, Source=area_3.Centroid, Target=python_3.a)  # -> simplify(Geometry), Transform
loop_start_3 = LoopStart(Repeat=number_slider_5, Data=series_2)  # -> port, Counter, Data; disabled
loop_start_4 = LoopStart(N=number_slider_6, T=[toggle_3, number_slider_6], D0=end.Start)  # -> port, Counter, Data, Data_2; disabled
merge = Merge(Data1=scale.Geometry, Data2=crv_5)  # disabled
pt_2 = Point(area_2.Centroid)  # disabled
number_slider_7 = Slider(29, range=0..53)
panel_5 = Panel(loop_start_3.Counter)  # disabled
cluster_2 = BranchLook(data=loop_start_3.Data, i=loop_start_3.Counter)  # disabled
group = Group(Objects=flatten(orient_2.Geometry))
ma = MassAddition(Input=cluster_2)  # -> Result, PartialResults; disabled
equals = Equality(FirstNumber=loop_start_4.Counter, SecondNumber=number_slider_6)  # -> Equality, Inequality; disabled
panel_6 = Panel(loop_start_4.Counter)  # disabled
orient_3 = Orient(Geometry=merge, Source=pt_2, Target=loop_start_4.Data)  # -> simplify(Geometry), Transform; disabled
cluster_3 = BranchLook(data=orient_2.Geometry, i=number_slider_7)
loop_end = LoopEnd(port=loop_start_3.port, Exit=False, Data=ma.Result, TimeOutVal=0, pausedState=False, state="Output last")  # disabled
cluster_4 = BranchLook(data=python_2.a, i=number_slider_7)
item_4 = ListItem(List=python.oContourLine, Index=number_slider_7, Wrap=True)
crv_6 = Curve(reparameterize(crv_2))  # disabled
loop_end_2 = LoopEnd(
    port=loop_start_2.port,
    Exit=False,
    Data=partition,
    Data_2=loop_end,
    TimeOutVal=0,
    pausedState=False,
    state="Constant output")  # -> D0, D1; disabled
not = GateNot(A=equals.Equality)  # disabled
item_5 = ListItem(List=orient_3.Geometry, Index=0, Wrap=True)  # disabled
preview = CustomPreview(
    Geometry=orient_2.Geometry,
    Material={diffuse=RGB(221, 160, 221), emission=RGB(66, 48, 66), shine=0.5, specular=RGB(255, 255, 255), transparency=0})
item_6 = ListItem(List=cluster_3, Index=0, Wrap=True)
ccx = CurveCurve(CurveA=reparameterize(item_5), CurveB=reparameterize(crv_6))  # -> Points, ParamsA, ParamsB; disabled
area_5 = Area(Geometry=crv_6)  # -> Area, Centroid; disabled
python_4 = GhPythonScript(x=loop_start_4.Counter)  # -> a; disabled
# ---------- python_4: Python ----------
if x < 2:
    a = 0
else:
    a = 1
# ---------- end python_4 ----------
vec2pt = Vector2Pt(PointA=area_5.Centroid, PointB=ccx.Points, Unitize=False)  # -> Vector, Length; disabled
item_7 = ListItem(List=ccx.Points, Index=0, Wrap=True)  # disabled
item_8 = ListItem(List=vec2pt.Vector, Index=0, Wrap=True)  # -> Item, Item1; disabled
xprod = CrossProduct(VectorA=item_8.Item, VectorB=item_8.Item1, Unitize=False)  # -> Vector, Length; disabled
devec = DeconstructVector(Vector=xprod.Vector)  # -> XComponent, YComponent, ZComponent; disabled
larger = LargerThan(FirstNumber=devec.ZComponent, SecondNumber=0)  # -> LargerThan, OrEqualTo; disabled
sift = SiftPattern(List=ccx.Points, SiftPattern=larger.LargerThan)  # -> Output0, Output1; disabled
rev = ReverseList(List=sift.Output0)  # disabled
combine = CombineData(Input0=rev, Input1=sift.Output1)  # -> Result, Index; disabled
item_9 = ListItem(List=combine.Result, Index=0, Wrap=True)  # -> simplify(Item); disabled
loop_end_3 = LoopEnd(
    port=loop_start_4.port,
    Exit=False,
    Data=item_9,
    Data_2=orient_3.Geometry,
    TimeOutVal=0,
    pausedState=False,
    state="Last & Record")  # -> D0, D1; disabled
item_10 = ListItem(List=reverse(loop_end_3.D1), Index=0, Wrap=True)  # disabled
renumber = RenumberPaths(Data=item_10)  # disabled
loop_end_4 = LoopEnd(
    port=loop_start.port,
    Exit=not,
    Data=loop_start.Data,
    Data_2=renumber,
    TimeOutVal=0,
    pausedState=False,
    state="Constant & Record")  # -> D0, D1; disabled

# ==== cluster BranchLook: To see the condition of branch data.
data = ClusterInput()
data_2 = Data(data)
tstat = TreeStatistics(Tree=data_2)  # -> Paths, Length, Count
i = ClusterInput()
item = ListItem(List=tstat.Paths, Index=i, Wrap=True)
branch = TreeBranch(Tree=data_2, Path=item, MaintainPaths=True)
B = ClusterOutput(branch)
