# Grasshopper definition ver4.ghx (Grasshopper 1.0.7)
# plug-ins: treesloth01, Wallacei

genes = GenePool(
    Decimals=1,
    Maximum=20,
    Minimum=7,
    Value=[13.1, 7.8, 8.4, 12.5, 10.3, 19.8, 7.6, 11, 12.9, 11, 9.2, 18.5, 16.4, 19.6, 15.5, 18.9, 9.9, 7.2, 8.1, 9.6, 7.6, 7.4, 8.5, 14.5, 8.3, 15.4, 16.2, 19.9, 7.9, 11.6])
genes_2 = GenePool(
    Decimals=1,
    Maximum=20,
    Minimum=7,
    Value=[16.5, 16.6, 10.1, 20, 19.2, 9.6, 10.1, 12.1, 12.4, 16, 12.4, 17.7, 15.8, 18.1, 19.1, 13.2, 15.7, 10.7, 8.9, 9.1, 7.6, 19.8, 8.5, 18.6, 10.7, 12.7, 19.3, 13.3, 11.5, 14.9])
genes_3 = GenePool(
    Decimals=1,
    Maximum=20,
    Minimum=7,
    Value=[10.6, 8.3, 17.7, 9, 14, 12.6, 15.4, 17.3, 17.4, 13.3, 16.2, 18.1, 14.8, 11.5, 15.7, 9.9, 8.4, 10.1, 13.1, 14.9, 19.4, 12.5, 17.8, 18.8, 11.1, 18, 15.1, 11.4, 16.3, 13.3])
genes_4 = GenePool(
    Decimals=1,
    Maximum=20,
    Minimum=7,
    Value=[10.3, 16.3, 18.7, 7.6, 13.9, 9.9, 7, 17.1, 11.4, 12, 17.9, 18.4, 13.3, 16.2, 13.3, 9.6, 11.1, 16.5, 10, 7.8, 11.4, 16.2, 18.5, 16.7, 20, 19.2, 10.3, 19.2, 17.9, 16])
brep = Brep(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)
genes_5 = GenePool(
    Decimals=1,
    Maximum=20,
    Minimum=7,
    Value=[17.5, 11, 7.6, 11.1, 9.6, 19.5, 17.7, 18, 17.3, 12.7, 9.8, 11.4, 18.7, 8.9, 18, 7.7, 19.2, 8.6, 12.5, 8.5, 13.9, 14.7, 8.4, 15.5, 9.1, 17.2, 17.8, 10.8, 7, 14.7])
genes_6 = GenePool(Decimals=1, Maximum=20, Minimum=7, Value=[9.9, 7, 7, 7, 7, 7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])
contour = Contour(Shape=brep, Point=Point(0, 0, 0), Direction=Vector(0, 0, 1), Distance=Slider(3.7, range=0..10))
divdist = DivideDistance(Curve=contour, Distance="7")  # -> Points, Tangents, Parameters
lng = ListLength(List=flatten(divdist.Points))
entwine = Entwine(Branch00=genes, Branch01=genes_2, Branch02=genes_3, Branch03=genes_4, Branch04=genes_5, FlattenInputs=True)
series = Series(Start=0, Step=1, Count="5")
genes_7 = GenePool(Decimals=1, Maximum=10, Minimum=0, Value=[9.8, 0.6, 9.4, 6.5, 6.9])
item = ListItem(List=flatten(contour), Index=series, Wrap=True)  # -> graft(Item)
ins = InsertItems(List=entwine, Item=graft("0"), Indices="0", Wrap=True)
ma = MassAddition(Input=ins)  # -> Result, PartialResults
eval = EvaluateLength(Curve=item, Length=graft(genes_7), Normalized=invert(True))  # -> Point, Tangent, Parameter
seam = Seam(Curve=item, Seam=eval.Parameter)
eval_2 = EvaluateLength(Curve=seam, Length=ma.PartialResults, Normalized=invert(True))  # -> Point, Tangent, Parameter
clean = CleanTree(RemoveNulls=True, RemoveInvalid=True, RemoveEmpty=invert(False), Tree=eval_2.Point)
end = EndPoints(Curve=seam)  # -> Start, End
item_2 = ListItem(List=clean, Index=0, Wrap=True)  # -> Item1, Item
dist = Distance(PointA=item_2.Item1, PointB=item_2.Item)
smaller = SmallerThan(FirstNumber=dist, SecondNumber="5")  # -> SmallerThan, OrEqualTo
panel = Panel(smaller.SmallerThan)
python = GhPythonScript(chunk=clean, bool=smaller.SmallerThan)  # -> out, simplify(oChunk); inputs chunk: tree, bool: tree of Boolean
# ---------- python: Python ----------
import ghpythonlib.treehelpers as th

oChunk = []
for i, b in enumerate(bool.Branches):
    if b:
        oChunk.append(chunk.Branches[i][:-1])
    else:
        oChunk.append(chunk.Branches[i][:])

oChunk = th.list_to_tree(oChunk)
# ---------- end python ----------
panel_2 = Panel(python.oChunk)
brep_2 = Brep(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)
tstat = TreeStatistics(Tree=python.oChunk)  # -> Paths, Length, Count
area = Area(Geometry=brep_2)  # -> Area, Centroid
lng_2 = ListLength(List=tstat.Paths)
crv = Curve(simplify(item))
mesh = Mesh(brep_2)
cull_i = CullIndex(List=tstat.Paths, Indices="0", Wrap=True)
culln = CullNth(List=tstat.Paths, CullFrequency=lng_2)
orient = Orient(Geometry=mesh, Source=area.Centroid, Target=python.oChunk)  # -> simplify(Geometry), Transform
branch = TreeBranch(Tree=python.oChunk, Path=cull_i, MaintainPaths=True)
branch_2 = TreeBranch(Tree=crv, Path=culln, MaintainPaths=True)
branch_3 = TreeBranch(Tree=python.oChunk, Path=culln, MaintainPaths=True)
preview = CustomPreview(
    Geometry=orient.Geometry,
    Material={diffuse=RGB(221, 160, 221), emission=RGB(66, 48, 66), shine=0.5, specular=RGB(255, 255, 255), transparency=0})
crv_cp = CurveClosestPoint(Point=branch, Curve=branch_2)  # -> Point, Parameter, Distance
crv_cp_2 = CurveClosestPoint(Point=branch_3, Curve=branch_2)  # -> Point, Parameter, Distance
panel_3 = Panel(crv_cp_2.Parameter)
cp = ClosestPoint(Point=crv_cp.Point, Cloud=crv_cp_2.Point)  # -> ClosestPoint, CPIndex, Distance
addition = Addition(A=cp.CPIndex, B=1)
subtraction = Subtraction(A=cp.CPIndex, B=1)
item_3 = ListItem(List=crv_cp_2.Point, Index=addition, Wrap=True)
item_4 = ListItem(List=crv_cp_2.Point, Index=subtraction, Wrap=True)
vec2pt = Vector2Pt(PointA=crv_cp.Point, PointB=item_4, Unitize=invert(False))  # -> Vector, Length
vec2pt_2 = Vector2Pt(PointA=crv_cp.Point, PointB=cp.ClosestPoint, Unitize=invert(False))  # -> Vector, Length
vec2pt_3 = Vector2Pt(PointA=crv_cp.Point, PointB=item_3, Unitize=invert(False))  # -> Vector, Length
graft = GraftTree(Tree=item_3, IncludeEmptyLists=True, IncludeNullItems=True)
graft_2 = GraftTree(Tree=item_4, IncludeEmptyLists=True, IncludeNullItems=True)
merge = Merge(Data1=graft, Data2=graft_2)
dprod = DotProduct(VectorA=vec2pt_2.Vector, VectorB=vec2pt.Vector, Unitize=False)
dprod_2 = DotProduct(VectorA=vec2pt_2.Vector, VectorB=vec2pt_3.Vector, Unitize=False)
graft_3 = GraftTree(Tree=dprod_2, IncludeEmptyLists=True, IncludeNullItems=True)
graft_4 = GraftTree(Tree=dprod, IncludeEmptyLists=True, IncludeNullItems=True)
panel_4 = Panel(dprod_2)
panel_5 = Panel(dprod)
merge_2 = Merge(Data1=graft_3, Data2=graft_4)
sort = SortList(Keys=merge_2, ValuesA=merge)  # -> Keys, ValuesA
item_5 = ListItem(List=sort.ValuesA, Index=0, Wrap=True)
shift = ShiftPaths(Data=item_5, Offset=-1)
ln = Line(StartPoint=crv_cp.Point, EndPoint=shift)  # -> graft(Line)
ln_2 = Line(StartPoint=crv_cp.Point, EndPoint=cp.ClosestPoint)  # -> graft(Line)
len = Length(Curve=ln_2)
len_2 = Length(Curve=ln)
subtraction_2 = Subtraction(A=len, B=len_2)
abs = Absolute(Value=subtraction_2)  # -> flatten(Result)
ma_2 = MassAddition(Input=abs)  # -> Result, PartialResults
wallacei_x = WallaceiX(
    Genes=[genes, genes_2, genes_3, genes_4, genes_5, genes_7],
    Objectives=ma_2.Result,
    allFitness="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",
    allFrontIdx="41|0",
    allGenomes="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",
    curFrontIdx="41|0",
    curFrontIdxSave="0|15;1|0;2|0;3|0;3|1;4|0;5|0;5|1;6|0;7|0;8|0;9|0;10|0;11|0;12|0;13|0;14|0;15|0;16|0;17|0;18|0;18|1;19|0;19|1;19|2;20|0;21|0;22|0;23|0;24|0;25|0;26|0;27|0;28|0;29|0;30|0;31|0;32|0;33|0;34|0;35|0;36|0;37|0;38|0;38|1;38|2;39|0;40|0;40|1;40|2;41|0",
    popGen="50,100",
    total="151391",
    wlcDone=True)  # -> WallaceiGenomes, FitnessValues, Data, WPhenotypes
