# Grasshopper definition 1901_Checkerboard_yuki.gh (Grasshopper 1.0.7)

geometry = Geometry(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)
area = Area(Geometry=geometry)  # -> Area, Centroid
scale = Scale(Geometry=geometry, Center=area.Centroid, Factor=Slider(10, range=0..10))  # -> Geometry, Transform
surface = Surface(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)
ghpython_script = GhPythonScript(surface=surface, shit_distance=Slider(75.4, range=0..100), obj=scale.Geometry)  # -> out, b, pts, vis_halfCurve, even_planes, odd_planes, middle_plane, half_curve, objs; inputs surface: Surface, obj: Surface
# ---------- ghpython_script: Python ----------
import Rhino.Geometry as rg
import Rhino
import math
from copy import deepcopy
from ghpythonlib import treehelpers as th


tolerance = Rhino.RhinoDoc.ActiveDoc.ModelAbsoluteTolerance
shit_height = 50
shit_width = 20

class Column(object):
    
    global height
    global width
    
    def __init__(self, surface, shit_distance, outside_shellDist, edge_t):
        self.surface = surface
        self.shit_distance = shit_distance
        self.outside_shellDist = outside_shellDist
        self.edge_t = edge_t
        
    def create_contours(self, surface, height):
        bounding_box = rg.Brep.GetBoundingBox(surface, rg.Plane.WorldXY) 
        layer_amount =  int(math.ceil(bounding_box.Max.Z/shit_height)) 
        self.inter_crvs = []
        for i in range(layer_amount):
            origin = rg.Point3d(0,0,i*shit_height)
            brep = surface.ToBrep()
            plane = rg.Plane(origin, rg.Vector3d.XAxis, rg.Vector3d.YAxis)
            intersection_event = rg.Intersect.Intersection.BrepPlane(brep,plane,tolerance)
            self.inter_crvs.append(intersection_event[1][0])
        return self.inter_crvs
        
    def get_points(self):
        self.inter_crvs[0].Domain = rg.Interval(0,1)
        half_curve = rg.Curve.Split(self.inter_crvs[0], [0.0,0.5])[0]
        line = rg.Line(half_curve.PointAtStart, half_curve.PointAtEnd)
        self.curve = rg.Line.ToNurbsCurve(line)
        tList = self.curve.DivideByLength(round(rg.Curve.GetLength(self.curve)/shit_width) ,True)

        self.even_planes = []
        self.odd_planes = []             
        for i, t in enumerate(tList):
            if i%2 == 0:
                point = self.curve.PointAt(t)
                even_plane = rg.Plane(point, rg.Vector3d.YAxis)
                self.even_planes.append(even_plane)
            elif i%2 == 1:
                point = self.curve.PointAt(t)
                odd_plane = rg.Plane(point, rg.Vector3d.YAxis)
                self.odd_planes.append(odd_plane)
        self.pts = []
        for i, curve in enumerate(self.inter_crvs):
            pt_list = []
            if i%2 == 0:
                for even_plane in self.even_planes[1:-1]:
                    event = rg.Intersect.Intersection.CurvePlane(curve, even_plane, tolerance=0)
                    if event != None:
                        for i in range(len(event)):
                            pt_list.append(event[i].PointA)
                            
            elif i%2 == 1:
                for odd_plane in self.odd_planes:
                    event = rg.Intersect.Intersection.CurvePlane(curve, odd_plane, tolerance=0)
                    if event != None:
                        for i in range(len(event)):
                            pt_list.append(event[i].PointA)
            self.pts.append(pt_list)
        return [self.even_planes, self.odd_planes, self.pts]
        
    def get_seamPoints(self):
        t_middle = self.curve.DivideByCount(2, False)[0]
        middle_plane = rg.Plane(self.curve.PointAt(t_middle), rg.Vector3d.XAxis)
        self.seam_pts = []
        for i, curve in enumerate(self.inter_crvs):
            if i % 2 == 0:
                intersection_event = rg.Intersect.Intersection.CurvePlane(curve, middle_plane, tolerance=0)
                if intersection_event != None:
                    for i in range(len(intersection_event)):
                        self.seam_pts .append(intersection_event[i].PointA)
        
        
        
        
        
        return [middle_plane, self.seam_pts]
        
        
#        for i, curve in enumerate(self.inter_crvs):
#            curve.Domain = rg.Interval(0,1)
#            half_curve = rg.Curve.Split(curve,[0.0,0.5])[0]
#            
#            lines.append(line)
#            
#            tList = half_curve.DivideByLength(shit_distance,True)
#            if i%2 == 0:
#                points = []
#                for t_t in tList[i%2::2]:
#                    point = half_curve.PointAt(t_t)
#                    points.append(point)
#                points_total.append(points[1:-1])
#                
#            else:
#                points = []
#                for t_t in tList[i%2::2]:
#                    point = half_curve.PointAt(t_t)
#                    points.append(point)
#                points_total.append(points)
#                
#        return [points_total, lines]
#            
#            half_curves.append(half_curve)
#        return half_curves

a = Column(surface, shit_distance, outside_shellDist, edge_t)
b = a.create_contours(surface, shit_height)
pts = a.get_points()[2] 
pts2 = a.get_seamPoints()[1]
total_pts = pts.append(pts2)
even_planes = a.get_points()[0]
odd_planes = a.get_points()[1]
middle_plane = a.get_seamPoints()[0]
half_curve = a.curve


objs = []
for points in pts:
    for p in points:
        trans = rg.Transform.Translation(rg.Vector3d(p))
        obj_clone = deepcopy(obj)
        obj_clone.Transform(trans)
        objs.append(obj_clone)
        
pts = th.list_to_tree(pts)
# ---------- end ghpython_script ----------
curve = Curve(ghpython_script.b)
plane = Plane(ghpython_script.even_planes)
plane_2 = Plane(ghpython_script.odd_planes)
plane_3 = Plane(ghpython_script.middle_plane)
curve_2 = Curve(ghpython_script.half_curve)
surface_2 = Surface(ghpython_script.objs)
list_item = ListItem(List=ghpython_script.pts, Index=0, Wrap=True)  # -> Item2, Item1, Item, Item1_2
custom_preview = CustomPreview(Geometry=surface_2, Material=ColourSwatch(SwatchColor=RGB(255, 255, 255)))
panel = Panel(ghpython_script.pts)
panel_2 = Panel(ghpython_script.b)
