# Grasshopper definition 0118_print_execute_different_way_Jerry.ghx (Grasshopper 1.0.7)

point = Point(Tree({0}: [Point(537.0779998, -177.8772965, 0), Point(467.0779998, -334.5972965, 0), Point(397.0779998, -386.8372965, 0), Point(327.0779998, -417.2710508, 0), Point(257.0779998, -433.7999849, 0), Point(187.0779998, -439.0772965, 0), Point(117.0779998, -433.7999849, 0), Point(47.07799982, -417.2710508, 0), Point(-22.92200018, -386.8372965, 0), Point(-92.92200018, -334.5972965, 0), Point(-162.9220002, -177.8772965, 0), Point(-92.92200018, -21.15729652, 0), Point(-22.92200018, 31.08270348, 0), Point(47.07799982, 61.51645778, 0), Point(117.0779998, 78.0453918, 0), Point(187.0779998, 83.32270348, 0), Point(257.0779998, 78.0453918, 0), Point(327.0779998, 61.51645778, 0), Point(397.0779998, 31.08270348, 0), Point(467.0779998, -21.15729652, 0)], {1}: [Point(530.7143635, -177.8772965, 45), Point(502.0779998, -276.7731557, 45), Point(432.0779998, -351.3928426, 45), Point(362.0779998, -390.8399342, 45), Point(292.0779998, -413.4971428, 45), Point(222.0779998, -424.0449739, 45)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], {2}: [Point(524.3507271, -177.8772965, 90), Point(467.0779998, -308.1660288, 90), Point(397.0779998, -360.7563477, 90), Point(327.0779998, -390.5007732, 90), Point(257.0779998, -406.4973746, 90), Point(187.0779998, -411.5863874, 90)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], {3}: [Point(502.0779998, -252.8772965, 135), Point(432.0779998, -325.7332175, 135), Point(362.0779998, -364.5643295, 135), Point(292.0779998, -386.4737927, 135), Point(222.0779998, -396.6070915, 135), Point(152.0779998, -396.6070915, 135)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], {4}: [Point(511.6234544, -177.8772965, 180), Point(467.0779998, -282.1492716, 180), Point(397.0779998, -335.106304, 180), Point(327.0779998, -363.9219554, 180), Point(257.0779998, -379.2416619, 180), Point(187.0779998, -384.0954783, 180)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], {5}: [Point(502.0779998, -177.8772965, 225), Point(432.0779998, -300.6833433, 225), Point(362.0779998, -338.6237153, 225), Point(292.0779998, -359.567881, 225), Point(222.0779998, -369.1820198, 225), Point(152.0779998, -369.1820198, 225), Point(82.07799982, -359.567881, 225), Point(12.07799982, -338.6237153, 225), Point(-57.92200018, -300.6833433, 225), Point(-127.9220002, -177.8772965, 225), Point(-57.92200018, -55.07124974, 225), Point(12.07799982, -17.13087777, 225), Point(82.07799982, 3.813287953, 225), Point(152.0779998, 13.42742678, 225), Point(222.0779998, 13.42742678, 225), Point(292.0779998, 3.813287953, 225), Point(362.0779998, -17.13087777, 225), Point(432.0779998, -55.07124974, 225)], {6}: [Point(467.0779998, -256.5313709, 270), Point(397.0779998, -309.9951977, 270), Point(327.0779998, -337.5776233, 270), Point(257.0779998, -352.0428129, 270), Point(187.0779998, -356.6045693, 270), Point(117.0779998, -352.0428129, 270), Point(47.07799982, -337.5776233, 270), Point(-22.92200018, -309.9951977, 270), Point(-92.92200018, -256.5313709, 270), Point(-92.92200018, -99.22322211, 270), Point(-22.92200018, -45.75939536, 270), Point(47.07799982, -18.17696976, 270), Point(117.0779998, -3.71178012, 270), Point(187.0779998, 0.8499762026, 270), Point(257.0779998, -3.71178012, 270), Point(327.0779998, -18.17696976, 270), Point(397.0779998, -45.75939536, 270), Point(467.0779998, -99.22322211, 270)], {7}: [Point(492.5325453, -177.8772965, 315), Point(432.0779998, -276.4064393, 315), Point(362.0779998, -313.0986425, 315), Point(292.0779998, -332.8053207, 315), Point(222.0779998, -341.772485, 315), Point(152.0779998, -341.772485, 315), Point(82.07799982, -332.8053207, 315), Point(12.07799982, -313.0986425, 315), Point(-57.92200018, -276.4064393, 315), Point(-118.3765456, -177.8772965, 315), Point(-57.92200018, -79.34815373, 315), Point(12.07799982, -42.65595059, 315), Point(82.07799982, -22.94927235, 315), Point(152.0779998, -13.98210803, 315), Point(222.0779998, -13.98210803, 315), Point(292.0779998, -22.94927235, 315), Point(362.0779998, -42.65595059, 315), Point(432.0779998, -79.34815373, 315)], {8}: [Point(467.0779998, -252.8772965, 360), Point(397.0779998, -285.5653136, 360), Point(327.0779998, -311.522359, 360), Point(257.0779998, -324.9132749, 360), Point(187.0779998, -329.1136602, 360), Point(117.0779998, -324.9132749, 360), Point(47.07799982, -311.522359, 360), Point(-22.92200018, -285.5653136, 360), Point(-92.92200018, -252.8772965, 360), Point(-92.92200018, -102.8772965, 360), Point(-22.92200018, -70.18927949, 360), Point(47.07799982, -44.23223406, 360), Point(117.0779998, -30.84131812, 360), Point(187.0779998, -26.64093289, 360), Point(257.0779998, -30.84131812, 360), Point(327.0779998, -44.23223406, 360), Point(397.0779998, -70.18927949, 360), Point(467.0779998, -102.8772965, 360)], {9}: [Point(479.8052725, -177.8772965, 405), Point(432.0779998, -253.1218619, 405), Point(362.0779998, -288.0935605, 405), Point(292.0779998, -306.2188136, 405), Point(222.0779998, -314.3818938, 405), Point(152.0779998, -314.3818938, 405), Point(82.07799982, -306.2188136, 405), Point(12.07799982, -288.0935605, 405), Point(-57.92200018, -253.1218619, 405), Point(-105.6492729, -177.8772965, 405), Point(-57.92200018, -102.6327311, 405), Point(12.07799982, -67.66103254, 405), Point(82.07799982, -49.53577948, 405), Point(152.0779998, -41.37269926, 405), Point(222.0779998, -41.37269926, 405), Point(292.0779998, -49.53577948, 405), Point(362.0779998, -67.66103254, 405), Point(432.0779998, -102.6327311, 405)], {10}: [Point(467.0779998, -177.8772965, 450), Point(397.0779998, -262.0080282, 450), Point(327.0779998, -285.8261567, 450), Point(257.0779998, -297.8687222, 450), Point(187.0779998, -301.6227511, 450), Point(117.0779998, -297.8687222, 450), Point(47.07799982, -285.8261567, 450), Point(-22.92200018, -262.0080282, 450), Point(-92.92200018, -177.8772965, 450), Point(-22.92200018, -93.74656487, 450), Point(47.07799982, -69.92843639, 450), Point(117.0779998, -57.88587082, 450), Point(187.0779998, -54.13184198, 450), Point(257.0779998, -57.88587082, 450), Point(327.0779998, -69.92843639, 450), Point(397.0779998, -93.74656487, 450)]))

# ----
# Load classes from src
button = Button()
add_paths_from_local_dir = GhPythonScript(reload=button)  # -> dire
# ---------- add_paths_from_local_dir: Python ----------
import os
import sys

#get current file path
path = ghenv.Component.OnPingDocument().FilePath
#get parent directory of the parent directory
parentdir = os.path.dirname(os.path.dirname(path))
#go to root folder
root = os.path.dirname(parentdir)
#get src folder which contains classes
dire = os.path.join(root,'src')

print dire
#add path to sys
sys.path.append(dire)

ghenv.Component.Message = "paths added"

from compas_rhino import unload_modules

if reload:
    unload_modules("design")
    unload_modules("planning")
    
    unload_modules("ur_fabrication")
    
    ghenv.Component.Message = "paths updated"
# ---------- end add_paths_from_local_dir ----------
panel = Panel(add_paths_from_local_dir)

# ----
# points
panel_2 = Panel("Demo")
pt = Point(Tree({0}: [Point(67.93239169, -6.496640882, 5), Point(60.48905836, -17.1119841, 5), Point(51.9335028, -22.63702719, 5), Point(43.37794725, -25.66797616, 5), Point(34.82239169, -27.05642253, 5), Point(26.26683613, -27.05642253, 5)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], {1}: [Point(64.29689963, -11.86400841, 7.5), Point(56.08977989, -19.68993974, 7.5), Point(47.56860795, -23.91135401, 7.5), Point(39.05936395, -26.11554815, 7.5), Point(30.54461391, -26.81063042, 7.5), Point(22.02986388, -26.11554815, 7.5)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], {2}: [Point(66.13833437, -6.676441993, 10), Point(58.13664527, -17.46365157, 10), Point(48.93930149, -22.8652872, 10), Point(39.7419577, -25.56416825, 10), Point(30.54461391, -26.40255944, 10), Point(21.34727013, -25.56416825, 10)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], {3}: [Point(62.30205366, -12.19084301, 12.5), Point(53.46066841, -20.03523067, 12.5), Point(44.28458955, -24.02733668, 12.5), Point(35.12522422, -25.78891905, 12.5), Point(25.9640036, -25.78891905, 12.5), Point(16.80463828, -24.02733668, 12.5)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], {4}: [Point(64.53575206, -6.474844785, 15), Point(56.89433341, -16.93633127, 15), Point(48.11109358, -22.17486286, 15), Point(39.32785374, -24.79225038, 15), Point(30.54461391, -25.60532609, 15), Point(21.76137408, -24.79225038, 15)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], {5}: [Point(60.86796816, -11.81600565, 17.5), Point(52.42553228, -19.42861187, 17.5), Point(43.66418166, -23.30158924, 17.5), Point(34.91847393, -25.01061185, 17.5), Point(26.17075389, -25.01061185, 17.5), Point(17.42504616, -23.30158924, 17.5)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]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))
python = GhPythonScript(pts=point, prototype_name="straightWall", extra_text=panel_2)  # -> out, flatten(points), global_design; inputs pts: tree of Point3d
# ---------- python: Python ----------
from ghpythonlib.treehelpers import list_to_tree as _tree
from design import GlobalDesign


prototype_identifier = prototype_name + "_" +  extra_text

global_design = GlobalDesign.design_from_point(pts, prototype_identifier)

#generate uid
global_design.generate_uid_for_all_parts()
points = global_design.visualize()

#Convert to tree to visualize
points = _tree(points)
# ---------- end python ----------
pt_2 = Point(python.points)

# ----
# curves
number_slider = Slider(50, range=40..2000)
number_slider_2 = Slider(3.5, range=0..100)
crv = Curve([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])
generate_design_from_crv = GhPythonScript(
    input_crv=crv,
    h_spacing=Slider(7.5, range=0..100),
    height=number_slider,
    prototype_name="straightWall",
    extra_text="Demo")  # -> points, global_design; inputs input_crv: list of Curve
# ---------- generate_design_from_crv: Python ----------
from design import GlobalDesign
from ghpythonlib.treehelpers import list_to_tree as _tree


prototype_identifier = prototype_name + "_" +  extra_text

global_design= GlobalDesign.design_from_multiple_curve(input_crv, h_spacing, prototype_identifier)

#generate uid
global_design.generate_uid_for_all_parts()
points = global_design.visualize()

#Convert to tree to visualize
points = _tree(points)
# ---------- end generate_design_from_crv ----------

# ----
# single_curve
number_slider_3 = Slider(50, range=40..2000)
crv_2 = Curve(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)
generate_design_from_crv_2 = GhPythonScript(
    input_crv=crv_2,
    h_spacing=Slider(7.5, range=0..100),
    v_spacing=Slider(3.5, range=0..100),
    height=number_slider_3,
    prototype_name="straightWall",
    extra_text="Demo")  # -> points, global_design; inputs input_crv: Curve
# ---------- generate_design_from_crv_2: Python ----------
from design import GlobalDesign
from ghpythonlib.treehelpers import list_to_tree as _tree


prototype_identifier = prototype_name + "_" +  extra_text

global_design= GlobalDesign.design_from_single_curve(input_crv, h_spacing, height, v_spacing, prototype_identifier)

#generate uid
global_design.generate_uid_for_all_parts()
points = global_design.visualize()

#Convert to tree to visualize
points = _tree(points)
# ---------- end generate_design_from_crv_2 ----------

# ----
# brep
panel_3 = Panel("straightWall")
unit_length = Slider(15, range=0..100)
brep = Brep(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)
python_2 = GhPythonScript(
    column=brep,
    Layer_height=Slider(6.25, range=0..10),
    Unit_width=Slider(7, range=0..10),
    Unit_length=unit_length,
    SeamRotate=Slider(0.01, range=0.01..0.1),
    prototype_name=panel_3,
    extra_text="Demo")  # -> out, Pt_tree, flatten(points), global_design; inputs column: Brep
# ---------- python_2: Python ----------
from ghpythonlib.treehelpers import list_to_tree as _tree
from design import GlobalDesign


prototype_identifier = prototype_name + "_" +  extra_text
global_design, all_shots = GlobalDesign.design_from_brep(column, Layer_height, Unit_width, SeamRotate, prototype_identifier)

#generate uid
global_design.generate_uid_for_all_parts()
points = global_design.visualize()

#Convert to tree to visualize
points = _tree(points)
# ---------- end python_2 ----------
flatten = FlattenTree(Tree=python_2.Pt_tree, Path="{0}")
pt_3 = Point(python_2.points)

list = ValueList({"single_curve": 0, "points": 1, "brep": 2, "curves": 3}, selected="points")
filter = StreamFilter(
    Gate=list,
    Stream0=generate_design_from_crv_2.global_design,
    Stream1=python.global_design,
    Stream2=python_2.global_design,
    Stream3=generate_design_from_crv.global_design)
plan_sequence = GhPythonScript(design=filter, toolpath_volume=Slider(900, range=0..1000), n=Slider(0, range=0..15))  # -> sequencer, points, tool_curve, data; inputs toolpath_volume: Int32, n: Int32
# ---------- plan_sequence: Python ----------
from planning import ConstructionSequencer


sequencer = ConstructionSequencer(design, toolpath_volume)
sequencer.generate_toolpaths_continuous()

toolpath = sequencer.toolpaths[n]
toolpath.add_safety_points(setup = "UR")


points, tool_curve = toolpath.visualize_pts()
data = [toolpath.export_toolpath_to_UR(wait_time = 1.2)]
# ---------- end plan_sequence ----------
parse_data = GhPythonScript(data=plan_sequence.data)  # -> planes, toggles, wait_times
# ---------- parse_data: Python ----------
planes = data['planes']
toggles = data['toggles']
wait_times = data['wait times']
# ---------- end parse_data ----------
number_slider_4 = Slider(405, range=0..597)
send_to_robot = GhPythonScript(
    planes=flatten(parse_data.planes),
    toggles=flatten(parse_data.toggles),
    waits=flatten(parse_data.wait_times),
    lift_height=Slider(18, range=0..100),
    send=Button())  # -> ur10, robot_simulationPlane, robot_planes, script; inputs planes: list of Plane, toggles: list of Boolean, waits: list
# ---------- send_to_robot: Python ----------
import os
import sys
import Rhino.Geometry as rg

from math import radians

from ur_fabrication import UR

ur10 = UR(planes,toggles,waits, ip = "192.168.10.20")

ur10.tcp(-86.62,-28.48,147.92,0.0,180.0, 0.0)

origin = rg.Point3d(-293.81, -673.70, 11.50) #Origin
xaxis = rg.Point3d(247.93, -677.69, 10.70) #XAxis Point
yaxis = rg.Point3d(62.22, -430.51, 7.78) #Point on +XY Plane
ur10.set_base_plane(origin, xaxis, yaxis)

ur10.prepare_script()

robot_simulationPlane = ur10.simulationPlane
robot_planes = ur10.robot_frames
script = ur10.script
if send:
   ur10.trigger()
# ---------- end send_to_robot ----------
split = SplitList(List=send_to_robot.robot_simulationPlane, Index=Slider(2700, range=0..2700))  # -> ListA, ListB
pline = PolyLine(Vertices=split.ListA, Closed=False)
panel_4 = Panel(send_to_robot.script)
panel_5 = Panel(send_to_robot.robot_simulationPlane)
