# Grasshopper definition 20230111_print_execute_G3.gh (Grasshopper 1.0.7)
# plug-ins: treesloth01

number_slider = Slider(50, range=40..2000)  # disabled
number_slider_2 = Slider(7.5, range=0..100)  # disabled
number_slider_3 = Slider(3.5, range=0..100)  # disabled
panel = Panel("straightWall")  # disabled

# ----
# Load classes from src
button = Button()
add_paths_from_local_dir = GhPythonScript(reload=button)  # -> dire
# ---------- add_paths_from_local_dir: Python ----------
import os
import sys

#get current file path
path = ghenv.Component.OnPingDocument().FilePath
#get parent directory of the parent directory
parentdir = os.path.dirname(os.path.dirname(path))
#go to root folder
root = os.path.dirname(parentdir)
#get src folder which contains classes
dire = os.path.join(root,'src')

print dire
#add path to sys
sys.path.append(dire)

ghenv.Component.Message = "paths added"

from compas_rhino import unload_modules

if reload:
    unload_modules("design")
    unload_modules("planning")
    
    unload_modules("ur_fabrication")
    
    ghenv.Component.Message = "paths updated"
# ---------- end add_paths_from_local_dir ----------
panel_2 = Panel(add_paths_from_local_dir)

panel_3 = Panel("Demo")  # disabled
crv = Curve(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)  # disabled
generate_design_from_crv = GhPythonScript(
    input_crv=crv,
    h_spacing=number_slider_2,
    v_spacing=number_slider_3,
    height=number_slider,
    prototype_name=panel,
    extra_text=panel_3)  # -> points, global_design; inputs input_crv: Curve; disabled
# ---------- generate_design_from_crv: Python ----------
from design import GlobalDesign
from ghpythonlib.treehelpers import list_to_tree as _tree


prototype_identifier = prototype_name + "_" +  extra_text

global_design= GlobalDesign.design_from_curve(input_crv, h_spacing, height, v_spacing, prototype_identifier)

#generate uid
global_design.generate_uid_for_all_parts()
points = global_design.visualize()

#Convert to tree to visualize
points = _tree(points)
# ---------- end generate_design_from_crv ----------
unpack = UnpackData(Load=Toggle(True), Directory="D:\MAS\06_Impact_Printing", Filename="pts", WatchForChanges=False)  # -> OutputInformation, Data
panel_4 = Panel(unpack.OutputInformation)

# ----
# Single Unit
dom = ConstructDomain(DomainStart=0, DomainEnd=1)
unit_length = Slider(15, range=0..100)
brep = Brep(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)
python = GhPythonScript(
    pts=unpack.Data,
    column=brep,
    Layer_height=Slider(6.25, range=0..10),
    Unit_width=Slider(7, range=0..10),
    Unit_length=unit_length,
    Unit_Interval=dom,
    SeamRotate=Slider(0.02, range=0.01..0.1),
    prototype_name="straightWall",
    extra_text="Demo")  # -> out, Pt_tree, flatten(points), global_design; inputs pts: tree of Point3d, column: Brep
# ---------- python: Python ----------
from ghpythonlib.treehelpers import list_to_tree as _tree
from design import GlobalDesign


prototype_identifier = prototype_name + "_" +  extra_text
#global_design, all_shots = GlobalDesign.design_from_curve2(column, Layer_height, Unit_width, SeamRotate, prototype_identifier)
global_design = GlobalDesign.design_from_curve3(pts, Layer_height, Unit_width, SeamRotate, prototype_identifier)

#generate uid
global_design.generate_uid_for_all_parts()
points = global_design.visualize()

#Convert to tree to visualize
points = _tree(points)
# ---------- end python ----------
python_2 = GhPythonScript(x=python.global_design)  # -> out, a
# ---------- python_2: Python ----------
a = x
# ---------- end python_2 ----------
flatten = FlattenTree(Tree=python.Pt_tree, Path="{0}")
pt = Point(python.points)
plan_sequence = GhPythonScript(design=python.global_design, toolpath_volume=Slider(900, range=0..1000), n=Slider(0, range=0..15))  # -> sequencer, points, tool_curve, data; inputs toolpath_volume: Int32, n: Int32
# ---------- plan_sequence: Python ----------
from planning import ConstructionSequencer


sequencer = ConstructionSequencer(design, toolpath_volume)
sequencer.generate_toolpaths_continuous()

toolpath = sequencer.toolpaths[n]
toolpath.add_safety_points(setup = "UR")


points, tool_curve = toolpath.visualize_pts()
data = [toolpath.export_toolpath_to_UR(wait_time = 1.2)]
# ---------- end plan_sequence ----------
parse_data = GhPythonScript(data=plan_sequence.data)  # -> planes, toggles, wait_times
# ---------- parse_data: Python ----------
planes = data['planes']
toggles = data['toggles']
wait_times = data['wait times']
# ---------- end parse_data ----------
send_to_robot = GhPythonScript(
    planes=flatten(parse_data.planes),
    toggles=flatten(parse_data.toggles),
    waits=flatten(parse_data.wait_times),
    lift_height=Slider(18, range=0..100),
    send=Button())  # -> ur10, robot_simulationPlane, robot_planes, script; inputs planes: list of Plane, toggles: list of Boolean, waits: list
# ---------- send_to_robot: Python ----------
import os
import sys
import Rhino.Geometry as rg

from math import radians

from ur_fabrication import UR

ur10 = UR(planes,toggles,waits, ip = "192.168.10.20")

ur10.tcp(-86.62,-28.48,147.92,0.0,180.0, 0.0)

origin = rg.Point3d(-293.81, -673.70, 11.50) #Origin
xaxis = rg.Point3d(247.93, -677.69, 10.70) #XAxis Point
yaxis = rg.Point3d(62.22, -430.51, 7.78) #Point on +XY Plane
ur10.set_base_plane(origin, xaxis, yaxis)

ur10.prepare_script()

robot_simulationPlane = ur10.simulationPlane
robot_planes = ur10.robot_frames
script = ur10.script
if send:
   ur10.trigger()
# ---------- end send_to_robot ----------

brep_2 = Brep(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)
volume = Volume(Geometry=brep_2)  # -> Volume, Centroid
rot3d = Rotate3D(Geometry=brep_2, Angle=1.570796327, Center=volume.Centroid, Axis=Vector(0, 0, 1))  # -> Geometry, Transform
move = Move(Geometry=rot3d.Geometry, Motion=python.Pt_tree)  # -> Geometry, Transform
preview = CustomPreview(Geometry=move.Geometry, Material=ColourSwatch(SwatchColor=RGBA(186, 166, 132, 110)))
viewer = ParamViewer(python.Pt_tree)

python_3 = GhPythonScript(pts=unpack.Data)  # -> out, a; inputs pts: tree of Point3d
# ---------- python_3: Python ----------
import Rhino.Geometry as rg
import ghpythonlib.treehelpers as th

a = pts.Branches[0]
# ---------- end python_3 ----------
number_slider_4 = Slider(405, range=0..597)
split = SplitList(List=send_to_robot.robot_simulationPlane, Index=Slider(2700, range=0..2700))  # -> ListA, ListB
pline = PolyLine(Vertices=split.ListA, Closed=False)
panel_5 = Panel(send_to_robot.script)
panel_6 = Panel(send_to_robot.robot_simulationPlane)
