# Grasshopper definition 20230309 5 columns test.gh (Grasshopper 1.0.7)
# plug-ins: Pufferfish

point = Point(simplify(Tree({0}: [Point(47.49299841, -88.93049697, 0), Point(42.25870945, -78.97088536, 0), Point(35.97850425, -72.34567056, 0), Point(29.3465669, -67.5457629, 0), Point(22.54874346, -63.96674461, 0), Point(15.65902515, -61.31463395, 0)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], {1}: [Point(846.3413034, -97.54357692, 4.5), Point(844.4748744, -107.4784881, 4.5), Point(838.9789256, -116.7683477, 4.5), Point(832.606322, -122.9752112, 4.5), Point(825.9259567, -127.4561503, 4.5), Point(819.0976828, -130.7582899, 4.5)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], {2}: [Point(41.41449311, -86.26616047, 9), Point(35.68131067, -77.65981575, 9), Point(29.22170591, -71.88065028, 9), Point(22.49499909, -67.73024224, 9), Point(15.63757033, -64.71827318, 9), Point(8.707594126, -62.60190488, 9)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], {3}: [Point(841.5671973, -97.54357692, 13.5), Point(838.3116539, -110.1477442, 13.5), Point(832.3686469, -118.073613, 13.5), Point(825.8283647, -123.4199056, 13.5), Point(819.0579036, -127.2296476, 13.5), Point(812.1729699, -129.9382129, 13.5)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], {4}: [Point(39.29592774, -97.54357692, 18), Point(35.16169288, -83.64481047, 18), Point(29.03508631, -76.3891924, 18), Point(22.42049877, -71.48058451, 18), Point(15.60904366, -68.02262173, 18), Point(8.698474498, -65.63255887, 18)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], {5}: [Point(836.7364898, -105.0435769, 22.5), Point(831.9705044, -112.6765952, 22.5), Point(825.6855798, -119.2812282, 22.5), Point(819.0034217, -123.7498752, 22.5), Point(812.1541066, -126.8454574, 22.5), Point(805.220146, -128.9010255, 22.5)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]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)))
bounding_box = BoundingBox(Content=point, Plane=PlaneXY(0, 0, 0), UnionBox=True)  # -> Box, Box_2
tree_item = TreeItem(Tree=bounding_box.Box, Path=Slider(0, range=0..100), Index=0, Wrap=True)
point_2 = Point(Tree({0}: [Point(211.6479998, -177.8772965, 0), Point(207.7858583, -169.3251374, 0), Point(201.2543217, -164.8989725, 0), Point(194.1975039, -162.6690078, 0), Point(187.0779998, -161.9872965, 0), Point(179.9584957, -162.6690078, 0)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], {1}: [Point(211.6479998, -177.8772965, 9), Point(207.7858583, -169.3251374, 9), Point(201.2543217, -164.8989725, 9), Point(194.1975039, -162.6690078, 9), Point(187.0779998, -161.9872965, 9), Point(179.9584957, -162.6690078, 9)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], {2}: [Point(211.6479998, -177.8772965, 18), Point(207.7858583, -169.3251374, 18), Point(201.2543217, -164.8989725, 18), Point(194.1975039, -162.6690078, 18), Point(187.0779998, -161.9872965, 18), Point(179.9584957, -162.6690078, 18)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], {3}: [Point(211.6479998, -177.8772965, 27), Point(207.7858583, -169.3251374, 27), Point(201.2543217, -164.8989725, 27), Point(194.1975039, -162.6690078, 27), Point(187.0779998, -161.9872965, 27), Point(179.9584957, -162.6690078, 27)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], {4}: [Point(211.6479998, -177.8772965, 36), Point(207.7858583, -169.3251374, 36), Point(201.2543217, -164.8989725, 36), Point(194.1975039, -162.6690078, 36), Point(187.0779998, -161.9872965, 36), Point(179.9584957, -162.6690078, 36)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], {5}: [Point(211.6479998, -177.8772965, 45), Point(207.7858583, -169.3251374, 45), Point(201.2543217, -164.8989725, 45), Point(194.1975039, -162.6690078, 45), Point(187.0779998, -161.9872965, 45), Point(179.9584957, -162.6690078, 45)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]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))
deconstruct_brep = DeconstructBrep(Brep=tree_item)  # -> Faces, Edges, Vertices
list_item = ListItem(List=deconstruct_brep.Faces, Index=Slider(4, range=0..5), Wrap=True)
area = Area(Geometry=list_item)  # -> Area, Centroid
point_3 = Point(Point(0, 0, 0))
move_to_point = MoveToPoint(Geometry=point, PointA=area.Centroid, PointB=point_3)  # -> Moved, Vector, Transform
# 2nd pts
point_4 = Point(Tree({0}: [Point(432.7779998, -177.8772965, 0), Point(394.1565845, -92.35570543, 0), Point(328.8412182, -48.09405595, 0), Point(258.2730406, -25.79440927, 0), Point(187.0779998, -18.97729652, 0), Point(115.882959, -25.79440927, 0)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], {1}: [Point(432.7779998, -177.8772965, 90), Point(394.1565845, -92.35570543, 90), Point(328.8412182, -48.09405595, 90), Point(258.2730406, -25.79440927, 90), Point(187.0779998, -18.97729652, 90), Point(115.882959, -25.79440927, 90)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], {2}: [Point(432.7779998, -177.8772965, 180), Point(394.1565845, -92.35570543, 180), Point(328.8412182, -48.09405595, 180), Point(258.2730406, -25.79440927, 180), Point(187.0779998, -18.97729652, 180), Point(115.882959, -25.79440927, 180)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], {3}: [Point(432.7779998, -177.8772965, 270), Point(394.1565845, -92.35570543, 270), Point(328.8412182, -48.09405595, 270), Point(258.2730406, -25.79440927, 270), Point(187.0779998, -18.97729652, 270), Point(115.882959, -25.79440927, 270)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], {4}: [Point(432.7779998, -177.8772965, 360), Point(394.1565845, -92.35570543, 360), Point(328.8412182, -48.09405595, 360), Point(258.2730406, -25.79440927, 360), Point(187.0779998, -18.97729652, 360), Point(115.882959, -25.79440927, 360)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], {5}: [Point(432.7779998, -177.8772965, 450), Point(394.1565845, -92.35570543, 450), Point(328.8412182, -48.09405595, 450), Point(258.2730406, -25.79440927, 450), Point(187.0779998, -18.97729652, 450), Point(115.882959, -25.79440927, 450)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]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))
# 1st pts
pt = Point(Tree({0;0}: [Point(684.4993247, 0, -157.8214286), Point(617.8652062, 55.42231747, -157.8214286), Point(551.2310878, 137.5067858, -157.8214286), Point(484.5969693, 179.0059471, -157.8214286), Point(84.79225853, 179.0061017, -157.8214286), Point(18.15814007, 137.5066531, -157.8214286)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], {1;0}: [Point(651.1822654, 0, -112.8214286), Point(584.548147, 76.80975926, -112.8214286), Point(517.9140285, 149.033466, -112.8214286), Point(51.4751993, 149.0335394, -112.8214286), Point(-15.15891916, 76.80942763, -112.8214286), Point(-81.79303762, 0, -112.8214286)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], {2;0}: [Point(617.8652062, 0, -67.82142857), Point(551.2310878, 103.7201419, -67.82142857), Point(484.5969693, 158.1685699, -67.82142857), Point(84.79225853, 158.1685886, -67.82142857), Point(18.15814007, 103.7200996, -67.82142857), Point(-48.47597839, 0, -67.82142857)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], {3;0}: [Point(584.548147, 40.19490432, -22.82142857), Point(517.9140285, 123.5148395, -22.82142857), Point(51.4751993, 123.5149456, -22.82142857), Point(-15.15891916, 40.19494988, -22.82142857), Point(-15.15891916, -40.19494988, -22.82142857), Point(51.4751993, -123.5149456, -22.82142857)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], {4;0}: [Point(617.8652062, 0, 22.17857143), Point(551.2310878, 60.00634067, 22.17857143), Point(484.5969693, 136.5471693, 22.17857143), Point(84.79225853, 136.5473605, 22.17857143), Point(18.15814007, 60.00654696, 22.17857143), Point(-48.47597839, 0, 22.17857143)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], {5;0}: [Point(584.548147, 0, 67.17857143), Point(517.9140285, 90.47660308, 67.17857143), Point(451.2799101, 146.7544994, 67.17857143), Point(118.1093178, 146.754389, 67.17857143), Point(51.4751993, 90.47642439, 67.17857143), Point(-15.15891916, 0, 67.17857143)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], {6;0}: [Point(551.2310878, 0, 112.1785714), Point(484.5969693, 113.0056675, 112.1785714), Point(84.79225853, 113.006076, 112.1785714), Point(18.15814007, 0, 112.1785714), Point(84.79225853, -113.006076, 112.1785714), Point(484.5969693, -113.0056675, 112.1785714)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], {7;0}: [Point(584.548147, 0, 157.1785714), Point(517.9140285, 48.49302627, 157.1785714), Point(451.2799101, 127.091163, 157.1785714), Point(118.1093178, 127.0911177, 157.1785714), Point(51.4751993, 48.49306509, 157.1785714), Point(-15.15891916, 0, 157.1785714)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], {8;0}: [Point(551.2310878, 0, 202.1785714), Point(484.5969693, 82.50257775, 202.1785714), Point(84.79225853, 82.50247692, 202.1785714), Point(18.15814007, 0, 202.1785714), Point(84.79225853, -82.50247692, 202.1785714), Point(484.5969693, -82.50257775, 202.1785714)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], {9;0}: [Point(517.9140285, 0, 247.1785714), Point(451.2799101, 106.0209035, 247.1785714), Point(118.1093178, 106.0208703, 247.1785714), Point(51.4751993, 0, 247.1785714), Point(118.1093178, -106.0208703, 247.1785714), Point(451.2799101, -106.0209035, 247.1785714)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]))

# ----
# Load classes from src
button = Button()
add_paths_from_local_dir = GhPythonScript(reload=button)  # -> dire
# ---------- add_paths_from_local_dir: Python ----------
import os
import sys

#get current file path
path = ghenv.Component.OnPingDocument().FilePath
#get parent directory of the parent directory
parentdir = os.path.dirname(os.path.dirname(path))
#go to root folder
root = os.path.dirname(parentdir)
#get src folder which contains classes
dire = os.path.join(root,'src')

print dire
#add path to sys
sys.path.append(dire)

ghenv.Component.Message = "paths added"

from compas_rhino import unload_modules

if reload:
    unload_modules("design")
    unload_modules("planning")
    
    unload_modules("ur_fabrication")
    
    ghenv.Component.Message = "paths updated"
# ---------- end add_paths_from_local_dir ----------
panel = Panel(add_paths_from_local_dir)

# ----
# points
panel_2 = Panel("Demo")
pt_2 = Point(Tree({0}: [Point(67.93239169, -6.496640882, 5), Point(60.48905836, -17.1119841, 5), Point(51.9335028, -22.63702719, 5), Point(43.37794725, -25.66797616, 5), Point(34.82239169, -27.05642253, 5), Point(26.26683613, -27.05642253, 5)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], {1}: [Point(64.29689963, -11.86400841, 7.5), Point(56.08977989, -19.68993974, 7.5), Point(47.56860795, -23.91135401, 7.5), Point(39.05936395, -26.11554815, 7.5), Point(30.54461391, -26.81063042, 7.5), Point(22.02986388, -26.11554815, 7.5)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], {2}: [Point(66.13833437, -6.676441993, 10), Point(58.13664527, -17.46365157, 10), Point(48.93930149, -22.8652872, 10), Point(39.7419577, -25.56416825, 10), Point(30.54461391, -26.40255944, 10), Point(21.34727013, -25.56416825, 10)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], {3}: [Point(62.30205366, -12.19084301, 12.5), Point(53.46066841, -20.03523067, 12.5), Point(44.28458955, -24.02733668, 12.5), Point(35.12522422, -25.78891905, 12.5), Point(25.9640036, -25.78891905, 12.5), Point(16.80463828, -24.02733668, 12.5)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], {4}: [Point(64.53575206, -6.474844785, 15), Point(56.89433341, -16.93633127, 15), Point(48.11109358, -22.17486286, 15), Point(39.32785374, -24.79225038, 15), Point(30.54461391, -25.60532609, 15), Point(21.76137408, -24.79225038, 15)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], {5}: [Point(60.86796816, -11.81600565, 17.5), Point(52.42553228, -19.42861187, 17.5), Point(43.66418166, -23.30158924, 17.5), Point(34.91847393, -25.01061185, 17.5), Point(26.17075389, -25.01061185, 17.5), Point(17.42504616, -23.30158924, 17.5)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]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))
python = GhPythonScript(pts=move_to_point.Moved, prototype_name="straightWall", extra_text=panel_2)  # -> out, flatten(points), global_design; inputs pts: tree of Point3d
# ---------- python: Python ----------
from ghpythonlib.treehelpers import list_to_tree as _tree
from design import GlobalDesign


prototype_identifier = prototype_name + "_" +  extra_text

global_design = GlobalDesign.design_from_point(pts, prototype_identifier)

#generate uid
global_design.generate_uid_for_all_parts()
points = global_design.visualize()

#Convert to tree to visualize
points = _tree(points)
# ---------- end python ----------
pt_3 = Point(python.points)

# ----
# curves
number_slider = Slider(50, range=40..2000)
number_slider_2 = Slider(3.5, range=0..100)
crv = Curve([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])
generate_design_from_crv = GhPythonScript(
    input_crv=crv,
    h_spacing=Slider(7.5, range=0..100),
    height=number_slider,
    prototype_name="straightWall",
    extra_text="Demo")  # -> points, global_design; inputs input_crv: list of Curve
# ---------- generate_design_from_crv: Python ----------
from design import GlobalDesign
from ghpythonlib.treehelpers import list_to_tree as _tree


prototype_identifier = prototype_name + "_" +  extra_text

global_design= GlobalDesign.design_from_multiple_curve(input_crv, h_spacing, prototype_identifier)

#generate uid
global_design.generate_uid_for_all_parts()
points = global_design.visualize()

#Convert to tree to visualize
points = _tree(points)
# ---------- end generate_design_from_crv ----------

# ----
# single_curve
number_slider_3 = Slider(50, range=40..2000)
crv_2 = Curve(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)
generate_design_from_crv_2 = GhPythonScript(
    input_crv=crv_2,
    h_spacing=Slider(7.5, range=0..100),
    v_spacing=Slider(3.5, range=0..100),
    height=number_slider_3,
    prototype_name="straightWall",
    extra_text="Demo")  # -> points, global_design; inputs input_crv: Curve
# ---------- generate_design_from_crv_2: Python ----------
from design import GlobalDesign
from ghpythonlib.treehelpers import list_to_tree as _tree


prototype_identifier = prototype_name + "_" +  extra_text

global_design= GlobalDesign.design_from_single_curve(input_crv, h_spacing, height, v_spacing, prototype_identifier)

#generate uid
global_design.generate_uid_for_all_parts()
points = global_design.visualize()

#Convert to tree to visualize
points = _tree(points)
# ---------- end generate_design_from_crv_2 ----------

# ----
# brep
panel_3 = Panel("straightWall")
unit_length = Slider(15, range=0..100)
brep = Brep(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)
python_2 = GhPythonScript(
    column=brep,
    Layer_height=Slider(6.25, range=0..10),
    Unit_width=Slider(7, range=0..10),
    Unit_length=unit_length,
    SeamRotate=Slider(0.01, range=0.01..0.1),
    prototype_name=panel_3,
    extra_text="Demo")  # -> out, Pt_tree, flatten(points), global_design; inputs column: Brep
# ---------- python_2: Python ----------
from ghpythonlib.treehelpers import list_to_tree as _tree
from design import GlobalDesign


prototype_identifier = prototype_name + "_" +  extra_text
global_design, all_shots = GlobalDesign.design_from_brep(column, Layer_height, Unit_width, SeamRotate, prototype_identifier)

#generate uid
global_design.generate_uid_for_all_parts()
points = global_design.visualize()

#Convert to tree to visualize
points = _tree(points)
# ---------- end python_2 ----------
flatten = FlattenTree(Tree=python_2.Pt_tree, Path="{0}")
pt_4 = Point(python_2.points)

list = ValueList({"single_curve": 0, "points": 1, "brep": 2, "curves": 3}, selected="points")
filter = StreamFilter(
    Gate=list,
    Stream0=generate_design_from_crv_2.global_design,
    Stream1=python.global_design,
    Stream2=python_2.global_design,
    Stream3=generate_design_from_crv.global_design)
plan_sequence = GhPythonScript(design=filter, toolpath_volume=Slider(258, range=0..1000), n=Slider(0, range=0..15))  # -> sequencer, points, tool_curve, data; inputs toolpath_volume: Int32, n: Int32
# ---------- plan_sequence: Python ----------
from planning import ConstructionSequencer


sequencer = ConstructionSequencer(design, toolpath_volume)
sequencer.generate_toolpaths_continuous()

toolpath = sequencer.toolpaths[n]
toolpath.add_safety_points(setup = "UR")


points, tool_curve = toolpath.visualize_pts()
data = [toolpath.export_toolpath_to_UR(wait_time = 1.2)]
# ---------- end plan_sequence ----------
parse_data = GhPythonScript(data=plan_sequence.data)  # -> planes, toggles, wait_times
# ---------- parse_data: Python ----------
planes = data['planes']
toggles = data['toggles']
wait_times = data['wait times']
# ---------- end parse_data ----------
list_length = ListLength(List=parse_data.planes)
repeat_data = RepeatData(Data=Slider(1, range=0.7..1.2), Length=list_length)
number_slider_4 = Slider(405, range=0..597)
send_to_robot = GhPythonScript(
    planes=flatten(parse_data.planes),
    toggles=flatten(parse_data.toggles),
    waits=flatten(repeat_data),
    lift_height=Slider(18, range=0..100),
    send=Button())  # -> ur10, robot_simulationPlane, robot_planes, script; inputs planes: list of Plane, toggles: list of Boolean, waits: list
# ---------- send_to_robot: Python ----------
import os
import sys
import Rhino.Geometry as rg

from math import radians

from ur_fabrication import UR

ur10 = UR(planes,toggles,waits, ip = "192.168.10.20")

ur10.tcp(-86.62,-28.48,147.92,0.0,180.0, 0.0)

origin = rg.Point3d(-293.81, -673.70, 11.50) #Origin
xaxis = rg.Point3d(247.93, -677.69, 10.70) #XAxis Point
yaxis = rg.Point3d(62.22, -430.51, 7.78) #Point on +XY Plane
ur10.set_base_plane(origin, xaxis, yaxis)

ur10.prepare_script()

robot_simulationPlane = ur10.simulationPlane
robot_planes = ur10.robot_frames
script = ur10.script
if send:
   ur10.trigger()
# ---------- end send_to_robot ----------
geometry = Geometry(send_to_robot.robot_simulationPlane)
split = SplitList(List=send_to_robot.robot_simulationPlane, Index=Slider(2700, range=0..2700))  # -> ListA, ListB
list_item_2 = ListItem(List=geometry, Index=Slider(41, range=0..1387), Wrap=True)
pline = PolyLine(Vertices=split.ListA, Closed=False)
panel_4 = Panel(send_to_robot.script)
panel_5 = Panel(send_to_robot.robot_simulationPlane)
