# Grasshopper definition print_execute_different_way.ghx (Grasshopper 1.0.7)

# ----
# Load classes from src
button = Button()
add_paths_from_local_dir = GhPythonScript(reload=button)  # -> dire
# ---------- add_paths_from_local_dir: Python ----------
import os
import sys

#get current file path
path = ghenv.Component.OnPingDocument().FilePath
#get parent directory of the parent directory
parentdir = os.path.dirname(os.path.dirname(path))
#go to root folder
root = os.path.dirname(parentdir)
#get src folder which contains classes
dire = os.path.join(root,'src')

print dire
#add path to sys
sys.path.append(dire)

ghenv.Component.Message = "paths added"

from compas_rhino import unload_modules

if reload:
    unload_modules("design")
    unload_modules("planning")
    
    unload_modules("ur_fabrication")
    
    ghenv.Component.Message = "paths updated"
# ---------- end add_paths_from_local_dir ----------
panel = Panel(add_paths_from_local_dir)

# ----
# points
panel_2 = Panel("Demo")
pt = Point(Tree({0}: [Point(67.93239169, -6.496640882, 5), Point(60.48905836, -17.1119841, 5), Point(51.9335028, -22.63702719, 5), Point(43.37794725, -25.66797616, 5), Point(34.82239169, -27.05642253, 5), Point(26.26683613, -27.05642253, 5)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], {1}: [Point(64.29689963, -11.86400841, 7.5), Point(56.08977989, -19.68993974, 7.5), Point(47.56860795, -23.91135401, 7.5), Point(39.05936395, -26.11554815, 7.5), Point(30.54461391, -26.81063042, 7.5), Point(22.02986388, -26.11554815, 7.5)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], {2}: [Point(66.13833437, -6.676441993, 10), Point(58.13664527, -17.46365157, 10), Point(48.93930149, -22.8652872, 10), Point(39.7419577, -25.56416825, 10), Point(30.54461391, -26.40255944, 10), Point(21.34727013, -25.56416825, 10)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], {3}: [Point(62.30205366, -12.19084301, 12.5), Point(53.46066841, -20.03523067, 12.5), Point(44.28458955, -24.02733668, 12.5), Point(35.12522422, -25.78891905, 12.5), Point(25.9640036, -25.78891905, 12.5), Point(16.80463828, -24.02733668, 12.5)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], {4}: [Point(64.53575206, -6.474844785, 15), Point(56.89433341, -16.93633127, 15), Point(48.11109358, -22.17486286, 15), Point(39.32785374, -24.79225038, 15), Point(30.54461391, -25.60532609, 15), Point(21.76137408, -24.79225038, 15)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], {5}: [Point(60.86796816, -11.81600565, 17.5), Point(52.42553228, -19.42861187, 17.5), Point(43.66418166, -23.30158924, 17.5), Point(34.91847393, -25.01061185, 17.5), Point(26.17075389, -25.01061185, 17.5), Point(17.42504616, -23.30158924, 17.5)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]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))
python = GhPythonScript(pts=pt, prototype_name="straightWall", extra_text=panel_2)  # -> out, flatten(points), global_design; inputs pts: tree of Point3d
# ---------- python: Python ----------
from ghpythonlib.treehelpers import list_to_tree as _tree
from design import GlobalDesign


prototype_identifier = prototype_name + "_" +  extra_text

global_design = GlobalDesign.design_from_point(pts, prototype_identifier)

#generate uid
global_design.generate_uid_for_all_parts()
points = global_design.visualize()

#Convert to tree to visualize
points = _tree(points)
# ---------- end python ----------
pt_2 = Point(python.points)

# ----
# curves
number_slider = Slider(50, range=40..2000)
number_slider_2 = Slider(3.5, range=0..100)
crv = Curve([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])
generate_design_from_crv = GhPythonScript(
    input_crv=crv,
    h_spacing=Slider(7.5, range=0..100),
    height=number_slider,
    prototype_name="straightWall",
    extra_text="Demo")  # -> points, global_design; inputs input_crv: list of Curve
# ---------- generate_design_from_crv: Python ----------
from design import GlobalDesign
from ghpythonlib.treehelpers import list_to_tree as _tree


prototype_identifier = prototype_name + "_" +  extra_text

global_design= GlobalDesign.design_from_multiple_curve(input_crv, h_spacing, prototype_identifier)

#generate uid
global_design.generate_uid_for_all_parts()
points = global_design.visualize()

#Convert to tree to visualize
points = _tree(points)
# ---------- end generate_design_from_crv ----------

# ----
# single_curve
number_slider_3 = Slider(50, range=40..2000)
crv_2 = Curve(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)
generate_design_from_crv_2 = GhPythonScript(
    input_crv=crv_2,
    h_spacing=Slider(7.5, range=0..100),
    v_spacing=Slider(3.5, range=0..100),
    height=number_slider_3,
    prototype_name="straightWall",
    extra_text="Demo")  # -> points, global_design; inputs input_crv: Curve
# ---------- generate_design_from_crv_2: Python ----------
from design import GlobalDesign
from ghpythonlib.treehelpers import list_to_tree as _tree


prototype_identifier = prototype_name + "_" +  extra_text

global_design= GlobalDesign.design_from_single_curve(input_crv, h_spacing, height, v_spacing, prototype_identifier)

#generate uid
global_design.generate_uid_for_all_parts()
points = global_design.visualize()

#Convert to tree to visualize
points = _tree(points)
# ---------- end generate_design_from_crv_2 ----------

# ----
# brep
panel_3 = Panel("straightWall")
unit_length = Slider(15, range=0..100)
brep = Brep(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)
python_2 = GhPythonScript(
    column=brep,
    Layer_height=Slider(6.25, range=0..10),
    Unit_width=Slider(7, range=0..10),
    Unit_length=unit_length,
    SeamRotate=Slider(0.01, range=0.01..0.1),
    prototype_name=panel_3,
    extra_text="Demo")  # -> out, Pt_tree, flatten(points), global_design; inputs column: Brep
# ---------- python_2: Python ----------
from ghpythonlib.treehelpers import list_to_tree as _tree
from design import GlobalDesign


prototype_identifier = prototype_name + "_" +  extra_text
global_design, all_shots = GlobalDesign.design_from_brep(column, Layer_height, Unit_width, SeamRotate, prototype_identifier)

#generate uid
global_design.generate_uid_for_all_parts()
points = global_design.visualize()

#Convert to tree to visualize
points = _tree(points)
# ---------- end python_2 ----------
flatten = FlattenTree(Tree=python_2.Pt_tree, Path="{0}")
pt_3 = Point(python_2.points)

list = ValueList({"single_curve": 0, "points": 1, "brep": 2, "curves": 3}, selected="curves")
filter = StreamFilter(
    Gate=list,
    Stream0=generate_design_from_crv_2.global_design,
    Stream1=python.global_design,
    Stream2=python_2.global_design,
    Stream3=generate_design_from_crv.global_design)
plan_sequence = GhPythonScript(design=filter, toolpath_volume=Slider(900, range=0..1000), n=Slider(0, range=0..15))  # -> sequencer, points, tool_curve, data; inputs toolpath_volume: Int32, n: Int32
# ---------- plan_sequence: Python ----------
from planning import ConstructionSequencer


sequencer = ConstructionSequencer(design, toolpath_volume)
sequencer.generate_toolpaths_continuous()

toolpath = sequencer.toolpaths[n]
toolpath.add_safety_points(setup = "UR")


points, tool_curve = toolpath.visualize_pts()
data = [toolpath.export_toolpath_to_UR(wait_time = 1.2)]
# ---------- end plan_sequence ----------
parse_data = GhPythonScript(data=plan_sequence.data)  # -> planes, toggles, wait_times
# ---------- parse_data: Python ----------
planes = data['planes']
toggles = data['toggles']
wait_times = data['wait times']
# ---------- end parse_data ----------
number_slider_4 = Slider(405, range=0..597)
send_to_robot = GhPythonScript(
    planes=flatten(parse_data.planes),
    toggles=flatten(parse_data.toggles),
    waits=flatten(parse_data.wait_times),
    lift_height=Slider(18, range=0..100),
    send=Button())  # -> ur10, robot_simulationPlane, robot_planes, script; inputs planes: list of Plane, toggles: list of Boolean, waits: list
# ---------- send_to_robot: Python ----------
import os
import sys
import Rhino.Geometry as rg

from math import radians

from ur_fabrication import UR

ur10 = UR(planes,toggles,waits, ip = "192.168.10.20")

ur10.tcp(-86.62,-28.48,147.92,0.0,180.0, 0.0)

origin = rg.Point3d(-293.81, -673.70, 11.50) #Origin
xaxis = rg.Point3d(247.93, -677.69, 10.70) #XAxis Point
yaxis = rg.Point3d(62.22, -430.51, 7.78) #Point on +XY Plane
ur10.set_base_plane(origin, xaxis, yaxis)

ur10.prepare_script()

robot_simulationPlane = ur10.simulationPlane
robot_planes = ur10.robot_frames
script = ur10.script
if send:
   ur10.trigger()
# ---------- end send_to_robot ----------
split = SplitList(List=send_to_robot.robot_simulationPlane, Index=Slider(2700, range=0..2700))  # -> ListA, ListB
pline = PolyLine(Vertices=split.ListA, Closed=False)
panel_4 = Panel(send_to_robot.script)
panel_5 = Panel(send_to_robot.robot_simulationPlane)
